# Grasshopper definition ABxM CrossSectionAgents Karamba3d.gh (Grasshopper 1.0.7)
# plug-ins: Heteroptera, HygroDesign, ABxM.Grasshopper, Karamba3D, Opossum2_0_Proto_A, LunchBox

number_slider = Slider(1, range=0..10)
genes = GenePool(Decimals=2, Maximum=1, Minimum=-1, Value=[-0.01, 0])
neg = Negative(Value=number_slider)
dom = ConstructDomain(DomainStart=neg, DomainEnd=number_slider)
gnc = PoolController(GenePool=genes, Count=Slider(2, range=0..15), Range=dom, Randomness=1)
merge = Merge(Data1="0", Data2=genes)
rev = ReverseList(List=merge)
lng = ListLength(List=rev)  # -> expr("x-1", Length)
dom_2 = ConstructDomain(DomainStart=1, DomainEnd=lng)
subset = SubList(List=rev, Domain=dom_2, Wrap=True)  # -> List, Index
lng_2 = ListLength(List=merge)  # -> expr("(x*2) - 1", Length)
merge_2 = Merge(Data1=flatten(merge), Data2=flatten(subset.List))
series = Series(Start=0, Step=Slider(0.5, range=0..1), Count=lng_2)
c_script = CSharpScript(
    minimumRadius=Slider(0.4, range=0..2),
    Reference=["C:\Users\Alex Reiner\AppData\Roaming\Grasshopper\Libraries\ABxM.Core.dll", "C:\USERS\ALEX REINER\DESKTOP\DQL\HygroDesign.Core.dll"])  # -> out, oBehaviour; inputs minimumRadius: Double
# ---------- c_script: C# usings ----------
using ABxM.Core;
using ABxM.Core.Agent;
using ABxM.Core.Behavior;

using HygroDesign.Core;
# ---------- c_script: C# ----------
    minRad = minimumRadius;
    oBehaviour = radBehaviour;
# ---------- c_script: C# additional code ----------
  static double minRad;
  RadiusBehaviour radBehaviour = new RadiusBehaviour();

  public class RadiusBehaviour : BehaviorBase
  {
    public RadiusBehaviour()
    {
    }

    public override void Execute(AgentBase agent)
    {
      //initialization
      CrossSectionAgent CSAgent = agent as CrossSectionAgent;
      CrossSectionAgentSystem agentSystem = agent.AgentSystem as CrossSectionAgentSystem;
      CrossSection crossSection = agentSystem.CrossSection;

      //check radii to see if this agent still needs to move
      bool smaller = false;
      for(int i = 0; i < crossSection.BoardCurves.Count; i++)
      {
        if(crossSection.BoardCurves[i].ControlPointID != agent.Id) continue;
        if(crossSection.BoardCurves[i].AverageRadius < minRad){ smaller = true; break;}
      }
      if(smaller == false) return;

      //move agent
      Line midLine = new Line(crossSection.NurbsCurve.Points[agent.Id - 1].Location, crossSection.NurbsCurve.Points[agent.Id + 1].Location);
      Point3d targetPoint = midLine.PointAt(0.5);

      Vector3d moveVector = new Vector3d(targetPoint - crossSection.NurbsCurve.Points[agent.Id].Location);
      moveVector *= 0.1;

      CSAgent.Moves.Add(moveVector);
      CSAgent.Weights.Add(1.0);
      return;
    }
  }
# ---------- end c_script ----------
pt = ConstructPoint(XCoordinate=series, YCoordinate=0, ZCoordinate=merge_2)
data = Data(pt)
dom_3 = ConstructDomain(DomainStart=Slider(0.2, range=0..2), DomainEnd=Slider(1, range=0..1))
c_script_2 = CSharpScript(
    radiusDomain=dom_3,
    Reference=["C:\Users\Alex Reiner\AppData\Roaming\Grasshopper\Libraries\ABxM.Core.dll", "C:\USERS\ALEX REINER\DESKTOP\DQL\HygroDesign.Core.dll"])  # -> out, oBehaviour
# ---------- c_script_2: C# ----------
    radDom = radiusDomain;
    oBehaviour = radBehaviour;
# ---------- c_script_2: C# additional code ----------
  static Interval radDom;
  RadiusBehaviour radBehaviour = new RadiusBehaviour();

  public class RadiusBehaviour : BehaviorBase
  {
    public RadiusBehaviour()
    {
    }

    public override void Execute(AgentBase agent)
    {
      //initialization
      CrossSectionAgent CSAgent = agent as CrossSectionAgent;
      CrossSectionAgentSystem agentSystem = agent.AgentSystem as CrossSectionAgentSystem;
      CrossSection crossSection = agentSystem.CrossSection;

      //check radii to see if this agent still needs to move
      bool smaller = false;
      for(int i = 0; i < crossSection.BoardCurves.Count; i++)
      {
        if(crossSection.BoardCurves[i].ControlPointID != agent.Id) continue;
        if(crossSection.BoardCurves[i].AverageRadius < radDom[0]){ smaller = true; break;}
      }

      bool larger = false;
      for(int i = 0; i < crossSection.BoardCurves.Count; i++)
      {
        if(crossSection.BoardCurves[i].ControlPointID != agent.Id) continue;
        if(crossSection.BoardCurves[i].AverageRadius > radDom[1]){ larger = true; break;}
      }
      if(smaller == false && larger == false) return;

      //move agent
      Line midLine = new Line(crossSection.NurbsCurve.Points[agent.Id - 1].Location, crossSection.NurbsCurve.Points[agent.Id + 1].Location);
      Point3d targetPoint = midLine.PointAt(0.5);

      Vector3d moveVector;
      if(smaller == true)
      {
        moveVector = new Vector3d(targetPoint - crossSection.NurbsCurve.Points[agent.Id].Location);
        moveVector *= 0.1;
      }
      else
      {
        moveVector = new Vector3d(crossSection.NurbsCurve.Points[agent.Id].Location - targetPoint);
        moveVector *= 0.01;
      }



      CSAgent.Moves.Add(moveVector);
      CSAgent.Weights.Add(1.0);
      return;
    }
  }
# ---------- end c_script_2 ----------
board_width = Slider(0.25, range=0.1..0.5)
item = ListItem(List=data, Index=0, Wrap=True)  # -> Item, Item1, Item2, Item3, Item4
nurbs = NurbsCurve(Vertices=pt, Degree=3, Periodic=False)  # -> reparameterize(Curve), Length, Domain
dqltraining = DQLTrainingBehaviour()
merge_3 = Merge(Data1=item.Item1, Data2=item.Item2, Data3=item.Item3)
geo = Geometry(nurbs.Curve)
agent = CrossSectionAgent(StartingPoint=merge_3, Behaviours=dqltraining)  # -> flatten(CrossSectionAgent)
agent_2 = CrossSectionAgent(StartingPoint=item.Item)  # -> flatten(CrossSectionAgent)
agent_3 = CrossSectionAgent(StartingPoint=item.Item4)  # -> flatten(CrossSectionAgent)
crosec = CrossSectionFromNurbsCurve(NurbsCurve=geo, BoardWidth=board_width)
merge_4 = Merge(Data1=agent_2, Data2=agent, Data3=agent_3)
agentsystem = CrossSectionAgentSystem(CrossSection=crosec, Agents=merge_4, DisplacementThreshold=-1)
trigger = Trigger(Interval=20, TimerInterval=20, Target=solver)  # disabled
solver = StepByStepSolver(Reset=Button(), Execute=Toggle(False), AgentSystems=agentsystem)  # -> DisplayGeometries, AllAgentSystems, IterationCount
data_2 = Data(solver.AllAgentSystems)
python = GhPythonScript(x=data_2)  # -> out, a, b, c, d, e, f
# ---------- python: Python ----------
curves = []
ids = []
radii = []
controlPoints = []
utilizations = []

for board in x.CrossSection.BoardCurves:
    curves.append(board.Curve)
    ids.append(board.ControlPointID)
    radii.append(board.AverageRadius)

for agent in x.Agents:
    controlPoints.append(agent.Position)
    utilizations.append(agent.Utilization)

e = x.CrossSection.NurbsCurve

a = curves
b = ids
c = radii
d = controlPoints
f = utilizations
# ---------- end python ----------
panel = Panel(python.f)
pt_2 = Point(python.d)
crv = Curve(python.a)
num = Number(python.b)
num_2 = Number(python.c)
crv_2 = Curve(python.e)

number_slider_2 = Slider(10, range=0..10)
Y = UnitY(Factor=number_slider_2)
crv_3 = Curve(crv)
extr = Extrude(Base=crv_3, Direction=Y)
srf = Surface(extr)

srf_2 = Surface(srf)
tria = TriangularPanelsA(Surface=srf_2, UDivisions=Slider(53, range=0..100), VDivisions=Slider(1, range=0..100))  # -> simplify(Panels)
smesh = SimpleMesh(Brep=tria)
mjoin = MeshJoin(Meshes=smesh)  # -> flatten(Mesh)
mesh = Mesh(mjoin)

# ---- group: active layer
e0 = Slider(13449, range=0..100000)
e90 = Slider(764, range=0..100000)
ft0 = Slider(80, range=0..100)
gamma = Slider(6.91, range=0..10)
num_3 = Number(Slider(20, range=0..100))

# ---- group: passive layer
num_4 = Number(Slider(4, range=0..10))
e0_2 = Slider(464, range=0..100000)
e90_2 = Slider(10800, range=0..100000)
ft0_2 = Slider(0, range=0..100)
gamma_2 = Slider(4.58, range=0..10)

# ---- group: active layer / total thickness
addition = Addition(A=num_3, B=num_4)

# ----
mesh_2 = Mesh(mesh)
num_5 = Number(num)
c_script_3 = CSharpScript(item=mesh_2, map=num_5)  # -> out, A; inputs item: list of Mesh, map: list of Int32
# ---------- c_script_3: C# ----------
    DataTree<Mesh> output = new DataTree<Mesh>();
    for(int i = 0; i < item.Count; i++)
    {
      GH_Path pth = new GH_Path(map[i]);
      output.Add(item[i], pth);
    }
    A = output;
# ---------- end c_script_3 ----------

# ---- group: active layer / distance from bottom
expression = Expression(x=addition, y=num_3, Expression="x - y/2")

# ---- group: passive layer / distance from bottom
expression_2 = Expression(x=expression, y=addition, Expression="x - y/2")

# ---- group: active layer / CG from bottom
division = Division(A=addition, B=2)

# ----
mjoin_2 = MeshJoin(Meshes=c_script_3.A)  # -> flatten(Mesh)

# ---- group: passive layer / dist from CG
subtraction = Subtraction(A=expression_2, B=division)
abs = Absolute(Value=subtraction)

# ---- group: active layer / dist from CG
subtraction_2 = Subtraction(A=expression, B=division)
abs_2 = Absolute(Value=subtraction_2)

# ----
mesh_3 = Mesh(mjoin_2)

# ---- group: active layer / l
expression_3 = Expression(x=num_3, Expression="1000*x^3/12")

# ---- group: passive layer / l
expression_4 = Expression(x=num_4, Expression="1000*x^3/12")

# ---- group: passive layer / Ax2
expression_5 = Expression(x=num_4, y=abs, Expression="1000*x*y^2")

# ----
medges = MeshEdges(Mesh=mesh_3)  # -> NakedEdges, InteriorEdges, NonManifoldEdges

# ---- group: active layer / Ax2
expression_6 = Expression(x=num_3, y=abs_2, Expression="1000*x*y^2")

# ----
crv_4 = Curve(medges.NakedEdges)
explode = Explode(Curve=crv_4, Recursive=True)  # -> Segments, flatten(Vertices)

# ---- group: active layer / total l
addition_2 = Addition(A=expression_3, B=expression_6)

# ---- group: passive layer / total l
addition_3 = Addition(A=expression_4, B=expression_5)

# ----
cullpt = CullDuplicates(Points=explode.Vertices, Tolerance=0.01, CullMode=3)  # -> graft(Points), Indices, Valence
merge_5 = Merge(Data1="0", Data2=number_slider_2)

# ---- group: active layer / El0
multiplication = Multiplication(A=e0, B=addition_2)

# ---- group: active layer / T x ft0
multiplication_2 = Multiplication(A=num_3, B=ft0)

# ---- group: active layer / T x Gam
multiplication_3 = Multiplication(A=gamma, B=num_3)

# ---- group: passive layer / El0
multiplication_4 = Multiplication(A=e0_2, B=addition_3)

# ---- group: passive layer / El90
multiplication_5 = Multiplication(A=e90_2, B=addition_3)

# ---- group: passive layer / T x ft0
multiplication_6 = Multiplication(A=num_4, B=ft0_2)

# ---- group: active layer / El90
multiplication_7 = Multiplication(A=e90, B=addition_2)

# ----
pdecon = Deconstruct(Point=cullpt.Points)  # -> XComponent, YComponent, ZComponent
equals = Equality(FirstNumber=pdecon.YComponent, SecondNumber=merge_5)  # -> Equality, Inequality

# ---- group: effective material properties / El0 eff (Nmm2)
addition_4 = Addition(A=multiplication, B=multiplication_4)

# ---- group: effective material properties / El90 eff (Nmm2)
addition_5 = Addition(A=multiplication_7, B=multiplication_5)

# ---- group: effective material properties / Sum T x Ft0
addition_6 = Addition(A=multiplication_2, B=multiplication_6)

# ---- group: effective material properties / total thickness
addition_7 = Addition(A=num_3, B=num_4)

# ---- group: effective material properties / Sum Tx Gam
addition_8 = Addition(A=multiplication_3)

# ----
cset = CreateSet(List=equals.Equality)  # -> simplify(Set), Map
lng_3 = ListLength(List=cset.Set)

# ---- group: effective material properties / lx / ly
expression_7 = Expression(x=addition_7, Expression="1000*x^3/12")

# ----
larger = LargerThan(FirstNumber=lng_3, SecondNumber=1)  # -> LargerThan, OrEqualTo
cull = CullPattern(List=cullpt.Points, CullPattern=larger.LargerThan)  # -> flatten(List)

# ---- group: effective material properties / E0eff
division_2 = Division(A=addition_4, B=expression_7)

# ---- group: effective material properties / E90eff
division_3 = Division(A=addition_5, B=expression_7)

# ---- group: effective material properties / Gamma eff
division_4 = Division(A=addition_8, B=addition_7)

# ---- group: effective material properties / ft eff
division_5 = Division(A=addition_6, B=addition_7)

# ---- group: effective material properties
matprops = MaterialPropertiesKaramba3D(
    FamilyOfMaterial="CLT",
    Name="CLT",
    ElementIdentifier="CLT",
    YoungsModulusKNCm2Dir1=expr("x*0.1", division_2),
    YoungsModulusKNCm2Dir2=expr("x*0.1", division_3),
    InPlaneShearModulus_kN_cm2="42",
    InPlaneLateralContractionCoefficient=Slider(0.012, range=0..0.1, expression="0.012"),
    TransverseShearModulusKNCm2Dir1="5",
    TransverseShearModulusKNCm2Dir2="5",
    SpecificWeight_kN_m3=division_4,
    CoefficientOfThermalExpansion1CDir1=1.2e-05,
    CoefficientOfThermalExpansion1CDir2=1.2e-05,
    TensileStrengthKNCm2Dir1=division_5,
    TensileStrengthKNCm2Dir2=division_5,
    CompressiveStrengthKNCm2Dir1=-23.5,
    CompressiveStrengthKNCm2Dir2=-23.5,
    ShearStrengthKNCm2Dir12=13.6,
    TsaiWuIntCoeff=0,
    StrengthHypothesis="MISES",
    mode="Orthotropic")  # -> flatten(Material)
num_6 = Number(flatten(addition_7))

# ----
avr = Average(Input=cull)
pdecon_2 = Deconstruct(Point=cull)  # -> XComponent, YComponent, ZComponent
pdecon_3 = Deconstruct(Point=avr)  # -> XComponent, YComponent, ZComponent
larger_2 = LargerThan(FirstNumber=pdecon_2.YComponent, SecondNumber=pdecon_3.YComponent)  # -> LargerThan, OrEqualTo
dispatch = Dispatch(List=cull, DispatchPattern=larger_2.LargerThan)  # -> ListA, ListB
supp = SupportKaramba3D(PosInd=dispatch.ListB, menu=[buttons(on, off, on, off, off, off)])
supp_2 = SupportKaramba3D(PosInd=dispatch.ListA, menu=[buttons(on, off, on, off, off, off)])
cross_section = CrossSectionKaramba3D(FamilyNameOfCrossSection="DefaultCroSec", Height_cm=expr("x/10", num_6), mode="Shell - Const")
loads = LoadsKaramba3D(Vector=Vector(0, 0, -1), LCase="0", mode="Gravity")
meshtoshell = MeshToShellKaramba3D(Mesh=mesh_3, CrossSection=cross_section, LimitDistance_m=0.005)  # -> Element, Points, Info
assemble = AssembleModelKaramba3D(
    Elem=meshtoshell.Element,
    Support=[supp, supp_2],
    Load=loads,
    CrossSection=cross_section,
    Material=matprops,
    LimitDistance_m=0.005)  # -> Model, Info, Mass_kg, CenterOfGravity, LoadCaseNames
analyze = AnalyzeKaramba3D(Model=assemble.Model)  # -> CalculatedModel, MaximumDisplacement_cm, ResultingForceOfGravity_kN, ElasticEnergyChange_kNm
modelview = ModelViewKaramba3D(Model=analyze.CalculatedModel, ResultFactors=1, ResultCase=-1)  # -> Model, DeformedMesh, DeformedAxes, DeformedModel
multiplication_8 = Multiplication(A=analyze.MaximumDisplacement_cm, B=Slider(1000, range=0..1000))
panel_2 = Panel(analyze.MaximumDisplacement_cm)
shellview = ShellViewKaramba3D(Model=modelview.Model, IndexOfLayer=0)  # -> Model, MeshesOfRenderedShells, LegendColors, LegendTags
optimization_solver_with_surrogate_model = MOpossum224(
    OpossumData_OptimizationType=0,
    OpossumData_ResultSerializationStatus=0,
    OpossumData_objective=num_7,
    OpossumData_variable=genes)  # "Optimization Solver with Surrogate Models"
num_7 = Number(multiplication_8)
mesh_4 = Mesh(shellview.MeshesOfRenderedShells)
c_script_4 = CSharpScript(
    model=shellview.Model,
    agentSystem=solver.AllAgentSystems,
    Reference=["C:\Program Files\Rhino 7\Plug-ins\Karamba\karambaCommon.dll", "C:\Program Files\Rhino 7\Plug-ins\Karamba\karamba.gha", "C:\USERS\ALEX REINER\DESKTOP\DQL\HygroDesign.Core.dll", "C:\Users\Alex Reiner\AppData\Roaming\Grasshopper\Libraries\ABxM.Core.dll"])  # -> out, A
# ---------- c_script_4: C# usings ----------
using Karamba;
using Karamba.Elements;
using Karamba.Models;

using HygroDesign.Core;
# ---------- c_script_4: C# ----------
    Model kModel = model as Model;
    CrossSectionAgentSystem aSystem = agentSystem as CrossSectionAgentSystem;

    List<double> utilizations = new List<double>();

    for(int i = 0; i < kModel.elems.Count; i++)
    {
      ModelShell modelShell = kModel.elems[i] as ModelShell;
      List<double> faceUtilizations = modelShell.utilization(kModel, 0);
      double largest = 0;
      foreach(double utilization in faceUtilizations) if(utilization > largest) largest = utilization;
      
      CrossSectionAgent agent = aSystem.Agents[i + 1] as CrossSectionAgent;
      agent.Utilization = largest;
    }
    A = aSystem;
# ---------- end c_script_4 ----------
c_script_5 = CSharpScript(
    agentSystem=c_script_4.A,
    Reference=["C:\Program Files\Rhino 7\Plug-ins\Karamba\karambaCommon.dll", "C:\Program Files\Rhino 7\Plug-ins\Karamba\karamba.gha", "C:\USERS\ALEX REINER\DESKTOP\DQL\HygroDesign.Core.dll", "C:\Users\Alex Reiner\AppData\Roaming\Grasshopper\Libraries\ABxM.Core.dll"])  # -> out, oAgents, oUtilizations
# ---------- c_script_5: C# ----------
    List<CrossSectionAgent> agents = new List<CrossSectionAgent>();
    List<double> utilizations = new List<double>();
    
    CrossSectionAgentSystem CSAS = agentSystem as CrossSectionAgentSystem;
    
    for(int i = 0; i < CSAS.Agents.Count; i++)
    {
      CrossSectionAgent agent = CSAS.Agents[i] as CrossSectionAgent;
      agents.Add(agent);
      utilizations.Add(agent.Utilization);
    }
    oAgents = agents;
    oUtilizations = utilizations;
# ---------- end c_script_5 ----------
ma = MassAddition(Input=c_script_5.oUtilizations)  # -> Result, PartialResults
panel_3 = Panel(ma.Result)
item_2 = ListItem(List=c_script_5.oAgents, Index=0, Wrap=True)  # -> Item, Item1, Item2, Item3
dup = DuplicateData(Data=ma.Result, Number=Slider(3, range=0..10), Order=True)
panel_4 = Panel(c_script_4.A)
train = TrainCrossSectionAgents(Agents=[item_2.Item1, item_2.Item2, item_2.Item3], Reward=dup)
