# Grasshopper definition ABxM CrossSectionAgents.gh (Grasshopper 1.0.7)
# plug-ins: sof_gh_sofistik-2022, HygroDesign, Heteroptera, ABxM.Grasshopper

crosec = BilayerCrossSection(
    Radii=<missing>,
    Directions=<missing>,
    BoardWidth=<missing>,
    SnapTolerance=<missing>,
    SupportParameters=<missing>,
    BasePlane=<missing>)
io = IO(
    SofistikDocumentProperties_VersionMajor="2022",
    SofistikDocumentProperties_VersionMinor="4",
    SofistikDocumentProperties_VersionName="2022")
number_slider = Slider(1, range=0..10)
genes = GenePool(Decimals=2, Maximum=1, Minimum=-1, Value=[0.9151313835, 0.75120717, 0.3563725871, 0.08314819591, -0.8878900576])
neg = Negative(Value=number_slider)
dom = ConstructDomain(DomainStart=neg, DomainEnd=number_slider)
gnc = PoolController(GenePool=genes, Count=Slider(5, range=0..15), Range=dom, Randomness=1)
merge = Merge(Data1="0", Data2=genes)
rev = ReverseList(List=merge)
lng = ListLength(List=rev)  # -> expr("x-1", Length)
dom_2 = ConstructDomain(DomainStart=1, DomainEnd=lng)
subset = SubList(List=rev, Domain=dom_2, Wrap=True)  # -> List, Index
lng_2 = ListLength(List=merge)  # -> expr("(x*2) - 1", Length)
merge_2 = Merge(Data1=flatten(merge), Data2=flatten(subset.List))
series = Series(Start=0, Step=Slider(0.5, range=0..1), Count=lng_2)
pt = ConstructPoint(XCoordinate=series, YCoordinate=0, ZCoordinate=merge_2)
board_width = Slider(0.15, range=0.1..0.5)
dom_3 = ConstructDomain(DomainStart=Slider(0.2, range=0..2), DomainEnd=Slider(1, range=0..1))
c_script = CSharpScript(
    minimumRadius=Slider(0.4, range=0..2),
    Reference=["C:\Users\Alex Reiner\AppData\Roaming\Grasshopper\Libraries\ABxM.Core.dll", "C:\Users\Alex Reiner\AppData\Roaming\Grasshopper\Libraries\HygroDesign.Core.dll"])  # -> out, oBehaviour; inputs minimumRadius: Double
# ---------- c_script: C# usings ----------
using ABxM.Core;
using ABxM.Core.Agent;
using ABxM.Core.Behavior;

using HygroDesign.Core;
# ---------- c_script: C# ----------
    minRad = minimumRadius;
    oBehaviour = radBehaviour;
# ---------- c_script: C# additional code ----------
  static double minRad;
  RadiusBehaviour radBehaviour = new RadiusBehaviour();

  public class RadiusBehaviour : BehaviorBase
  {
    public RadiusBehaviour()
    {
    }

    public override void Execute(AgentBase agent)
    {
      //initialization
      CrossSectionAgent CSAgent = agent as CrossSectionAgent;
      CrossSectionAgentSystem agentSystem = agent.AgentSystem as CrossSectionAgentSystem;
      CrossSection crossSection = agentSystem.CrossSection;

      //check radii to see if this agent still needs to move
      bool smaller = false;
      for(int i = 0; i < crossSection.BoardCurves.Count; i++)
      {
        if(crossSection.BoardCurves[i].ControlPointID != agent.Id) continue;
        if(crossSection.BoardCurves[i].AverageRadius < minRad){ smaller = true; break;}
      }
      if(smaller == false) return;

      //move agent
      Line midLine = new Line(crossSection.NurbsCurve.Points[agent.Id - 1].Location, crossSection.NurbsCurve.Points[agent.Id + 1].Location);
      Point3d targetPoint = midLine.PointAt(0.5);

      Vector3d moveVector = new Vector3d(targetPoint - crossSection.NurbsCurve.Points[agent.Id].Location);
      moveVector *= 0.1;

      CSAgent.Moves.Add(moveVector);
      CSAgent.Weights.Add(1.0);
      return;
    }
  }
# ---------- end c_script ----------
nurbs = NurbsCurve(Vertices=pt, Degree=3, Periodic=False)  # -> reparameterize(Curve), Length, Domain
c_script_2 = CSharpScript(
    radiusDomain=dom_3,
    Reference=["C:\Users\Alex Reiner\AppData\Roaming\Grasshopper\Libraries\ABxM.Core.dll", "C:\Users\Alex Reiner\AppData\Roaming\Grasshopper\Libraries\HygroDesign.Core.dll"])  # -> out, oBehaviour
# ---------- c_script_2: C# ----------
    radDom = radiusDomain;
    oBehaviour = radBehaviour;
# ---------- c_script_2: C# additional code ----------
  static Interval radDom;
  RadiusBehaviour radBehaviour = new RadiusBehaviour();

  public class RadiusBehaviour : BehaviorBase
  {
    public RadiusBehaviour()
    {
    }

    public override void Execute(AgentBase agent)
    {
      //initialization
      CrossSectionAgent CSAgent = agent as CrossSectionAgent;
      CrossSectionAgentSystem agentSystem = agent.AgentSystem as CrossSectionAgentSystem;
      CrossSection crossSection = agentSystem.CrossSection;

      //check radii to see if this agent still needs to move
      bool smaller = false;
      for(int i = 0; i < crossSection.BoardCurves.Count; i++)
      {
        if(crossSection.BoardCurves[i].ControlPointID != agent.Id) continue;
        if(crossSection.BoardCurves[i].AverageRadius < radDom[0]){ smaller = true; break;}
      }

      bool larger = false;
      for(int i = 0; i < crossSection.BoardCurves.Count; i++)
      {
        if(crossSection.BoardCurves[i].ControlPointID != agent.Id) continue;
        if(crossSection.BoardCurves[i].AverageRadius > radDom[1]){ larger = true; break;}
      }
      if(smaller == false && larger == false) return;

      //move agent
      Line midLine = new Line(crossSection.NurbsCurve.Points[agent.Id - 1].Location, crossSection.NurbsCurve.Points[agent.Id + 1].Location);
      Point3d targetPoint = midLine.PointAt(0.5);

      Vector3d moveVector;
      if(smaller == true)
      {
        moveVector = new Vector3d(targetPoint - crossSection.NurbsCurve.Points[agent.Id].Location);
        moveVector *= 0.1;
      }
      else
      {
        moveVector = new Vector3d(crossSection.NurbsCurve.Points[agent.Id].Location - targetPoint);
        moveVector *= 0.01;
      }



      CSAgent.Moves.Add(moveVector);
      CSAgent.Weights.Add(1.0);
      return;
    }
  }
# ---------- end c_script_2 ----------
geo = Geometry(nurbs.Curve)
crosec_2 = CrossSectionFromNurbsCurve(NurbsCurve=geo, BoardWidth=board_width)
agent = CrossSectionAgent(StartingPoint=pt, Behaviours=c_script.oBehaviour)
agentsystem = CrossSectionAgentSystem(CrossSection=crosec_2, Agents=agent, DisplacementThreshold=-1)
trigger = Trigger(Interval=20, TimerInterval=20, Target=solver)  # disabled
solver = StepByStepSolver(Reset=Button(), Execute=Toggle(False), AgentSystems=agentsystem)  # -> DisplayGeometries, AllAgentSystems, IterationCount
data = Data(solver.AllAgentSystems)
python = GhPythonScript(x=data)  # -> out, a, b, c, d, e
# ---------- python: Python ----------
curves = []
ids = []
radii = []
controlPoints = []

for board in x.CrossSection.BoardCurves:
    curves.append(board.Curve)
    ids.append(board.ControlPointID)
    radii.append(board.AverageRadius)

for agent in x.Agents:
    controlPoints.append(agent.Position)

e = x.CrossSection.NurbsCurve

a = curves
b = ids
c = radii
d = controlPoints
# ---------- end python ----------
crv = Curve(python.e)
crv_2 = Curve(python.a)
num = Number(python.b)
pt_2 = Point(python.d)
num_2 = Number(python.c)
panel = Panel(num_2)
