# Grasshopper definition BilayerDesign - Rebuild.gh (Grasshopper 1.0.7)
# plug-ins: HygroDesign, Pufferfish

number_slider = Slider(1000, range=0..1000)
neg = Negative(Value=number_slider)
rectangle = Rectangle(Plane=PlaneXY(0, 0, 0), XSize=number_slider, YSize=neg, Radius=0)  # -> Rectangle, Length
drec = DeconstuctRectangle(Rectangle=rectangle.Rectangle)  # -> BasePlane, XInterval, YInterval
dedomain = DeconstructDomain(Domain=drec.XInterval)  # -> Start, End
dedomain_2 = DeconstructDomain(Domain=drec.YInterval)  # -> Start, End
pt = ConstructPoint(XCoordinate=dedomain.Start, YCoordinate=0, ZCoordinate=0)
pt_2 = ConstructPoint(XCoordinate=dedomain.End, YCoordinate=0, ZCoordinate=0)
subtraction = Subtraction(A=dedomain_2.End, B=dedomain_2.Start)
ln = Line(StartPoint=pt, EndPoint=pt_2)
divide = DivideCurve(Curve=ln, Count=expr("x-1", Slider(3, range=0..10)), Kinks=False)  # -> Points, Tangents, Parameters
multiplication = Multiplication(A=subtraction, B=Slider(0.545, range=0.5..1))
multiplication_2 = Multiplication(A=subtraction, B=Slider(0.486, range=0..0.5))
multiplication_3 = Multiplication(A=subtraction, B=Slider(0.937, range=0.5..1))
multiplication_4 = Multiplication(A=subtraction, B=Slider(0.115, range=0..1))
multiplication_5 = Multiplication(A=subtraction, B=Slider(1, range=0.5..1))
multiplication_6 = Multiplication(A=subtraction, B=Slider(0.338, range=0..0.5))
multiplication_7 = Multiplication(A=subtraction, B=Slider(0.56, range=0.5..1))
multiplication_8 = Multiplication(A=subtraction, B=Slider(0.481, range=0..0.5))
neg_2 = Negative(Value=multiplication_2)
neg_3 = Negative(Value=multiplication)
neg_4 = Negative(Value=multiplication_4)
neg_5 = Negative(Value=multiplication_3)
neg_6 = Negative(Value=multiplication_6)
neg_7 = Negative(Value=multiplication_5)
neg_8 = Negative(Value=multiplication_8)
neg_9 = Negative(Value=multiplication_7)
item = ListItem(List=divide.Points, Index=0, Wrap=True)  # -> Item, Item1, Item2
Y = UnitY(Factor=neg_2)
Y_2 = UnitY(Factor=neg_4)
Y_3 = UnitY(Factor=neg_3)
Y_4 = UnitY(Factor=neg_5)
Y_5 = UnitY(Factor=neg_6)
Y_6 = UnitY(Factor=neg_7)
Y_7 = UnitY(Factor=neg_8)
Y_8 = UnitY(Factor=neg_9)
move = Move(Geometry=[item.Item, item.Item2], Motion=Y)  # -> Geometry, Transform
move_2 = Move(Geometry=item.Item1, Motion=Y_3)  # -> Geometry, Transform
move_3 = Move(Geometry=[item.Item, item.Item2], Motion=Y_2)  # -> Geometry, Transform
move_4 = Move(Geometry=item.Item1, Motion=Y_4)  # -> Geometry, Transform
move_5 = Move(Geometry=[item.Item, item.Item2], Motion=Y_5)  # -> Geometry, Transform
move_6 = Move(Geometry=item.Item1, Motion=Y_6)  # -> Geometry, Transform
move_7 = Move(Geometry=[item.Item, item.Item2], Motion=Y_7)  # -> Geometry, Transform
move_8 = Move(Geometry=item.Item1, Motion=Y_8)  # -> Geometry, Transform
item_2 = ListItem(List=move.Geometry, Index=0, Wrap=True)  # -> Item, Item1
item_3 = ListItem(List=move_3.Geometry, Index=0, Wrap=True)  # -> Item, Item1
item_4 = ListItem(List=move_5.Geometry, Index=0, Wrap=True)  # -> Item, Item1
item_5 = ListItem(List=move_7.Geometry, Index=0, Wrap=True)  # -> Item, Item1
merge = Merge(Data1=flatten(item_2.Item), Data2=flatten(move_2.Geometry), Data3=flatten(item_2.Item1))
merge_2 = Merge(Data1=flatten(item_3.Item), Data2=flatten(move_4.Geometry), Data3=flatten(item_3.Item1))
merge_3 = Merge(Data1=flatten(item_4.Item), Data2=flatten(move_6.Geometry), Data3=flatten(item_4.Item1))
merge_4 = Merge(Data1=flatten(item_5.Item), Data2=flatten(move_8.Geometry), Data3=flatten(item_5.Item1))
intcrv = Interpolate(Vertices=merge, Degree=3, Periodic=False, KnotStyle=1)  # -> Curve, Length, Domain
intcrv_2 = Interpolate(Vertices=merge_2, Degree=3, Periodic=False, KnotStyle=1)  # -> Curve, Length, Domain
intcrv_3 = Interpolate(Vertices=merge_3, Degree=3, Periodic=False, KnotStyle=1)  # -> Curve, Length, Domain
intcrv_4 = Interpolate(Vertices=merge_4, Degree=3, Periodic=False, KnotStyle=1)  # -> Curve, Length, Domain
merge_5 = Merge(Data1=intcrv.Curve, Data2=intcrv_2.Curve, Data3=intcrv_3.Curve, Data4=intcrv_4.Curve)
rec = Rectangle(rectangle.Rectangle)

# ---- group: spruce
panel = Panel("spruce")
number_slider_2 = Slider(0.0001, range=0..0.0001)
number_slider_3 = Slider(0.0019, range=0..1)
number_slider_4 = Slider(0.0036, range=0..1)
number_slider_5 = Slider(10000, range=0..20000)
number_slider_6 = Slider(800, range=0..20000)
number_slider_7 = Slider(450, range=0..20000)
number_slider_8 = Slider(400, range=0..1000)

# ---- group: beech
panel_2 = Panel("beech")
number_slider_9 = Slider(0.0001, range=0..0.0001)
number_slider_10 = Slider(0.002, range=0..1)
number_slider_11 = Slider(0.0041, range=0..1)
number_slider_12 = Slider(14000, range=0..20000)
number_slider_13 = Slider(2280, range=0..20000)
number_slider_14 = Slider(1160, range=0..20000)
number_slider_15 = Slider(720, range=0..1000)

# ----
species = WoodSpecies(
    name=panel_2,
    density=number_slider_15,
    LExp=number_slider_9,
    RExp=number_slider_10,
    TExp=number_slider_11,
    LEmod=number_slider_12,
    REmod=number_slider_13,
    TEmod=number_slider_14)
species_2 = WoodSpecies(
    name=panel,
    density=number_slider_8,
    LExp=number_slider_2,
    RExp=number_slider_3,
    TExp=number_slider_4,
    LEmod=number_slider_5,
    REmod=number_slider_6,
    TEmod=number_slider_7)
panel_3 = Panel(
    HMaxelLength=Slider(250, range=0..1000),
    HMaxelWidth=Slider(150, range=0..1000),
    LengthCount=Slider(20, range=0..100),
    WidthCount=Slider(13, range=0..100))
dec_pan = DeconstructPanel(Panel=panel_3)  # -> Bilayers, graft(HMaxels), LengthRange, WidthRange

number_slider_16 = Slider(1000, range=0..1000)
rectangle_2 = Rectangle(Plane=PlaneXY(0, 0, 0), XSize=number_slider_16, YSize=number_slider_16, Radius=0)  # -> Rectangle, Length
drec_2 = DeconstuctRectangle(Rectangle=rectangle_2.Rectangle)  # -> BasePlane, XInterval, YInterval
dedomain_3 = DeconstructDomain(Domain=drec_2.YInterval)  # -> Start, End
subtraction_2 = Subtraction(A=dedomain_3.End, B=dedomain_3.Start)
division = Division(A=subtraction_2, B=2)
dom = ConstructDomain(DomainStart=0, DomainEnd=1)
number_slider_17 = Slider(0.412, range=0..1)
addition = Addition(A=dedomain_3.Start, B=division)
dom_2 = ConstructDomain(DomainStart=addition, DomainEnd=dedomain_3.End)
dom_3 = ConstructDomain(DomainStart=addition, DomainEnd=dedomain_3.Start)
remap = RemapNumbers(Value=number_slider_17, Source=dom, Target=dom_3)  # -> Mapped, Clipped
remap_2 = RemapNumbers(Value=Slider(0.997, range=0..1), Source=dom, Target=drec_2.XInterval)  # -> Mapped, Clipped
remap_3 = RemapNumbers(Value=number_slider_17, Source=dom, Target=dom_2)  # -> Mapped, Clipped
remap_4 = RemapNumbers(Value=Slider(0.857, range=0..1), Source=dom, Target=drec_2.XInterval)  # -> Mapped, Clipped
pt_3 = ConstructPoint(XCoordinate=0, YCoordinate=remap_2.Mapped, ZCoordinate=0)
pt_4 = ConstructPoint(XCoordinate=remap.Mapped, YCoordinate=remap_4.Mapped, ZCoordinate=0)
pt_5 = ConstructPoint(XCoordinate=remap_3.Mapped, YCoordinate=remap_4.Mapped, ZCoordinate=0)
pt_6 = ConstructPoint(XCoordinate=number_slider_16, YCoordinate=remap_2.Mapped, ZCoordinate=0)
merge_6 = Merge(Data1=pt_3, Data2=pt_4, Data3=pt_5, Data4=pt_6)
nurbs = NurbsCurve(Vertices=merge_6, Degree=2, Periodic=False)  # -> Curve, Length, Domain

number_slider_18 = Slider(1000, range=0..1000)
rectangle_3 = Rectangle(Plane=PlaneXY(0, 0, 0), XSize=number_slider_18, YSize=number_slider_18, Radius=0)  # -> Rectangle, Length
drec_3 = DeconstuctRectangle(Rectangle=rectangle_3.Rectangle)  # -> BasePlane, XInterval, YInterval
dedomain_4 = DeconstructDomain(Domain=drec_3.YInterval)  # -> Start, End
subtraction_3 = Subtraction(A=dedomain_4.End, B=dedomain_4.Start)
division_2 = Division(A=subtraction_3, B=2)
dom_4 = ConstructDomain(DomainStart=0, DomainEnd=1)
number_slider_19 = Slider(0.77, range=0..1)
addition_2 = Addition(A=dedomain_4.Start, B=division_2)
dom_5 = ConstructDomain(DomainStart=addition_2, DomainEnd=dedomain_4.End)
dom_6 = ConstructDomain(DomainStart=addition_2, DomainEnd=dedomain_4.Start)
remap_5 = RemapNumbers(Value=number_slider_19, Source=dom_4, Target=dom_6)  # -> Mapped, Clipped
remap_6 = RemapNumbers(Value=Slider(0.945, range=0..1), Source=dom_4, Target=drec_3.XInterval)  # -> Mapped, Clipped
remap_7 = RemapNumbers(Value=number_slider_19, Source=dom_4, Target=dom_5)  # -> Mapped, Clipped
remap_8 = RemapNumbers(Value=Slider(0.046, range=0..1), Source=dom_4, Target=drec_3.XInterval)  # -> Mapped, Clipped
pt_7 = ConstructPoint(XCoordinate=0, YCoordinate=remap_6.Mapped, ZCoordinate=0)
pt_8 = ConstructPoint(XCoordinate=remap_5.Mapped, YCoordinate=remap_8.Mapped, ZCoordinate=0)
pt_9 = ConstructPoint(XCoordinate=remap_7.Mapped, YCoordinate=remap_8.Mapped, ZCoordinate=0)
pt_10 = ConstructPoint(XCoordinate=number_slider_18, YCoordinate=remap_6.Mapped, ZCoordinate=0)
merge_7 = Merge(Data1=pt_7, Data2=pt_8, Data3=pt_9, Data4=pt_10)
nurbs_2 = NurbsCurve(Vertices=merge_7, Degree=2, Periodic=False)  # -> Curve, Length, Domain

number_slider_20 = Slider(1000, range=0..1000)
rectangle_4 = Rectangle(Plane=PlaneXY(0, 0, 0), XSize=number_slider_20, YSize=number_slider_20, Radius=0)  # -> Rectangle, Length
drec_4 = DeconstuctRectangle(Rectangle=rectangle_4.Rectangle)  # -> BasePlane, XInterval, YInterval
dedomain_5 = DeconstructDomain(Domain=drec_4.YInterval)  # -> Start, End
subtraction_4 = Subtraction(A=dedomain_5.End, B=dedomain_5.Start)
division_3 = Division(A=subtraction_4, B=2)
dom_7 = ConstructDomain(DomainStart=0, DomainEnd=1)
addition_3 = Addition(A=dedomain_5.Start, B=division_3)
number_slider_21 = Slider(0.852, range=0..1)
dom_8 = ConstructDomain(DomainStart=addition_3, DomainEnd=dedomain_5.End)
dom_9 = ConstructDomain(DomainStart=addition_3, DomainEnd=dedomain_5.Start)
remap_9 = RemapNumbers(Value=number_slider_21, Source=dom_7, Target=dom_9)  # -> Mapped, Clipped
remap_10 = RemapNumbers(Value=Slider(0.014, range=0..1), Source=dom_7, Target=drec_4.XInterval)  # -> Mapped, Clipped
remap_11 = RemapNumbers(Value=number_slider_21, Source=dom_7, Target=dom_8)  # -> Mapped, Clipped
remap_12 = RemapNumbers(Value=Slider(0.781, range=0..1), Source=dom_7, Target=drec_4.XInterval)  # -> Mapped, Clipped
pt_11 = ConstructPoint(XCoordinate=0, YCoordinate=remap_10.Mapped, ZCoordinate=0)
pt_12 = ConstructPoint(XCoordinate=remap_9.Mapped, YCoordinate=remap_12.Mapped, ZCoordinate=0)
pt_13 = ConstructPoint(XCoordinate=remap_11.Mapped, YCoordinate=remap_12.Mapped, ZCoordinate=0)
pt_14 = ConstructPoint(XCoordinate=number_slider_20, YCoordinate=remap_10.Mapped, ZCoordinate=0)
merge_8 = Merge(Data1=pt_11, Data2=pt_12, Data3=pt_13, Data4=pt_14)
nurbs_3 = NurbsCurve(Vertices=merge_8, Degree=2, Periodic=False)  # -> Curve, Length, Domain

merge_9 = Merge(Data1=nurbs.Curve, Data2=nurbs_2.Curve, Data3=nurbs_3.Curve)
crv = Curve(merge_9)
lng = ListLength(List=crv)  # -> expr("x-2", Length)
dom_10 = ConstructDomain(DomainStart=0, DomainEnd=lng)
subset = SubList(List=crv, Domain=dom_10, Wrap=True)  # -> graft(List), Index
shift = ShiftList(List=crv, Shift=1, Wrap=False)  # -> graft(List)
merge_10 = Merge(Data1=subset.List, Data2=shift)  # -> simplify(Result)
group = Group(Objects=merge_10)  # -> flatten(Group)

data = Data(dec_pan.HMaxels)
dec_hmaxel = DeconstructHMaxel(HMaxel=data)  # -> PassiveLayers, ActiveBoards, Height, RowRange, ColumnRange
rectangle_5 = Rectangle(Plane=PlaneXY(0, 0, 0), XSize=dec_hmaxel.RowRange, YSize=dec_hmaxel.ColumnRange, Radius=0)  # -> Rectangle, Length
area = Area(Geometry=rectangle_5.Rectangle)  # -> Area, Centroid

crv_2 = Curve(merge_5)
lng_2 = ListLength(List=crv_2)  # -> expr("x-2", Length)
dom_11 = ConstructDomain(DomainStart=0, DomainEnd=lng_2)
subset_2 = SubList(List=crv_2, Domain=dom_11, Wrap=True)  # -> graft(List), Index
shift_2 = ShiftList(List=crv_2, Shift=1, Wrap=False)  # -> graft(List)
merge_11 = Merge(Data1=subset_2.List, Data2=shift_2)  # -> simplify(Result)
group_2 = Group(Objects=merge_11)  # -> flatten(Group)

num = Number(dec_pan.WidthRange)
num_2 = Number(dec_pan.LengthRange)
dedomain_6 = DeconstructDomain(Domain=num)  # -> Start, End
subtraction_5 = Subtraction(A=dedomain_6.End, B=dedomain_6.Start)
division_4 = Division(A=subtraction_5, B=2)
number_slider_22 = Slider(1, range=0..1)
addition_4 = Addition(A=dedomain_6.Start, B=division_4)
dom_12 = ConstructDomain(DomainStart=0, DomainEnd=1)
dom_13 = ConstructDomain(DomainStart=addition_4, DomainEnd=dedomain_6.End)
dom_14 = ConstructDomain(DomainStart=addition_4, DomainEnd=dedomain_6.Start)
remap_13 = RemapNumbers(Value=Slider(1, range=0.25..1), Source=dom_12, Target=num_2)  # -> Mapped, Clipped
remap_14 = RemapNumbers(Value=Slider(0, range=0..0.75), Source=dom_12, Target=num_2)  # -> Mapped, Clipped
remap_15 = RemapNumbers(Value=number_slider_22, Source=dom_12, Target=dom_14)  # -> Mapped, Clipped
remap_16 = RemapNumbers(Value=number_slider_22, Source=dom_12, Target=dom_13)  # -> Mapped, Clipped
pt_15 = ConstructPoint(XCoordinate=remap_13.Mapped, YCoordinate=dedomain_6.Start, ZCoordinate=0)
pt_16 = ConstructPoint(XCoordinate=remap_14.Mapped, YCoordinate=remap_15.Mapped, ZCoordinate=0)
pt_17 = ConstructPoint(XCoordinate=remap_14.Mapped, YCoordinate=remap_16.Mapped, ZCoordinate=0)
pt_18 = ConstructPoint(XCoordinate=remap_13.Mapped, YCoordinate=dedomain_6.End, ZCoordinate=0)
merge_12 = Merge(Data1=pt_15, Data2=pt_16, Data3=pt_17, Data4=pt_18)
nurbs_4 = NurbsCurve(Vertices=merge_12, Degree=2, Periodic=False)  # -> Curve, Length, Domain

# ---- group: generate distribution
pt_19 = Point(simplify(area.Centroid))
data_2 = Data(group)
pdecon = Deconstruct(Point=pt_19)  # -> XComponent, YComponent, ZComponent
bnd = Bounds(Numbers=flatten(pdecon.XComponent))
bnd_2 = Bounds(Numbers=flatten(pdecon.YComponent))
lng_3 = ListLength(List=data_2)
dedomain_7 = DeconstructDomain(Domain=bnd)  # -> Start, End
remap_17 = RemapNumbers(Value=pdecon.YComponent, Source=bnd_2, Target=Domain(0, 1))  # -> graft(Mapped), Clipped
c_script = CSharpScript(count=lng_3, start=dedomain_7.Start, end=dedomain_7.End)  # -> out, A; inputs count: Int32, start: Double, end: Double
# ---------- c_script: C# ----------
    double totalLength = end - start;
    double domLength = totalLength / (double) count;

    List<Interval> intervals = new List<Interval>();
    double currentStart = start;
    for(int i = 0; i < count; i++)
    {
      intervals.Add(new Interval(currentStart, currentStart + domLength));
      currentStart += domLength;
    }
    A = intervals;
# ---------- end c_script ----------
num_3 = Number(graft(pdecon.XComponent))
inc = Includes(Value=num_3, Domain=simplify(c_script.A))  # -> Includes, Deviation
cull = CullPattern(List=data_2, CullPattern=inc.Includes)
item_6 = ListItem(List=cull, Index=0, Wrap=True)
cull_2 = CullPattern(List=c_script.A, CullPattern=inc.Includes)
ungroup = Ungroup(Group=item_6)  # -> simplify(Objects)
item_7 = ListItem(List=cull_2, Index=0, Wrap=True)
remap_18 = RemapNumbers(Value=num_3, Source=item_7, Target=Domain(0, 1))  # -> Mapped, Clipped
eval = EvaluateCurve(Curve=reparameterize(ungroup), Parameter=remap_17.Mapped)  # -> Point, Tangent, Angle
pdecon_2 = Deconstruct(Point=eval.Point)  # -> XComponent, YComponent, ZComponent
item_8 = ListItem(List=pdecon_2.YComponent, Index=0, Wrap=True)  # -> Item, Item1
twn2nums = TweenTwoNumbers(NumberA=item_8.Item, NumberB=item_8.Item1, Factor=remap_18.Mapped)
num_4 = Number(twn2nums)

pt_20 = Point(simplify(area.Centroid))
data_3 = Data(group_2)
pdecon_3 = Deconstruct(Point=pt_20)  # -> XComponent, YComponent, ZComponent
bnd_3 = Bounds(Numbers=flatten(pdecon_3.XComponent))
bnd_4 = Bounds(Numbers=flatten(pdecon_3.YComponent))
lng_4 = ListLength(List=data_3)
dedomain_8 = DeconstructDomain(Domain=bnd_3)  # -> Start, End
remap_19 = RemapNumbers(Value=pdecon_3.YComponent, Source=bnd_4, Target=Domain(0, 1))  # -> graft(Mapped), Clipped
c_script_2 = CSharpScript(count=lng_4, start=dedomain_8.Start, end=dedomain_8.End)  # -> out, A; inputs count: Int32, start: Double, end: Double; same code as c_script
num_5 = Number(graft(pdecon_3.XComponent))
inc_2 = Includes(Value=num_5, Domain=simplify(c_script_2.A))  # -> Includes, Deviation
cull_3 = CullPattern(List=data_3, CullPattern=inc_2.Includes)
item_9 = ListItem(List=cull_3, Index=0, Wrap=True)
cull_4 = CullPattern(List=c_script_2.A, CullPattern=inc_2.Includes)
ungroup_2 = Ungroup(Group=item_9)  # -> simplify(Objects)
item_10 = ListItem(List=cull_4, Index=0, Wrap=True)
remap_20 = RemapNumbers(Value=num_5, Source=item_10, Target=Domain(0, 1))  # -> Mapped, Clipped
eval_2 = EvaluateCurve(Curve=reparameterize(ungroup_2), Parameter=remap_19.Mapped)  # -> Point, Tangent, Angle
pdecon_4 = Deconstruct(Point=eval_2.Point)  # -> XComponent, YComponent, ZComponent
item_11 = ListItem(List=pdecon_4.YComponent, Index=0, Wrap=True)  # -> Item, Item1
twn2nums_2 = TweenTwoNumbers(NumberA=item_11.Item, NumberB=item_11.Item1, Factor=remap_20.Mapped)
num_6 = Number(twn2nums_2)

# ---- group: material / beech
data_4 = Data(species)

# ---- group: material / Species
crv_3 = Curve(nurbs_4.Curve)

# ---- group: material / spruce
data_5 = Data(species_2)

# ---- group: material
pt_21 = Point(graft(area.Centroid))
xz = XZPlane(Origin=pt_21)
pcx = CurvePlane(Curve=crv_3, Plane=xz)  # -> simplify(Points), ParamsC, ParamsP
pdecon_5 = Deconstruct(Point=pcx.Points)  # -> XComponent, YComponent, ZComponent
pdecon_6 = Deconstruct(Point=pt_21)  # -> XComponent, YComponent, ZComponent
smaller = SmallerThan(FirstNumber=pdecon_5.XComponent, SecondNumber=pdecon_6.XComponent)  # -> SmallerThan, OrEqualTo
not = GateNot(A=smaller.SmallerThan)
cull_5 = CullPattern(List=data_4, CullPattern=not)
cull_6 = CullPattern(List=data_5, CullPattern=smaller.SmallerThan)
merge_13 = Merge(Data1=cull_5, Data2=cull_6)  # -> simplify(Result)
dup = DuplicateData(Data=merge_13, Number="2", Order=True)  # -> simplify(Data)

# ----
num_7 = Number(num_4)
rec_2 = Rectangle(rectangle_2.Rectangle)
drec_5 = DeconstuctRectangle(Rectangle=rec_2)  # -> BasePlane, XInterval, YInterval
dom_15 = ConstructDomain(DomainStart=Slider(25, range=0..100), DomainEnd=Slider(75, range=0..100))
remap_21 = RemapNumbers(Value=num_7, Source=drec_5.YInterval, Target=dom_15)  # -> Mapped, Clipped
trim = TrimTree(Tree=remap_21.Mapped, Depth=1)

num_8 = Number(num_6)
rec_3 = Rectangle(rec)
drec_6 = DeconstuctRectangle(Rectangle=rec_3)  # -> BasePlane, XInterval, YInterval
dom_16 = ConstructDomain(DomainStart=0, DomainEnd=1)
remap_22 = RemapNumbers(Value=num_8, Source=drec_6.YInterval, Target=dom_16)  # -> Mapped, Clipped
trim_2 = TrimTree(Tree=remap_22.Mapped, Depth=1)

data_6 = Data(panel_3)
data_7 = Data(species_2)
data_8 = Data(dec_pan.HMaxels)

data_9 = Data(data_6)
panel_4 = Panel("""0
1""")
data_10 = Data(data_7)
bilayer = ConstructBilayer(
    Panel=data_9,
    BoardLength=Slider(4, range=0..10),
    RowOffsets=panel_4,
    PassiveSpecies=data_10,
    ActiveThickness=Slider(20, range=0..100),
    PassiveThickness=Slider(5, range=0..10))

data_11 = Data(data_6)
panel_5 = Panel("""2
3""")
data_12 = Data(data_7)
bilayer_2 = ConstructBilayer(
    Panel=data_11,
    BoardLength=Slider(4, range=0..10),
    RowOffsets=panel_5,
    PassiveSpecies=data_12,
    ActiveThickness=Slider(20, range=0..100),
    PassiveThickness=Slider(4, range=0..10))

up_hmaxel = UpdateHMaxel(HMaxel=simplify(data_8), Height=simplify(trim), RadiusFactor=simplify(trim_2), Species=simplify(dup))  # -> flatten(HMaxel)
merge_14 = Merge(Data1=bilayer, Data2=bilayer_2)
data_13 = Data(panel_3)
up_pan = UpdatePanel(Panel=data_13, Bilayers=merge_14, HMaxels=up_hmaxel)
dec_pan_2 = DeconstructPanel(Panel=up_pan)  # -> Bilayers, HMaxels, LengthRange, WidthRange
dec_hmaxel_2 = DeconstructHMaxel(HMaxel=dec_pan_2.HMaxels)  # -> PassiveLayers, ActiveBoards, Height, RowRange, ColumnRange
dec_bilayer = DeconstructBilayer(Bilayer=dec_pan_2.Bilayers)  # -> ActiveLayer, PassiveLayer
dec_active_layer = DeconstructActiveLayer(ActiveLayer=dec_bilayer.ActiveLayer)  # -> ActiveLayerBoards, Thickness
lng_5 = ListLength(List=dec_hmaxel_2.ActiveBoards)  # -> simplify(flatten(Length))
rectangle_6 = Rectangle(Plane=PlaneXY(0, 0, 0), XSize=dec_hmaxel_2.RowRange, YSize=dec_hmaxel_2.ColumnRange, Radius=0)  # -> Rectangle, Length
dec_active_board = DeconstructActiveBoard(ActiveBoard=dec_active_layer.ActiveLayerBoards)  # -> simplify(HMaxels), StockBoard, RowRange, ColumnRange, DesiredRadius
boundary = BoundarySurfaces(Edges=rectangle_6.Rectangle)
bnd_5 = Bounds(Numbers=lng_5)
remap_23 = RemapNumbers(Value=lng_5, Source=bnd_5, Target=Domain(0, 1))  # -> Mapped, Clipped
gradient = Gradient(
    LowerLimit=0,
    UpperLimit=1,
    Parameter=remap_23.Mapped,
    stops=[0: RGB(234, 38, 0), 0.25: RGB(234, 126, 0), 0.5: RGB(254, 244, 84), 0.75: RGB(173, 203, 249), 1: RGB(75, 107, 169)])
preview = CustomPreview(Geometry=boundary, Material=gradient)
