# Grasshopper definition BilayerDesign - Structural optimization with fixed stock.gh (Grasshopper 1.0.7)
# plug-ins: Sofistik, Telepathy, HygroDesign, Pufferfish, MeshEdit Components, Karamba3D, Kangaroo2 Components, Weaverbird, Human, LunchBox

update = Button()
python = GhPythonScript(update=update)  # inputs update: Boolean
# ---------- python: Python ----------
# Seghier Mohamed Abdelaziz - 2021 - seghierdesign@gmail.com

import Grasshopper as gh

ghDoc = ghenv.Component.OnPingDocument()
objects = ghDoc.Objects

object = []

for obj in objects: 

    if obj.NickName.Length == 0:
        if str(obj.RemovedFromDocument.DeclaringType) == "Grasshopper.Kernel.GH_Component":
            object.append(obj)
                
if update == True:
    gh.Kernel.GH_Document.NewSolution(ghDoc,False)
    for o in object:
        gh.Kernel.GH_Document.RemoveObject(ghDoc ,o,False)
# ---------- end python ----------

# ---- group: beech
species = WoodSpecies(
    Name="beech",
    LExpansion=Slider(0.0001, range=0..0.0001),
    RExpansion=Slider(0.002, range=0..1),
    TExpansion=Slider(0.0041, range=0..1),
    LElasticModulus=Slider(14000, range=0..20000),
    RElasticModulus=Slider(2280, range=0..20000),
    TElasticModulus=Slider(1160, range=0..20000))

# ---- group: spruce
species_2 = WoodSpecies(
    Name="spruce",
    LExpansion=Slider(0.0001, range=0..0.0001),
    RExpansion=Slider(0.0019, range=0..1),
    TExpansion=Slider(0.0036, range=0..1),
    LElasticModulus=Slider(10000, range=0..20000),
    RElasticModulus=Slider(800, range=0..20000),
    TElasticModulus=Slider(450, range=0..20000))

# ----
number_slider = Slider(150, range=0..10000)
number_slider_2 = Slider(4, range=0..10)
number_slider_3 = Slider(2500, range=0..10000)
number_slider_4 = Slider(27, range=0..100)
xy = XYPlane(Origin=Point(0, 0, 0))
multiplication = Multiplication(A=number_slider_4, B=number_slider)
multiplication_2 = Multiplication(A=number_slider_3, B=number_slider_2)
bilayer = Bilayer(
    BasePlane=xy,
    BoardWidth=number_slider,
    BoardLength=number_slider_3,
    WidthCount=number_slider_4,
    LengthCount=number_slider_2,
    ActiveThickness=Slider(20, range=0..100),
    PassiveThickness=Slider(4, range=0..100),
    PassiveSpecies=species_2)
rectangle = Rectangle(Plane=PlaneXY(0, 0, 0), XSize=multiplication_2, YSize=multiplication, Radius=0)  # -> Rectangle, Length
num = Number(number_slider)
num_2 = Number(number_slider_3)

number_slider_5 = Slider(1000, range=0..1000)
neg = Negative(Value=number_slider_5)
rectangle_2 = Rectangle(Plane=PlaneXY(0, 0, 0), XSize=number_slider_5, YSize=neg, Radius=0)  # -> Rectangle, Length
drec = DeconstuctRectangle(Rectangle=rectangle_2.Rectangle)  # -> BasePlane, XInterval, YInterval
dedomain = DeconstructDomain(Domain=drec.XInterval)  # -> Start, End
dedomain_2 = DeconstructDomain(Domain=drec.YInterval)  # -> Start, End
pt = ConstructPoint(XCoordinate=dedomain.Start, YCoordinate=0, ZCoordinate=0)
pt_2 = ConstructPoint(XCoordinate=dedomain.End, YCoordinate=0, ZCoordinate=0)
subtraction = Subtraction(A=dedomain_2.End, B=dedomain_2.Start)
ln = Line(StartPoint=pt, EndPoint=pt_2)
number_slider_6 = Slider(0.6, range=0.5..1)
number_slider_7 = Slider(0.4, range=0..0.5)
divide = DivideCurve(Curve=ln, Count=expr("x-1", Slider(3, range=0..10)), Kinks=False)  # -> Points, Tangents, Parameters
multiplication_3 = Multiplication(A=subtraction, B=Slider(1, range=0.5..1))
multiplication_4 = Multiplication(A=subtraction, B=Slider(0.2, range=0..0.5))
multiplication_5 = Multiplication(A=subtraction, B=Slider(0.8, range=0.5..1))
multiplication_6 = Multiplication(A=subtraction, B=Slider(0.3, range=0..1))
multiplication_7 = Multiplication(A=subtraction, B=number_slider_6)
multiplication_8 = Multiplication(A=subtraction, B=number_slider_6)
neg_2 = Negative(Value=multiplication_4)
neg_3 = Negative(Value=multiplication_3)
neg_4 = Negative(Value=multiplication_6)
neg_5 = Negative(Value=multiplication_5)
neg_6 = Negative(Value=multiplication_8)
neg_7 = Negative(Value=multiplication_7)
item = ListItem(List=divide.Points, Index=0, Wrap=True)  # -> Item, Item1, Item2
Y = UnitY(Factor=neg_2)
Y_2 = UnitY(Factor=neg_4)
Y_3 = UnitY(Factor=neg_3)
Y_4 = UnitY(Factor=neg_5)
Y_5 = UnitY(Factor=neg_6)
Y_6 = UnitY(Factor=neg_7)
move = Move(Geometry=[item.Item, item.Item2], Motion=Y)  # -> Geometry, Transform
move_2 = Move(Geometry=item.Item1, Motion=Y_3)  # -> Geometry, Transform
move_3 = Move(Geometry=[item.Item, item.Item2], Motion=Y_2)  # -> Geometry, Transform
move_4 = Move(Geometry=item.Item1, Motion=Y_4)  # -> Geometry, Transform
move_5 = Move(Geometry=[item.Item, item.Item2], Motion=Y_5)  # -> Geometry, Transform
move_6 = Move(Geometry=item.Item1, Motion=Y_6)  # -> Geometry, Transform
item_2 = ListItem(List=move.Geometry, Index=0, Wrap=True)  # -> Item, Item1
item_3 = ListItem(List=move_3.Geometry, Index=0, Wrap=True)  # -> Item, Item1
item_4 = ListItem(List=move_5.Geometry, Index=0, Wrap=True)  # -> Item, Item1
merge = Merge(Data1=flatten(item_2.Item), Data2=flatten(move_2.Geometry), Data3=flatten(item_2.Item1))
merge_2 = Merge(Data1=flatten(item_3.Item), Data2=flatten(move_4.Geometry), Data3=flatten(item_3.Item1))
merge_3 = Merge(Data1=flatten(item_4.Item), Data2=flatten(move_6.Geometry), Data3=flatten(item_4.Item1))
intcrv = Interpolate(Vertices=merge, Degree=3, Periodic=False, KnotStyle=1)  # -> Curve, Length, Domain
intcrv_2 = Interpolate(Vertices=merge_2, Degree=3, Periodic=False, KnotStyle=1)  # -> Curve, Length, Domain
intcrv_3 = Interpolate(Vertices=merge_3, Degree=3, Periodic=False, KnotStyle=1)  # -> Curve, Length, Domain
merge_4 = Merge(Data1=intcrv.Curve, Data2=intcrv_2.Curve, Data3=intcrv_3.Curve)
rec = Rectangle(rectangle_2.Rectangle)

board_count = Slider(500, range=0..500)

# ---- group: name
num_3 = Number(board_count)
series = Series(Start=0, Step=1, Count=num_3)
dup = DuplicateData(Data="S", Number=num_3, Order=True)  # -> graft(Data)
txt = Text(graft(series))
merge_5 = Merge(Data1=dup, Data2=txt)  # -> simplify(Result)
join = TextJoin(Text=merge_5)  # -> flatten(Result)

# ---- group: active thickness
number_slider_8 = Slider(20, range=0..100)

# ---- group: RT
dom = ConstructDomain(DomainStart=Slider(15, range=0..100), DomainEnd=Slider(75, range=0..100))
random = Random(Range=dom, Number=board_count, Seed=Slider(225, range=0..1000))

# ---- group: name
num_4 = Number(board_count)
series_2 = Series(Start=0, Step=1, Count=num_4)
dup_2 = DuplicateData(Data="B", Number=num_4, Order=True)  # -> graft(Data)
txt_2 = Text(graft(series_2))
merge_6 = Merge(Data1=dup_2, Data2=txt_2)  # -> simplify(Result)
join_2 = TextJoin(Text=merge_6)  # -> flatten(Result)

# ---- group: thickness
num_5 = Number(number_slider_8)
num_6 = Number(board_count)
dup_3 = DuplicateData(Data=num_5, Number=num_6, Order=True)

# ---- group: length
num_7 = Number(num_2)
num_8 = Number(board_count)
dup_4 = DuplicateData(Data=num_7, Number=num_8, Order=True)

# ---- group: width
num_9 = Number(num)
num_10 = Number(board_count)
dup_5 = DuplicateData(Data=num_9, Number=num_10, Order=True)

# ---- group: beech
data = Data(species)

# ---- group: spruce
data_2 = Data(species_2)

# ---- group: bounding rectangle input (rectangle y domain represents full range of radii from stockpiles)
rec_2 = Rectangle(rec)

# ----
stock_boards = StockBoards(Name=join_2, Species=data, Thickness=dup_3, Length=dup_4, Width=dup_5, RTAngle=random)
stock_boards_2 = StockBoards(Name=join, Species=data_2, Thickness=dup_3, Length=dup_4, Width=dup_5, RTAngle=random)
merge_7 = Merge(Data1=stock_boards, Data2=stock_boards_2)

# ---- group: curve controller inputs (represents distribution of radii along a given cross section)
crv = Curve(merge_4)

# ----
crv_2 = Curve(crv)
lng = ListLength(List=crv_2)  # -> expr("x-2", Length)
dom_2 = ConstructDomain(DomainStart=0, DomainEnd=lng)
subset = SubList(List=crv_2, Domain=dom_2, Wrap=True)  # -> graft(List), Index
shift = ShiftList(List=crv_2, Shift=1, Wrap=False)  # -> graft(List)
merge_8 = Merge(Data1=subset.List, Data2=shift)  # -> simplify(Result)
group = Group(Objects=merge_8)  # -> flatten(Group)

deconstruct_bilayer = DeconstructBilayer(Bilayer=bilayer)
dec_board = DeconstructBoard(Board=deconstruct_bilayer)  # -> Polyline, Name, Species, RTAngle, MoistureChange, DesiredRadius, Radius, BlendedRadius, BoardRegions
area = Area(Geometry=dec_board.Polyline)  # -> Area, Centroid
c_script = CSharpScript(rects=flatten(dec_board.Polyline))  # -> out; inputs rects: list of Rectangle3d; disabled
# ---------- c_script: C# usings ----------
using Rhino.DocObjects;
# ---------- c_script: C# ----------
    var object_enumerator_settings = new ObjectEnumeratorSettings();

    var rhinoObjects = RhinoDoc.ActiveDoc.Objects.GetObjectList(object_enumerator_settings);
    var objectTable = RhinoDoc.ActiveDoc.Objects;

    foreach( var rhinoObject in rhinoObjects)
    {
      if(rhinoObject.ObjectType == ObjectType.Curve)
      {
        Curve rhinoCurve = rhinoObject.Geometry as Curve;
        if(rhinoCurve.IsClosed)objectTable.Delete(rhinoObject);
      }
    }

    foreach(var rect in rects)objectTable.AddCurve(rect.ToNurbsCurve());
# ---------- end c_script ----------
pt_3 = Point(simplify(area.Centroid))

# ---- group: generate distribution
pt_4 = Point(simplify(pt_3))
data_3 = Data(group)
pdecon = Deconstruct(Point=pt_4)  # -> XComponent, YComponent, ZComponent
bnd = Bounds(Numbers=flatten(pdecon.XComponent))
bnd_2 = Bounds(Numbers=flatten(pdecon.YComponent))
lng_2 = ListLength(List=data_3)
dedomain_3 = DeconstructDomain(Domain=bnd)  # -> Start, End
remap = RemapNumbers(Value=pdecon.YComponent, Source=bnd_2, Target=Domain(0, 1))  # -> graft(Mapped), Clipped
c_script_2 = CSharpScript(count=lng_2, start=dedomain_3.Start, end=dedomain_3.End)  # -> out, A; inputs count: Int32, start: Double, end: Double
# ---------- c_script_2: C# ----------
    double totalLength = end - start;
    double domLength = totalLength / (double) count;

    List<Interval> intervals = new List<Interval>();
    double currentStart = start;
    for(int i = 0; i < count; i++)
    {
      intervals.Add(new Interval(currentStart, currentStart + domLength));
      currentStart += domLength;
    }
    A = intervals;
# ---------- end c_script_2 ----------
num_11 = Number(graft(pdecon.XComponent))
inc = Includes(Value=num_11, Domain=simplify(c_script_2.A))  # -> Includes, Deviation
cull = CullPattern(List=data_3, CullPattern=inc.Includes)
item_5 = ListItem(List=cull, Index=0, Wrap=True)
cull_2 = CullPattern(List=c_script_2.A, CullPattern=inc.Includes)
ungroup = Ungroup(Group=item_5)  # -> simplify(Objects)
item_6 = ListItem(List=cull_2, Index=0, Wrap=True)
remap_2 = RemapNumbers(Value=num_11, Source=item_6, Target=Domain(0, 1))  # -> Mapped, Clipped
eval = EvaluateCurve(Curve=reparameterize(ungroup), Parameter=remap.Mapped)  # -> Point, Tangent, Angle
pdecon_2 = Deconstruct(Point=eval.Point)  # -> XComponent, YComponent, ZComponent
item_7 = ListItem(List=pdecon_2.YComponent, Index=0, Wrap=True)  # -> Item, Item1
twn2nums = TweenTwoNumbers(NumberA=item_7.Item, NumberB=item_7.Item1, Factor=remap_2.Mapped)
num_12 = Number(twn2nums)

# ----
bbox = BoundingBox(Content=dec_board.Polyline, Plane=PlaneXY(0, 0, 0), UnionBox=True)  # -> Box, Box_2
debox = DeconstructBox(Box=bbox.Box)  # -> Plane, X, Y, Z
dedomain_4 = DeconstructDomain(Domain=debox.X)  # -> Start, End
dedomain_5 = DeconstructDomain(Domain=debox.Y)  # -> Start, End
pt_5 = ConstructPoint(XCoordinate=dedomain_4.End, YCoordinate=dedomain_5.End, ZCoordinate=0)
pt_6 = ConstructPoint(XCoordinate=dedomain_4.Start, YCoordinate=dedomain_5.End, ZCoordinate=0)
pt_7 = ConstructPoint(XCoordinate=dedomain_4.Start, YCoordinate=dedomain_5.Start, ZCoordinate=0)
pt_8 = ConstructPoint(XCoordinate=dedomain_4.End, YCoordinate=dedomain_5.Start, ZCoordinate=0)
merge_9 = Merge(Data1=pt_5, Data2=pt_6, Data3=pt_7, Data4=pt_8)
nurbs = NurbsCurve(Vertices=merge_9, Degree=3, Periodic=False)  # -> Curve, Length, Domain

# ---- group: material / beech
data_4 = Data(species)

# ---- group: material / Species
crv_3 = Curve(nurbs.Curve)

# ---- group: material / spruce
data_5 = Data(species_2)

# ---- group: material
pt_9 = Point(graft(pt_3))
xz = XZPlane(Origin=pt_9)
pcx = CurvePlane(Curve=crv_3, Plane=xz)  # -> simplify(Points), ParamsC, ParamsP
pdecon_3 = Deconstruct(Point=pcx.Points)  # -> XComponent, YComponent, ZComponent
pdecon_4 = Deconstruct(Point=pt_9)  # -> XComponent, YComponent, ZComponent
smaller = SmallerThan(FirstNumber=pdecon_3.XComponent, SecondNumber=pdecon_4.XComponent)  # -> SmallerThan, OrEqualTo
not = GateNot(A=smaller.SmallerThan)
cull_3 = CullPattern(List=data_4, CullPattern=not)
cull_4 = CullPattern(List=data_5, CullPattern=smaller.SmallerThan)
merge_10 = Merge(Data1=cull_3, Data2=cull_4)  # -> simplify(Result)
path_mapper = PathMapper(merge_10, source="{A}", target="{0}")

# ---- group: Thickness
dec_reg = DeconstructBoardRegion(BoardRegion=dec_board.BoardRegions)  # -> Polyline, Name, Species, RTAngle, MoistureChange, DesiredRadius, Radius, BlendedRadius, ThicknessBlendedRadius
area_2 = Area(Geometry=dec_reg.Polyline)  # -> Area, Centroid
pt_10 = Point(simplify(area_2.Centroid))
pdecon_5 = Deconstruct(Point=pt_10)  # -> XComponent, YComponent, ZComponent
bnd_3 = Bounds(Numbers=flatten(pdecon_5.XComponent))
dom_3 = ConstructDomain(DomainStart=Slider(1.2, range=0..1.2), DomainEnd=Slider(0, range=0..1))
remap_3 = RemapNumbers(Value=pdecon_5.XComponent, Source=bnd_3, Target=dom_3)  # -> Mapped, Clipped

# ----
pt_11 = Point(pt_3)
pdecon_6 = Deconstruct(Point=pt_11)  # -> XComponent, YComponent, ZComponent
bnd_4 = Bounds(Numbers=flatten(pdecon_6.XComponent))
dom_4 = ConstructDomain(DomainStart="1", DomainEnd="0")
remap_4 = RemapNumbers(Value=pdecon_6.XComponent, Source=bnd_4, Target=dom_4)  # -> simplify(Mapped), Clipped

num_13 = Number(num_12)
rec_3 = Rectangle(rec_2)
drec_2 = DeconstuctRectangle(Rectangle=rec_3)  # -> BasePlane, XInterval, YInterval
dom_5 = ConstructDomain(DomainStart=0, DomainEnd=1)
remap_5 = RemapNumbers(Value=num_13, Source=drec_2.YInterval, Target=dom_5)  # -> Mapped, Clipped
trim = TrimTree(Tree=remap_5.Mapped, Depth=1)

data_6 = Data(bilayer)
tag = TextTag3D(Location=pt_10, Text=remap_3.Mapped, Size=Slider(100, range=0..100), Justification=7)

update_bilayer = UpdateBilayer(Bilayer=data_6, Radius=trim, RadiusWeight=remap_4.Mapped, Material=path_mapper)
dup_bilayer = DuplicateBilayer(Bilayer=update_bilayer, Count=Slider(4, range=0..10))
panel = Panel(Bilayers=dup_bilayer)
adjust_cro_sec = AdjustCrossSection(Panel=panel, Thicknesses=remap_3.Mapped)
dup_panel = DuplicatePanel(Panel=adjust_cro_sec, Count=Slider(2, range=0..10))

# ---- group: moisture changes
panel_2 = Panel("""2
4
8""")
num_14 = Number(panel_2)

# ----
data_7 = Data(merge_7)
design_env = DesignEnvironment(Panels=dup_panel, StockBoards=data_7, MoistureChanges=num_14)  # -> Panels, StockBoards
convolution = CurvatureConvolution(
    Panels=design_env.Panels,
    TengentialBlending=Slider(0.34, range=0.01..3),
    LongitudinalBlending=Slider(0.3, range=0.01..3),
    MaxRadiusInfluence=100000,
    StiffnessFactor=0.1,
    ThicknessFactor=0.1,
    VisualizeBoardWeights=0)  # -> Panels, Weights

cross_section = BooleanToggle(True)
relaxation = BooleanToggle(False)
cull_5 = CullPattern(List=convolution.Panels, CullPattern=cross_section)

item_8 = ListItem(List=convolution.Panels, Index=0, Wrap=True)  # -> Item, Item1
deconstruct_panel = DeconstructPanel(Panel=item_8.Item)
deconstruct_bilayer_2 = DeconstructBilayer(Bilayer=deconstruct_panel)
dec_board_2 = DeconstructBoard(Board=deconstruct_bilayer_2)  # -> Polyline, Name, Species, RTAngle, MoistureChange, DesiredRadius, Radius, BlendedRadius, BoardRegions
display_panel = DisplayPanels(Panels=item_8.Item)  # -> ActiveBoards, PassiveBoards
dec_reg_2 = DeconstructBoardRegion(BoardRegion=dec_board_2.BoardRegions)  # -> Polyline, Name, Species, RTAngle, MoistureChange, DesiredRadius, Radius, BlendedRadius, ThicknessBlendedRadius

bbox_2 = BoundingBox(Content=flatten(dec_reg_2.Polyline), Plane=PlaneXY(0, 0, 0), UnionBox=True)  # -> Box, Box_2
debox_2 = DeconstructBox(Box=bbox_2.Box)  # -> Plane, X, Y, Z
dedomain_6 = DeconstructDomain(Domain=debox_2.Y)  # -> Start, End
subtraction_2 = Subtraction(A=dedomain_6.End, B=dedomain_6.Start)
multiplication_9 = Multiplication(A=subtraction_2, B="1.5")
series_3 = Series(Start=Slider(6884, range=0..10000), Step=multiplication_9, Count=Slider(5, range=0..10))
item_9 = ListItem(List=series_3, Index=0, Wrap=True)  # -> Item, Item1, Item2, Item3, Item4

crosecset = UniqueCrossSections(Panel=cull_5)
dec_reg_3 = DeconstructBoardRegion(BoardRegion=crosecset)  # -> Polyline, Name, Species, RTAngle, MoistureChange, DesiredRadius, Radius, BlendedRadius, ThicknessBlendedRadius

python_2 = GhPythonScript(x=dec_reg_2.Species)  # -> out, a
# ---------- python_2: Python ----------
a = x.Name
# ---------- end python_2 ----------
len = TextLength(Text=python_2.a)
bnd_5 = Bounds(Numbers=flatten(len))
dedomain_7 = DeconstructDomain(Domain=bnd_5)  # -> Start, End
gradient = Gradient(
    LowerLimit=dedomain_7.Start,
    UpperLimit=dedomain_7.End,
    Parameter=len,
    stops=[0: RGB(80, 55, 25), 0.5: RGB(159, 65, 29), 1: RGB(174, 166, 129)])
Y_7 = UnitY(Factor=item_9.Item3)
vec = Vector(Y_7)
move_7 = Move(Geometry=display_panel.ActiveBoards, Motion=vec)  # -> Geometry, Transform
move_8 = Move(Geometry=display_panel.PassiveBoards, Motion=vec)  # -> Geometry, Transform
preview = CustomPreview(Geometry=move_7.Geometry, Material=gradient)
preview_2 = CustomPreview(Geometry=move_8.Geometry, Material=ColourSwatch(SwatchColor=RGB(115, 115, 115)))

bnd_6 = Bounds(Numbers=flatten(dec_reg_2.RTAngle))
dedomain_8 = DeconstructDomain(Domain=bnd_6)  # -> Start, End
gradient_2 = Gradient(
    LowerLimit=dedomain_8.Start,
    UpperLimit=dedomain_8.End,
    Parameter=dec_reg_2.RTAngle,
    stops=[0: RGB(124, 0, 219), 1: RGB(207, 130, 255)])
Y_8 = UnitY(Factor=item_9.Item2)
vec_2 = Vector(Y_8)
move_9 = Move(Geometry=display_panel.ActiveBoards, Motion=vec_2)  # -> Geometry, Transform
move_10 = Move(Geometry=display_panel.PassiveBoards, Motion=vec_2)  # -> Geometry, Transform
preview_3 = CustomPreview(Geometry=move_9.Geometry, Material=gradient_2)
preview_4 = CustomPreview(Geometry=move_10.Geometry, Material=ColourSwatch(SwatchColor=RGB(115, 115, 115)))

bnd_7 = Bounds(Numbers=flatten(dec_reg_2.MoistureChange))
dedomain_9 = DeconstructDomain(Domain=bnd_7)  # -> Start, End
Y_9 = UnitY(Factor=item_9.Item1)
gradient_3 = Gradient(
    LowerLimit=dedomain_9.Start,
    UpperLimit=dedomain_9.End,
    Parameter=dec_reg_2.MoistureChange,
    stops=[0: RGB(180, 239, 240), 0.502: RGB(122, 194, 214), 1: RGB(120, 176, 222)])
vec_3 = Vector(Y_9)
move_11 = Move(Geometry=display_panel.ActiveBoards, Motion=vec_3)  # -> Geometry, Transform
move_12 = Move(Geometry=display_panel.PassiveBoards, Motion=vec_3)  # -> Geometry, Transform
preview_5 = CustomPreview(Geometry=move_11.Geometry, Material=gradient_3)
preview_6 = CustomPreview(Geometry=move_12.Geometry, Material=ColourSwatch(SwatchColor=RGB(115, 115, 115)))

c_script_3 = CSharpScript(desired=dec_reg_2.DesiredRadius, actual=dec_reg_2.ThicknessBlendedRadius)  # -> out, A; inputs desired: Double, actual: Double
# ---------- c_script_3: C# ----------
    A = 100 * Math.Abs(desired - actual) / ((desired + actual) / 2);
# ---------- end c_script_3 ----------
Y_10 = UnitY(Factor=item_9.Item)
gradient_4 = Gradient(LowerLimit=0, UpperLimit="100", Parameter=c_script_3.A, stops=[0.15: RGB(255, 130, 160), 0.85: RGB(220, 0, 40)])
vec_4 = Vector(Y_10)
move_13 = Move(Geometry=display_panel.ActiveBoards, Motion=vec_4)  # -> Geometry, Transform
move_14 = Move(Geometry=display_panel.PassiveBoards, Motion=vec_4)  # -> Geometry, Transform
swatch = ColourSwatch(SwatchColor=RGBA(0, 0, 0, 66))
preview_7 = CustomPreview(Geometry=move_13.Geometry, Material=gradient_4)
preview_8 = CustomPreview(Geometry=move_14.Geometry, Material=gradient_4)

number_slider_9 = Slider(1, range=0..100000)  # disabled

cull_6 = CullPattern(List=cull_5, CullPattern=cross_section)
deconstruct_panel_2 = DeconstructPanel(Panel=cull_6)
deconstruct_bilayer_3 = DeconstructBilayer(Bilayer=deconstruct_panel_2)
dec_board_3 = DeconstructBoard(Board=deconstruct_bilayer_3)  # -> Polyline, Name, Species, RTAngle, MoistureChange, DesiredRadius, Radius, BlendedRadius, BoardRegions
dec_reg_4 = DeconstructBoardRegion(BoardRegion=dec_board_3.BoardRegions)  # -> Polyline, ThicknessBlendedRadius, Species, MoistureChange, DesiredRadius, Radius, BlendedRadius, ThicknessBlendedRadius_2, ThicknessBlendedRadius_3

support = RemoteSender(<missing>)
support_2 = RemoteReceiver(support)
node_sofistik = NodeSofistik(<missing>)
support_sofistik = SupportSofistik(flatten(<missing>))
load_sofistik = LoadSofistik(<missing>)

crv_4 = Curve(dec_reg_3.Polyline)
area_3 = Area(Geometry=crv_4)  # -> Area, Centroid
avr = Average(Input=area_3.Centroid)
bbox_3 = BoundingBox(Content=flatten(avr), Plane=PlaneXY(0, 0, 0), UnionBox=True)  # -> Box, Box_2
debox_3 = DeconstructBox(Box=bbox_3.Box)  # -> Plane, X, Y, Z
dedomain_10 = DeconstructDomain(Domain=debox_3.X)  # -> Start, End
subtraction_3 = Subtraction(A=dedomain_10.End, B=dedomain_10.Start)

trim_2 = TrimTree(Tree=crv_4, Depth=1)

bbox_4 = BoundingBox(Content=trim_2, Plane=PlaneXY(0, 0, 0), UnionBox=True)  # -> Box, Box_2
debox_4 = DeconstructBox(Box=bbox_4.Box)  # -> Plane, X, Y, Z
dedomain_11 = DeconstructDomain(Domain=debox_4.X)  # -> Start, End
subtraction_4 = Subtraction(A=dedomain_11.End, B=dedomain_11.Start)
area_4 = Area(Geometry=bbox_4.Box)  # -> Area, Centroid
division = Division(A=subtraction_4, B=subtraction_3)
scale = Scale(Geometry=avr, Center=area_4.Centroid, Factor=division)  # -> Geometry, Transform
yz = YZPlane(Origin=scale.Geometry)

num_15 = Number(num)
pln = Plane(yz)
num_16 = Number(dec_reg_3.ThicknessBlendedRadius)
c_script_4 = CSharpScript(iRadii=num_16, iBoardWidth=num_15, iPlanes=pln)  # -> out, simplify(A); inputs iRadii: tree of Double, iBoardWidth: Double, iPlanes: tree of Plane
# ---------- c_script_4: C# ----------
    DataTree<Point3d> pointTree = new DataTree<Point3d>();

    for (int j = 0; j < iRadii.BranchCount; j++)
    {

      //initialize variables
      Plane bp = iPlanes.Branch(j)[0];
      Point3d startPoint = new Point3d(bp.Origin);
      Point3d centerPoint = startPoint;
      Vector3d rotationAxis = new Vector3d(bp.ZAxis);
      Vector3d centerPointVect = new Vector3d(bp.YAxis);
      centerPointVect.Rotate(Math.PI / 2, rotationAxis);

      for (int i = 0; i < iRadii.Branch(j).Count; i++){
        GH_Path pth = iRadii.Paths[j].AppendElement(i);
        Point3d point1 = startPoint;
        Point3d point2 = startPoint;

        pointTree.Add(point1, pth);

        //calculate rotation angle
        Double arcLength = iBoardWidth;
        Double radius = iRadii.Branch(j)[i];
        Double rotation = (arcLength / radius);

        //calculate rotation center point
        centerPointVect.Unitize();
        centerPointVect *= radius;
        centerPoint += centerPointVect;


        //execute half rotation
        Transform tx = Transform.Rotation(rotation / 2, rotationAxis, centerPoint);


        point2.Transform(tx);
        pointTree.Add(point2, pth);

        //execute full rotation
        tx = Transform.Rotation(rotation, rotationAxis, centerPoint);
        startPoint.Transform(tx);
        pointTree.Add(startPoint, pth);

        //updata rotation parameters
        centerPoint = startPoint;
        centerPointVect.Transform(tx);
      }
    }
    A = pointTree;
# ---------- end c_script_4 ----------

trim_3 = TrimTree(Tree=c_script_4.A, Depth=1)
cullpt = CullDuplicates(Points=trim_3, Tolerance=0.1, CullMode=3)  # -> Points, Indices, Valence
pt_12 = Point(cullpt.Points)

# ---- group: animate
pt_13 = Point(simplify(pt_12))
pln_2 = Plane(graft(pln))
num_17 = Number(Slider(1, range=0..1))
c_script_5 = CSharpScript(iPoints=simplify(pt_13), iPlanes=pln_2, iShapeFactor=num_17)  # -> out, A; inputs iPoints: tree of Point3d, iPlanes: tree of Plane, iShapeFactor: Double
# ---------- c_script_5: C# ----------
    DataTree<Point3d> output = new DataTree<Point3d>();
    
    double shapeFactor = 1.0 - iShapeFactor;

    //step through curves
    for (int i = 0; i < iPoints.BranchCount; i++)
    {
      Plane currentPlane = iPlanes.Branch(iPoints.Path(i)[0])[0];

      //get vectors from plane
      Vector3d zVect = currentPlane.YAxis;

      Vector3d rotVect = currentPlane.ZAxis;

      //create new startpoint inside list
      Point3d startPoint = iPoints.Branch(i)[0];

      //step through points. Create and rotate vectors
      for (int j = 0; j < iPoints.Branch(i).Count; j++)
      {
        if (j == 0) output.Add(startPoint, iPoints.Path(i));
        else{
          //create current segment vector
          Vector3d segmentVect = new Vector3d(iPoints.Branch(i)[j] - iPoints.Branch(i)[j - 1]);

          //measure angle with vertical vector
          double angle = Vector3d.VectorAngle(zVect, segmentVect, currentPlane);

          //rotate
          segmentVect.Rotate(-angle * shapeFactor, rotVect);

          startPoint += segmentVect;
          output.Add(startPoint, iPoints.Path(i));
        }
      }
    }

    A = output;
# ---------- end c_script_5 ----------
pt_14 = Point(c_script_5.A)
intcrv_4 = Interpolate(Vertices=pt_14, Degree=3, Periodic=False, KnotStyle=1)  # -> Curve, Length, Domain
crv_5 = Curve(intcrv_4.Curve)

# ----
crv_6 = Curve(crv_5)
pt_15 = Point(simplify(graft(scale.Geometry)))
end = EndPoints(Curve=crv_6)  # -> Start, End
vec2pt = Vector2Pt(PointA=end.Start, PointB=end.End, Unitize=False)  # -> Vector, Length
yz_2 = YZPlane(Origin=end.Start)
Y_11 = UnitY(Factor="-1")
angle = Angle(VectorA=vec2pt.Vector, VectorB=Y_11, Plane=yz_2)  # -> Angle, Reflex
rotate = Rotate(Geometry=crv_6, Angle=angle.Angle, Plane=yz_2)  # -> Geometry, Transform
curvepoint = PointOnCurve(rotate.Geometry, parameter=0.5)
vec2pt_2 = Vector2Pt(PointA=curvepoint, PointB=pt_15, Unitize=False)  # -> Vector, Length
move_15 = Move(Geometry=rotate.Geometry, Motion=vec2pt_2.Vector)  # -> Geometry, Transform
path_mapper_2 = PathMapper(move_15.Geometry, source=["{A;B}", "{A}"], target=["{A}", "{0}"])
crv_7 = Curve(path_mapper_2)
loft = Loft(Curves=crv_7, Options={Adjust=False, Closed=False, LoftEnds=0, LoftSimp=0, LoftType=2, Rebuild=10, Refit=0.01})

bool = Boolean(relaxation)  # disabled
cull_7 = CullPattern(List=loft, CullPattern=bool)  # disabled
number_slider_10 = Slider(8, range=0..100)  # disabled
srf = Surface(cull_7)  # disabled
num_18 = Number(number_slider_4)  # disabled
quads = QuadPanels(Surface=srf, UDivisions=number_slider_10, VDivisions=num_18)  # disabled
srf_2 = Surface(reparameterize(simplify(quads)))  # disabled

smesh = SimpleMesh(Brep=srf_2)  # disabled
area_5 = MeshArea(Mesh=smesh)  # -> Area, Centroid; disabled
meshcp = MeshClosestPoint(Point=area_5.Centroid, Mesh=smesh)  # -> Point, Index, Parameter; disabled
meval = MeshEval(Mesh=smesh, Parameter=meshcp.Parameter)  # -> Point, Normal, Colour; disabled
pl = PlaneNormal(Origin=meval.Point, ZAxis=meval.Normal)  # disabled
X = UnitX(Factor=1)  # disabled
deplane = DeconstructPlane(Plane=pl)  # -> Origin, XAxis, YAxis, ZAxis; disabled
angle_2 = Angle(VectorA=deplane.XAxis, VectorB=X, Plane=pl)  # -> Angle, Reflex; disabled
rotate_2 = Rotate(Geometry=pl, Angle=angle_2.Angle, Plane=pl)  # -> graft(Geometry), Transform; disabled

medges = MeshEdges(Mesh=smesh)  # -> simplify(NakedEdges), InteriorEdges, NonManifoldEdges; disabled
curvepoint_2 = PointOnCurve(medges.NakedEdges, parameter=0.5)  # disabled
plcoord = PlaneCoordinates(Point=curvepoint_2, System=rotate_2.Geometry)  # -> XCoordinate, YCoordinate, ZCoordinate; disabled
sort = SortList(Keys=plcoord.XCoordinate, ValuesA=medges.NakedEdges)  # -> Keys, ValuesA; disabled
item_10 = ListItem(List=reverse(sort.ValuesA), Index=0, Wrap=True)  # disabled
item_11 = ListItem(List=sort.ValuesA, Index=0, Wrap=True)  # disabled

merge_11 = Merge(Data1=item_11, Data2=item_10)  # disabled
trim_4 = TrimTree(Tree=merge_11, Depth=1)  # disabled
rdlines = RemoveDuplicateLinesKaramba3D(Line=trim_4, LimitDistance=0.005)  # -> OutLine, Info, Indexes; disabled
join_3 = JoinCurves(Curves=rdlines.OutLine, Preserve=False)  # disabled
explode = Explode(Curve=join_3, Recursive=True)  # -> Segments, simplify(Vertices); disabled
pline = PolyLine(Vertices=explode.Vertices, Closed=False)  # -> simplify(graft(Polyline)); disabled
path_mapper_3 = PathMapper(pline, source=["{A}", "{A;B}"], target=["{0}", "{A}"])  # disabled
curvepoint_3 = PointOnCurve(path_mapper_3, parameter=0.5)  # disabled
pdecon_7 = Deconstruct(Point=curvepoint_3)  # -> XComponent, YComponent, ZComponent; disabled
sort_2 = SortList(Keys=pdecon_7.XComponent, ValuesA=path_mapper_3)  # -> Keys, ValuesA; disabled
crv_8 = Curve(sort_2.ValuesA)  # disabled

crv_9 = Curve(crv_8)  # disabled
item_12 = ListItem(List=crv_9, Index=0, Wrap=True)  # disabled
curvepoint_4 = PointOnCurve(crv_9, parameter=0.5)  # disabled
curvepoint_5 = PointOnCurve(item_12, parameter=0.5)  # disabled
vec2pt_3 = Vector2Pt(PointA=curvepoint_5, PointB=curvepoint_4, Unitize=False)  # -> Vector, Length; disabled
move_16 = Move(Geometry=item_12, Motion=vec2pt_3.Vector)  # -> Geometry, Transform; disabled

crv_10 = Curve(crv_8)  # disabled
flip = FlipCurve(Curve=crv_10, Guide=move_16.Geometry)  # -> Curve, Flag; disabled

explode_2 = Explode(Curve=flip.Curve, Recursive=True)  # -> simplify(Segments), Vertices; disabled
explode_3 = Explode(Curve=move_16.Geometry, Recursive=True)  # -> simplify(Segments), Vertices; disabled
lng_3 = ListLength(List=explode_2.Segments)  # disabled
lng_4 = ListLength(List=explode_2.Segments)  # disabled
lng_5 = ListLength(List=explode_3.Segments)  # disabled
lng_6 = ListLength(List=explode_3.Segments)  # disabled
subtraction_5 = Subtraction(A=lng_3, B=2)  # disabled
subtraction_6 = Subtraction(A=lng_4, B=1)  # disabled
subtraction_7 = Subtraction(A=lng_5, B=2)  # disabled
subtraction_8 = Subtraction(A=lng_6, B=1)  # disabled
dom_6 = ConstructDomain(DomainStart=0, DomainEnd=subtraction_5)  # disabled
dom_7 = ConstructDomain(DomainStart=1, DomainEnd=subtraction_6)  # disabled
dom_8 = ConstructDomain(DomainStart=0, DomainEnd=subtraction_7)  # disabled
dom_9 = ConstructDomain(DomainStart=1, DomainEnd=subtraction_8)  # disabled
subset_2 = SubList(List=explode_2.Segments, Domain=dom_6, Wrap=True)  # -> List, Index; disabled
subset_3 = SubList(List=explode_2.Segments, Domain=dom_7, Wrap=True)  # -> List, Index; disabled
subset_4 = SubList(List=explode_3.Segments, Domain=dom_8, Wrap=True)  # -> List, Index; disabled
subset_5 = SubList(List=explode_3.Segments, Domain=dom_9, Wrap=True)  # -> List, Index; disabled
angle_3 = Angle(VectorA=subset_4.List, VectorB=subset_5.List)  # -> simplify(Angle), Reflex; disabled
angle_4 = Angle(VectorA=subset_2.List, VectorB=subset_3.List)  # -> simplify(Angle), Reflex; disabled
num_19 = Number(angle_3.Angle)  # disabled
num_20 = Number(angle_4.Angle)  # disabled

explode_4 = Explode(Curve=flip.Curve, Recursive=True)  # -> simplify(Segments), Vertices; disabled
explode_5 = Explode(Curve=move_16.Geometry, Recursive=True)  # -> simplify(Segments), Vertices; disabled
path_mapper_4 = PathMapper(explode_4.Segments, source=["{A}(i)", "{A;B}(i)"], target=["{i}(A)", "{A;i}(B)"])  # disabled
path_mapper_5 = PathMapper(explode_5.Segments, source=["{A}(i)", "{A;B}(i)"], target=["{i}(A)", "{A;i}(B)"])  # disabled
crv_11 = Curve(path_mapper_5)  # disabled
crv_12 = Curve(path_mapper_4)  # disabled
lng_7 = ListLength(List=crv_12)  # -> expr("x-2", Length); disabled
lng_8 = ListLength(List=crv_11)  # -> expr("x-2", Length); disabled
lng_9 = ListLength(List=crv_12)  # -> expr("x-1", Length); disabled
lng_10 = ListLength(List=crv_11)  # -> expr("x-1", Length); disabled
dom_10 = ConstructDomain(DomainStart=0, DomainEnd=lng_7)  # disabled
dom_11 = ConstructDomain(DomainStart=0, DomainEnd=lng_8)  # disabled
dom_12 = ConstructDomain(DomainStart=1, DomainEnd=lng_9)  # disabled
dom_13 = ConstructDomain(DomainStart=1, DomainEnd=lng_10)  # disabled
subset_6 = SubList(List=crv_12, Domain=dom_10, Wrap=True)  # -> graft(List), Index; disabled
subset_7 = SubList(List=crv_11, Domain=dom_11, Wrap=True)  # -> graft(List), Index; disabled
subset_8 = SubList(List=crv_12, Domain=dom_12, Wrap=True)  # -> graft(List), Index; disabled
subset_9 = SubList(List=crv_11, Domain=dom_13, Wrap=True)  # -> graft(List), Index; disabled
loft_2 = Loft(
    Curves=[subset_6.List, subset_8.List],
    Options={Adjust=False, Closed=False, LoftEnds=0, LoftSimp=0, LoftType=0, Rebuild=10, Refit=0.01})  # -> simplify(Loft); disabled
loft_3 = Loft(
    Curves=[subset_7.List, subset_9.List],
    Options={Adjust=False, Closed=False, LoftEnds=0, LoftSimp=0, LoftType=0, Rebuild=10, Refit=0.01})  # -> simplify(Loft); disabled
smesh_2 = SimpleMesh(Brep=loft_2)  # disabled
smesh_3 = SimpleMesh(Brep=loft_3)  # disabled
path_mapper_6 = PathMapper(smesh_3, source=["{A;B;C}", "{A;B}"], target=["{A}", "{0}"])  # disabled
path_mapper_7 = PathMapper(smesh_2, source=["{A;B;C}", "{A;B}"], target=["{A}", "{0}"])  # disabled
mjoin = MeshJoin(Meshes=path_mapper_6)  # disabled
mjoin_2 = MeshJoin(Meshes=path_mapper_7)  # disabled
weld = WeldMesh(Mesh=mjoin, Angle=3.141592654)  # disabled
weld_2 = WeldMesh(Mesh=mjoin_2, Angle=3.141592654)  # disabled

explode_6 = Explode(Curve=move_16.Geometry, Recursive=True)  # -> Segments, Vertices; disabled
num_21 = Number(num_20)  # disabled
num_22 = Number(num_19)  # disabled
mesh = Mesh(weld)  # disabled
path_mapper_8 = PathMapper(explode_6.Vertices, source=["{A;B}(i)", "{A}(i)"], target=["{A;i}(B)", "{i}(A)"])  # disabled
division_2 = Division(A=num_21, B=num_22)  # disabled
avr_2 = Average(Input=division_2)  # disabled
number_slider_11 = Slider(100, range=0..100000)  # disabled
number_slider_12 = Slider(1, range=0..10000)  # disabled
number_slider_13 = Slider(10000, range=0..10000)  # disabled
pline_2 = PolyLine(Vertices=path_mapper_8, Closed=False)  # -> simplify(Polyline); disabled
path_mapper_9 = PathMapper(pline_2, source=["{A;B}", "{A}"], target=["{A}", "{0}"])  # disabled
crv_13 = Curve(move_16.Geometry)  # disabled
show = Show(G=mesh)  # disabled
rod = Rod(Polyline=path_mapper_9, LengthFactor=1, AngleFactor=1, AxialStrength=number_slider_11, BendStrength=number_slider_12)  # disabled
path_mapper_10 = PathMapper(rod, source=["{A;B}", "{A}"], target=["{A}", "{0}"])  # disabled

path_mapper_11 = PathMapper(avr_2, source=["{A}", "{A;B}"], target=["{0}", "{A}"])  # disabled

rod_2 = Rod(
    Polyline=crv_13,
    LengthFactor=1,
    AngleFactor=path_mapper_11,
    AxialStrength=number_slider_11,
    BendStrength=number_slider_13)  # disabled
path_mapper_12 = PathMapper(rod_2, source=["{A;B}", "{A}"], target=["{A}", "{0}"])  # disabled
merge_12 = Merge(Data1=path_mapper_10, Data2=path_mapper_12, Data3=show)  # disabled

zombiesolver = ZombieSolver(GoalObjects=merge_12, Threshold=1e-10, Tolerance=0.0001, MaxIterations=number_slider_9)  # -> I, V, O; disabled
mesh_2 = Mesh(zombiesolver.O)  # disabled
clean = CleanTree(RemoveNulls=True, RemoveInvalid=True, RemoveEmpty=False, Tree=mesh_2)  # disabled

wbedges = WeaverbirdsMeshEdges(MeshOrPolylines=graft(clean))  # -> simplify(Lines); disabled
mesh_3 = Mesh(simplify(graft(clean)))  # disabled

wbedges_2 = WeaverbirdsMeshEdges(MeshOrPolylines=weld_2)  # -> simplify(Lines); disabled
line = Line(wbedges)  # disabled
number_slider_14 = Slider(1330, range=0..10000)  # disabled
group_2 = Group(Objects=line)  # -> flatten(Group); disabled
len_2 = Length(Curve=wbedges_2)  # disabled
len_3 = Length(Curve=line)  # disabled
lng_11 = ListLength(List=group_2)  # disabled
subtraction_9 = Subtraction(A=len_3, B=len_2)  # disabled
series_4 = Series(Start=0, Step=number_slider_14, Count=lng_11)  # disabled
number_slider_15 = Slider(5928, range=0..10000)  # disabled
smaller_2 = SmallerThan(FirstNumber=subtraction_9, SecondNumber=0)  # -> SmallerThan, OrEqualTo; disabled
dispatch = Dispatch(List=subtraction_9, DispatchPattern=smaller_2.SmallerThan)  # -> ListA, ListB; disabled
Y_12 = UnitY(Factor=series_4)  # disabled
Y_13 = UnitY(Factor=number_slider_15)  # disabled
move_17 = Move(Geometry=group_2, Motion=Y_12)  # -> Geometry, Transform; disabled
bnd_8 = Bounds(Numbers=dispatch.ListA)  # disabled
bnd_9 = Bounds(Numbers=dispatch.ListB)  # disabled
number_slider_16 = Slider(7456, range=0..10000)  # disabled
move_18 = Move(Geometry=move_17.Geometry, Motion=Y_13)  # -> Geometry, Transform; disabled
dedomain_12 = DeconstructDomain(Domain=bnd_9)  # -> Start, End; disabled
dedomain_13 = DeconstructDomain(Domain=bnd_8)  # -> Start, End; disabled
X_2 = UnitX(Factor=number_slider_16)  # disabled
move_19 = Move(Geometry=move_18.Geometry, Motion=X_2)  # -> Geometry, Transform; disabled
gradient_5 = Gradient(
    LowerLimit=dedomain_13.Start,
    UpperLimit=dedomain_13.End,
    Parameter=dispatch.ListA,
    stops=[0: RGB(75, 107, 169), 0.501: RGB(173, 203, 249), 1: RGB(254, 244, 84)])  # disabled
gradient_6 = Gradient(
    LowerLimit=dedomain_12.Start,
    UpperLimit=dedomain_12.End,
    Parameter=dispatch.ListB,
    stops=[0: RGB(254, 244, 84), 0.499: RGB(234, 126, 0), 1: RGB(234, 38, 0), 1: RGB(75, 107, 169), 1: RGB(173, 203, 249)])  # disabled
ungroup_2 = Ungroup(Group=move_19.Geometry)  # disabled
dispatch_2 = Dispatch(List=ungroup_2, DispatchPattern=smaller_2.SmallerThan)  # -> ListA, ListB; disabled
previewlw = CustomPreviewLineweights(Geometry=dispatch_2.ListA, Shader=gradient_5, Thickness=3, Absolute=False)  # disabled
previewlw_2 = CustomPreviewLineweights(Geometry=dispatch_2.ListB, Shader=gradient_6, Thickness=3, Absolute=False)  # disabled

crv_14 = Curve(wbedges)  # disabled
end_2 = EndPoints(Curve=crv_14)  # -> Start, End; disabled
pdecon_8 = Deconstruct(Point=end_2.Start)  # -> XComponent, YComponent, ZComponent; disabled
pdecon_9 = Deconstruct(Point=end_2.End)  # -> XComponent, YComponent, ZComponent; disabled
subtraction_10 = Subtraction(A=pdecon_8.XComponent, B=pdecon_9.XComponent)  # disabled
number_slider_17 = Slider(100, range=0..100)  # disabled
abs = Absolute(Value=subtraction_10)  # disabled
smaller_3 = SmallerThan(FirstNumber=abs, SecondNumber=number_slider_17)  # -> SmallerThan, OrEqualTo; disabled
cull_8 = CullPattern(List=crv_14, CullPattern=smaller_3.SmallerThan)  # disabled
join_4 = JoinCurves(Curves=cull_8, Preserve=False)  # disabled
curvepoint_6 = PointOnCurve(join_4, parameter=0.5)  # disabled
pdecon_10 = Deconstruct(Point=curvepoint_6)  # -> XComponent, YComponent, ZComponent; disabled
sort_3 = SortList(Keys=pdecon_10.XComponent, ValuesA=join_4)  # -> Keys, ValuesA; disabled
explode_7 = Explode(Curve=sort_3.ValuesA, Recursive=True)  # -> Segments, simplify(Vertices); disabled
intcrv_5 = Interpolate(Vertices=explode_7.Vertices, Degree=3, Periodic=False, KnotStyle=1)  # -> Curve, Length, Domain; disabled
path_mapper_13 = PathMapper(intcrv_5.Curve, source=["{A;B}", "{A}"], target=["{A}", "{0}"])  # disabled
loft_4 = Loft(Curves=path_mapper_13, Options={Adjust=False, Closed=False, LoftEnds=0, LoftSimp=0, LoftType=0, Rebuild=10, Refit=0.01})  # disabled

mesh_4 = Mesh(mesh_3)  # disabled
number_slider_18 = Slider(1, range=0..1)  # disabled
num_23 = Number(expr("x+1", number_slider_10))  # disabled
medges_2 = MeshEdges(Mesh=mesh_4)  # -> NakedEdges, InteriorEdges, NonManifoldEdges; disabled
demesh = DeconstructMesh(Mesh=mesh_4)  # -> Vertices, Faces, Colours, Normals; disabled
join_5 = JoinCurves(Curves=medges_2.NakedEdges, Preserve=False)  # disabled
patch = Patch(Curves=join_5, Points=demesh.Vertices, Spans=num_23, Flexibility=number_slider_18, Trim=True)  # disabled
srf_3 = Surface(simplify(patch))  # disabled

# ---- group: control gate
srf_4 = Surface(loft_4)
srf_5 = Surface(loft)
bool_2 = Boolean(relaxation)
not_2 = GateNot(A=bool_2)
cull_9 = CullPattern(List=srf_5, CullPattern=not_2)
merge_13 = Merge(Data1=srf_4, Data2=cull_9)

# ----
crv_15 = Curve(dec_reg_4.Polyline)
srf_6 = Surface(reparameterize(simplify(graft(merge_13))))
rec_4 = Rectangle(rectangle.Rectangle)
explode_8 = Explode(Curve=crv_15, Recursive=True)  # -> Segments, Vertices
path_mapper_14 = PathMapper(crv_15, source=["{A;B}", "{A}", "{A;B;C}"], target=["{A}", "{0}", "{A}"])
len_4 = Length(Curve=explode_8.Segments)
tstat = TreeStatistics(Tree=path_mapper_14)  # -> Paths, Length, Count
division_3 = Division(A=len_4, B=Slider(100, range=0..100))
lng_12 = ListLength(List=tstat.Paths)
divide_2 = DivideCurve(Curve=explode_8.Segments, Count=division_3, Kinks=False)  # -> Points, Tangents, Parameters
dup_6 = DuplicateData(Data=rec_4, Number=lng_12, Order=True)  # -> graft(Data)
path_mapper_15 = PathMapper(divide_2.Points, source=["{A;B;C;D}", "{A;B;C}", "{A;B;C;D;E}"], target=["{A}", "{0}", "{A}"])
srf_7 = Surface(reparameterize(simplify(dup_6)))
srf_cp = SurfaceClosestPoint(Point=path_mapper_15, Surface=srf_7)  # -> Point, UVPoint, Distance
evalsrf = EvaluateSurface(Surface=reparameterize(srf_6), Point=srf_cp.UVPoint)  # -> Point, Normal, UDirection, VDirection, Frame
c_script_6 = CSharpScript(trimmedTree=evalsrf.Point, originalTree=divide_2.Points)  # -> out, A; inputs trimmedTree: tree, originalTree: tree
# ---------- c_script_6: C# ----------
    if(originalTree.DataCount != trimmedTree.DataCount) Component.AddRuntimeMessage(GH_RuntimeMessageLevel.Error, "Number of items in both trees must be equal");

    DataTree<object> outputs = new DataTree<object>();
    List<GH_Path> paths = GetPaths(originalTree);
    //step through trimmed tree objects and add them to output tree with the correct

    int counter = 0;
    for(int i = 0; i < trimmedTree.BranchCount; i++)
    {
      for(int j = 0; j < trimmedTree.Branch(i).Count; j++)
      {
        outputs.Add(trimmedTree.Branch(i)[j], paths[counter]);
        counter++;
      }
    }
    A = outputs;
# ---------- c_script_6: C# additional code ----------
  public List<GH_Path> GetPaths(DataTree<object> originalTree)
  {
    List<GH_Path> output = new List<GH_Path>();
    for(int i = 0; i < originalTree.BranchCount; i++)
    {
      for(int j = 0; j < originalTree.Branch(i).Count; j++)
      {
        output.Add(originalTree.Paths[i]);
      }
    }
    return output;
  }
# ---------- end c_script_6 ----------
intcrv_6 = Interpolate(Vertices=c_script_6.A, Degree=3, Periodic=False, KnotStyle=1)  # -> Curve, Length, Domain
trim_5 = TrimTree(Tree=intcrv_6.Curve, Depth=1)
item_13 = ListItem(List=trim_5, Index=0, Wrap=True)  # -> Item, Item1, Item2, Item3
flip_2 = FlipCurve(Curve=item_13.Item3)  # -> Curve, Flag
merge_14 = Merge(Data1=item_13.Item1, Data2=flip_2.Curve)
loft_5 = Loft(Curves=merge_14, Options={Adjust=False, Closed=False, LoftEnds=0, LoftSimp=0, LoftType=0, Rebuild=10, Refit=0.01})

srf_8 = Surface(merge_13)
edges = BrepEdges(Brep=srf_8)  # -> Naked, Interior, NonManifold
len_5 = Length(Curve=edges.Naked)
sort_4 = SortList(Keys=len_5, ValuesA=edges.Naked)  # -> Keys, reverse(ValuesA)
item_14 = ListItem(List=sort_4.ValuesA, Index=0, Wrap=True)  # -> Item, Item1
flip_3 = FlipCurve(Curve=item_14.Item1)  # -> Curve, Flag
merge_15 = Merge(Data1=item_14.Item, Data2=flip_3.Curve)
divide_3 = DivideCurve(Curve=merge_15, Count=Slider(100, range=0..100), Kinks=False)  # -> Points, Tangents, Parameters
path_mapper_16 = PathMapper(divide_3.Points, source="{A;B;C}(i)", target="{A;B;i}(C)")
item_15 = ListItem(List=path_mapper_16, Index=0, Wrap=True)  # -> Item, Item1
dist = Distance(PointA=item_15.Item, PointB=item_15.Item1)
trim_6 = TrimTree(Tree=dist, Depth=1)
bnd_10 = Bounds(Numbers=trim_6)
dedomain_14 = DeconstructDomain(Domain=bnd_10)  # -> simplify(Start), End
multiplication_10 = Multiplication(A=dedomain_14.Start, B=Slider(0.95, range=0..1))  # -> flatten(Result)
c_script_7 = CSharpScript(x=multiplication_10)  # -> out, A; inputs x: list of Double
# ---------- c_script_7: C# ----------
    List<double> output = new List<double>();
    
    double currentVal = 0;
    for(int i = 0; i < x.Count; i++)
    {
      output.Add(currentVal);
      currentVal += x[i];
    }
    A = output;
# ---------- end c_script_7 ----------
Y_14 = UnitY(Factor=c_script_7.A)
move_20 = Move(Geometry=srf_8, Motion=graft(Y_14))  # -> Geometry, Transform

mesh_5 = Mesh(mesh_3)  # disabled
mesh_6 = Mesh(flatten(mesh_5))  # disabled
number_slider_19 = Slider(2905, range=0..10000)  # disabled
c_script_8 = CSharpScript(mesh=mesh_5, surface=srf_3)  # -> out, Curvature; inputs mesh: Mesh, surface: Surface; disabled
# ---------- c_script_8: C# ----------
        //get surface gaussian curvature at each mesh point
        List<double> gaussianCurvatures = new List<double>();
        double maxGaussian = 0;
        double minGaussian = double.MaxValue;

        double U;
        double V;

        for (int i = 0; i < mesh.Vertices.Count; i++)
        {
            Point3d currentMeshPoint = mesh.Vertices.Point3dAt(i);
            surface.ClosestPoint(currentMeshPoint, out U, out V);
            SurfaceCurvature surfaceCurvature = surface.CurvatureAt(U, V);
            double gaussian = surfaceCurvature.Gaussian;
            gaussianCurvatures.Add(gaussian);

            //get the range of curvatures
            if (gaussian > maxGaussian) maxGaussian = gaussian;
            if( gaussian < minGaussian) minGaussian = gaussian;
        }


        //get the range of curvatures


        //remap the curvatures to color values on the mesh points
        for (int i = 0; i < mesh.Vertices.Count; i++)
        {
            double hue = (gaussianCurvatures[i] - minGaussian) / (0 - minGaussian) * (0.5 - maxGaussian) + maxGaussian;
        }
        Curvature = gaussianCurvatures;
# ---------- end c_script_8 ----------
move_21 = Move(Geometry=mesh_6, Motion=Y_14)  # -> simplify(graft(Geometry)), Transform; disabled
num_24 = Number(c_script_8.Curvature)  # disabled
Y_15 = UnitY(Factor=number_slider_19)  # disabled
number_slider_20 = Slider(7456, range=0..10000)  # disabled
bnd_11 = Bounds(Numbers=num_24)  # disabled
mesh_7 = Mesh(move_21.Geometry)  # disabled
dedomain_15 = DeconstructDomain(Domain=bnd_11)  # -> Start, End; disabled
move_22 = Move(Geometry=mesh_7, Motion=Y_15)  # -> Geometry, Transform; disabled
X_3 = UnitX(Factor=number_slider_20)  # disabled
gradient_7 = Gradient(
    LowerLimit=dedomain_15.Start,
    UpperLimit=dedomain_15.End,
    Parameter=num_24,
    stops=[0: RGB(0, 128, 0), 0.5: RGB(255, 255, 0), 1: RGB(255, 0, 0)])  # disabled
move_23 = Move(Geometry=move_22.Geometry, Motion=X_3)  # -> Geometry, Transform; disabled
c_script_9 = CSharpScript(mesh=move_23.Geometry, colors=simplify(gradient_7))  # -> out, A; inputs mesh: Mesh, colors: list of Color; disabled
# ---------- c_script_9: C# ----------
    for(int i = 0; i < mesh.Vertices.Count; i++)
    {
      mesh.VertexColors.SetColor(i, colors[i]);
    }
    A = mesh;
# ---------- end c_script_9 ----------

gaussian_curvature = Panel(bnd_11)  # disabled
relaxation_2 = Panel(bnd_8)  # disabled

trim_7 = TrimTree(Tree=loft_5, Depth=2)
vec_5 = Vector(Y_14)
join_6 = BrepJoin(Breps=trim_7)  # -> Breps, Closed
trim_8 = TrimTree(Tree=join_6.Breps, Depth=1)
item_16 = ListItem(List=trim_8, Index=0, Wrap=True)  # -> flatten(Item)
move_24 = Move(Geometry=item_16, Motion=vec_5)  # -> Geometry, Transform

brep = Brep(move_24.Geometry)
shift_2 = ShiftList(List=brep, Shift=-1, Wrap=True)
split = SplitBrep(Brep=brep, Cutter=shift_2)
area_6 = Area(Geometry=split)  # -> Area, Centroid
sort_5 = SortList(Keys=area_6.Area, ValuesA=split)  # -> Keys, reverse(ValuesA)
item_17 = ListItem(List=sort_5.ValuesA, Index=0, Wrap=True)
brep_2 = Brep(flatten(item_17))

item_18 = ListItem(List=brep_2, Index=0, Wrap=True)
item_19 = ListItem(List=brep_2, Index=1, Wrap=True)
number_slider_21 = Slider(1000, range=0..1000)
bbx = BrepBrep(BrepA=item_18, BrepB=item_19)  # -> Curves, Points
ext = ExtendCurve(Curve=bbx.Curves, Type=0, Start=number_slider_21, End=number_slider_21)
Y_16 = UnitY(Factor=Slider(10000, range=0..10000))
neg_8 = Negative(Value=Y_16)
extr = Extrude(Base=ext, Direction=neg_8)
split_2 = SplitBrep(Brep=item_18, Cutter=extr)
area_7 = Area(Geometry=split_2)  # -> Area, Centroid
pdecon_11 = Deconstruct(Point=area_7.Centroid)  # -> XComponent, YComponent, ZComponent
sort_6 = SortList(Keys=pdecon_11.ZComponent, ValuesA=split_2)  # -> Keys, reverse(ValuesA)
item_20 = ListItem(List=sort_6.ValuesA, Index=0, Wrap=True)

item_21 = ListItem(List=reverse(brep_2), Index=0, Wrap=True)
item_22 = ListItem(List=reverse(brep_2), Index=1, Wrap=True)
number_slider_22 = Slider(1000, range=0..1000)
bbx_2 = BrepBrep(BrepA=item_21, BrepB=item_22)  # -> Curves, Points
ext_2 = ExtendCurve(Curve=bbx_2.Curves, Type=0, Start=number_slider_22, End=number_slider_22)
Y_17 = UnitY(Factor=Slider(10000, range=0..10000))
extr_2 = Extrude(Base=ext_2, Direction=Y_17)
split_3 = SplitBrep(Brep=item_21, Cutter=extr_2)
area_8 = Area(Geometry=split_3)  # -> Area, Centroid
pdecon_12 = Deconstruct(Point=area_8.Centroid)  # -> XComponent, YComponent, ZComponent
sort_7 = SortList(Keys=pdecon_12.ZComponent, ValuesA=split_3)  # -> Keys, reverse(ValuesA)
item_23 = ListItem(List=sort_7.ValuesA, Index=0, Wrap=True)

brep_3 = Brep(brep_2)

lng_13 = ListLength(List=brep_3)
dom_14 = ConstructDomain(DomainStart=1, DomainEnd=expr("x-2", lng_13))
larger = LargerThan(FirstNumber=lng_13, SecondNumber=2)  # -> LargerThan, OrEqualTo
subset_10 = SubList(List=brep_3, Domain=dom_14, Wrap=True)  # -> List, Index
cull_10 = CullPattern(List=subset_10.List, CullPattern=larger.LargerThan)

lng_14 = ListLength(List=brep_2)  # -> expr("x-1", Length)
merge_16 = Merge(Data1=flatten(item_20), Data2=flatten(cull_10), Data3=flatten(item_23))
dom_15 = ConstructDomain(DomainStart=0, DomainEnd=lng_14)
subset_11 = SubList(List=merge_16, Domain=dom_15, Wrap=True)  # -> List, Index

debrep = DeconstructBrep(Brep=subset_11.List)  # -> simplify(Faces), Edges, Vertices
debrep_2 = DeconstructBrep(Brep=debrep.Faces)  # -> Faces, Edges, Vertices
pdecon_13 = Deconstruct(Point=debrep_2.Vertices)  # -> XComponent, YComponent, ZComponent
avr_3 = Average(Input=debrep_2.Vertices)
sort_8 = SortList(Keys=pdecon_13.XComponent)  # -> Keys, ValuesA
item_24 = ListItem(List=sort_8.Keys, Index=0, Wrap=True)
pdecon_14 = Deconstruct(Point=avr_3)  # -> XComponent, YComponent, ZComponent
trim_9 = TrimTree(Tree=pdecon_14.YComponent, Depth=1)
trim_10 = TrimTree(Tree=item_24, Depth=1)
sort_9 = SortList(Keys=trim_10, ValuesA=debrep.Faces, ValuesB=trim_9)  # -> Keys, ValuesA, ValuesB
round = Round(Number=sort_9.Keys)  # -> Nearest, Floor, Ceiling
cset = CreateSet(List=round.Nearest)  # -> Set, Map
c_script_10 = CSharpScript(valueSet=cset.Set, values=round.Nearest, others1=sort_9.ValuesA, others2=sort_9.ValuesB)  # -> out, A, B; inputs valueSet: tree of Double, values: tree of Double, others1: tree, others2: tree
# ---------- c_script_10: C# ----------
    DataTree<object> output1 = new DataTree<object>();
    DataTree<object> output2 = new DataTree<object>();

    for(int i = 0; i < values.BranchCount; i++)
    {
      for(int j = 0; j < values.Branch(i).Count; j++)
      {
        for(int v = 0; v < valueSet.Branch(i).Count; v++)
        {
          if(values.Branch(i)[j] == valueSet.Branch(i)[v])
          {
            output1.Add(others1.Branch(i)[j], new GH_Path(i, v));
            output2.Add(others2.Branch(i)[j], new GH_Path(i, v));
          }
        }
      }
    }
    A = output1;
    B = output2;
# ---------- end c_script_10 ----------
sort_10 = SortList(Keys=c_script_10.B, ValuesA=c_script_10.A)  # -> Keys, ValuesA
c_script_11 = CSharpScript(surfaces=sort_10.ValuesA)  # -> out, A; inputs surfaces: tree
# ---------- c_script_11: C# ----------
    //find longest branch for each panel
    List<int> longestBranchLength = new List<int>();
    int basePath = 0;
    for(int i = 0; i < surfaces.BranchCount; i++)
    {
      if(surfaces.Paths[i][0] == basePath)
      {
        if(longestBranchLength.Count == basePath)longestBranchLength.Add(surfaces.Branch(i).Count);
        if(surfaces.Branch(i).Count > longestBranchLength[basePath]) longestBranchLength[basePath] = surfaces.Branch(i).Count;
      }
      else 
      {
        basePath++;
        longestBranchLength.Add(surfaces.Branch(i).Count);
      }
    }
    
    DataTree<object> output = new DataTree<object>();
    //add surfaces to correct paths, flipping matrix but keeping rows straight
    for(int i = 0; i < surfaces.BranchCount; i++)
    {
      int offset = (longestBranchLength[surfaces.Paths[i][0]] - surfaces.Branch(i).Count) / 2;
      for(int j = 0; j < surfaces.Branch(i).Count; j++)
      {
        GH_Path path = new GH_Path(surfaces.Paths[i][0], j + offset);
        output.Add(surfaces.Branch(i)[j], path);
      }
    }
    A = output;
# ---------- end c_script_11 ----------
trim_11 = TrimTree(Tree=c_script_11.A, Depth=1)

brep_4 = Brep(subset_11.List)
join_7 = BrepJoin(Breps=brep_4)  # -> Breps, Closed
debrep_3 = DeconstructBrep(Brep=join_7.Breps)  # -> Faces, Edges, Vertices
pdecon_15 = Deconstruct(Point=debrep_3.Vertices)  # -> XComponent, YComponent, ZComponent
equalst = EqualityWithinTolerance(FirstNumber=pdecon_15.XComponent, SecondNumber="0", Tolerance=Slider(10, range=0..10))  # -> Equality, Inequality
cull_11 = CullPattern(List=debrep_3.Vertices, CullPattern=equalst.Equality)

# ---- group: surfaces
srf_9 = Surface(trim_11)

# ---- group: support points
pt_16 = Point(cull_11)

# ----
data_8 = Data(cull_6)
data_9 = Data(species_2)
dec_panel_buildups = DeconstructPanelBuildup(Panels=data_8)  # -> WoodSpecies, Thicknesses
tstat_2 = TreeStatistics(Tree=dec_panel_buildups.Thicknesses)  # -> Paths, Length, Count
lng_15 = ListLength(List=tstat_2.Paths)
dup_7 = DuplicateData(Data=data_9, Number=lng_15, Order=True)  # -> graft(Data)
dup_8 = DuplicateData(Data="4", Number=lng_15, Order=True)  # -> graft(Data)
match = MatchTree(Tree=dup_7, Guide=dec_panel_buildups.WoodSpecies)
match_2 = MatchTree(Tree=dup_8, Guide=dec_panel_buildups.Thicknesses)
merge_17 = Merge(Data1=dec_panel_buildups.WoodSpecies, Data2=match)
merge_18 = Merge(Data1=dec_panel_buildups.Thicknesses, Data2=match_2)

# ---- group: species
data_10 = Data(merge_17)

# ---- group: thicknesses
num_25 = Number(merge_18)

# ----
c_script_12 = CSharpScript(x=data_10)  # -> out, A; inputs x: tree
# ---------- c_script_12: C# ----------
    DataTree<object> output = new DataTree<object>();
    int firstIndex = 0;
    int branchCount = 0;
    for(int i = 0; i < x.BranchCount; i++)
    {
      GH_Path path = new GH_Path(firstIndex, branchCount);
      if(x.Paths[i][0] == firstIndex)
      {
        output.AddRange(x.Branch(i), path);
      }
      else
      {
        firstIndex++;
        branchCount = -1;
        i--;
      }
      branchCount++;
    }
    A = output;
# ---------- end c_script_12 ----------
c_script_13 = CSharpScript(x=num_25)  # -> out, A; inputs x: tree; same code as c_script_12

debrep_4 = DeconstructBrep(Brep=simplify(graft(move_24.Geometry)))  # -> simplify(Faces), Edges, Vertices
brep_5 = Brep(subset_11.List)
edges_2 = BrepEdges(Brep=brep_5)  # -> Naked, Interior, NonManifold
srf_10 = Surface(graft(debrep_4.Faces))
crv_16 = Curve(edges_2.Naked)
debrep_5 = DeconstructBrep(Brep=srf_10)  # -> Faces, Edges, simplify(Vertices)
join_8 = JoinCurves(Curves=crv_16, Preserve=False)  # -> simplify(Curves)
len_6 = Length(Curve=join_8)
group_3 = Group(Objects=debrep_5.Vertices)
sort_11 = SortList(Keys=len_6, ValuesA=join_8)  # -> Keys, reverse(ValuesA)
trim_12 = TrimTree(Tree=group_3, Depth=1)
lng_16 = ListLength(List=trim_12)
item_25 = ListItem(List=sort_11.ValuesA, Index=0, Wrap=True)
project = Project(Geometry=item_25, Plane=PlaneXY(0, 0, 0))  # -> Geometry, Transform
dup_9 = DuplicateData(Data=project.Geometry, Number=lng_16, Order=True)  # -> simplify(graft(Data))

project_2 = Project(Geometry=debrep_5.Vertices, Plane=PlaneXY(0, 0, 0))  # -> Geometry, Transform

incurve = PointInCurve(Point=project_2.Geometry, Curve=dup_9)  # -> Relationship, Point
equals = Equality(FirstNumber=incurve.Relationship, SecondNumber="0")  # -> Equality, Inequality
cull_12 = CullPattern(List=incurve.Relationship, CullPattern=equals.Inequality)
lng_17 = ListLength(List=cull_12)
larger_2 = LargerThan(FirstNumber=lng_17, SecondNumber="0")  # -> LargerThan, OrEqualTo

panel_3 = Panel(larger_2.LargerThan)

bool_3 = Boolean(larger_2.LargerThan)
cull_13 = CullPattern(List=c_script_12.A, CullPattern=bool_3)
cull_14 = CullPattern(List=c_script_13.A, CullPattern=bool_3)
clean_2 = CleanTree(RemoveNulls=True, RemoveInvalid=True, RemoveEmpty=True, Tree=cull_13)
clean_3 = CleanTree(RemoveNulls=True, RemoveInvalid=True, RemoveEmpty=True, Tree=cull_14)
c_script_14 = CSharpScript(x=clean_2)  # -> out, A; inputs x: tree; same code as c_script_12
c_script_15 = CSharpScript(x=clean_3)  # -> out, A; inputs x: tree; same code as c_script_12

# ---- group: species
data_11 = Data(c_script_14.A)

# ---- group: thicknesses
num_26 = Number(c_script_15.A)

# ----
lng_18 = ListLength(List=num_26)
bnd_12 = Bounds(Numbers=flatten(lng_18))
dedomain_16 = DeconstructDomain(Domain=bnd_12)  # -> Start, End
gradient_8 = Gradient(
    LowerLimit=dedomain_16.Start,
    UpperLimit=dedomain_16.End,
    Parameter=lng_18,
    stops=[0: RGB(255, 255, 255), 1: RGB(59, 59, 59)])
preview_9 = CustomPreview(Geometry=graft(srf_9), Material=gradient_8)

# ---- group: buildups
dec_secies = DeconstructSpecies(Species=data_11)  # -> N, LX, RX, TX, LE, RE, TE
cset_2 = CreateSet(List=dec_secies.N)  # -> Set, Map
material_buildups = Panel("""100
200
300
101
201
301""")

# ---- group: buildups / layer count
lng_19 = ListLength(List=dec_secies.N)

# ---- group: buildups / material type
lng_20 = ListLength(List=cset_2.Set)

# ---- group: buildups (continued)
c_script_16 = CSharpScript(layerCount=lng_19, materialCount=lng_20)  # -> out, A; inputs layerCount: tree of Int32, materialCount: tree of Int32
# ---------- c_script_16: C# ----------
    DataTree<int> keys = new DataTree<int>();
    
    for(int i = 0; i < layerCount.BranchCount;i++)
    {
      int lCount = layerCount.Branch(i)[0];
      int mCount = materialCount.Branch(i)[0];
      GH_Path path = layerCount.Paths[i];
      
      if(lCount == 3 && mCount == 1) keys.Add(0, path);
      if(lCount == 5 && mCount == 1) keys.Add(1, path);
      if(lCount == 7 && mCount == 1) keys.Add(2, path);
      if(lCount == 3 && mCount == 2) keys.Add(3, path);
      if(lCount == 5 && mCount == 2) keys.Add(4, path);
      if(lCount == 7 && mCount == 2) keys.Add(5, path);
      
    }
    A = keys;
# ---------- end c_script_16 ----------
item_26 = ListItem(List=material_buildups, Index=c_script_16.A, Wrap=True)

# ---- group: material ids
num_27 = Number(item_26)
