# Grasshopper definition BilayerDesign - Variable Thickness Eddy.gh (Grasshopper 1.0.7)
# plug-ins: HygroDesign, Pufferfish, MeshEdit Components, Karamba3D, Kangaroo2 Components, Weaverbird, Human, LunchBox, Utils, Sofistik, EleFront, Telepathy

number_slider = Slider(20, range=0..100)

number_slider_2 = Slider(1000, range=0..1000)
neg = Negative(Value=number_slider_2)
rectangle = Rectangle(Plane=PlaneXY(0, 0, 0), XSize=number_slider_2, YSize=neg, Radius=0)  # -> Rectangle, Length
drec = DeconstuctRectangle(Rectangle=rectangle.Rectangle)  # -> BasePlane, XInterval, YInterval
dedomain = DeconstructDomain(Domain=drec.XInterval)  # -> Start, End
dedomain_2 = DeconstructDomain(Domain=drec.YInterval)  # -> Start, End
pt = ConstructPoint(XCoordinate=dedomain.Start, YCoordinate=0, ZCoordinate=0)
pt_2 = ConstructPoint(XCoordinate=dedomain.End, YCoordinate=0, ZCoordinate=0)
subtraction = Subtraction(A=dedomain_2.End, B=dedomain_2.Start)
ln = Line(StartPoint=pt, EndPoint=pt_2)
number_slider_3 = Slider(0.4, range=0..0.5)
number_slider_4 = Slider(0.6, range=0.5..1)
divide = DivideCurve(Curve=ln, Count=expr("x-1", Slider(3, range=0..10)), Kinks=False)  # -> Points, Tangents, Parameters
multiplication = Multiplication(A=subtraction, B=Slider(1, range=0.5..1))
multiplication_2 = Multiplication(A=subtraction, B=Slider(0.2, range=0..0.5))
multiplication_3 = Multiplication(A=subtraction, B=Slider(0.8, range=0.5..1))
multiplication_4 = Multiplication(A=subtraction, B=Slider(0.3, range=0..1))
multiplication_5 = Multiplication(A=subtraction, B=number_slider_4)
multiplication_6 = Multiplication(A=subtraction, B=number_slider_4)
neg_2 = Negative(Value=multiplication_2)
neg_3 = Negative(Value=multiplication)
neg_4 = Negative(Value=multiplication_4)
neg_5 = Negative(Value=multiplication_3)
neg_6 = Negative(Value=multiplication_6)
neg_7 = Negative(Value=multiplication_5)
item = ListItem(List=divide.Points, Index=0, Wrap=True)  # -> Item, Item1, Item2
Y = UnitY(Factor=neg_2)
Y_2 = UnitY(Factor=neg_4)
Y_3 = UnitY(Factor=neg_3)
Y_4 = UnitY(Factor=neg_5)
Y_5 = UnitY(Factor=neg_6)
Y_6 = UnitY(Factor=neg_7)
move = Move(Geometry=[item.Item, item.Item2], Motion=Y)  # -> Geometry, Transform
move_2 = Move(Geometry=item.Item1, Motion=Y_3)  # -> Geometry, Transform
move_3 = Move(Geometry=[item.Item, item.Item2], Motion=Y_2)  # -> Geometry, Transform
move_4 = Move(Geometry=item.Item1, Motion=Y_4)  # -> Geometry, Transform
move_5 = Move(Geometry=[item.Item, item.Item2], Motion=Y_5)  # -> Geometry, Transform
move_6 = Move(Geometry=item.Item1, Motion=Y_6)  # -> Geometry, Transform
item_2 = ListItem(List=move.Geometry, Index=0, Wrap=True)  # -> Item, Item1
item_3 = ListItem(List=move_3.Geometry, Index=0, Wrap=True)  # -> Item, Item1
item_4 = ListItem(List=move_5.Geometry, Index=0, Wrap=True)  # -> Item, Item1
merge = Merge(Data1=flatten(item_2.Item), Data2=flatten(move_2.Geometry), Data3=flatten(item_2.Item1))
merge_2 = Merge(Data1=flatten(item_3.Item), Data2=flatten(move_4.Geometry), Data3=flatten(item_3.Item1))
merge_3 = Merge(Data1=flatten(item_4.Item), Data2=flatten(move_6.Geometry), Data3=flatten(item_4.Item1))
intcrv = Interpolate(Vertices=merge, Degree=3, Periodic=False, KnotStyle=1)  # -> Curve, Length, Domain
intcrv_2 = Interpolate(Vertices=merge_2, Degree=3, Periodic=False, KnotStyle=1)  # -> Curve, Length, Domain
intcrv_3 = Interpolate(Vertices=merge_3, Degree=3, Periodic=False, KnotStyle=1)  # -> Curve, Length, Domain
merge_4 = Merge(Data1=intcrv.Curve, Data2=intcrv_2.Curve, Data3=intcrv_3.Curve)
rec = Rectangle(rectangle.Rectangle)

board_count = Slider(200, range=0..500)
species = WoodSpecies(
    Name="beech",
    LExpansion=Slider(0.0001, range=0..0.0001),
    RExpansion=Slider(0.002, range=0..1),
    TExpansion=Slider(0.0041, range=0..1),
    LElasticModulus=Slider(14000, range=0..20000),
    RElasticModulus=Slider(2280, range=0..20000),
    TElasticModulus=Slider(1160, range=0..20000))
species_2 = WoodSpecies(
    Name="spruce",
    LExpansion=Slider(0.0001, range=0..0.0001),
    RExpansion=Slider(0.0019, range=0..1),
    TExpansion=Slider(0.0036, range=0..1),
    LElasticModulus=Slider(10000, range=0..20000),
    RElasticModulus=Slider(800, range=0..20000),
    TElasticModulus=Slider(450, range=0..20000))

xy = XYPlane(Origin=Point(0, 0, 0))
number_slider_5 = Slider(150, range=0..10000)
number_slider_6 = Slider(2500, range=0..10000)
number_slider_7 = Slider(10, range=0..10)
bilayer = Bilayer(
    BasePlane=xy,
    BoardWidth=number_slider_5,
    BoardLength=number_slider_6,
    WidthCount=number_slider,
    LengthCount=Slider(3, range=0..10),
    ActiveThickness=Slider(20, range=0..100),
    PassiveThickness=Slider(4, range=0..100),
    PassiveSpecies=species_2)
num = Number(number_slider_5)
num_2 = Number(number_slider_6)

# ---- group: name
num_3 = Number(board_count)
series = Series(Start=0, Step=1, Count=num_3)
dup = DuplicateData(Data="S", Number=num_3, Order=True)  # -> graft(Data)
txt = Text(graft(series))
merge_5 = Merge(Data1=dup, Data2=txt)  # -> simplify(Result)
join = TextJoin(Text=merge_5)  # -> flatten(Result)

# ---- group: active thickness
number_slider_8 = Slider(20, range=0..100)

# ---- group: RT
dom = ConstructDomain(DomainStart=Slider(15, range=0..100), DomainEnd=Slider(75, range=0..100))
random = Random(Range=dom, Number=board_count, Seed=Slider(225, range=0..1000))

# ---- group: name
num_4 = Number(board_count)
series_2 = Series(Start=0, Step=1, Count=num_4)
dup_2 = DuplicateData(Data="B", Number=num_4, Order=True)  # -> graft(Data)
txt_2 = Text(graft(series_2))
merge_6 = Merge(Data1=dup_2, Data2=txt_2)  # -> simplify(Result)
join_2 = TextJoin(Text=merge_6)  # -> flatten(Result)

# ---- group: thickness
num_5 = Number(number_slider_8)
num_6 = Number(board_count)
dup_3 = DuplicateData(Data=num_5, Number=num_6, Order=True)

# ---- group: length
num_7 = Number(num_2)
num_8 = Number(board_count)
dup_4 = DuplicateData(Data=num_7, Number=num_8, Order=True)

# ---- group: width
num_9 = Number(num)
num_10 = Number(board_count)
dup_5 = DuplicateData(Data=num_9, Number=num_10, Order=True)

# ---- group: beech
data = Data(species)

# ---- group: spruce
data_2 = Data(species_2)

# ---- group: bounding rectangle input (rectangle y domain represents full range of radii from stockpiles)
rec_2 = Rectangle(rec)

# ----
stock_boards = StockBoards(Name=join_2, Species=data, Thickness=dup_3, Length=dup_4, Width=dup_5, RTAngle=random)

# ---- group: curve controller inputs (represents distribution of radii along a given cross section)
crv = Curve(merge_4)

# ----
stock_boards_2 = StockBoards(Name=join, Species=data_2, Thickness=dup_3, Length=dup_4, Width=dup_5, RTAngle=random)
scale = Scale(Geometry=crv, Center=Point(0, 0, 0), Factor=Slider(0.001, range=0..0.001))  # -> Geometry, Transform
merge_7 = Merge(Data1=stock_boards, Data2=stock_boards_2)

crv_2 = Curve(crv)
lng = ListLength(List=crv_2)  # -> expr("x-2", Length)
dom_2 = ConstructDomain(DomainStart=0, DomainEnd=lng)
subset = SubList(List=crv_2, Domain=dom_2, Wrap=True)  # -> graft(List), Index
shift = ShiftList(List=crv_2, Shift=1, Wrap=False)  # -> graft(List)
merge_8 = Merge(Data1=subset.List, Data2=shift)  # -> simplify(Result)
group = Group(Objects=merge_8)  # -> flatten(Group)

deconstruct_bilayer = DeconstructBilayer(Bilayer=bilayer)
dec_board = DeconstructBoard(Board=deconstruct_bilayer)  # -> Polyline, Name, Species, RTAngle, MoistureChange, DesiredRadius, Radius, BlendedRadius, BoardRegions
area = Area(Geometry=dec_board.Polyline)  # -> Area, Centroid
c_script = CSharpScript(rects=flatten(dec_board.Polyline))  # -> out; inputs rects: list of Rectangle3d; disabled
# ---------- c_script: C# usings ----------
using Rhino.DocObjects;
# ---------- c_script: C# ----------
    var object_enumerator_settings = new ObjectEnumeratorSettings();

    var rhinoObjects = RhinoDoc.ActiveDoc.Objects.GetObjectList(object_enumerator_settings);
    var objectTable = RhinoDoc.ActiveDoc.Objects;

    foreach( var rhinoObject in rhinoObjects)
    {
      if(rhinoObject.ObjectType == ObjectType.Curve)
      {
        Curve rhinoCurve = rhinoObject.Geometry as Curve;
        if(rhinoCurve.IsClosed)objectTable.Delete(rhinoObject);
      }
    }

    foreach(var rect in rects)objectTable.AddCurve(rect.ToNurbsCurve());
# ---------- end c_script ----------
pt_3 = Point(simplify(area.Centroid))

# ---- group: generate distribution
pt_4 = Point(simplify(pt_3))
data_3 = Data(group)
pdecon = Deconstruct(Point=pt_4)  # -> XComponent, YComponent, ZComponent
bnd = Bounds(Numbers=flatten(pdecon.XComponent))
bnd_2 = Bounds(Numbers=flatten(pdecon.YComponent))
lng_2 = ListLength(List=data_3)
dedomain_3 = DeconstructDomain(Domain=bnd)  # -> Start, End
remap = RemapNumbers(Value=pdecon.YComponent, Source=bnd_2, Target=Domain(0, 1))  # -> graft(Mapped), Clipped
c_script_2 = CSharpScript(count=lng_2, start=dedomain_3.Start, end=dedomain_3.End)  # -> out, A; inputs count: Int32, start: Double, end: Double
# ---------- c_script_2: C# ----------
    double totalLength = end - start;
    double domLength = totalLength / (double) count;

    List<Interval> intervals = new List<Interval>();
    double currentStart = start;
    for(int i = 0; i < count; i++)
    {
      intervals.Add(new Interval(currentStart, currentStart + domLength));
      currentStart += domLength;
    }
    A = intervals;
# ---------- end c_script_2 ----------
num_11 = Number(graft(pdecon.XComponent))
inc = Includes(Value=num_11, Domain=simplify(c_script_2.A))  # -> Includes, Deviation
cull = CullPattern(List=data_3, CullPattern=inc.Includes)
item_5 = ListItem(List=cull, Index=0, Wrap=True)
cull_2 = CullPattern(List=c_script_2.A, CullPattern=inc.Includes)
ungroup = Ungroup(Group=item_5)  # -> simplify(Objects)
item_6 = ListItem(List=cull_2, Index=0, Wrap=True)
remap_2 = RemapNumbers(Value=num_11, Source=item_6, Target=Domain(0, 1))  # -> Mapped, Clipped
eval = EvaluateCurve(Curve=reparameterize(ungroup), Parameter=remap.Mapped)  # -> Point, Tangent, Angle
pdecon_2 = Deconstruct(Point=eval.Point)  # -> XComponent, YComponent, ZComponent
item_7 = ListItem(List=pdecon_2.YComponent, Index=0, Wrap=True)  # -> Item, Item1
twn2nums = TweenTwoNumbers(NumberA=item_7.Item, NumberB=item_7.Item1, Factor=remap_2.Mapped)
num_12 = Number(twn2nums)

# ----
bbox = BoundingBox(Content=dec_board.Polyline, Plane=PlaneXY(0, 0, 0), UnionBox=True)  # -> Box, Box_2
debox = DeconstructBox(Box=bbox.Box)  # -> Plane, X, Y, Z
dedomain_4 = DeconstructDomain(Domain=debox.X)  # -> Start, End
dedomain_5 = DeconstructDomain(Domain=debox.Y)  # -> Start, End
pt_5 = ConstructPoint(XCoordinate=dedomain_4.End, YCoordinate=dedomain_5.End, ZCoordinate=0)
pt_6 = ConstructPoint(XCoordinate=dedomain_4.Start, YCoordinate=dedomain_5.End, ZCoordinate=0)
pt_7 = ConstructPoint(XCoordinate=dedomain_4.Start, YCoordinate=dedomain_5.Start, ZCoordinate=0)
pt_8 = ConstructPoint(XCoordinate=dedomain_4.End, YCoordinate=dedomain_5.Start, ZCoordinate=0)
merge_9 = Merge(Data1=pt_5, Data2=pt_6, Data3=pt_7, Data4=pt_8)
nurbs = NurbsCurve(Vertices=merge_9, Degree=3, Periodic=False)  # -> Curve, Length, Domain

# ---- group: material / Species
crv_3 = Curve(nurbs.Curve)

# ---- group: material / beech
data_4 = Data(species)

# ---- group: material / spruce
data_5 = Data(species_2)

# ---- group: material
pt_9 = Point(graft(pt_3))
xz = XZPlane(Origin=pt_9)
pcx = CurvePlane(Curve=crv_3, Plane=xz)  # -> simplify(Points), ParamsC, ParamsP
pdecon_3 = Deconstruct(Point=pcx.Points)  # -> XComponent, YComponent, ZComponent
pdecon_4 = Deconstruct(Point=pt_9)  # -> XComponent, YComponent, ZComponent
smaller = SmallerThan(FirstNumber=pdecon_3.XComponent, SecondNumber=pdecon_4.XComponent)  # -> SmallerThan, OrEqualTo
not = GateNot(A=smaller.SmallerThan)
cull_3 = CullPattern(List=data_4, CullPattern=not)
cull_4 = CullPattern(List=data_5, CullPattern=smaller.SmallerThan)
merge_10 = Merge(Data1=cull_3, Data2=cull_4)  # -> simplify(Result)
path_mapper = PathMapper(merge_10, source="{A}", target="{0}")

# ----
dec_reg = DeconstructBoardRegion(BoardRegion=dec_board.BoardRegions)  # -> Polyline, Name, Species, RTAngle, MoistureChange, DesiredRadius, Radius, BlendedRadius, ThicknessBlendedRadius
area_2 = Area(Geometry=dec_reg.Polyline)  # -> Area, Centroid

# ---- group: Thickness
pt_10 = Point(simplify(area_2.Centroid))
pdecon_5 = Deconstruct(Point=pt_10)  # -> XComponent, YComponent, ZComponent
bnd_3 = Bounds(Numbers=flatten(pdecon_5.XComponent))
dom_3 = ConstructDomain(DomainStart=Slider(0.6, range=0..1.2), DomainEnd=Slider(0.21, range=0..1))
remap_3 = RemapNumbers(Value=pdecon_5.XComponent, Source=bnd_3, Target=dom_3)  # -> Mapped, Clipped
roundd = RoundToDecimalPlace(NumberX=remap_3.Mapped, DecimalPlace=Slider(10, range=0..10), RoundType=0)  # -> Rounded, Difference

# ----
pt_11 = Point(pt_3)
pdecon_6 = Deconstruct(Point=pt_11)  # -> XComponent, YComponent, ZComponent
bnd_4 = Bounds(Numbers=flatten(pdecon_6.XComponent))
dom_4 = ConstructDomain(DomainStart="1", DomainEnd="0")
remap_4 = RemapNumbers(Value=pdecon_6.XComponent, Source=bnd_4, Target=dom_4)  # -> simplify(Mapped), Clipped

num_13 = Number(num_12)
rec_3 = Rectangle(rec_2)
drec_2 = DeconstuctRectangle(Rectangle=rec_3)  # -> BasePlane, XInterval, YInterval
dom_5 = ConstructDomain(DomainStart=0, DomainEnd=1)
remap_5 = RemapNumbers(Value=num_13, Source=drec_2.YInterval, Target=dom_5)  # -> Mapped, Clipped
trim = TrimTree(Tree=remap_5.Mapped, Depth=1)

data_6 = Data(bilayer)
tag = TextTag3D(Location=pt_10, Text=remap_3.Mapped, Size=Slider(87, range=0..100), Justification=5)
update_bilayer = UpdateBilayer(Bilayer=data_6, Radius=trim, RadiusWeight=remap_4.Mapped, Material=path_mapper)
dup_bilayer = DuplicateBilayer(Bilayer=update_bilayer, Count=Slider(4, range=0..10))

# ---- group: moisture changes
step_size = Slider(4, range=0..10)
series_3 = Series(Start=step_size, Step=step_size, Count=Slider(4, range=0..10))
num_14 = Number(series_3)

panel = Panel("""2
4
8""")
num_15 = Number(panel)

# ----
panel_2 = Panel(Bilayers=dup_bilayer)
adjust_cro_sec = AdjustCrossSection(Panel=panel_2, Thicknesses=remap_3.Mapped)
dup_panel = DuplicatePanel(Panel=adjust_cro_sec, Count=Slider(2, range=0..10))
data_7 = Data(merge_7)
design_env = DesignEnvironment(Panels=dup_panel, StockBoards=data_7, MoistureChanges=num_15)  # -> Panels, StockBoards
cross_section = BooleanToggle(True)
relaxation = BooleanToggle(False)
convolution = CurvatureConvolution(
    Panels=design_env.Panels,
    TengentialBlending=Slider(0.34, range=0.01..3),
    LongitudinalBlending=Slider(0.3, range=0.01..3),
    MaxRadiusInfluence=100000,
    StiffnessFactor=0.1,
    ThicknessFactor=0.1,
    VisualizeBoardWeights=0)  # -> Panels, Weights
cull_5 = CullPattern(List=convolution.Panels, CullPattern=cross_section)
item_8 = ListItem(List=convolution.Panels, Index=0, Wrap=True)  # -> Item, Item1; disabled
crosecset = UniqueCrossSections(Panel=cull_5)
dec_reg_2 = DeconstructBoardRegion(BoardRegion=crosecset)  # -> Polyline, ThicknessBlendedRadius, Species, MoistureChange, DesiredRadius, Radius, BlendedRadius, ThicknessBlendedRadius_2, ThicknessBlendedRadius_3
number_slider_9 = Slider(3788, range=0..10000)  # disabled
number_slider_10 = Slider(1883, range=0..10000)  # disabled
number_slider_11 = Slider(5667, range=0..10000)  # disabled
number_slider_12 = Slider(7531, range=0..10000)  # disabled
Y_7 = UnitY(Factor=number_slider_9)  # disabled
Y_8 = UnitY(Factor=number_slider_10)  # disabled
Y_9 = UnitY(Factor=number_slider_11)  # disabled
Y_10 = UnitY(Factor=number_slider_12)  # disabled

vec = Vector(Y_9)  # disabled
data_8 = Data(item_8.Item)  # disabled
display_panel = DisplayPanels(Panels=data_8)  # -> ActiveBoards, PassiveBoards; disabled
deconstruct_panel = DeconstructPanel(Panel=data_8)  # disabled
deconstruct_bilayer_2 = DeconstructBilayer(Bilayer=deconstruct_panel)  # disabled
dec_board_2 = DeconstructBoard(Board=deconstruct_bilayer_2)  # -> Polyline, Name, Species, RTAngle, MoistureChange, DesiredRadius, Radius, BlendedRadius, BoardRegions; disabled
move_7 = Move(Geometry=display_panel.ActiveBoards, Motion=vec)  # -> Geometry, Transform; disabled
move_8 = Move(Geometry=display_panel.PassiveBoards, Motion=vec)  # -> Geometry, Transform; disabled
dec_reg_3 = DeconstructBoardRegion(BoardRegion=dec_board_2.BoardRegions)  # -> Polyline, Name, Species, RTAngle, MoistureChange, DesiredRadius, Radius, BlendedRadius, ThicknessBlendedRadius; disabled
bnd_5 = Bounds(Numbers=flatten(dec_reg_3.RTAngle))  # disabled
dedomain_6 = DeconstructDomain(Domain=bnd_5)  # -> Start, End; disabled
gradient = Gradient(
    LowerLimit=dedomain_6.Start,
    UpperLimit=dedomain_6.End,
    Parameter=dec_reg_3.RTAngle,
    stops=[0: RGB(124, 0, 219), 1: RGB(207, 130, 255)])  # disabled
swatch = ColourSwatch(SwatchColor=RGB(115, 115, 115))  # disabled
preview = CustomPreview(Geometry=move_7.Geometry, Material=gradient)  # disabled
preview_2 = CustomPreview(Geometry=move_8.Geometry, Material=swatch)  # disabled

bool = Boolean(relaxation)
Y_11 = UnitY(Factor=Slider(5928, range=0..10000))
Y_12 = UnitY(Factor=Slider(2905, range=0..10000))

cull_6 = CullPattern(List=cull_5, CullPattern=cross_section)
deconstruct_panel_2 = DeconstructPanel(Panel=cull_6)
deconstruct_bilayer_3 = DeconstructBilayer(Bilayer=deconstruct_panel_2)
dec_board_3 = DeconstructBoard(Board=deconstruct_bilayer_3)  # -> Polyline, Name, Species, RTAngle, MoistureChange, DesiredRadius, Radius, BlendedRadius, BoardRegions
dec_reg_4 = DeconstructBoardRegion(BoardRegion=dec_board_3.BoardRegions)  # -> Polyline, ThicknessBlendedRadius, Species, MoistureChange, DesiredRadius, Radius, BlendedRadius, ThicknessBlendedRadius_2, ThicknessBlendedRadius_3

division = Division(A=num, B=2)
addition = Addition(A=division, B=Slider(10, range=0..10))
material_buildups = Panel("""spruce3
spruce5
spruce7
spruceBeech3
spruceBeech5
sprucebeech7""")
number_slider_13 = Slider(100, range=0..100)
number_slider_14 = Slider(0.001, range=0..0.001)
toggle = BooleanToggle(True)

# ---- group: 2022 - Edgar
panel_3 = Panel("C:\Program Files\SOFiSTiK\2023\SOFiSTiK 2023\sof_cdb_w_edu-2023.dll")
entwine = Entwine(Branch00="C:\Program Files\SOFiSTiK\2023\SOFiSTiK 2023\wps.exe", Branch01=panel_3, FlattenInputs=True)  # -> simplify(Result)

# ---- group: Create_Data_Path
button = Button()

# ----
panel_4 = Panel("C:\Program Files\SOFiSTiK\2020\SOFiSTiK 2020\sof_cdb_w-70.dll")
sofistik_path = ValueList({"2022-Edgar": 1, "2022-Other Users": 2}, selected="2022-Edgar")
entwine_2 = Entwine(Branch00="C:\Program Files\SOFiSTiK\2020\SOFiSTiK 2020\wps.exe", Branch01=panel_4, FlattenInputs=True)  # -> simplify(Result)
filter = StreamFilter(Gate=sofistik_path, Stream0=entwine_2, Stream1=entwine)
bang = ExplodeTree(Data=filter)  # -> Branch0, Branch1
pathwps_exe = Data(bang.Branch0)
pathcdb_dll = FilePath(bang.Branch1)
pathinfo = PathInfo()  # -> Directory, Filename, Path
concat = Concatenate(FragmentA=pathinfo.Path)
concat_2 = Concatenate(FragmentA=pathinfo.Path, FragmentB="\", FragmentD="structure")
createfolder = CSharpScript(path=concat, create=button)  # -> out, A; inputs path: String, create: Boolean
# ---------- createfolder: C# ----------
 
    
    if (create)
    {    
      if(!System.IO.Directory.Exists(path))
        System.IO.Directory.CreateDirectory(path);
    }
# ---------- end createfolder ----------
panel_5 = Panel(concat)
panel_6 = Panel(concat_2)
path = Data(panel_6)

# ---- group: Sof_Meshing
button_2 = Button()
toggle_2 = BooleanToggle(True)

# ----
assemble_mesh_properties_sofimesh = AssembleMeshPropertiesSofiMesh(GroupDivisor="10000", Topo="ON 0", TolG="-0.005", HMin="0.13", Fein="0.13", EFak="1.8", Prog="1.8", NodeIndex=1000)

# ----
# timb no 11 ep 17136[N/mm2] g 667[N/mm2] e90 370[N/mm2] g90 50[N/mm2] gam 7.2[KN/m3]
panel_7 = Panel("beech")
# timb no 11 ep 12200[N/mm2] g 690[N/mm2] e90 370[N/mm2] g90 50[N/mm2] gam 4.8[KN/m3]
panel_8 = Panel("Süruce")

# ---- group: AQUA
material = Panel("""KOPF
UNIT 5
NORM 'DIN' 'en199x-200x' COUN 49 UNIT 5

HOLZ 1    C '24:1' E90 370 BEZ "=Spruce"
ARBL EPS BRUC SIG 1.300000[-]
HMAT 1 TYP FOUR NSP 0.100000 A 1

HOLZ 4  PLY '40:1' TMAX 10 BEZ "=Plywood 40 Cl.1 (EN 1995)"
ARBL EPS BRUC SIG 1.200000[-]
HMAT 4 TYP FOUR NSP 0.100000 A 1

STAH 6    S '235' TMAX 40 BEZ "=S 235 (EN 10025-2)" GAM 0.0
ARBL EPS GEBR SIG 1[-]
ARBL EPS BRUC SIG 1[-] TYP  EXT
HMAT 3 TYP FOUR NSP 0 A 1

HOLZ NR 20 ep 1713[N/mm2] g 880[N/mm2] e90 1000[N/mm2] g90 61[N/mm2] gam 7.2[KN/m3]


HOLZ NR 10 ep 12200[N/mm2] g 690[N/mm2] e90 370[N/mm2] g90 50[N/mm2] gam 4.8[KN/m3]


HOLZ NR 11 ep 370[N/mm2] g 690[N/mm2] e90 12200[N/mm2] g90 50[N/mm2] gam 4.8[KN/m3]

MLAY NR 100  T0 {0}[mm]  11 $$
             T1 {1}[mm]  10 $$
             T2 {0}[mm]  11 Bez 'Bilayer'

MLAY NR 101  T0 {0}[mm]  11 $$
             T1 {1}[mm]  20 $$
             T2 {0}[mm]  11 Bez 'BilayerB'

MLAY NR 200  T0 {0}[mm]  11 $$
             T1 {1}[mm]  10 $$
	     T3 {0}[mm]  11 $$
             T4 {1}[mm]  10 $$
             T5 {0}[mm]  11 Bez '2Bilayer'

MLAY NR 201  T0 {0}[mm]  11 $$
             T1 {1}[mm]  20 $$
	     T3 {0}[mm]  11 $$
             T4 {1}[mm]  20 $$
             T5 {0}[mm]  11 Bez '2BilayerB'

MLAY NR 300  T0 {0}[mm]  11 $$
             T1 {1}[mm]  10 $$
	     T2 {0}[mm]  11 $$
             T3 {1}[mm]  10 $$
	     T4 {0}[mm]  11 $$
             T5 {1}[mm]  10 $$
             T6 {0}[mm]  11 Bez '3Bilayer'

MLAY NR 301  T0 {0}[mm]  11 $$
             T1 {1}[mm]  20 $$
	     T2 {0}[mm]  11 $$
             T3 {1}[mm]  20 $$
	     T4 {0}[mm]  11 $$
             T5 {1}[mm]  20 $$
             T6 {0}[mm]  11 Bez '3BilayerB'""")
panel_9 = Panel("20")
panel_10 = Panel("4")
format = Format(Format=material, Culture=127, Data0=panel_10, Data1=panel_9)
panel_11 = Panel(format)
aqua_file = Data(panel_11)

# ----
# Ase: +prog ase urs:5 $ SINGLE LCs
# kopf
# steu solv 4
# WARN = 120,575
# syst prob line iter 1000
# lf 1000 egz 1.0 bez 'G'
# ende
number_slider_15 = Slider(0.05, range=0..0.1)

# ----
# ASE
ase = Panel("""+prog ase urs:5 $ SINGLE LCs
kopf
steu solv 4
WARN = 120,575
syst prob line iter 1000
lf 1000 egz 1.0 bez 'G'
ende""")
# SLS: $--------------------------
# $SOLVER
# #define SOLV = 4 $4 = paralleles Rechnen
# #define WARN = 120,575
# $SYSTEM
# #define PROB = TH3
# #define nITER = 250
# #define FMAX = 1.1
# #define TOL = -0.0001
# #define NMAT = nein
# #define ITER = 3 W2 1 $3 W2 1 = Update Steifigkeit nach jedem Iterationsschritt
# $SEILE
# #define SEIL = 0 $0=ohne inneren Seildurchhang; 2=mit
# $Deadload
# #define G=1.00
# $--------------------------
# 
# +PROG ASE
# #define LF =100
# #define BEZ='1.0G+1.0Gadd'
# KOPF LF$(LF): $(BEZ)
# STEU SOLV $(SOLV) ; STEU ITER $(ITER) ; STEU SEIL $(SEIL)
# SYST PROB $(PROB) ITER $(nITER) FMAX $(FMAX) TOL $(TOL) NMAT $(NMAT)
# STEU WARN $(WARN)
# GRUP      -  $ alle Gruppen einschalten
# 
# LF $(LF) EGZ $(G)*1.0 BEZ $(BEZ)
# LC 1001 FAKT 1.0 $Gadd
# ENDE
# 
# +PROG ASE
# #define LF =101
# #define BEZ='1.0G+1.0Gadd+1.0Code'
# KOPF LF$(LF): $(BEZ)
# STEU SOLV $(SOLV) ; STEU ITER $(ITER) ; STEU SEIL $(SEIL)
# SYST PROB $(PROB) ITER $(nITER) FMAX $(FMAX) TOL $(TOL) NMAT $(NMAT)
# STEU WARN $(WARN)
# GRUP      -  $ alle Gruppen einschalten
# 
# LF $(LF) EGZ $(G)*1.0 BEZ $(BEZ)
# LC 1001 FAKT 1.0 $Gadd
# LC 1002 FAKT 1.0 $Code
# ENDE
# 
# +PROG ASE
# #define LF =102
# #define BEZ='1.0G+1.0Gadd+1.0Code+1.0Q1'
# KOPF LF$(LF): $(BEZ)
# STEU SOLV $(SOLV) ; STEU ITER $(ITER) ; STEU SEIL $(SEIL)
# SYST PROB $(PROB) ITER $(nITER) FMAX $(FMAX) TOL $(TOL) NMAT $(NMAT)
# STEU WARN $(WARN)
# GRUP      -  $ alle Gruppen einschalten
# 
# LF $(LF) EGZ $(G)*1.0 BEZ $(BEZ)
# LC 1001 FAKT 1.0 $Gadd
# LC 1002 FAKT 1.0 $Code
# LC 1003 FAKT 1.0 $Q1
# ENDE
sls = Panel("""$--------------------------
$SOLVER
#define SOLV = 4 $4 = paralleles Rechnen
#define WARN = 120,575
$SYSTEM
#define PROB = TH2
#define nITER = 250
#define FMAX = 1.1
#define TOL = -0.01
#define NMAT = nein
#define ITER = 3 W2 1 $3 W2 1 = Update Steifigkeit nach jedem Iterationsschritt
$SEILE
#define SEIL = 0 $0=ohne inneren Seildurchhang; 2=mit
$Deadload
#define G=1.00
$--------------------------

+PROG ASE
#define LF =101
#define BEZ='1.0G+1.0Gadd+1.0Code'
KOPF LF$(LF): $(BEZ)
STEU SOLV $(SOLV) ; STEU ITER $(ITER) ; STEU SEIL $(SEIL)
SYST PROB $(PROB) ITER $(nITER) FMAX $(FMAX) TOL $(TOL) NMAT $(NMAT)
STEU WARN $(WARN)
GRUP      -  $ alle Gruppen einschalten

LF $(LF) EGZ $(G)*1.0 BEZ $(BEZ)
LC 1001 FAKT 1.0 $Gadd
LC 1002 FAKT 1.0 $Code
ENDE""")
# ULS: $--------------------------
# $SOLVER
# #define SOLV = 4 $4 = paralleles Rechnen
# #define WARN =  120,575
# $SYSTEM
# #define PROB = TH3
# #define nITER = 250
# #define FMAX = 1.1
# #define TOL = -0.0001
# #define NMAT = nein
# #define ITER = 3 W2 1 $3 W2 1 = Update Steifigkeit nach jedem Iterationsschritt
# $SEILE
# #define SEIL = 0 $0=ohne inneren Seildurchhang; 2=mit
# $Deadload
# #define G=1.00
# $--------------------------
# 
# +PROG ASE
# #define LF =200
# #define BEZ='1.35G+1.35Gadd'
# KOPF LF$(LF): $(BEZ)
# STEU SOLV $(SOLV) ; STEU ITER $(ITER) ; STEU SEIL $(SEIL)
# SYST PROB $(PROB) ITER $(nITER) FMAX $(FMAX) TOL $(TOL) NMAT $(NMAT)
# STEU WARN $(WARN)
# GRUP      -  $ alle Gruppen einschalten
# 
# LF $(LF) EGZ $(G)*1.35 BEZ $(BEZ)
# LC 1001 FAKT 1.35 $Gadd
# ENDE
# 
# +PROG ASE
# #define LF =201
# #define BEZ='1.35G+1.35Gadd+1.5Code'
# KOPF LF$(LF): $(BEZ)
# STEU SOLV $(SOLV) ; STEU ITER $(ITER) ; STEU SEIL $(SEIL)
# SYST PROB $(PROB) ITER $(nITER) FMAX $(FMAX) TOL $(TOL) NMAT $(NMAT)
# STEU WARN $(WARN)
# GRUP      -  $ alle Gruppen einschalten
# 
# LF $(LF) EGZ $(G)*1.35 BEZ $(BEZ)
# LC 1001 FAKT 1.35 $Gadd
# LC 1002 FAKT 1.5 $Code
# ENDE
# 
# +PROG ASE
# #define LF =202
# #define BEZ='1.35G+1.35Gadd+1.5Code+1.5Q1'
# KOPF LF$(LF): $(BEZ)
# STEU SOLV $(SOLV) ; STEU ITER $(ITER) ; STEU SEIL $(SEIL)
# SYST PROB $(PROB) ITER $(nITER) FMAX $(FMAX) TOL $(TOL) NMAT $(NMAT)
# STEU WARN $(WARN)
# GRUP      -  $ alle Gruppen einschalten
# 
# LF $(LF) EGZ $(G)*1.35 BEZ $(BEZ)
# LC 1001 FAKT 1.35 $Gadd
# LC 1002 FAKT 1.5 $Code
# LC 1003 FAKT 1.5 $Q1
# ENDE
uls = Panel("""$--------------------------
$SOLVER
#define SOLV = 4 $4 = paralleles Rechnen
#define WARN =  120,575
$SYSTEM
#define PROB = TH2
#define nITER = 250
#define FMAX = 1.1
#define TOL = -0.01
#define NMAT = nein
#define ITER = 3 W2 1 $3 W2 1 = Update Steifigkeit nach jedem Iterationsschritt
$SEILE
#define SEIL = 0 $0=ohne inneren Seildurchhang; 2=mit
$Deadload
#define G=1.00
$--------------------------

+PROG ASE
#define LF =201
#define BEZ='1.35G+1.35Gadd+1.5Code'
KOPF LF$(LF): $(BEZ)
STEU SOLV $(SOLV) ; STEU ITER $(ITER) ; STEU SEIL $(SEIL)
SYST PROB $(PROB) ITER $(nITER) FMAX $(FMAX) TOL $(TOL) NMAT $(NMAT)
STEU WARN $(WARN)
GRUP      -  $ alle Gruppen einschalten

LF $(LF) EGZ $(G)*1.35 BEZ $(BEZ)
LC 1001 FAKT 1.35 $Gadd
LC 1002 FAKT 1.5 $Code
ENDE""")
merge_11 = Merge(Data1=ase, Data2=sls, Data3=uls)

# ---- group: Loading / Random Point Load / Point Load
panel_12 = Panel("1003")
panel_13 = Panel("pzz")
panel_14 = Panel("-1.0")

# ----
toggle_3 = BooleanToggle(False)
panel_15 = Panel("""101 SLS - Deform
202 ULS - Stresses""")
number_slider_16 = Slider(6000, range=0..10000)

# ---- group: Deformation / mm
kragarmlänge = Data()
multiplication_7 = Multiplication(A=kragarmlänge, B=1000)
division_2 = Division(A=multiplication_7, B="150")
panel_16 = Panel(division_2)

# ---- group: Manual Stress Calculation
python = GhPythonScript(E0="11000", E90="400", t1="5", t2="20", nxx="5", mxx="0.5", nyy="5", myy="0.5")  # -> out, sigma_x_top, sigma_x_bot, sig_y_top_1, sig_y_int_1, sig_y_int_2, sig_y_bot_2
# ---------- python: Python ----------
import math 

# -------------- X direction -------------
Ax  = t2
Wxx = Ax*Ax/6

sigma_nx    = nxx / Ax
sigma_mxx   = mxx / Wxx * 1000
sigma_x_top = sigma_nx - sigma_mxx
sigma_x_bot = sigma_nx + sigma_mxx


# -------------- Y direction -------------
by_eq   = E90/E0
Ay_1    = t1
Ay_2    = t2 * by_eq
Ay_eq   = Ay_1 + Ay_2 
zg_y_1  = t1/2
zg_y_2  = t1 + t2/2
zg_y    = (zg_y_1 * Ay_1 + zg_y_2 * Ay_2) / Ay_eq
Iyy_1   = t1*t1*t1/12
Iyy_2   = t2*t2*t2/12*by_eq
Iyy     = Iyy_1 + Iyy_2 + math.pow(zg_y - zg_y_1,2)*Ay_1 + math.pow(zg_y - zg_y_2,2)*Ay_2

eps_y_top = myy / Iyy / E0 * (0 - zg_y) * 1000         + nyy / Ay_eq / E0
eps_y_int = myy / Iyy / E0 * (t1 - zg_y) * 1000        + nyy / Ay_eq / E0
eps_y_bot = myy / Iyy / E0 * (t1 + t2 - zg_y) * 1000   + nyy / Ay_eq / E0

sig_y_top_1 = eps_y_top * E0
sig_y_int_1 = eps_y_int * E0 
sig_y_int_2 = eps_y_int * E90 
sig_y_bot_2 = eps_y_bot * E90
# ---------- end python ----------
panel_17 = Panel([python.sig_y_top_1, python.sig_y_int_1, python.sig_y_int_2, python.sig_y_bot_2])

# ---- group: Manual Stress Calculation / Make sure you have used the same setting for analysis!
panel_18 = Panel("5")
panel_19 = Panel("20")
panel_20 = Panel("11000")
panel_21 = Panel("400")

# ----
panel_22 = Panel("150")

fonts = FontTable()
item_9 = ListItem(List=fonts, Index=Slider(28, range=0..436), Wrap=True)
panel_23 = Panel(item_9)

crv_4 = Curve(dec_reg_2.Polyline)
area_3 = Area(Geometry=crv_4)  # -> Area, Centroid
avr = Average(Input=area_3.Centroid)
bbox_2 = BoundingBox(Content=flatten(avr), Plane=PlaneXY(0, 0, 0), UnionBox=True)  # -> Box, Box_2
debox_2 = DeconstructBox(Box=bbox_2.Box)  # -> Plane, X, Y, Z
dedomain_7 = DeconstructDomain(Domain=debox_2.X)  # -> Start, End
subtraction_2 = Subtraction(A=dedomain_7.End, B=dedomain_7.Start)

panel_24 = Panel(crv_4)
trim_2 = TrimTree(Tree=crv_4, Depth=1)

bbox_3 = BoundingBox(Content=trim_2, Plane=PlaneXY(0, 0, 0), UnionBox=True)  # -> Box, Box_2
debox_3 = DeconstructBox(Box=bbox_3.Box)  # -> Plane, X, Y, Z
dedomain_8 = DeconstructDomain(Domain=debox_3.X)  # -> Start, End
subtraction_3 = Subtraction(A=dedomain_8.End, B=dedomain_8.Start)
area_4 = Area(Geometry=bbox_3.Box)  # -> Area, Centroid
division_3 = Division(A=subtraction_3, B=subtraction_2)
scale_2 = Scale(Geometry=avr, Center=area_4.Centroid, Factor=division_3)  # -> Geometry, Transform
yz = YZPlane(Origin=scale_2.Geometry)

num_16 = Number(num)
num_17 = Number(dec_reg_2.ThicknessBlendedRadius)
pln = Plane(yz)
c_script_3 = CSharpScript(iRadii=num_17, iBoardWidth=num_16, iPlanes=pln)  # -> out, simplify(A); inputs iRadii: tree of Double, iBoardWidth: Double, iPlanes: tree of Plane
# ---------- c_script_3: C# ----------
    DataTree<Point3d> pointTree = new DataTree<Point3d>();

    for (int j = 0; j < iRadii.BranchCount; j++)
    {

      //initialize variables
      Plane bp = iPlanes.Branch(j)[0];
      Point3d startPoint = new Point3d(bp.Origin);
      Point3d centerPoint = startPoint;
      Vector3d rotationAxis = new Vector3d(bp.ZAxis);
      Vector3d centerPointVect = new Vector3d(bp.YAxis);
      centerPointVect.Rotate(Math.PI / 2, rotationAxis);

      for (int i = 0; i < iRadii.Branch(j).Count; i++){
        GH_Path pth = iRadii.Paths[j].AppendElement(i);
        Point3d point1 = startPoint;
        Point3d point2 = startPoint;

        pointTree.Add(point1, pth);

        //calculate rotation angle
        Double arcLength = iBoardWidth;
        Double radius = iRadii.Branch(j)[i];
        Double rotation = (arcLength / radius);

        //calculate rotation center point
        centerPointVect.Unitize();
        centerPointVect *= radius;
        centerPoint += centerPointVect;


        //execute half rotation
        Transform tx = Transform.Rotation(rotation / 2, rotationAxis, centerPoint);


        point2.Transform(tx);
        pointTree.Add(point2, pth);

        //execute full rotation
        tx = Transform.Rotation(rotation, rotationAxis, centerPoint);
        startPoint.Transform(tx);
        pointTree.Add(startPoint, pth);

        //updata rotation parameters
        centerPoint = startPoint;
        centerPointVect.Transform(tx);
      }
    }
    A = pointTree;
# ---------- end c_script_3 ----------

panel_25 = Panel(num_17)

trim_3 = TrimTree(Tree=c_script_3.A, Depth=1)
cullpt = CullDuplicates(Points=trim_3, Tolerance=0.1, CullMode=3)  # -> Points, Indices, Valence
pt_12 = Point(cullpt.Points)

# ---- group: animate
pt_13 = Point(simplify(pt_12))
pln_2 = Plane(graft(pln))
num_18 = Number(Slider(1, range=0..1))
c_script_4 = CSharpScript(iPoints=simplify(pt_13), iPlanes=pln_2, iShapeFactor=num_18)  # -> out, A; inputs iPoints: tree of Point3d, iPlanes: tree of Plane, iShapeFactor: Double
# ---------- c_script_4: C# ----------
    DataTree<Point3d> output = new DataTree<Point3d>();
    
    double shapeFactor = 1.0 - iShapeFactor;

    //step through curves
    for (int i = 0; i < iPoints.BranchCount; i++)
    {
      Plane currentPlane = iPlanes.Branch(iPoints.Path(i)[0])[0];

      //get vectors from plane
      Vector3d zVect = currentPlane.YAxis;

      Vector3d rotVect = currentPlane.ZAxis;

      //create new startpoint inside list
      Point3d startPoint = iPoints.Branch(i)[0];

      //step through points. Create and rotate vectors
      for (int j = 0; j < iPoints.Branch(i).Count; j++)
      {
        if (j == 0) output.Add(startPoint, iPoints.Path(i));
        else{
          //create current segment vector
          Vector3d segmentVect = new Vector3d(iPoints.Branch(i)[j] - iPoints.Branch(i)[j - 1]);

          //measure angle with vertical vector
          double angle = Vector3d.VectorAngle(zVect, segmentVect, currentPlane);

          //rotate
          segmentVect.Rotate(-angle * shapeFactor, rotVect);

          startPoint += segmentVect;
          output.Add(startPoint, iPoints.Path(i));
        }
      }
    }

    A = output;
# ---------- end c_script_4 ----------
pt_14 = Point(c_script_4.A)
intcrv_4 = Interpolate(Vertices=pt_14, Degree=3, Periodic=False, KnotStyle=1)  # -> Curve, Length, Domain
crv_5 = Curve(intcrv_4.Curve)

# ----
crv_6 = Curve(crv_5)
pt_15 = Point(simplify(graft(scale_2.Geometry)))
end = EndPoints(Curve=crv_6)  # -> Start, End
vec2pt = Vector2Pt(PointA=end.Start, PointB=end.End, Unitize=False)  # -> Vector, Length
yz_2 = YZPlane(Origin=end.Start)
Y_13 = UnitY(Factor="-1")
angle = Angle(VectorA=vec2pt.Vector, VectorB=Y_13, Plane=yz_2)  # -> Angle, Reflex
rotate = Rotate(Geometry=crv_6, Angle=angle.Angle, Plane=yz_2)  # -> Geometry, Transform
curvepoint = PointOnCurve(rotate.Geometry, parameter=0.5)
vec2pt_2 = Vector2Pt(PointA=curvepoint, PointB=pt_15, Unitize=False)  # -> Vector, Length
move_9 = Move(Geometry=rotate.Geometry, Motion=vec2pt_2.Vector)  # -> Geometry, Transform
path_mapper_2 = PathMapper(move_9.Geometry, source=["{A;B}", "{A}"], target=["{A}", "{0}"])
crv_7 = Curve(path_mapper_2)
loft = Loft(Curves=crv_7, Options={Adjust=False, Closed=False, LoftEnds=0, LoftSimp=0, LoftType=2, Rebuild=10, Refit=0.01})

cull_7 = CullPattern(List=loft, CullPattern=bool)

number_slider_17 = Slider(8, range=0..100)
srf = Surface(cull_7)
num_19 = Number(number_slider)
quads = QuadPanels(Surface=srf, UDivisions=number_slider_17, VDivisions=num_19)
srf_2 = Surface(reparameterize(simplify(quads)))

smesh = SimpleMesh(Brep=srf_2)
area_5 = MeshArea(Mesh=smesh)  # -> Area, Centroid
meshcp = MeshClosestPoint(Point=area_5.Centroid, Mesh=smesh)  # -> Point, Index, Parameter
meval = MeshEval(Mesh=smesh, Parameter=meshcp.Parameter)  # -> Point, Normal, Colour
pl = PlaneNormal(Origin=meval.Point, ZAxis=meval.Normal)
X = UnitX(Factor=1)
deplane = DeconstructPlane(Plane=pl)  # -> Origin, XAxis, YAxis, ZAxis
angle_2 = Angle(VectorA=deplane.XAxis, VectorB=X, Plane=pl)  # -> Angle, Reflex
rotate_2 = Rotate(Geometry=pl, Angle=angle_2.Angle, Plane=pl)  # -> graft(Geometry), Transform

medges = MeshEdges(Mesh=smesh)  # -> simplify(NakedEdges), InteriorEdges, NonManifoldEdges
curvepoint_2 = PointOnCurve(medges.NakedEdges, parameter=0.5)
plcoord = PlaneCoordinates(Point=curvepoint_2, System=rotate_2.Geometry)  # -> XCoordinate, YCoordinate, ZCoordinate
sort = SortList(Keys=plcoord.XCoordinate, ValuesA=medges.NakedEdges)  # -> Keys, ValuesA
item_10 = ListItem(List=reverse(sort.ValuesA), Index=0, Wrap=True)
item_11 = ListItem(List=sort.ValuesA, Index=0, Wrap=True)

merge_12 = Merge(Data1=item_11, Data2=item_10)
trim_4 = TrimTree(Tree=merge_12, Depth=1)
rdlines = RemoveDuplicateLinesKaramba3D(Line=trim_4, LimitDistance=0.005)  # -> OutLine, Info, Indexes
join_3 = JoinCurves(Curves=rdlines.OutLine, Preserve=False)
explode = Explode(Curve=join_3, Recursive=True)  # -> Segments, simplify(Vertices)
pline = PolyLine(Vertices=explode.Vertices, Closed=False)  # -> simplify(graft(Polyline))
path_mapper_3 = PathMapper(pline, source=["{A}", "{A;B}"], target=["{0}", "{A}"])
curvepoint_3 = PointOnCurve(path_mapper_3, parameter=0.5)
pdecon_7 = Deconstruct(Point=curvepoint_3)  # -> XComponent, YComponent, ZComponent
sort_2 = SortList(Keys=pdecon_7.XComponent, ValuesA=path_mapper_3)  # -> Keys, ValuesA
crv_8 = Curve(sort_2.ValuesA)

crv_9 = Curve(crv_8)
item_12 = ListItem(List=crv_9, Index=0, Wrap=True)
curvepoint_4 = PointOnCurve(crv_9, parameter=0.5)
curvepoint_5 = PointOnCurve(item_12, parameter=0.5)
vec2pt_3 = Vector2Pt(PointA=curvepoint_5, PointB=curvepoint_4, Unitize=False)  # -> Vector, Length
move_10 = Move(Geometry=item_12, Motion=vec2pt_3.Vector)  # -> Geometry, Transform

crv_10 = Curve(crv_8)
flip = FlipCurve(Curve=crv_10, Guide=move_10.Geometry)  # -> Curve, Flag

explode_2 = Explode(Curve=flip.Curve, Recursive=True)  # -> simplify(Segments), Vertices
explode_3 = Explode(Curve=move_10.Geometry, Recursive=True)  # -> simplify(Segments), Vertices
lng_3 = ListLength(List=explode_2.Segments)
lng_4 = ListLength(List=explode_2.Segments)
lng_5 = ListLength(List=explode_3.Segments)
lng_6 = ListLength(List=explode_3.Segments)
subtraction_4 = Subtraction(A=lng_3, B=2)
subtraction_5 = Subtraction(A=lng_4, B=1)
subtraction_6 = Subtraction(A=lng_5, B=2)
subtraction_7 = Subtraction(A=lng_6, B=1)
dom_6 = ConstructDomain(DomainStart=0, DomainEnd=subtraction_4)
dom_7 = ConstructDomain(DomainStart=1, DomainEnd=subtraction_5)
dom_8 = ConstructDomain(DomainStart=0, DomainEnd=subtraction_6)
dom_9 = ConstructDomain(DomainStart=1, DomainEnd=subtraction_7)
subset_2 = SubList(List=explode_2.Segments, Domain=dom_6, Wrap=True)  # -> List, Index
subset_3 = SubList(List=explode_2.Segments, Domain=dom_7, Wrap=True)  # -> List, Index
subset_4 = SubList(List=explode_3.Segments, Domain=dom_8, Wrap=True)  # -> List, Index
subset_5 = SubList(List=explode_3.Segments, Domain=dom_9, Wrap=True)  # -> List, Index
angle_3 = Angle(VectorA=subset_4.List, VectorB=subset_5.List)  # -> simplify(Angle), Reflex
angle_4 = Angle(VectorA=subset_2.List, VectorB=subset_3.List)  # -> simplify(Angle), Reflex
num_20 = Number(angle_3.Angle)
num_21 = Number(angle_4.Angle)

explode_4 = Explode(Curve=flip.Curve, Recursive=True)  # -> simplify(Segments), Vertices
explode_5 = Explode(Curve=move_10.Geometry, Recursive=True)  # -> simplify(Segments), Vertices
path_mapper_4 = PathMapper(explode_4.Segments, source=["{A}(i)", "{A;B}(i)"], target=["{i}(A)", "{A;i}(B)"])
path_mapper_5 = PathMapper(explode_5.Segments, source=["{A}(i)", "{A;B}(i)"], target=["{i}(A)", "{A;i}(B)"])
crv_11 = Curve(path_mapper_5)
crv_12 = Curve(path_mapper_4)
lng_7 = ListLength(List=crv_12)  # -> expr("x-2", Length)
lng_8 = ListLength(List=crv_11)  # -> expr("x-2", Length)
lng_9 = ListLength(List=crv_12)  # -> expr("x-1", Length)
lng_10 = ListLength(List=crv_11)  # -> expr("x-1", Length)
dom_10 = ConstructDomain(DomainStart=0, DomainEnd=lng_7)
dom_11 = ConstructDomain(DomainStart=0, DomainEnd=lng_8)
dom_12 = ConstructDomain(DomainStart=1, DomainEnd=lng_9)
dom_13 = ConstructDomain(DomainStart=1, DomainEnd=lng_10)
subset_6 = SubList(List=crv_12, Domain=dom_10, Wrap=True)  # -> graft(List), Index
subset_7 = SubList(List=crv_11, Domain=dom_11, Wrap=True)  # -> graft(List), Index
subset_8 = SubList(List=crv_12, Domain=dom_12, Wrap=True)  # -> graft(List), Index
subset_9 = SubList(List=crv_11, Domain=dom_13, Wrap=True)  # -> graft(List), Index
loft_2 = Loft(
    Curves=[subset_6.List, subset_8.List],
    Options={Adjust=False, Closed=False, LoftEnds=0, LoftSimp=0, LoftType=0, Rebuild=10, Refit=0.01})  # -> simplify(Loft)
loft_3 = Loft(
    Curves=[subset_7.List, subset_9.List],
    Options={Adjust=False, Closed=False, LoftEnds=0, LoftSimp=0, LoftType=0, Rebuild=10, Refit=0.01})  # -> simplify(Loft)
smesh_2 = SimpleMesh(Brep=loft_2)
smesh_3 = SimpleMesh(Brep=loft_3)
path_mapper_6 = PathMapper(smesh_3, source=["{A;B;C}", "{A;B}"], target=["{A}", "{0}"])
path_mapper_7 = PathMapper(smesh_2, source=["{A;B;C}", "{A;B}"], target=["{A}", "{0}"])
mjoin = MeshJoin(Meshes=path_mapper_6)
mjoin_2 = MeshJoin(Meshes=path_mapper_7)
weld = WeldMesh(Mesh=mjoin, Angle=3.141592654)
weld_2 = WeldMesh(Mesh=mjoin_2, Angle=3.141592654)

vec_2 = Vector(Y_10)  # disabled
data_9 = Data(item_8.Item)  # disabled
display_panel_2 = DisplayPanels(Panels=data_9)  # -> ActiveBoards, PassiveBoards; disabled
deconstruct_panel_3 = DeconstructPanel(Panel=data_9)  # disabled
deconstruct_bilayer_4 = DeconstructBilayer(Bilayer=deconstruct_panel_3)  # disabled
move_11 = Move(Geometry=display_panel_2.ActiveBoards, Motion=vec_2)  # -> Geometry, Transform; disabled
move_12 = Move(Geometry=display_panel_2.PassiveBoards, Motion=vec_2)  # -> Geometry, Transform; disabled
dec_board_4 = DeconstructBoard(Board=deconstruct_bilayer_4)  # -> Polyline, Name, Species, RTAngle, MoistureChange, DesiredRadius, Radius, BlendedRadius, BoardRegions; disabled
dec_reg_5 = DeconstructBoardRegion(BoardRegion=dec_board_4.BoardRegions)  # -> Polyline, Name, Species, RTAngle, MoistureChange, DesiredRadius, Radius, BlendedRadius, ThicknessBlendedRadius; disabled
swatch_2 = ColourSwatch(SwatchColor=RGB(115, 115, 115))  # disabled
preview_3 = CustomPreview(Geometry=move_12.Geometry, Material=swatch_2)  # disabled

python_2 = GhPythonScript(x=dec_reg_5.Species)  # -> out, a; disabled
# ---------- python_2: Python ----------
a = x.Name
# ---------- end python_2 ----------
len = TextLength(Text=python_2.a)  # disabled
bnd_6 = Bounds(Numbers=flatten(len))  # disabled
dedomain_9 = DeconstructDomain(Domain=bnd_6)  # -> Start, End; disabled

gradient_2 = Gradient(
    LowerLimit=dedomain_9.Start,
    UpperLimit=dedomain_9.End,
    Parameter=len,
    stops=[0: RGB(80, 55, 25), 0.5: RGB(159, 65, 29), 1: RGB(174, 166, 129)])  # disabled
preview_4 = CustomPreview(Geometry=move_11.Geometry, Material=gradient_2)  # disabled

vec_3 = Vector(Y_8)  # disabled
data_10 = Data(item_8.Item)  # disabled
deconstruct_panel_4 = DeconstructPanel(Panel=data_10)  # disabled
display_panel_3 = DisplayPanels(Panels=data_10)  # -> ActiveBoards, PassiveBoards; disabled
deconstruct_bilayer_5 = DeconstructBilayer(Bilayer=deconstruct_panel_4)  # disabled
move_13 = Move(Geometry=display_panel_3.ActiveBoards, Motion=vec_3)  # -> Geometry, Transform; disabled
move_14 = Move(Geometry=display_panel_3.PassiveBoards, Motion=vec_3)  # -> Geometry, Transform; disabled
panel_26 = Panel("100")  # disabled
swatch_3 = ColourSwatch(SwatchColor=RGBA(0, 0, 0, 66))  # disabled

dec_board_5 = DeconstructBoard(Board=deconstruct_bilayer_5)  # -> Polyline, Name, Species, RTAngle, MoistureChange, DesiredRadius, Radius, BlendedRadius, BoardRegions; disabled
dec_reg_6 = DeconstructBoardRegion(BoardRegion=dec_board_5.BoardRegions)  # -> Polyline, Name, Species, RTAngle, MoistureChange, DesiredRadius, Radius, BlendedRadius, ThicknessBlendedRadius; disabled

c_script_5 = CSharpScript(desired=dec_reg_6.DesiredRadius, actual=dec_reg_6.ThicknessBlendedRadius)  # -> out, A; inputs desired: Double, actual: Double; disabled
# ---------- c_script_5: C# ----------
    A = 100 * Math.Abs(desired - actual) / ((desired + actual) / 2);
# ---------- end c_script_5 ----------
gradient_3 = Gradient(LowerLimit=0, UpperLimit=panel_26, Parameter=c_script_5.A, stops=[0.15: RGB(255, 130, 160), 0.85: RGB(220, 0, 40)])  # disabled
preview_5 = CustomPreview(Geometry=move_13.Geometry, Material=gradient_3)  # disabled
preview_6 = CustomPreview(Geometry=move_14.Geometry, Material=gradient_3)  # disabled

vec_4 = Vector(Y_7)  # disabled
data_11 = Data(item_8.Item)  # disabled
deconstruct_panel_5 = DeconstructPanel(Panel=data_11)  # disabled
display_panel_4 = DisplayPanels(Panels=data_11)  # -> ActiveBoards, PassiveBoards; disabled
deconstruct_bilayer_6 = DeconstructBilayer(Bilayer=deconstruct_panel_5)  # disabled
dec_board_6 = DeconstructBoard(Board=deconstruct_bilayer_6)  # -> Polyline, Name, Species, RTAngle, MoistureChange, DesiredRadius, Radius, BlendedRadius, BoardRegions; disabled
move_15 = Move(Geometry=display_panel_4.ActiveBoards, Motion=vec_4)  # -> Geometry, Transform; disabled
move_16 = Move(Geometry=display_panel_4.PassiveBoards, Motion=vec_4)  # -> Geometry, Transform; disabled
dec_reg_7 = DeconstructBoardRegion(BoardRegion=dec_board_6.BoardRegions)  # -> Polyline, Name, Species, RTAngle, MoistureChange, DesiredRadius, Radius, BlendedRadius, ThicknessBlendedRadius; disabled
swatch_4 = ColourSwatch(SwatchColor=RGB(115, 115, 115))  # disabled
preview_7 = CustomPreview(Geometry=move_16.Geometry, Material=swatch_4)  # disabled

bnd_7 = Bounds(Numbers=flatten(dec_reg_7.MoistureChange))  # disabled
panel_27 = Panel(dec_reg_7.MoistureChange)  # disabled
dedomain_10 = DeconstructDomain(Domain=bnd_7)  # -> Start, End; disabled

gradient_4 = Gradient(
    LowerLimit=dedomain_10.Start,
    UpperLimit=dedomain_10.End,
    Parameter=dec_reg_7.MoistureChange,
    stops=[0.15: RGB(130, 253, 255), 0.85: RGB(0, 172, 219)])  # disabled
preview_8 = CustomPreview(Geometry=move_15.Geometry, Material=gradient_4)  # disabled

explode_6 = Explode(Curve=move_10.Geometry, Recursive=True)  # -> Segments, Vertices
num_22 = Number(num_21)
num_23 = Number(num_20)
mesh = Mesh(weld)
path_mapper_8 = PathMapper(explode_6.Vertices, source=["{A;B}(i)", "{A}(i)"], target=["{A;i}(B)", "{i}(A)"])
division_4 = Division(A=num_22, B=num_23)
avr_2 = Average(Input=division_4)
number_slider_18 = Slider(100, range=0..100000)
pline_2 = PolyLine(Vertices=path_mapper_8, Closed=False)  # -> simplify(Polyline)
path_mapper_9 = PathMapper(pline_2, source=["{A;B}", "{A}"], target=["{A}", "{0}"])
crv_13 = Curve(move_10.Geometry)
show = Show(G=mesh)
rod = Rod(
    Polyline=path_mapper_9,
    LengthFactor=1,
    AngleFactor=1,
    AxialStrength=number_slider_18,
    BendStrength=Slider(1, range=0..10000))
path_mapper_10 = PathMapper(rod, source=["{A;B}", "{A}"], target=["{A}", "{0}"])

path_mapper_11 = PathMapper(avr_2, source=["{A}", "{A;B}"], target=["{0}", "{A}"])

rod_2 = Rod(
    Polyline=crv_13,
    LengthFactor=1,
    AngleFactor=path_mapper_11,
    AxialStrength=number_slider_18,
    BendStrength=Slider(10000, range=0..10000))
path_mapper_12 = PathMapper(rod_2, source=["{A;B}", "{A}"], target=["{A}", "{0}"])
merge_13 = Merge(Data1=path_mapper_10, Data2=path_mapper_12, Data3=show)

zombiesolver = ZombieSolver(GoalObjects=merge_13, Threshold=1e-10, Tolerance=0.0001, MaxIterations=Slider(1, range=0..100000))  # -> I, V, O
mesh_2 = Mesh(zombiesolver.O)
clean = CleanTree(RemoveNulls=True, RemoveInvalid=True, RemoveEmpty=False, Tree=mesh_2)

mesh_3 = Mesh(simplify(graft(clean)))

mesh_4 = Mesh(mesh_3)
num_24 = Number(expr("x+1", number_slider_17))
medges_2 = MeshEdges(Mesh=mesh_4)  # -> NakedEdges, InteriorEdges, NonManifoldEdges
demesh = DeconstructMesh(Mesh=mesh_4)  # -> Vertices, Faces, Colours, Normals
join_4 = JoinCurves(Curves=medges_2.NakedEdges, Preserve=False)
patch = Patch(Curves=join_4, Points=demesh.Vertices, Spans=num_24, Flexibility=Slider(1, range=0..1), Trim=True)
srf_3 = Surface(simplify(patch))

wbedges = WeaverbirdsMeshEdges(MeshOrPolylines=graft(clean))  # -> simplify(Lines)
wbedges_2 = WeaverbirdsMeshEdges(MeshOrPolylines=weld_2)  # -> simplify(Lines)
group_2 = Group(Objects=wbedges)  # -> flatten(Group)
len_2 = Length(Curve=wbedges_2)
len_3 = Length(Curve=wbedges)
lng_11 = ListLength(List=group_2)
subtraction_8 = Subtraction(A=len_3, B=len_2)
series_4 = Series(Start=0, Step=Slider(1330, range=0..10000), Count=lng_11)
smaller_2 = SmallerThan(FirstNumber=subtraction_8, SecondNumber=0)  # -> SmallerThan, OrEqualTo
dispatch = Dispatch(List=subtraction_8, DispatchPattern=smaller_2.SmallerThan)  # -> ListA, ListB
Y_14 = UnitY(Factor=series_4)
move_17 = Move(Geometry=group_2, Motion=Y_14)  # -> Geometry, Transform
bnd_8 = Bounds(Numbers=dispatch.ListA)
bnd_9 = Bounds(Numbers=dispatch.ListB)
dedomain_11 = DeconstructDomain(Domain=bnd_9)  # -> Start, End
dedomain_12 = DeconstructDomain(Domain=bnd_8)  # -> Start, End
X_2 = UnitX(Factor=Slider(7456, range=0..10000))
gradient_5 = Gradient(
    LowerLimit=dedomain_11.Start,
    UpperLimit=dedomain_11.End,
    Parameter=dispatch.ListB,
    stops=[0: RGB(254, 244, 84), 0.499: RGB(234, 126, 0), 1: RGB(234, 38, 0), 1: RGB(75, 107, 169), 1: RGB(173, 203, 249)])

crv_14 = Curve(wbedges)
end_2 = EndPoints(Curve=crv_14)  # -> Start, End
pdecon_8 = Deconstruct(Point=end_2.Start)  # -> XComponent, YComponent, ZComponent
pdecon_9 = Deconstruct(Point=end_2.End)  # -> XComponent, YComponent, ZComponent
subtraction_9 = Subtraction(A=pdecon_8.XComponent, B=pdecon_9.XComponent)
abs = Absolute(Value=subtraction_9)
smaller_3 = SmallerThan(FirstNumber=abs, SecondNumber=Slider(100, range=0..100))  # -> SmallerThan, OrEqualTo
cull_8 = CullPattern(List=crv_14, CullPattern=smaller_3.SmallerThan)
join_5 = JoinCurves(Curves=cull_8, Preserve=False)
curvepoint_6 = PointOnCurve(join_5, parameter=0.5)
pdecon_10 = Deconstruct(Point=curvepoint_6)  # -> XComponent, YComponent, ZComponent
sort_3 = SortList(Keys=pdecon_10.XComponent, ValuesA=join_5)  # -> Keys, ValuesA
explode_7 = Explode(Curve=sort_3.ValuesA, Recursive=True)  # -> Segments, simplify(Vertices)
intcrv_5 = Interpolate(Vertices=explode_7.Vertices, Degree=3, Periodic=False, KnotStyle=1)  # -> Curve, Length, Domain
path_mapper_13 = PathMapper(intcrv_5.Curve, source=["{A;B}", "{A}"], target=["{A}", "{0}"])
loft_4 = Loft(Curves=path_mapper_13, Options={Adjust=False, Closed=False, LoftEnds=0, LoftSimp=0, LoftType=0, Rebuild=10, Refit=0.01})

move_18 = Move(Geometry=move_17.Geometry, Motion=Y_11)  # -> Geometry, Transform
gradient_6 = Gradient(
    LowerLimit=dedomain_12.Start,
    UpperLimit=dedomain_12.End,
    Parameter=dispatch.ListA,
    stops=[0: RGB(75, 107, 169), 0.501: RGB(173, 203, 249), 1: RGB(254, 244, 84)])

move_19 = Move(Geometry=move_18.Geometry, Motion=X_2)  # -> Geometry, Transform
ungroup_2 = Ungroup(Group=move_19.Geometry)
dispatch_2 = Dispatch(List=ungroup_2, DispatchPattern=smaller_2.SmallerThan)  # -> ListA, ListB
previewlw = CustomPreviewLineweights(Geometry=dispatch_2.ListA, Shader=gradient_6, Thickness=3, Absolute=False)
previewlw_2 = CustomPreviewLineweights(Geometry=dispatch_2.ListB, Shader=gradient_5, Thickness=3, Absolute=False)

# ---- group: control gate
srf_4 = Surface(loft_4)
srf_5 = Surface(loft)
bool_2 = Boolean(relaxation)
not_2 = GateNot(A=bool_2)
cull_9 = CullPattern(List=srf_5, CullPattern=not_2)
merge_14 = Merge(Data1=srf_4, Data2=cull_9)

# ----
srf_6 = Surface(merge_14)
edges = BrepEdges(Brep=srf_6)  # -> Naked, Interior, NonManifold
len_4 = Length(Curve=edges.Naked)
sort_4 = SortList(Keys=len_4, ValuesA=edges.Naked)  # -> Keys, reverse(ValuesA)
item_13 = ListItem(List=sort_4.ValuesA, Index=0, Wrap=True)  # -> Item, Item1
flip_2 = FlipCurve(Curve=item_13.Item1)  # -> Curve, Flag
merge_15 = Merge(Data1=item_13.Item, Data2=flip_2.Curve)
divide_2 = DivideCurve(Curve=merge_15, Count=Slider(100, range=0..100), Kinks=False)  # -> Points, Tangents, Parameters
path_mapper_14 = PathMapper(divide_2.Points, source="{A;B;C}(i)", target="{A;B;i}(C)")
item_14 = ListItem(List=path_mapper_14, Index=0, Wrap=True)  # -> Item, Item1
dist = Distance(PointA=item_14.Item, PointB=item_14.Item1)
trim_5 = TrimTree(Tree=dist, Depth=1)
bnd_10 = Bounds(Numbers=trim_5)
dedomain_13 = DeconstructDomain(Domain=bnd_10)  # -> simplify(Start), End
multiplication_8 = Multiplication(A=dedomain_13.Start, B=Slider(0.95, range=0..1))  # -> flatten(Result)
c_script_6 = CSharpScript(x=multiplication_8)  # -> out, A; inputs x: list of Double
# ---------- c_script_6: C# ----------
    List<double> output = new List<double>();
    
    double currentVal = 0;
    for(int i = 0; i < x.Count; i++)
    {
      output.Add(currentVal);
      currentVal += x[i];
    }
    A = output;
# ---------- end c_script_6 ----------
Y_15 = UnitY(Factor=c_script_6.A)
move_20 = Move(Geometry=srf_6, Motion=Y_15)  # -> Geometry, Transform

relaxation_2 = Panel(bnd_8)

mesh_5 = Mesh(mesh_3)
c_script_7 = CSharpScript(mesh=mesh_5, surface=srf_3)  # -> out, Curvature; inputs mesh: Mesh, surface: Surface
# ---------- c_script_7: C# ----------
        //get surface gaussian curvature at each mesh point
        List<double> gaussianCurvatures = new List<double>();
        double maxGaussian = 0;
        double minGaussian = double.MaxValue;

        double U;
        double V;

        for (int i = 0; i < mesh.Vertices.Count; i++)
        {
            Point3d currentMeshPoint = mesh.Vertices.Point3dAt(i);
            surface.ClosestPoint(currentMeshPoint, out U, out V);
            SurfaceCurvature surfaceCurvature = surface.CurvatureAt(U, V);
            double gaussian = surfaceCurvature.Gaussian;
            gaussianCurvatures.Add(gaussian);

            //get the range of curvatures
            if (gaussian > maxGaussian) maxGaussian = gaussian;
            if( gaussian < minGaussian) minGaussian = gaussian;
        }


        //get the range of curvatures


        //remap the curvatures to color values on the mesh points
        for (int i = 0; i < mesh.Vertices.Count; i++)
        {
            double hue = (gaussianCurvatures[i] - minGaussian) / (0 - minGaussian) * (0.5 - maxGaussian) + maxGaussian;
        }
        Curvature = gaussianCurvatures;
# ---------- end c_script_7 ----------
mesh_6 = Mesh(flatten(mesh_5))
num_25 = Number(c_script_7.Curvature)
bnd_11 = Bounds(Numbers=num_25)
dedomain_14 = DeconstructDomain(Domain=bnd_11)  # -> Start, End
gradient_7 = Gradient(
    LowerLimit=dedomain_14.Start,
    UpperLimit=dedomain_14.End,
    Parameter=num_25,
    stops=[0: RGB(0, 128, 0), 0.5: RGB(255, 255, 0), 1: RGB(255, 0, 0)])
X_3 = UnitX(Factor=Slider(7456, range=0..10000))

gaussian_curvature = Panel(bnd_11)

move_21 = Move(Geometry=mesh_6, Motion=Y_15)  # -> simplify(graft(Geometry)), Transform

mesh_7 = Mesh(move_21.Geometry)

move_22 = Move(Geometry=mesh_7, Motion=Y_12)  # -> Geometry, Transform

move_23 = Move(Geometry=move_22.Geometry, Motion=X_3)  # -> Geometry, Transform
c_script_8 = CSharpScript(mesh=move_23.Geometry, colors=simplify(gradient_7))  # -> out, A; inputs mesh: Mesh, colors: list of Color
# ---------- c_script_8: C# ----------
    for(int i = 0; i < mesh.Vertices.Count; i++)
    {
      mesh.VertexColors.SetColor(i, colors[i]);
    }
    A = mesh;
# ---------- end c_script_8 ----------

srf_7 = Surface(reparameterize(simplify(graft(merge_14))))
crv_15 = Curve(dec_reg_4.Polyline)
explode_8 = Explode(Curve=crv_15, Recursive=True)  # -> Segments, Vertices
len_5 = Length(Curve=explode_8.Segments)
path_mapper_15 = PathMapper(crv_15, source=["{A;B}", "{A}", "{A;B;C}"], target=["{A}", "{0}", "{A}"])
division_5 = Division(A=len_5, B=Slider(100, range=0..100))
runion = RegionUnion(Curves=path_mapper_15)
divide_3 = DivideCurve(Curve=explode_8.Segments, Count=division_5, Kinks=False)  # -> Points, Tangents, Parameters
path_mapper_16 = PathMapper(divide_3.Points, source=["{A;B;C;D}", "{A;B;C}", "{A;B;C;D;E}"], target=["{A}", "{0}", "{A}"])
srf_8 = Surface(reparameterize(simplify(runion)))
srf_cp = SurfaceClosestPoint(Point=path_mapper_16, Surface=srf_8)  # -> Point, UVPoint, Distance

c_script_9 = CSharpScript(x=srf_cp.UVPoint)  # -> out, A; inputs x: Point3d
# ---------- c_script_9: C# ----------
    A = new Point3d(x.Y, x.X, x.Z);
# ---------- end c_script_9 ----------

evalsrf = EvaluateSurface(Surface=reparameterize(srf_7), Point=c_script_9.A)  # -> Point, Normal, UDirection, VDirection, Frame
c_script_10 = CSharpScript(trimmedTree=evalsrf.Point, originalTree=divide_3.Points)  # -> out, A; inputs trimmedTree: tree, originalTree: tree
# ---------- c_script_10: C# ----------
    if(originalTree.DataCount != trimmedTree.DataCount) Component.AddRuntimeMessage(GH_RuntimeMessageLevel.Error, "Number of items in both trees must be equal");

    DataTree<object> outputs = new DataTree<object>();
    List<GH_Path> paths = GetPaths(originalTree);
    //step through trimmed tree objects and add them to output tree with the correct

    int counter = 0;
    for(int i = 0; i < trimmedTree.BranchCount; i++)
    {
      for(int j = 0; j < trimmedTree.Branch(i).Count; j++)
      {
        outputs.Add(trimmedTree.Branch(i)[j], paths[counter]);
        counter++;
      }
    }
    A = outputs;
# ---------- c_script_10: C# additional code ----------
  public List<GH_Path> GetPaths(DataTree<object> originalTree)
  {
    List<GH_Path> output = new List<GH_Path>();
    for(int i = 0; i < originalTree.BranchCount; i++)
    {
      for(int j = 0; j < originalTree.Branch(i).Count; j++)
      {
        output.Add(originalTree.Paths[i]);
      }
    }
    return output;
  }
# ---------- end c_script_10 ----------
intcrv_6 = Interpolate(Vertices=c_script_10.A, Degree=3, Periodic=False, KnotStyle=1)  # -> Curve, Length, Domain
trim_6 = TrimTree(Tree=intcrv_6.Curve, Depth=1)
join_6 = JoinCurves(Curves=trim_6, Preserve=False)  # -> simplify(Curves)
path_mapper_17 = PathMapper(join_6, source=["{A;B;C}", "{A;B}", "{A;B;C;D}"], target=["{A}", "{0}", "{A}"])
lng_12 = ListLength(List=path_mapper_17)
dup_6 = DuplicateData(Data=srf_7, Number=lng_12, Order=True)
srfsplit = SurfaceSplit(Surface=simplify(graft(dup_6)), Curves=simplify(graft(path_mapper_17)))  # -> simplify(Fragments)
area_6 = Area(Geometry=srfsplit)  # -> Area, Centroid
sort_5 = SortList(Keys=area_6.Area, ValuesA=srfsplit)  # -> Keys, reverse(ValuesA)
item_15 = ListItem(List=sort_5.ValuesA, Index=Slider(1, range=0..1), Wrap=True)

path_mapper_18 = PathMapper(item_15, source=["{A}", "{A;B}"], target=["{0}", "{A}"])

c_script_11 = CSharpScript(trimmedTree=path_mapper_18, originalTree=join_6)  # -> out, A; inputs trimmedTree: tree, originalTree: tree; same code as c_script_10

trim_7 = TrimTree(Tree=c_script_11.A, Depth=2)
join_7 = BrepJoin(Breps=trim_7)  # -> Breps, Closed
trim_8 = TrimTree(Tree=join_7.Breps, Depth=1)
item_16 = ListItem(List=trim_8, Index=0, Wrap=True)  # -> flatten(Item)
move_24 = Move(Geometry=item_16, Motion=Y_15)  # -> simplify(graft(Geometry)), Transform

srf_9 = Surface(move_20.Geometry)
number_slider_19 = Slider(30, range=0..100)

flip_3 = FlipMatrix(Data=srf_9)
item_17 = ListItem(List=flip_3, Index=0, Wrap=True)

shift_2 = ShiftList(List=item_17, Shift=1, Wrap=True)
shift_3 = ShiftList(List=item_17, Shift=-1, Wrap=True)
bbx = BrepBrep(BrepA=item_17, BrepB=shift_3)  # -> Curves, Points
bbx_2 = BrepBrep(BrepA=item_17, BrepB=shift_2)  # -> Curves, Points
merge_16 = Merge(Data1=bbx_2.Curves, Data2=bbx.Curves)  # -> simplify(Result)
srf_10 = Surface(simplify(graft(item_17)))
ext = ExtendCurve(Curve=merge_16, Type=0, Start=number_slider_19, End=number_slider_19)
srfsplit_2 = SurfaceSplit(Surface=srf_10, Curves=ext)  # -> simplify(Fragments)
area_7 = Area(Geometry=srfsplit_2)  # -> Area, Centroid
area_8 = Area(Geometry=srf_10)  # -> Area, Centroid
dist_2 = Distance(PointA=area_8.Centroid, PointB=area_7.Centroid)
sort_6 = SortList(Keys=dist_2, ValuesA=srfsplit_2)  # -> Keys, ValuesA
item_18 = ListItem(List=sort_6.ValuesA, Index=0, Wrap=True)  # -> flatten(Item)

clean_2 = CleanTree(RemoveNulls=True, RemoveInvalid=True, RemoveEmpty=False, Tree=item_18)
srf_11 = Surface(clean_2)

item_19 = ListItem(List=srf_11, Index=0, Wrap=True)
item_20 = ListItem(List=srf_11, Index=1, Wrap=True)
number_slider_20 = Slider(1000, range=0..1000)
bbx_3 = BrepBrep(BrepA=item_19, BrepB=item_20)  # -> Curves, Points
ext_2 = ExtendCurve(Curve=bbx_3.Curves, Type=0, Start=number_slider_20, End=number_slider_20)
Y_16 = UnitY(Factor=Slider(10000, range=0..10000))
neg_8 = Negative(Value=Y_16)
extr = Extrude(Base=ext_2, Direction=neg_8)
split = SplitBrep(Brep=item_19, Cutter=extr)
area_9 = Area(Geometry=split)  # -> Area, Centroid
pdecon_11 = Deconstruct(Point=area_9.Centroid)  # -> XComponent, YComponent, ZComponent
sort_7 = SortList(Keys=pdecon_11.ZComponent, ValuesA=split)  # -> Keys, reverse(ValuesA)
item_21 = ListItem(List=sort_7.ValuesA, Index=0, Wrap=True)

item_22 = ListItem(List=reverse(srf_11), Index=0, Wrap=True)
item_23 = ListItem(List=reverse(srf_11), Index=1, Wrap=True)
number_slider_21 = Slider(1000, range=0..1000)
bbx_4 = BrepBrep(BrepA=item_22, BrepB=item_23)  # -> Curves, Points
ext_3 = ExtendCurve(Curve=bbx_4.Curves, Type=0, Start=number_slider_21, End=number_slider_21)
Y_17 = UnitY(Factor=Slider(10000, range=0..10000))
extr_2 = Extrude(Base=ext_3, Direction=Y_17)
split_2 = SplitBrep(Brep=item_22, Cutter=extr_2)
area_10 = Area(Geometry=split_2)  # -> Area, Centroid
pdecon_12 = Deconstruct(Point=area_10.Centroid)  # -> XComponent, YComponent, ZComponent
sort_8 = SortList(Keys=pdecon_12.ZComponent, ValuesA=split_2)  # -> Keys, reverse(ValuesA)
item_24 = ListItem(List=sort_8.ValuesA, Index=0, Wrap=True)

srf_12 = Surface(srf_11)
lng_13 = ListLength(List=srf_12)
dom_14 = ConstructDomain(DomainStart=1, DomainEnd=expr("x-2", lng_13))
larger = LargerThan(FirstNumber=lng_13, SecondNumber=2)  # -> LargerThan, OrEqualTo
subset_10 = SubList(List=srf_12, Domain=dom_14, Wrap=True)  # -> List, Index
cull_10 = CullPattern(List=subset_10.List, CullPattern=larger.LargerThan)

merge_17 = Merge(Data1=flatten(item_21), Data2=flatten(cull_10), Data3=flatten(item_24))

debrep = DeconstructBrep(Brep=move_24.Geometry)  # -> simplify(Faces), Edges, Vertices
srf_13 = Surface(graft(debrep.Faces))
srf_14 = Surface(graft(merge_17))
edges_2 = BrepEdges(Brep=srf_14)  # -> simplify(Naked), Interior, NonManifold
join_8 = JoinCurves(Curves=edges_2.Naked, Preserve=False)  # -> simplify(Curves)
srf_15 = Surface(srf_14)

area_11 = Area(Geometry=srf_13)  # -> Area, Centroid
crv_cp = CurveClosestPoint(Point=area_11.Centroid, Curve=join_8)  # -> Point, Parameter, Distance
larger_2 = LargerThan(FirstNumber=crv_cp.Distance, SecondNumber=addition)  # -> LargerThan, OrEqualTo
dispatch_3 = Dispatch(List=srf_13, DispatchPattern=larger_2.LargerThan)  # -> ListA, ListB
srf_16 = Surface(simplify(dispatch_3.ListB))
srf_17 = Surface(dispatch_3.ListA)
clean_3 = CleanTree(RemoveNulls=True, RemoveInvalid=True, RemoveEmpty=True, Tree=srf_16)
trim_9 = TrimTree(Tree=clean_3, Depth=1)
lng_14 = ListLength(List=trim_9)
dup_7 = DuplicateData(Data=join_8, Number=lng_14, Order=True)

srfsplit_3 = SurfaceSplit(Surface=graft(trim_9), Curves=graft(dup_7))  # -> simplify(Fragments)

match = MatchTree(Tree=srfsplit_3, Guide=clean_3)
merge_18 = Merge(Data1=simplify(srf_17), Data2=simplify(match))

area_12 = Area(Geometry=merge_18)  # -> Area, Centroid
trim_10 = TrimTree(Tree=area_12.Centroid, Depth=1)
lng_15 = ListLength(List=area_12.Centroid)
srf_cp_2 = SurfaceClosestPoint(Point=trim_10, Surface=srf_15)  # -> Point, UVPoint, Distance
trim_11 = TrimTree(Tree=lng_15, Depth=1)
partition = PartitionList(List=simplify(srf_cp_2.Distance), Size=trim_11)
smaller_4 = SmallerThan(FirstNumber=partition, SecondNumber=Slider(10, range=0..10))  # -> SmallerThan, OrEqualTo
cull_11 = CullPattern(List=merge_18, CullPattern=smaller_4.SmallerThan)
area_13 = Area(Geometry=cull_11)  # -> Area, Centroid
pdecon_13 = Deconstruct(Point=area_13.Centroid)  # -> XComponent, YComponent, ZComponent
sort_9 = SortList(Keys=pdecon_13.ZComponent, ValuesA=cull_11)  # -> Keys, reverse(ValuesA)
item_25 = ListItem(List=sort_9.ValuesA, Index=0, Wrap=True)
lng_16 = ListLength(List=item_25)
equals = Equality(FirstNumber=lng_16, SecondNumber=0)  # -> Equality, Inequality
srf_18 = Surface(item_25)

panel_28 = Panel(srf_18)

# ---- group: support points
srf_19 = Surface(graft(merge_17))
srf_20 = Surface(srf_18)
debrep_2 = DeconstructBrep(Brep=srf_20)  # -> Faces, Edges, Vertices
explode_9 = Explode(Curve=srf_19, Recursive=True)  # -> Segments, Vertices
trim_12 = TrimTree(Tree=simplify(debrep_2.Vertices), Depth=1)
curvepoint_7 = PointOnCurve(explode_9.Segments, parameter=0.5)
pdecon_14 = Deconstruct(Point=curvepoint_7)  # -> XComponent, YComponent, ZComponent
sort_10 = SortList(Keys=pdecon_14.XComponent, ValuesA=explode_9.Segments)  # -> Keys, ValuesA
item_26 = ListItem(List=sort_10.ValuesA, Index=0, Wrap=True)  # -> simplify(Item)
crv_cp_2 = CurveClosestPoint(Point=trim_12, Curve=item_26)  # -> Point, Parameter, Distance
smaller_5 = SmallerThan(FirstNumber=crv_cp_2.Distance, SecondNumber=Slider(10, range=0..10))  # -> SmallerThan, OrEqualTo
cull_12 = CullPattern(List=trim_12, CullPattern=smaller_5.SmallerThan)
cullpt_2 = CullDuplicates(Points=cull_12, Tolerance=0.1, CullMode=3)  # -> simplify(Points), Indices, Valence

# ----
srf_21 = Surface(flatten(srf_18))

# ---- group: boards
srf_22 = Surface(reverse(srf_18))

# ----
item_27 = ListItem(List=srf_21, Index=Slider(136, range=0..1000), Wrap=True)
null = NullItem(Item=flatten(srf_22))  # -> NullFlags, InvalidFlags, Description
scale_3 = Scale(Geometry=srf_22, Center=Point(0, 0, 0), Factor=number_slider_14)  # -> Geometry, Transform
srf_23 = Surface(item_27)
null_2 = NullItem(Item=scale_3.Geometry)  # -> NullFlags, InvalidFlags, Description
scale_4 = Scale(Geometry=cullpt_2.Points, Center=Point(0, 0, 0), Factor=number_slider_14)  # -> Geometry, Transform
not_3 = GateNot(A=null_2.NullFlags)
cull_13 = CullPattern(List=scale_3.Geometry, CullPattern=not_3)
clean_4 = CleanTree(RemoveNulls=True, RemoveInvalid=True, RemoveEmpty=toggle, Tree=cull_13)

# ---- group: InputSurfaces
brep = Brep(clean_4)

# ----
pt_16 = Point(scale_4.Geometry)
support = RemoteSender(pt_16)
support_2 = RemoteReceiver(support)
cullpt_3 = CullDuplicates(Points=support_2, Tolerance=number_slider_15, CullMode=1)  # -> Points, Indices, Valence

data_12 = Data(cull_6)
data_13 = Data(species_2)
dec_panel_buildups = DeconstructPanelBuildup(Panels=data_12)  # -> WoodSpecies, Thicknesses
tstat = TreeStatistics(Tree=dec_panel_buildups.Thicknesses)  # -> Paths, Length, Count
lng_17 = ListLength(List=tstat.Paths)
dup_8 = DuplicateData(Data=data_13, Number=lng_17, Order=True)  # -> graft(Data)
dup_9 = DuplicateData(Data="4", Number=lng_17, Order=True)  # -> graft(Data)
match_2 = MatchTree(Tree=dup_8, Guide=dec_panel_buildups.WoodSpecies)
match_3 = MatchTree(Tree=dup_9, Guide=dec_panel_buildups.Thicknesses)
merge_19 = Merge(Data1=dec_panel_buildups.WoodSpecies, Data2=match_2)
merge_20 = Merge(Data1=dec_panel_buildups.Thicknesses, Data2=match_3)

# ---- group: species
data_14 = Data(merge_19)

# ---- group: thicknesses
num_26 = Number(merge_20)

# ----
c_script_12 = CSharpScript(x=data_14)  # -> out, A; inputs x: tree
# ---------- c_script_12: C# ----------
    DataTree<object> output = new DataTree<object>();
    int firstIndex = 0;
    int branchCount = 0;
    for(int i = 0; i < x.BranchCount; i++)
    {
      GH_Path path = new GH_Path(firstIndex, branchCount);
      if(x.Paths[i][0] == firstIndex)
      {
        output.AddRange(x.Branch(i), path);
      }
      else
      {
        firstIndex++;
        branchCount = -1;
        i--;
      }
      branchCount++;
    }
    A = output;
# ---------- end c_script_12 ----------
c_script_13 = CSharpScript(x=num_26)  # -> out, A; inputs x: tree; same code as c_script_12

# ---- group: buildups
cull_14 = CullPattern(List=c_script_12.A, CullPattern=equals.Inequality)
dec_secies = DeconstructSpecies(Species=cull_14)  # -> N, LX, RX, TX, LE, RE, TE
cset = CreateSet(List=dec_secies.N)  # -> Set, Map
material_buildups_2 = Panel("""100
200
300
101
201
301""")

# ----
panel_29 = Panel(dec_secies.N)

# ---- group: buildups / layer count
lng_18 = ListLength(List=dec_secies.N)

# ----
panel_30 = Panel(dec_secies.LE)
panel_31 = Panel(dec_secies.RE)
panel_32 = Panel(dec_secies.TE)

# ---- group: buildups / material type
lng_19 = ListLength(List=cset.Set)

# ---- group: buildups (continued)
c_script_14 = CSharpScript(layerCount=lng_18, materialCount=lng_19)  # -> out, A, B, C; inputs layerCount: tree of Int32, materialCount: tree of Int32
# ---------- c_script_14: C# ----------
    DataTree<int> keys = new DataTree<int>();
    DataTree<int> numberize = new DataTree<int>();
    DataTree<double> thickness = new DataTree<double>();

    for(int i = 0; i < layerCount.BranchCount;i++)
    {
      int lCount = layerCount.Branch(i)[0];
      int mCount = materialCount.Branch(i)[0];
      GH_Path path = layerCount.Paths[i];
      numberize.Add(i + 1, path);
      if(lCount == 3 && mCount == 1)
      {
        keys.Add(0, path);
        thickness.Add(2.8, path);
      }
      if(lCount == 5 && mCount == 1)
      {
        keys.Add(1, path);
        thickness.Add(5.2, path);
      }
      if(lCount == 7 && mCount == 1)
      {
        keys.Add(2, path);
        thickness.Add(7.6, path);
      }
      if(lCount == 3 && mCount == 2)
      {
        keys.Add(3, path);
        thickness.Add(2.8, path);
      }
      if(lCount == 5 && mCount == 2)
      {
        keys.Add(4, path);
        thickness.Add(5.2, path);
      }
      if(lCount == 7 && mCount == 2)
      {
        keys.Add(5, path);
        thickness.Add(7.6, path);
      }

    }

    A = keys;
    B = numberize;
    C = thickness;
# ---------- end c_script_14 ----------
item_28 = ListItem(List=material_buildups_2, Index=c_script_14.A, Wrap=True)

# ----
data_15 = Data(c_script_14.C)
panel_33 = Panel(item_28)
panel_34 = Panel(c_script_14.C)
cull_15 = CullPattern(List=c_script_14.B, CullPattern=not_3)
panel_35 = Panel(cull_15)
cull_16 = CullPattern(List=c_script_14.C, CullPattern=not_3)
clean_5 = CleanTree(RemoveNulls=True, RemoveInvalid=True, RemoveEmpty=toggle, Tree=cull_16)
clean_6 = CleanTree(RemoveNulls=True, RemoveInvalid=True, RemoveEmpty=toggle, Tree=cull_15)

# ---- group: Main Surfaces
surfaces = Data(brep)
assemble_structural_area_sofistik = AssembleStructuralAreaSofistik(Geometry=surfaces, GroupNr=clean_6)  # -> simplify(StructuralAreasSofiMesh)

# ---- group: Mesh
item_29 = ListItem(List=surfaces, Index=0, Wrap=True)
item_30 = ListItem(List=surfaces, Index=0, Wrap=True)  # -> Item1, Item
debrep_3 = DeconstructBrep(Brep=item_29)  # -> Faces, Edges, Vertices
debrep_4 = DeconstructBrep(Brep=item_30.Item1)  # -> Faces, Edges, Vertices
debrep_5 = DeconstructBrep(Brep=surfaces)  # -> Faces, Edges, Vertices
item_31 = ListItem(List=debrep_3.Vertices, Index=0, Wrap=True)  # -> Item, Item1
item_32 = ListItem(List=debrep_4.Vertices, Index=0, Wrap=True)  # -> Item1, Item
item_33 = ListItem(List=debrep_5.Edges, Index=Slider(1, range=0..10), Wrap=True)
pt_17 = Point(item_31.Item)
pt_18 = Point(item_31.Item1)
pt_19 = Point(item_32.Item1)
data_16 = Data(item_33)
len_6 = Length(Curve=data_16)
len_7 = Length(Curve=debrep_5.Edges)
rec_3pt = Rectangle3Pt(PointA=pt_17, PointB=pt_19, PointC=pt_18)  # -> Rectangle, Length
smaller_6 = SmallerThan(FirstNumber=len_6, SecondNumber=len_7)  # -> SmallerThan, OrEqualTo
boundary = BoundarySurfaces(Edges=rec_3pt.Rectangle)
area_14 = Area(Geometry=boundary)  # -> Area, Centroid
cull_17 = CullPattern(List=debrep_5.Edges, CullPattern=smaller_6.SmallerThan)
multiplication_9 = Multiplication(A=area_14.Area, B=1.5)
panel_36 = Panel("1")
assemble_structural_line_sofistik = AssembleStructuralLineSofistik(Curve=cull_17, GroupNr=item_28)

# ----
# SOFIMESH
generate_mesh_sofistik = GenerateMeshSofistik(
    Path=path,
    StructuralLines=assemble_structural_line_sofistik,
    StructuralAreas=assemble_structural_area_sofistik,
    MeshProperties=assemble_mesh_properties_sofimesh,
    WpsExe=pathwps_exe,
    Cdb_w50Dll=pathcdb_dll,
    Run=button_2,
    meshs_Branch0_Path="{1}",
    meshs_Branch1_Path="{2}",
    meshs_Branch2_Path="{7}",
    meshs_Branch3_Path="{8}",
    meshs_Branch4_Path="{9}",
    meshs_Branch5_Path="{10}",
    meshs_Branch6_Path="{11}",
    meshs_Branch7_Path="{12}",
    meshs_Branch8_Path="{13}",
    meshs_Branch9_Path="{14}",
    meshs_Branch10_Path="{15}",
    meshs_Branch11_Path="{16}",
    meshs_Branch12_Path="{17}",
    meshs_Branch13_Path="{18}",
    meshs_Branch14_Path="{19}",
    meshs_Branch15_Path="{20}",
    meshs_Branch16_Path="{21}",
    meshs_Branch17_Path="{22}",
    meshs_Branch18_Path="{23}",
    meshs_Branch19_Path="{24}",
    meshs_Branch20_Path="{25}",
    meshs_Branch21_Path="{26}",
    meshs_Branch22_Path="{27}",
    meshs_Branch23_Path="{28}",
    meshs_Branch24_Path="{29}",
    meshs_Branch25_Path="{30}",
    meshs_Branch26_Path="{31}",
    meshs_Branch27_Path="{32}",
    meshs_Branch28_Path="{33}",
    meshs_Branch29_Path="{34}"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)  # -> Meshs, Completed
flatten = FlattenTree(Tree=generate_mesh_sofistik.Meshs, Path="{0}")  # -> simplify(graft(Tree))
mesh_8 = Mesh(flatten)

mesh_9 = Data(mesh_8)
graft = GraftTree(Tree=mesh_9, IncludeEmptyLists=True, IncludeNullItems=True)  # -> simplify(Tree)
area_15 = Area(Geometry=graft)  # -> Area, Centroid
addition_2 = Addition(A=panel_10, B=panel_9, C=panel_10)
srf_cp_3 = SurfaceClosestPoint(Point=area_15.Centroid, Surface=graft(surfaces))  # -> Point, UVPoint, Distance
curvature = PrincipalCurvature(Surface=graft(surfaces), Point=srf_cp_3.UVPoint)  # -> Frame, Min, Max, MinDirection, MaxDirection
deplane_2 = DeconstructPlane(Plane=curvature.Frame)  # -> Origin, XAxis, YAxis, ZAxis
amp = Amplitude(Vector=deplane_2.XAxis, Amplitude=0.1)
amp_2 = Amplitude(Vector=deplane_2.YAxis, Amplitude=0.1)
amp_3 = Amplitude(Vector=deplane_2.ZAxis, Amplitude=0.1)
vdis = VectorDisplay(Anchor=area_15.Centroid, Vector=amp)
vdis_2 = VectorDisplay(Anchor=area_15.Centroid, Vector=amp_2)
vdis_3 = VectorDisplay(Anchor=area_15.Centroid, Vector=amp_3)
assemble_shell_sofistika = AssembleShellSofistikA(Mesh=simplify(graft(mesh_9)), MaterialNr=item_28, Thickness=reverse(clean_5), GroupNr=simplify(graft(clean_6)))  # -> flatten(Shell)

# ---- group: Preassembly
preassemble_model_sofistik = PreAssembleModelSofistik(Points=flatten(pt_16), Shells=assemble_shell_sofistika, tol=0.001)  # -> NodeList, Shells, Beams, Trusses, Cables, Couplings

# ---- group: Loading / Random Point Load
mesh_10 = Mesh(mesh_8)
item_34 = ListItem(List=flatten(mesh_10), Index=0, Wrap=True)  # -> Item, Item1
demesh_2 = DeconstructMesh(Mesh=item_34.Item1)  # -> Vertices, Faces, Colours, Normals
random_point = GhPythonScript(x=demesh_2.Vertices)  # -> out, a; inputs x: list of Point3d
# ---------- random_point: Python ----------
import Rhino.Geometry as rg
import random

# List of points

# Get a random point from the list
random_point = random.choice(x)

a = random_point
# ---------- end random_point ----------
pt_20 = Point(random_point.a)
find_nodes_sofistik = FindNodesSofistik(Nodes=preassemble_model_sofistik.NodeList, Geometry=pt_20, tol=0.001)
assemble_pointload_sofistik = AssemblePointLoadSofistik(LoadNodes=find_nodes_sofistik, LoadcaseNumber=panel_12, LoadType=panel_13, LoadValues=panel_14)

# ----
# SUPPORT DEFINITION
node_sofistik = NodeSofistik(preassemble_model_sofistik.NodeList)
find_nodes_sofistik_2 = FindNodesSofistik(Nodes=node_sofistik, Geometry=cullpt_3.Points, tol=0.001)
assemble_support_sofistik = AssembleSupportSofistik(Node=find_nodes_sofistik_2, Type="F")

# ---- group: Loading / Selfweight Floor Build Up
item_35 = ListItem(List=preassemble_model_sofistik.Shells, Index=0, Wrap=True)  # -> Item, Item1
assemble_meshload_sofistik = AssembleMeshLoadSofistik(LoadMesh=item_35.Item1, LoadcaseNumber="1001", LoadType="pzz", LoadValues="-1.5")  # -> flatten(MeshLoad)

# ---- group: Loading / Traffic Loads
item_36 = ListItem(List=preassemble_model_sofistik.Shells, Index=0, Wrap=True)  # -> Item, Item1
assemble_meshload_sofistik_2 = AssembleMeshLoadSofistik(LoadMesh=item_36.Item1, LoadcaseNumber="1002", LoadType="pzz", LoadValues="0")  # -> flatten(MeshLoad)

# ----
intersect_shells_sofistik = IntersectShellsSofistik(Shells=preassemble_model_sofistik.Shells, shell_combination=0, tol=0.001)  # -> NodesASofistikA, NodesBSofistikA
assemble_coupling_sofistik = AssembleCouplingSofistik(Node=intersect_shells_sofistik.NodesASofistikA, ReferenceNode=intersect_shells_sofistik.NodesBSofistikA, Type="KF")  # -> flatten(CouplingSofistikA)

# ---- group: Loading
merge_21 = Merge(Data1=assemble_meshload_sofistik, Data2=assemble_meshload_sofistik_2)

# ---- group: Calculation
path_2 = Data(path)
aqua = Data(aqua_file)
support_sofistik = SupportSofistik(flatten(assemble_support_sofistik))
button_3 = Button()
load_sofistik = LoadSofistik(merge_21)
assemble_model_sofistik = AssembleModelSofistik(
    Path=path_2,
    AquaFile=aqua,
    Nodes=preassemble_model_sofistik.NodeList,
    Shells=flatten(preassemble_model_sofistik.Shells),
    Beams=preassemble_model_sofistik.Beams,
    Couplings=assemble_coupling_sofistik,
    Supports=support_sofistik,
    Loads=load_sofistik,
    AseFile=merge_11,
    SofistikPath=pathwps_exe,
    Run=button_2,
    disable_warnings=False,
    run_sofistik=True)  # -> CdbPath, GroupDivisor, Springs, Beams, Trusses, Cables, Completed, Errors

# ---- group: Sofistik
open_sofistik = OpenSofistik(Path=assemble_model_sofistik.CdbPath, Teddy=Button(), Animator=Button(), Wingraf=Button(), FileLocation=Button())

# ----
toggle_4 = BooleanToggle(True)
load_case = Panel("101")
uls_2 = Panel("201")
pathcdb_dll_2 = FilePath(pathcdb_dll)
pathcdb = FilePath(assemble_model_sofistik.CdbPath)

# ---- group: Manual Stress Calculation
toggle_5 = BooleanToggle(True)
pathcdb_dll_3 = FilePath(pathcdb)
get_shell_forces_sofistik = GetShellForcesSofistik(Path=pathcdb_dll_2, LoadCase=1, SofistikPath=pathcdb_dll_3, Run=toggle_5)  # -> QNR, T, MXX, MYY, MXY, VX, VY, NXX, NYY, NXY
get_deformed_mesh_sofistik = GetDeformedMeshSofistik(LoadCase=1, ScalingFactor=Slider(0, range=0..100), SofistikPath=pathcdb_dll_3, Run=toggle_5)  # -> InitialMesh, DeformedMesh
int = Integer(get_shell_forces_sofistik.MXX)
facen = FaceNormals(Mesh=get_deformed_mesh_sofistik.InitialMesh)  # -> Centers, Normals
python_3 = GhPythonScript(
    E0=panel_20,
    E90=panel_21,
    t1=panel_18,
    t2=panel_19,
    nxx=get_shell_forces_sofistik.NXX,
    mxx=get_shell_forces_sofistik.MXX,
    nyy=get_shell_forces_sofistik.NYY,
    myy=get_shell_forces_sofistik.MYY)  # -> out, sig_x_top, sig_x_bot, sig_y_top_1, sig_y_int_1, sig_y_int_2, sig_y_bot_2
# ---------- python_3: Python ----------
import math 

# -------------- X direction -------------
Ax  = t2
Wxx = Ax*Ax/6

sigma_nx    = nxx / Ax
sigma_mxx   = mxx / Wxx * 1000
sig_x_top = sigma_nx - sigma_mxx
sig_x_bot = sigma_nx + sigma_mxx


# -------------- Y direction -------------
by_eq   = E90/E0
Ay_1    = t1
Ay_2    = t2 * by_eq
Ay_eq   = Ay_1 + Ay_2 
zg_y_1  = t1/2
zg_y_2  = t1 + t2/2
zg_y    = (zg_y_1 * Ay_1 + zg_y_2 * Ay_2) / Ay_eq
Iyy_1   = t1*t1*t1/12
Iyy_2   = t2*t2*t2/12*by_eq
Iyy     = Iyy_1 + Iyy_2 + math.pow(zg_y - zg_y_1,2)*Ay_1 + math.pow(zg_y - zg_y_2,2)*Ay_2

eps_y_top = myy / Iyy / E0 * (0 - zg_y) * 1000         + nyy / Ay_eq / E0
eps_y_int = myy / Iyy / E0 * (t1 - zg_y) * 1000        + nyy / Ay_eq / E0
eps_y_bot = myy / Iyy / E0 * (t1 + t2 - zg_y) * 1000   + nyy / Ay_eq / E0

sig_y_top_1 = eps_y_top * E0
sig_y_int_1 = eps_y_int * E0 
sig_y_int_2 = eps_y_int * E90 
sig_y_bot_2 = eps_y_bot * E90
# ---------- end python_3 ----------
bnd_12 = Bounds(Numbers=get_shell_forces_sofistik.MXX)
entwine_3 = Entwine(Branch00=python_3.sig_x_top, Branch01=python_3.sig_x_bot, FlattenInputs=True)
dedomain_15 = DeconstructDomain(Domain=bnd_12)  # -> Start, End
textdot = DefineTextDot(Text=get_shell_forces_sofistik.MXX, Location=facen.Centers, Font="Arial", Size=Slider(10, range=0..10))
swatch_5 = ColourSwatch(SwatchColor=RGB(255, 255, 255))
flip_4 = FlipMatrix(Data=entwine_3)
gradient_8 = Gradient(
    LowerLimit=dedomain_15.Start,
    UpperLimit=dedomain_15.End,
    Parameter=get_shell_forces_sofistik.MXX,
    stops=[0: RGB(234, 38, 0), 0.25: RGB(234, 126, 0), 0.5: RGB(254, 244, 84), 0.75: RGB(173, 203, 249), 1: RGB(75, 107, 169)])
abs_2 = Absolute()
abs_3 = Absolute(Value=flip_4)
sort_11 = SortList(Keys=abs_3, ValuesA=flip_4)  # -> Keys, ValuesA
item_37 = ListItem(List=reverse(sort_11.ValuesA), Index=0, Wrap=True)  # -> flatten(Item)
colourmesh = ColourMesh(Mesh=get_deformed_mesh_sofistik.InitialMesh, Colors=gradient_8)

# ---- group: Deformation
get_nodal_results_sofistik = GetNodalResultsSofistik(Path=pathcdb, LoadCases=load_case, SofistikPath=pathcdb_dll_2, Run=toggle_4)  # -> NodeNumber, Nodes, LoadForces, LoadMoments, Displacements, Rotations, Forces, Moments
get_deformed_mesh_sofistika = GetDeformedMeshSofistikA(Path=pathcdb, LoadCase=load_case, ScalingFactor=Slider(2, range=0..100), SofistikPath=pathcdb_dll_2, Run=toggle_4)  # -> InitialMesh, DeformedMesh
vlen = VectorLength(Vector=get_nodal_results_sofistik.Displacements)
demesh_3 = DeconstructMesh(Mesh=get_deformed_mesh_sofistika.DeformedMesh)  # -> Vertices, Faces, Colours, Normals
vec_5 = Vector(get_nodal_results_sofistik.Displacements)
num_27 = Number(get_nodal_results_sofistik.Displacements)
vlen_2 = VectorLength(Vector=vec_5)
bnd_13 = Bounds(Numbers=num_27)
num_28 = Number(vlen_2)
bnd_14 = Bounds(Numbers=num_28)
dedomain_16 = DeconstructDomain(Domain=bnd_13)  # -> Start, End
dedomain_17 = DeconstructDomain(Domain=bnd_14)  # -> Start, End
gradient_9 = Gradient(
    LowerLimit=dedomain_16.End,
    UpperLimit=dedomain_16.Start,
    Parameter="150",
    stops=[0: RGB(234, 38, 0), 0.25: RGB(234, 126, 0), 0.5: RGB(254, 244, 84), 0.75: RGB(173, 203, 249), 1: RGB(75, 107, 169)])
expression = Expression(x=dedomain_17.End, Expression="Round(x*1000,2)")
sort_12 = SortList(Keys=vlen, ValuesA=get_nodal_results_sofistik.Nodes)  # -> reverse(Keys), reverse(ValuesA)
totalmaxdisplacement_mm = Panel(expression)
smaller_7 = SmallerThan(FirstNumber=panel_16, SecondNumber=totalmaxdisplacement_mm)  # -> SmallerThan, OrEqualTo
panel_37 = Panel(smaller_7.SmallerThan)
sort_13 = SortList(Keys=vlen, ValuesA=demesh_3.Vertices)  # -> reverse(Keys), reverse(ValuesA)
item_38 = ListItem(List=sort_12.ValuesA, Index=0, Wrap=True)
item_39 = ListItem(List=sort_13.ValuesA, Index=0, Wrap=True)
concat_3 = Concatenate(FragmentA="   ", FragmentB=totalmaxdisplacement_mm, FragmentC=" mm")
tag_2 = TextTag(Location=item_38, Text=concat_3, Colour=ColourSwatch(SwatchColor=RGB(0, 0, 0)))
pt_21 = Point(item_38)

# ---- group: CLT
pathcdb_2 = FilePath(pathcdb)
pathcdb_dll_4 = FilePath(pathcdb_dll_2)
check_cross_sections = CSharpScript(
    path=pathcdb_2,
    lcNumbers=uls_2,
    dllPath=pathcdb_dll_4,
    kmod="0.8",
    run=toggle_4,
    Reference="C:\Users\Alex Reiner\AppData\Roaming\Grasshopper\Libraries\Sofistik.gha")  # -> out, eta_x, eta_y, eta_vxy, eta_vz, eta_v, eta; inputs path: String, lcNumbers: list of Int32, dllPath: String, kmod: Double, run: Boolean
# ---------- check_cross_sections: C# usings ----------
using System.IO;
using System.Linq;
using System.Data;
using System.Drawing;
using System.Reflection;
using System.Windows.Forms;
using System.Xml;
using System.Xml.Linq;
using System.Runtime.InteropServices;

using Rhino.DocObjects;
using Rhino.Collections;
using GH_IO;
using GH_IO.Serialization;
using Sofistik;
using Sofistik.Properties;
using Sofistik.Meshing;
# ---------- check_cross_sections: C# ----------
    // Safety factor
    double gammaM = 1.3;

    // Check for validity
    if (string.IsNullOrWhiteSpace(path)) { return; }
    if (string.IsNullOrWhiteSpace(dllPath)) { return; }

    if (!run)
      return;

    // Load sof_cdb.dll under specified path
    NativeMethods.SetDllDirectory(Path.GetDirectoryName(dllPath));
    IntPtr hModule = NativeMethods.LoadLibrary(dllPath);
    if (hModule == IntPtr.Zero)
    {
      Print("HModule = IntPtr.Zero, aborted");
      return;
    }

    // Retrieve the materials from the database
    materialInfos = CdbMethods.GetMaterialInfos(hModule, path);
    materials = new Dictionary<int, Sofistik.Material>();
    foreach (KeyValuePair<int, MaterialType> materialInfo in materialInfos)
    {
      int mnr = materialInfo.Key;
      materials.Add(mnr, CdbMethods.GetMaterial(hModule, path, mnr));
    }

    //  foreach (KeyValuePair<int, Sofistik.Material> kvp in materials)
    //  {
    //    int mnr = kvp.Key;
    //    TimberMaterial material = kvp.Value as TimberMaterial;
    //    if (material == null)
    //      continue;
    //    Rhino.RhinoApp.WriteLine("material " + mnr.ToString() + " Fv,k " + (0.001 * material.Fv_k).ToString());
    //    Rhino.RhinoApp.WriteLine("material " + mnr.ToString() + " Fvb,k " + (0.001 * material.Fvb_k).ToString());
    //    Rhino.RhinoApp.WriteLine("material " + mnr.ToString() + " Fvb,90,k " + (0.001 * material.Fvb90_k).ToString());
    //  }

    // Retrieve quads and quad results from database
    List<CQUAD> quads = CdbMethods.GetQuads(hModule, path);
    int nQuads = quads.Count;

    quadResults = new Dictionary<int,List<CQUAD_FOR>>();
    foreach (var quad in quads)
    {
      quadResults.Add(quad.m_NR, new List<CQUAD_FOR>());
    }
    foreach (int lcNumber in lcNumbers)
    {
      if (lcNumber <= 0)
        return;
      List<CQUAD_FOR> quadForces = CdbMethods.GetQuadForces(hModule, path, lcNumber);
      if (quadForces.Count != nQuads)
      {
        Print("quadForces.Count != quads.Count");
        return;
      }
      foreach (var quadForce in quadForces)
      {
        int quadNr = quadForce.m_NR;
        if(quadResults.ContainsKey(quadNr))
        {
          quadResults[quadNr].Add(quadForce);
        }
      }
    }

    // Initialize output variables
    List<double> _eta_x = new List<double>();
    List<double> _eta_y = new List<double>();
    List<double> _eta_vxy = new List<double>();
    List<double> _eta_vz = new List<double>();
    List<double> _eta_v = new List<double>();
    List<double> _eta = new List<double>();

    for (int i = 0; i < nQuads; i++)
    {
      double eta_x_i = 0.0;
      double eta_y_i = 0.0;
      double eta_vxy_i = 0.0;
      double eta_vz_i = 0.0;
      double eta_v_i = 0.0;

      // retrieve quadnr and thickness
      int quadNr = quads[i].m_NR;
      double t = 1000.0 * (double) quads[i].m_THICK[0]; // mm

      // retrieve material nr of the quad
      int mnr = quads[i].m_MAT;

      // check if material is mlay or single layer material
      if (materials[mnr].MaterialType != MaterialType.Mlay)
      {
        ComputeSingleLayerResult(quadNr, t, mnr, kmod, gammaM, out eta_x_i, out eta_y_i, out eta_vxy_i, out eta_vz_i);
      }
      else
      {
        ComputeMultiLayerResult(quadNr, mnr, kmod, gammaM, out eta_x_i, out eta_y_i, out eta_vxy_i, out eta_vz_i);
      }
      eta_v_i = eta_vxy_i + eta_vz_i;
      double eta_i = new double[]{eta_x_i, eta_y_i, eta_v_i}.Max();
      _eta_x.Add(eta_x_i);
      _eta_y.Add(eta_y_i);
      _eta_vxy.Add(eta_vxy_i);
      _eta_vz.Add(eta_vz_i);
      _eta_v.Add(eta_v_i);
      _eta.Add(eta_i);
    }

    eta_x = _eta_x;
    eta_y = _eta_y;
    eta_vxy = _eta_vxy;
    eta_vz = _eta_vz;
    eta_v = _eta_v;
    eta = _eta;

    NativeMethods.FreeLibrary(hModule);
    NativeMethods.SetDllDirectory(null);
# ---------- check_cross_sections: C# additional code ----------
  Dictionary<int, MaterialType> materialInfos;
  Dictionary<int, Sofistik.Material> materials;
  Dictionary<int,List<CQUAD_FOR>> quadResults;

  protected void ComputeSingleLayerResult(int quadNr, double t, int mnr, double kmod, double gammaM,
    out double eta_x, out double eta_y, out double eta_vxy, out double eta_vz)
  {
    // retrieve the material values of the quad
    TimberMaterial material = materials[mnr] as TimberMaterial;
    if (material == null)
    {
      Print("Cannot perform timber checks on non-timber materials, aborted.");
      eta_x = 0.0;
      eta_y = 0.0;
      eta_vxy = 0.0;
      eta_vz = 0.0;
      return;
    }
    double fm0_rd = 0.001 * (kmod / gammaM) * material.Fm0_k;
    double fm90_rd = 0.001 * (kmod / gammaM) * material.Fm90_k;   // N/mm²
    double ft0_rd = 0.001 * (kmod / gammaM) * material.Ft0_k;    // N/mm²
    double ft90_rd = 0.001 * (kmod / gammaM) * material.Ft90_k;   // N/mm²
    double fc0_rd = 0.001 * (kmod / gammaM) * material.Fc0_k;    // N/mm²
    double fc90_rd = 0.001 * (kmod / gammaM) * material.Fc90_k;   // N/mm²
    double fv_rd = 0.001 * (kmod / gammaM) * material.Fv_k;     // N/mm²
    double fvb_rd = 0.001 * (kmod / gammaM) * material.Fvb_k;    // N/mm²
    double fvb90_rd = 0.001 * (kmod / gammaM) * material.Fvb90_k;  // N/mm²

    // retrieve the quad forces for this quad, n --> kN/m, m --> kN-m/m
    List<CQUAD_FOR> quadForces = quadResults[quadNr];
    double nx_t = 0.0;
    double nx_c = 0.0;
    double ny_t = 0.0;
    double ny_c = 0.0;
    double nxy = 0.0;
    double mx = 0.0;
    double my = 0.0;
    double mxy = 0.0;
    double vx = 0.0;
    double vy = 0.0;
    foreach (var quadForce in quadForces)
    {
      if (quadForce.m_NX > nx_t)
        nx_t = quadForce.m_NX;
      if (quadForce.m_NX < nx_c)
        nx_c = quadForce.m_NX;
      if (quadForce.m_NY > ny_t)
        ny_t = quadForce.m_NY;
      if (quadForce.m_NY < ny_c)
        ny_c = quadForce.m_NY;
      if (Math.Abs(quadForce.m_NXY) > nxy)
        nxy = Math.Abs(quadForce.m_NXY);

      if (Math.Abs(quadForce.m_MXX) > mx)
        mx = Math.Abs(quadForce.m_MXX);
      if (Math.Abs(quadForce.m_MYY) > my)
        my = Math.Abs(quadForce.m_MYY);
      if (Math.Abs(quadForce.m_MXY) > mxy)
        mxy = Math.Abs(quadForce.m_MXY);

      if (Math.Abs(quadForce.m_VX) > vx)
        vx = Math.Abs(quadForce.m_VX);
      if (Math.Abs(quadForce.m_VY) > vy)
        vy = Math.Abs(quadForce.m_VY);
    }

    // Bending Resistance and Axial resistance
    // x-Direction:
    double mx_rd = 0.001 * fm0_rd * t * t / 6.0;
    double nx_c_rd = fc0_rd * t;  // kN/m
    double nx_t_rd = ft0_rd * t;  // kN/m

    // y-Direction:
    double my_rd = 0.001 * fm90_rd * t * t / 6.0;
    double ny_c_rd = fc90_rd * t;  // kN/m
    double ny_t_rd = ft90_rd * t;  // kN/m

    // Torsion Resistance
    double mxy_rd = 1000.0 * fv_rd * t * t / 6.0; // TODO: CHECK THIS

    // In-Plane shear resistance
    double nxy_rd = 1000.0 * fv_rd * t;

    // Out-of-plane shear resistance
    double vx_rd = fvb_rd * t / 1.5;
    double vy_rd = fvb90_rd * t / 1.5;

    eta_x = Math.Max(
      mx / mx_rd + nx_t / nx_t_rd,
      mx / mx_rd - nx_c / nx_c_rd);

    eta_y = Math.Max(
      my / my_rd + ny_t / ny_t_rd,
      my / my_rd - ny_c / ny_c_rd);
    eta_vxy = mxy / mxy_rd + nxy / nxy_rd;
    eta_vz = Math.Sqrt(Math.Pow(vx / vx_rd, 2) + Math.Pow(vy / vy_rd, 2));
  }

  protected void ComputeMultiLayerResult(int quadNr, int mnr, double kmod, double gammaM,
    out double eta_x, out double eta_y, out double eta_vxy, out double eta_vz)
  {
    eta_x = 0.0;
    eta_y = 0.0;
    eta_vxy = 0.0;
    eta_vz = 0.0;

    int layerMaterialNr = 0;

    LayeredMaterial layeredMaterial = materials[mnr] as LayeredMaterial;
    if (layeredMaterial == null)
    {
      Print("Multi-Layer results can only be computed with multi-layer materials.");
      return;
    }

    Dictionary<int,TimberMaterial> timberMaterials = new Dictionary<int,TimberMaterial>();
    foreach (int key in materials.Keys)
    {
      var timberMaterial = materials[key] as TimberMaterial;
      if (timberMaterial != null)
      {
        timberMaterials.Add(key, timberMaterial);
      }
    }

    List<Tuple<int,double,double>> layers = layeredMaterial.Layers;

    // compute t, assume symetric build-up
    double t = 0.0;     // m
    double tmax = 0.0;  // m
    for (int j = 0; j < layers.Count; j++)
    {
      t += layers[j].Item2;
      if (layers[j].Item2 > tmax)
      {
        tmax = layers[j].Item2;
      }
    }

    // retrieve the quad forces for this quad, n --> kN/m, m --> kN-m/m
    List<CQUAD_FOR> quadForces = quadResults[quadNr];
    double nx_t = 0.0;
    double nx_c = 0.0;
    double ny_t = 0.0;
    double ny_c = 0.0;
    double nxy = 0.0;
    double mx = 0.0;
    double my = 0.0;
    double mxy = 0.0;
    double vx = 0.0;
    double vy = 0.0;
    foreach (var quadForce in quadForces)
    {
      if (quadForce.m_NX > nx_t)
        nx_t = quadForce.m_NX;
      if (quadForce.m_NX < nx_c)
        nx_c = quadForce.m_NX;
      if (quadForce.m_NY > ny_t)
        ny_t = quadForce.m_NY;
      if (quadForce.m_NY < ny_c)
        ny_c = quadForce.m_NY;
      if (Math.Abs(quadForce.m_NXY) > nxy)
        nxy = Math.Abs(quadForce.m_NXY);

      if (Math.Abs(quadForce.m_MXX) > mx)
        mx = Math.Abs(quadForce.m_MXX);
      if (Math.Abs(quadForce.m_MYY) > my)
        my = Math.Abs(quadForce.m_MYY);
      if (Math.Abs(quadForce.m_MXY) > mxy)
        mxy = Math.Abs(quadForce.m_MXY);

      if (Math.Abs(quadForce.m_VX) > vx)
        vx = Math.Abs(quadForce.m_VX);
      if (Math.Abs(quadForce.m_VY) > vy)
        vy = Math.Abs(quadForce.m_VY);
    }

    // compute Bx, By and Bxy
    // compute Dx, Dy and Dxy
    double Bx = 0.0;
    double By = 0.0;
    double Bxy = 0.0;
    double Dx = 0.0;
    double Dy = 0.0;
    double Dxy = 0.0;
    double z_j = -0.5 * t;
    for (int j = 0; j < layers.Count; j++)
    {
      // material properties
      double Ex_j = timberMaterials[layers[j].Item1].E0;   // [kN/m²]
      double Ey_j = timberMaterials[layers[j].Item1].E90;  // [kN/m²]
      double Gxy_j = timberMaterials[layers[j].Item1].G0;  // [kN/m²]

      // geometry information
      double t_j = layers[j].Item2;
      z_j += 0.5 * t_j;
      Bx += Ex_j * (t_j * Math.Pow(z_j, 2) + Math.Pow(t_j, 3) / 12);
      By += Ey_j * (t_j * Math.Pow(z_j, 2) + Math.Pow(t_j, 3) / 12);
      Bxy += Gxy_j * (2 * t_j * Math.Pow(z_j, 2) + Math.Pow(t_j, 3) / 6);
      Dx += Ex_j * t_j;
      Dy += Ey_j * t_j;
      Dxy += Gxy_j * t_j;
      z_j += 0.5 * t_j;
    }

    // compute ESx and ESy
    double ESx = 0.0;
    double ESy = 0.0;
    z_j = 0.0;
    if (layers.Count == 3 || layers.Count == 7 || layers.Count == 11)
    {
      // rolling shear, critical layer for x-Direction: midlayer
      // rolling shear, critical layer for y-Direction: midlayer + 1
      for (int j = layers.Count / 2; j < layers.Count; j++)
      {
        // material properties
        double Ex_j = timberMaterials[layers[j].Item1].E0;   // [kN/m²]
        double Ey_j = timberMaterials[layers[j].Item1].E90;  // [kN/m²]

        // geometry information
        double t_j = layers[j].Item2;
        if (j > layers.Count / 2)
        {
          z_j += 0.5 * t_j;
          ESx += Ex_j * z_j * t_j;
          ESy += Ey_j * z_j * t_j;
        }
        else
        {
          ESx += Ex_j * t_j * t_j / 8.0;
        }
        z_j += 0.5 * t_j;
      }
    }
    else if (layers.Count == 5 || layers.Count == 9 || layers.Count == 13)
    {
      // rolling shear, critical layer for x-Direction: midlayer + 1
      // rolling shear, critical layer for y-Direction: midlayer
      for (int j = layers.Count / 2; j < layers.Count; j++)
      {
        // material properties
        double Ex_j = timberMaterials[layers[j].Item1].E0;   // [kN/m²]
        double Ey_j = timberMaterials[layers[j].Item1].E90;  // [kN/m²]

        // geometry information
        double t_j = layers[j].Item2;
        if (j > layers.Count / 2)
        {
          z_j += 0.5 * t_j;
          ESx += Ex_j * z_j * t_j;
          ESy += Ey_j * z_j * t_j;
        }
        else
        {
          ESy += Ey_j * t_j * t_j / 8.0;
        }
        z_j += 0.5 * t_j;
      }
    }
    else
    {
      Print("Asymetric build-up, or too many layers, not supported.");
      return;
    }

    // Bending Resistance and Axial resistance
    // x-Direction:
    layerMaterialNr = layers[layers.Count - 1].Item1;
    double fm_rd = 0.001 * (kmod / gammaM) * timberMaterials[layerMaterialNr].Fm0_k; // N/mm²
    double ft0_rd = 0.001 * (kmod / gammaM) * timberMaterials[layerMaterialNr].Ft0_k; // N/mm²
    double fc0_rd = 0.001 * (kmod / gammaM) * timberMaterials[layerMaterialNr].Fc0_k; // N/mm²

    double zo = 0.5 * t;
    double mx_rd = 1000.0 * fm_rd * Bx / (timberMaterials[layerMaterialNr].E0 * zo);
    double nx_c_rd = 1000.0 * fc0_rd * Dx / (timberMaterials[layerMaterialNr].E0);
    double nx_t_rd = 1000.0 * ft0_rd * Dx / (timberMaterials[layerMaterialNr].E0);

    // y-Direction:
    layerMaterialNr = layers[layers.Count - 2].Item1;
    fm_rd = 0.001 * (kmod / gammaM) * timberMaterials[layerMaterialNr].Fm0_k; // N/mm²
    ft0_rd = 0.001 * (kmod / gammaM) * timberMaterials[layerMaterialNr].Ft0_k; // N/mm²
    fc0_rd = 0.001 * (kmod / gammaM) * timberMaterials[layerMaterialNr].Fc0_k; // N/mm²

    double to = t - layers[layers.Count - 1].Item2;
    zo = to - 0.5 * t;
    double my_rd = 1000.0 * fm_rd * By / (timberMaterials[layerMaterialNr].E90 * zo);
    double ny_c_rd = 1000.0 * fc0_rd * Dy / (timberMaterials[layerMaterialNr].E90);
    double ny_t_rd = 1000.0 * ft0_rd * Dy / (timberMaterials[layerMaterialNr].E90);

    // Material values shear + torsion
    double fv_k = double.MaxValue;
    double fv_T_k = double.MaxValue;
    foreach (var layer in layers)
    {
      if (timberMaterials[layer.Item1].Fv_k < fv_k)
      {
        fv_k = timberMaterials[layer.Item1].Fv_k;
      }
      if (timberMaterials[layer.Item1].Fvb90_k < fv_T_k)
      {
        fv_T_k = timberMaterials[layer.Item1].Fvb90_k;
      }
    }
    double fv_rd = 0.001 * (kmod / gammaM) * fv_k;       // N/mm²
    double fv_T_rd = 0.001 * (kmod / gammaM) * fv_T_k;   // N/mm²

    // Twisting Resistance
    zo = 0.5 * t;
    layerMaterialNr = layers[layers.Count - 1].Item1;
    double mxy_rd = 1000.0 * fv_T_rd * Bxy / (timberMaterials[layerMaterialNr].G0 * zo);

    // In-Plane shear resistance
    layerMaterialNr = layers[layers.Count - 1].Item1;
    double t0_netto = Dx / (timberMaterials[layerMaterialNr].E0);
    layerMaterialNr = layers[layers.Count - 2].Item1;
    double t90_netto = Dy / (timberMaterials[layerMaterialNr].E90);
    double t_netto = Math.Min(t0_netto, t90_netto);
    double a = 0.15;
    double nxy_1_rd = 1000.0 * fv_T_rd * t_netto * a / (3.0 * tmax);
    double nxy_2_rd = 1000.0 * fv_rd * t;
    double nxy_rd = Math.Min(nxy_1_rd, nxy_2_rd);

    // Out-of-plane shear resistance
    double fv_R_rd = 0.0;    // N/mm²
    double vx_rd = (1000.0 * fv_R_rd * Bx) / ESx;
    double vy_rd = 0.0;
    switch (layers.Count)
    {
      case 3:
        // rolling shear, critical layer for x-Direction: midlayer
        fv_R_rd = 0.001 * (kmod / gammaM) * timberMaterials[layers[1].Item1].Fvb_k;
        vx_rd = (1000.0 * fv_R_rd * Bx) / ESx;
        // for y-Direction: no rolling shear, simple shear for the mid board
        double t_mid = layers[1].Item2;
        vy_rd = (1000.0 * fv_T_rd * t_mid) / 1.5;
        break;
      case 5:
        // rolling shear, critical layer for x-Direction: midlayer - 1
        fv_R_rd = 0.001 * (kmod / gammaM) * timberMaterials[layers[1].Item1].Fvb_k;
        vx_rd = (1000.0 * fv_R_rd * Bx) / ESx;
        // rolling shear, critical layer for y-Direction: midlayer
        fv_R_rd = 0.001 * (kmod / gammaM) * timberMaterials[layers[2].Item1].Fvb_k;
        vy_rd = (1000.0 * fv_R_rd * By) / ESy;
        break;
      case 7:
        // rolling shear, critical layer for x-Direction: midlayer
        fv_R_rd = 0.001 * (kmod / gammaM) * timberMaterials[layers[3].Item1].Fvb_k;
        vx_rd = (1000.0 * fv_R_rd * Bx) / ESx;
        // rolling shear, critical layer for y-Direction: midlayer - 1
        fv_R_rd = 0.001 * (kmod / gammaM) * timberMaterials[layers[2].Item1].Fvb_k;
        vy_rd = (1000.0 * fv_R_rd * By) / ESy;
        break;
      case 9:
        // rolling shear, critical layer for x-Direction: midlayer - 1
        fv_R_rd = 0.001 * (kmod / gammaM) * timberMaterials[layers[3].Item1].Fvb_k;
        vx_rd = (1000.0 * fv_R_rd * Bx) / ESx;
        // rolling shear, critical layer for y-Direction: midlayer
        fv_R_rd = 0.001 * (kmod / gammaM) * timberMaterials[layers[4].Item1].Fvb_k;
        vy_rd = (1000.0 * fv_R_rd * By) / ESy;
        break;
      default:
        Print("Asymetric build-up, or too many layers, not supported.");
        return;
    }
    eta_x = Math.Max(
      mx / mx_rd + nx_t / nx_t_rd,
      mx / mx_rd - nx_c / nx_c_rd);

    eta_y = Math.Max(
      my / my_rd + ny_t / ny_t_rd,
      my / my_rd - ny_c / ny_c_rd);
    eta_vxy = mxy / mxy_rd + nxy / nxy_rd;
    eta_vz = Math.Sqrt(Math.Pow(vx / vx_rd, 2) + Math.Pow(vy / vy_rd, 2));
  }

  internal class NativeMethods
  {
    [DllImport("Kernel32.dll", BestFitMapping = false, CharSet = CharSet.Ansi, SetLastError = true, ThrowOnUnmappableChar = true)]
    internal static extern IntPtr LoadLibrary([MarshalAs(UnmanagedType.LPStr)]string lpFileName);

    [DllImport("Kernel32.dll", BestFitMapping = false, CharSet = CharSet.Ansi, ExactSpelling = true, SetLastError = true, ThrowOnUnmappableChar = true)]
    internal static extern IntPtr GetProcAddress(IntPtr hModule, string procName);

    [DllImport("Kernel32.dll", SetLastError = true)]
    internal static extern bool FreeLibrary(IntPtr hModule);

    [DllImport("Kernel32.dll", CharSet = CharSet.Unicode, SetLastError = true)]
    [return: MarshalAs(UnmanagedType.Bool)]
    internal static extern bool SetDllDirectory(string lpPathName);
  }
# ---------- end check_cross_sections ----------
bnd_15 = Bounds(Numbers=check_cross_sections.eta_x)
bnd_16 = Bounds(Numbers=check_cross_sections.eta_y)
bnd_17 = Bounds(Numbers=check_cross_sections.eta_vxy)
bnd_18 = Bounds(Numbers=check_cross_sections.eta_vz)
bnd_19 = Bounds(Numbers=check_cross_sections.eta_v)
bnd_20 = Bounds(Numbers=check_cross_sections.eta)
addition_3 = Addition(A=check_cross_sections.eta_vxy, B=check_cross_sections.eta_vz)
panel_38 = Panel([bnd_15, bnd_16, bnd_17, bnd_18, bnd_19, bnd_20])
bnd_21 = Bounds(Numbers=addition_3)
get_deformed_mesh_sofistik_2 = GetDeformedMeshSofistik(Path=pathcdb_2, LoadCase=1, ScalingFactor=100, SofistikPath=pathcdb_dll_4, Run=toggle_4)  # -> InitialMesh, DeformedMesh
dedomain_18 = DeconstructDomain(Domain=bnd_20)  # -> Start, End
gradient_10 = Gradient(
    LowerLimit=Slider(1, range=0..1),
    UpperLimit=dedomain_18.Start,
    Parameter=check_cross_sections.eta,
    stops=[0: RGB(234, 38, 0), 0.25: RGB(234, 126, 0), 0.5: RGB(254, 244, 84), 0.75: RGB(173, 203, 249), 1: RGB(75, 107, 169)])

# ----
panel_39 = Panel(check_cross_sections.eta)

sort_14 = SortList(Keys=flatten(check_cross_sections.eta))  # -> reverse(Keys), ValuesA
expression_2 = Expression(x=sort_14.Keys, Expression="Round(x,2)")
maxutilisation = Panel(expression_2)

eta_y = Panel(bnd_16)
eta_vxy_vz = Panel(bnd_21)
eta_v = Panel(bnd_19)
eta = Panel(bnd_20)
eta_vxy = Panel(bnd_17)
eta_vz = Panel(bnd_18)
eta_x = Panel(bnd_15)

# ---- group: Deformed
dedomain_19 = DeconstructDomain(Domain=bnd_20)  # -> Start, End
gradient_11 = Gradient(
    LowerLimit=dedomain_19.End,
    UpperLimit=dedomain_19.Start,
    Parameter=check_cross_sections.eta,
    stops=[0: RGB(234, 38, 0), 0.25: RGB(234, 126, 0), 0.5: RGB(254, 244, 84), 0.75: RGB(173, 203, 249), 1: RGB(75, 107, 169)])
gradient_12 = Gradient(
    LowerLimit=dedomain_19.End,
    UpperLimit=dedomain_19.Start,
    Parameter=check_cross_sections.eta,
    stops=[0: RGB(217, 76, 48), 0.25: RGB(199, 133, 58), 0.5: RGB(214, 205, 71), 0.75: RGB(99, 142, 207), 1: RGB(12, 60, 156)])
number_slider_22 = Slider(0.001, range=0..0.1)
wbfacepolys = WeaverbirdsFacePolylines(Mesh=get_deformed_mesh_sofistik_2.InitialMesh)  # -> flatten(Polygons)

# ----
facen_2 = FaceNormals(Mesh=get_deformed_mesh_sofistik_2.InitialMesh)  # -> Centers, Normals
number_slider_23 = Slider(28, range=0..2100)
neg_9 = Negative(Value=number_slider_23)
dom_15 = ConstructDomain(DomainStart=neg_9, DomainEnd=number_slider_23)
dom_16 = ConstructDomain(DomainStart="0", DomainEnd=number_slider_23)
sort_15 = SortList(Keys=check_cross_sections.eta, ValuesA=facen_2.Centers, ValuesB=gradient_10)  # -> reverse(flatten(Keys)), reverse(flatten(ValuesA)), reverse(flatten(ValuesB))
subset_11 = SubList(List=sort_15.Keys, Domain=dom_16, Wrap=True)  # -> List, Index
subset_12 = SubList(List=sort_15.ValuesA, Domain=dom_16, Wrap=True)  # -> List, Index
subset_13 = SubList(List=sort_15.ValuesB, Domain=dom_16, Wrap=True)  # -> List, Index
expression_3 = Expression(x=subset_11.List, Expression="Round(x,2)")
swatch_6 = ColourSwatch(SwatchColor=RGB(0, 191, 255))
maxutilisation_2 = Panel(expression_3)

item_40 = ListItem(List=maxutilisation, Index=0, Wrap=True)

wbjoin = WeaverbirdsJoinMeshesAndWeld(Mesh=get_deformed_mesh_sofistika.DeformedMesh, Weld=False)
wbjoin_2 = WeaverbirdsJoinMeshesAndWeld(Mesh=get_deformed_mesh_sofistika.InitialMesh, Weld=False)
number_slider_24 = Slider(0.02, range=0..1)
facen_3 = FaceNormals(Mesh=wbjoin_2)  # -> Centers, Normals
facen_4 = FaceNormals(Mesh=wbjoin)  # -> Centers, Normals
wbfacepolys_2 = WeaverbirdsFacePolylines(Mesh=wbjoin)  # -> flatten(Polygons)
wbfacepolys_3 = WeaverbirdsFacePolylines(Mesh=wbjoin_2)  # -> flatten(Polygons)
swatch_7 = ColourSwatch(SwatchColor=RGB(255, 0, 0))
swatch_8 = ColourSwatch(SwatchColor=RGB(0, 0, 0))
dist_3 = Distance(PointA=facen_3.Centers, PointB=facen_4.Centers)
sph = Sphere(Base=pt_21, Radius=number_slider_24)
sph_2 = Sphere(Base=item_39, Radius=number_slider_24)
bnd_22 = Bounds(Numbers=dist_3)
dedomain_20 = DeconstructDomain(Domain=bnd_22)  # -> Start, End
gradient_13 = Gradient(
    LowerLimit=dedomain_20.End,
    UpperLimit=dedomain_20.Start,
    Parameter=dist_3,
    stops=[0: RGBA(235, 39, 0, 80), 0.25: RGBA(235, 125, 0, 80), 0.5: RGBA(255, 244, 84, 80), 0.83: RGBA(172, 203, 250, 80), 1: RGBA(74, 77, 168, 80)])
gradient_14 = Gradient(
    LowerLimit=dedomain_20.End,
    UpperLimit=dedomain_20.Start,
    Parameter=dist_3,
    stops=[0: RGBA(186, 31, 0, 45), 0.25: RGBA(199, 106, 0, 45), 0.5: RGBA(232, 217, 0, 45), 0.83: RGBA(0, 97, 242, 45), 1: RGBA(0, 8, 240, 45)])
gradient_15 = Gradient(
    LowerLimit=Slider(0.1, range=0..1),
    UpperLimit=dedomain_20.Start,
    Parameter=dist_3,
    stops=[0: RGB(234, 38, 0), 0.25: RGB(234, 126, 0), 0.5: RGB(254, 244, 84), 0.83: RGB(173, 203, 249), 1: RGB(74, 77, 168)])
number_slider_25 = Slider(0.01, range=0..10)
number_slider_26 = Slider(14, range=0..20)

maxutilisation_3 = Panel(item_40)

# ---- group: CLT Utilization
previewlw_3 = CustomPreviewLineweights(Geometry=wbfacepolys, Shader=gradient_12, Thickness=number_slider_22, Absolute=True)
colourmesh_2 = ColourMesh(Mesh=get_deformed_mesh_sofistik_2.InitialMesh, Colors=gradient_10)
screentext = ScreenOrientedText(
    Text=maxutilisation_2,
    Justification=7,
    Location=subset_12.List,
    SizeFactor=Slider(15, range=1..50),
    Color=ColourSwatch(SwatchColor=RGB(0, 0, 0)),
    Depth=Slider(1, range=0..50),
    Absolute=False)

# ---- group: Deformation / Deformed
colourmesh_3 = ColourMesh(Mesh=get_deformed_mesh_sofistika.DeformedMesh, Colors=gradient_15)
previewlw_4 = CustomPreviewLineweights(Geometry=wbfacepolys_2, Shader=gradient_14, Thickness=number_slider_25, Absolute=True)
previewlw_5 = CustomPreviewLineweights(Geometry=sph_2, Shader=swatch_7, Thickness=number_slider_25, Absolute=True)
screentext_2 = ScreenOrientedText(
    Text=concat_3,
    Font=item_9,
    Justification=7,
    Location=item_39,
    SizeFactor=number_slider_26,
    Color=swatch_8,
    Depth=0,
    Absolute=False)

# ---- group: Deformation / Undeformed
colourmesh_4 = ColourMesh(Mesh=get_deformed_mesh_sofistika.InitialMesh, Colors=gradient_9)
previewlw_6 = CustomPreviewLineweights(Geometry=wbfacepolys_3, Shader=gradient_14, Thickness=number_slider_25, Absolute=True)
screentext_3 = ScreenOrientedText(
    Text=concat_3,
    Font=item_9,
    Justification=7,
    Location=pt_21,
    SizeFactor=number_slider_26,
    Color=swatch_8,
    Depth=0,
    Absolute=False)
previewlw_7 = CustomPreviewLineweights(Geometry=sph, Shader=swatch_7, Thickness=number_slider_25, Absolute=True)
