# Grasshopper definition OOB Nurbs control system.gh (Grasshopper 1.0.7)
# plug-ins: sof_gh_sofistik-2022, HygroDesign, MeshEdit Components, Karamba3D, Kangaroo2 Components, Weaverbird, Human, LunchBox, Opossum2_0_Proto_A, Pufferfish

# ---- group: parametric input
number_slider = Slider(1000, range=0..2000)
number_slider_2 = Slider(498, range=0..500)
number_slider_3 = Slider(461, range=0..500)
number_slider_4 = Slider(6, range=0..500)
number_slider_5 = Slider(0.9, range=0.1..0.9)
number_slider_6 = Slider(0.897, range=0.1..0.9)
number_slider_7 = Slider(0.883, range=0.1..0.9)
division = Division(A=number_slider, B=2)
division_2 = Division(A=number_slider, B=2)
division_3 = Division(A=number_slider, B=2)
neg = Negative(Value=number_slider_2)
neg_2 = Negative(Value=number_slider_3)
neg_3 = Negative(Value=number_slider_4)
multiplication = Multiplication(A=number_slider_5, B=division)
multiplication_2 = Multiplication(A=number_slider_6, B=division_2)
multiplication_3 = Multiplication(A=number_slider_7, B=division_3)
subtraction = Subtraction(A=number_slider, B=multiplication)
subtraction_2 = Subtraction(A=number_slider, B=multiplication_2)
subtraction_3 = Subtraction(A=number_slider, B=multiplication_3)
pt = ConstructPoint(XCoordinate=0, YCoordinate=0, ZCoordinate=0)
pt_2 = ConstructPoint(XCoordinate=multiplication, YCoordinate=neg, ZCoordinate=0)
pt_3 = ConstructPoint(XCoordinate=subtraction, YCoordinate=neg, ZCoordinate=0)
pt_4 = ConstructPoint(XCoordinate=number_slider, YCoordinate=0, ZCoordinate=0)
pt_5 = ConstructPoint(XCoordinate=0, YCoordinate=0, ZCoordinate=0)
pt_6 = ConstructPoint(XCoordinate=multiplication_2, YCoordinate=neg_2, ZCoordinate=0)
pt_7 = ConstructPoint(XCoordinate=subtraction_2, YCoordinate=neg_2, ZCoordinate=0)
pt_8 = ConstructPoint(XCoordinate=number_slider, YCoordinate=0, ZCoordinate=0)
pt_9 = ConstructPoint(XCoordinate=0, YCoordinate=0, ZCoordinate=0)
pt_10 = ConstructPoint(XCoordinate=multiplication_3, YCoordinate=neg_3, ZCoordinate=0)
pt_11 = ConstructPoint(XCoordinate=subtraction_3, YCoordinate=neg_3, ZCoordinate=0)
pt_12 = ConstructPoint(XCoordinate=number_slider, YCoordinate=0, ZCoordinate=0)
merge = Merge(Data1=pt, Data2=pt_2, Data3=pt_3, Data4=pt_4)
merge_2 = Merge(Data1=pt_5, Data2=pt_6, Data3=pt_7, Data4=pt_8)
merge_3 = Merge(Data1=pt_9, Data2=pt_10, Data3=pt_11, Data4=pt_12)
nurbs = NurbsCurve(Vertices=merge, Degree=3, Periodic=False)  # -> Curve, Length, Domain
nurbs_2 = NurbsCurve(Vertices=merge_2, Degree=3, Periodic=False)  # -> Curve, Length, Domain
nurbs_3 = NurbsCurve(Vertices=merge_3, Degree=3, Periodic=False)  # -> Curve, Length, Domain
merge_4 = Merge(Data1=nurbs.Curve, Data2=nurbs_2.Curve, Data3=nurbs_3.Curve)

# ----
update = Button()
io = IO(
    SofistikDocumentProperties_VersionMajor="2022",
    SofistikDocumentProperties_VersionMinor="0",
    SofistikDocumentProperties_VersionName="2022")
python = GhPythonScript(update=update)  # inputs update: Boolean
# ---------- python: Python ----------
# Seghier Mohamed Abdelaziz - 2021 - seghierdesign@gmail.com

import Grasshopper as gh

ghDoc = ghenv.Component.OnPingDocument()
objects = ghDoc.Objects

object = []

for obj in objects: 

    if obj.NickName.Length == 0:
        if str(obj.RemovedFromDocument.DeclaringType) == "Grasshopper.Kernel.GH_Component":
            object.append(obj)
                
if update == True:
    gh.Kernel.GH_Document.NewSolution(ghDoc,False)
    for o in object:
        gh.Kernel.GH_Document.RemoveObject(ghDoc ,o,False)
# ---------- end python ----------

number_slider_8 = Slider(3000, range=0..3000)
number_slider_9 = Slider(11, range=0..30)
number_slider_10 = Slider(150, range=0..200)
xy = XYPlane(Origin=Point(0, 0, 0))
panel = BilayerPanel(
    BasePlane=xy,
    BoardWidth=number_slider_10,
    BoardLength=number_slider_8,
    WidthCount=number_slider_9,
    LengthCount=Slider(3, range=0..10))

panel_orientation = Panel("-1")
compute_double_curvature = BooleanToggle(True)
compute_3d_boards = BooleanToggle(False)
compute_structure = BooleanToggle(True)

species = WoodSpecies()
item = ListItem(List=species, Index=0, Wrap=True)  # -> Item, Item1

multiplication_4 = Multiplication(A=number_slider_10, B=number_slider_9)

# ---- group: beech
data = Data(item.Item)

# ---- group: spruce
data_2 = Data(item.Item1)

# ---- group: manual input
crv = Curve(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)
crv_2 = Curve(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)
crv_3 = Curve(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)
merge_5 = Merge(Data1=crv, Data2=crv_2, Data3=crv_3)

# ----
board_count = Slider(500, range=0..500)

crv_4 = Curve(merge_4)
lng = ListLength(List=crv_4)  # -> expr("x-2", Length)
dom = ConstructDomain(DomainStart=0, DomainEnd=lng)
subset = SubList(List=crv_4, Domain=dom, Wrap=True)  # -> graft(List), Index
shift = ShiftList(List=crv_4, Shift=1, Wrap=False)  # -> graft(List)
merge_6 = Merge(Data1=subset.List, Data2=shift)  # -> simplify(Result)
group = Group(Objects=merge_6)  # -> flatten(Group)

movopossum_3_0_0 = Opossum(
    OpossumData_objective=num_27,
    OpossumData_variable=[number_slider_2, number_slider_5, number_slider_6, number_slider_3, number_slider_7, number_slider_4])

deconstruct_panel = DeconstructPanel(Panel=panel)
dec_board = DeconstructBoard(Board=deconstruct_panel)  # -> Name, Material, Polyline, Radius, MoistureChange, Error, BlendedRadius, Width
area = Area(Geometry=dec_board.Polyline)  # -> Area, Centroid

# ---- group: name
num = Number(board_count)
series = Series(Start=0, Step=1, Count=num)
dup = DuplicateData(Data="S", Number=num, Order=True)  # -> graft(Data)
txt = Text(graft(series))
merge_7 = Merge(Data1=dup, Data2=txt)  # -> simplify(Result)
join = TextJoin(Text=merge_7)  # -> flatten(Result)

# ---- group: RT
dom_2 = ConstructDomain(DomainStart=Slider(11, range=0..100), DomainEnd=Slider(75, range=0..100))
random = Random(Range=dom_2, Number=board_count, Seed=Slider(225, range=0..1000))

dom_3 = ConstructDomain(DomainStart=Slider(15, range=0..100), DomainEnd=Slider(75, range=0..100))
random_2 = Random(Range=dom_3, Number=board_count, Seed=Slider(225, range=0..1000))

# ---- group: name
num_2 = Number(board_count)
series_2 = Series(Start=0, Step=1, Count=num_2)
dup_2 = DuplicateData(Data="B", Number=num_2, Order=True)  # -> graft(Data)
txt_2 = Text(graft(series_2))
merge_8 = Merge(Data1=dup_2, Data2=txt_2)  # -> simplify(Result)
join_2 = TextJoin(Text=merge_8)  # -> flatten(Result)

# ---- group: length
num_3 = Number(number_slider_8)
num_4 = Number(board_count)
dup_3 = DuplicateData(Data=num_3, Number=num_4, Order=True)

num_5 = Number(number_slider_10)
num_6 = Number(board_count)
dup_4 = DuplicateData(Data=num_5, Number=num_6, Order=True)

num_7 = Number(number_slider_10)
num_8 = Number(board_count)
dup_5 = DuplicateData(Data=num_7, Number=num_8, Order=True)

num_9 = Number(number_slider_8)
num_10 = Number(board_count)
dup_6 = DuplicateData(Data=num_9, Number=num_10, Order=True)

# ---- group: moisture changes
panel_2 = Panel("""5
10
15
20""")
num_11 = Number(panel_2)

# ----
series_3 = Series(Start=Slider(1, range=0..1), Step=1, Count=Slider(25, range=0..100))
stockpile = Stockpile(Material=data, Name=join_2, Length=dup_3, Width=dup_4, RTAngle=random, MoistureChanges=num_11)
stockpile_2 = Stockpile(Material=data_2, Name=join, Length=dup_6, Width=dup_5, RTAngle=random_2, MoistureChanges=num_11)
merge_9 = Merge(Data1=stockpile, Data2=stockpile_2)
bool = Boolean(compute_double_curvature)
Y = UnitY(Factor=Slider(10000, range=0..10000))
Y_2 = UnitY(Factor=Slider(5000, range=0..10000))
bool_2 = Boolean(compute_3d_boards)
python_2 = GhPythonScript(x=data)  # -> out, a, b
# ---------- python_2: Python ----------
a = x.LElasticModulus
b = x.RElasticModulus
# ---------- end python_2 ----------
python_3 = GhPythonScript(x=data_2)  # -> out, a, b; same code as python_2

# ---- group: active layer
ft0 = Slider(80, range=0..100)
gamma = Slider(7.37, range=0..10)
num_12 = Number(Slider(20, range=0..100))

# ---- group: passive layer
ft0_2 = Slider(0, range=0..100)
num_13 = Number(Slider(4, range=0..10))

# ---- group: active layer
ft0_3 = Slider(80, range=0..100)
gamma_2 = Slider(4.21, range=0..10)
num_14 = Number(Slider(20, range=0..100))

# ---- group: passive layer
num_15 = Number(Slider(4, range=0..10))
ft0_4 = Slider(0, range=0..100)

# ---- group: active layer / total thickness
addition = Addition(A=num_12, B=num_13)

addition_2 = Addition(A=num_14, B=num_15)

# ---- group: active layer / distance from bottom
expression = Expression(x=addition, y=num_12, Expression="x - y/2")

expression_2 = Expression(x=addition_2, y=num_14, Expression="x - y/2")

# ---- group: passive layer / distance from bottom
expression_3 = Expression(x=expression, y=addition, Expression="x - y/2")

expression_4 = Expression(x=expression_2, y=addition_2, Expression="x - y/2")

# ---- group: active layer / CG from bottom
division_4 = Division(A=addition, B=2)

division_5 = Division(A=addition_2, B=2)

# ---- group: passive layer / dist from CG
subtraction_4 = Subtraction(A=expression_3, B=division_4)
abs = Absolute(Value=subtraction_4)

subtraction_5 = Subtraction(A=expression_4, B=division_5)
abs_2 = Absolute(Value=subtraction_5)

# ---- group: active layer / dist from CG
subtraction_6 = Subtraction(A=expression, B=division_4)
abs_3 = Absolute(Value=subtraction_6)

subtraction_7 = Subtraction(A=expression_2, B=division_5)
abs_4 = Absolute(Value=subtraction_7)

# ---- group: active layer / l
expression_5 = Expression(x=num_12, Expression="1000*x^3/12")

# ---- group: passive layer / l
expression_6 = Expression(x=num_13, Expression="1000*x^3/12")

# ---- group: passive layer / Ax2
expression_7 = Expression(x=num_13, y=abs, Expression="1000*x*y^2")

# ----
number_slider_11 = Slider(0.001, range=0..0.001)

# ---- group: active layer / l
expression_8 = Expression(x=num_14, Expression="1000*x^3/12")

# ---- group: passive layer / l
expression_9 = Expression(x=num_15, Expression="1000*x^3/12")

# ---- group: passive layer / Ax2
expression_10 = Expression(x=num_15, y=abs_2, Expression="1000*x*y^2")

# ---- group: active layer / Ax2
expression_11 = Expression(x=num_12, y=abs_3, Expression="1000*x*y^2")

# ----
bool_3 = Boolean(compute_structure)

# ---- group: active layer / Ax2
expression_12 = Expression(x=num_14, y=abs_4, Expression="1000*x*y^2")

# ---- group: active layer / total l
addition_3 = Addition(A=expression_5, B=expression_11)

addition_4 = Addition(A=expression_8, B=expression_12)

# ---- group: passive layer / total l
addition_5 = Addition(A=expression_6, B=expression_7)

addition_6 = Addition(A=expression_9, B=expression_10)

# ---- group: active layer / El0
multiplication_5 = Multiplication(A=python_2.a, B=addition_3)

# ---- group: active layer / T x ft0
multiplication_6 = Multiplication(A=num_12, B=ft0)

# ---- group: active layer / T x Gam
multiplication_7 = Multiplication(A=gamma, B=num_12)

# ---- group: passive layer / El0
multiplication_8 = Multiplication(A=python_3.b, B=addition_5)

# ---- group: passive layer / El90
multiplication_9 = Multiplication(A=python_3.a, B=addition_5)

# ---- group: passive layer / T x ft0
multiplication_10 = Multiplication(A=num_13, B=ft0_2)

# ---- group: active layer / El90
multiplication_11 = Multiplication(A=python_2.b, B=addition_3)

# ---- group: active layer / El0
multiplication_12 = Multiplication(A=python_3.a, B=addition_4)

# ---- group: active layer / T x ft0
multiplication_13 = Multiplication(A=num_14, B=ft0_3)

# ---- group: active layer / T x Gam
multiplication_14 = Multiplication(A=gamma_2, B=num_14)

# ---- group: passive layer / El0
multiplication_15 = Multiplication(A=python_3.b, B=addition_6)

# ---- group: passive layer / El90
multiplication_16 = Multiplication(A=python_3.a, B=addition_6)

# ---- group: passive layer / T x ft0
multiplication_17 = Multiplication(A=num_15, B=ft0_4)

# ---- group: active layer / El90
multiplication_18 = Multiplication(A=python_3.b, B=addition_4)

# ---- group: effective material properties / El0 eff (Nmm2)
addition_7 = Addition(A=multiplication_5, B=multiplication_8)

# ---- group: effective material properties / El90 eff (Nmm2)
addition_8 = Addition(A=multiplication_11, B=multiplication_9)

# ---- group: effective material properties / Sum T x Ft0
addition_9 = Addition(A=multiplication_6, B=multiplication_10)

# ---- group: effective material properties / total thickness
addition_10 = Addition(A=num_12, B=num_13)

# ---- group: effective material properties / El0 eff (Nmm2)
addition_11 = Addition(A=multiplication_12, B=multiplication_15)

# ---- group: effective material properties / El90 eff (Nmm2)
addition_12 = Addition(A=multiplication_18, B=multiplication_16)

# ---- group: effective material properties / Sum T x Ft0
addition_13 = Addition(A=multiplication_13, B=multiplication_17)

# ---- group: effective material properties / total thickness
addition_14 = Addition(A=num_14, B=num_15)

# ---- group: effective material properties / Sum Tx Gam
addition_15 = Addition(A=multiplication_7)

addition_16 = Addition(A=multiplication_14)

# ---- group: effective material properties / lx / ly
expression_13 = Expression(x=addition_10, Expression="1000*x^3/12")

expression_14 = Expression(x=addition_14, Expression="1000*x^3/12")

# ---- group: effective material properties / E0eff
division_6 = Division(A=addition_7, B=expression_13)

# ---- group: effective material properties / E90eff
division_7 = Division(A=addition_8, B=expression_13)

# ---- group: effective material properties / ft eff
division_8 = Division(A=addition_9, B=addition_10)

# ---- group: effective material properties / E0eff
division_9 = Division(A=addition_11, B=expression_14)

# ---- group: effective material properties / E90eff
division_10 = Division(A=addition_12, B=expression_14)

# ---- group: effective material properties / Gamma eff
division_11 = Division(A=addition_16, B=addition_14)

# ---- group: effective material properties / ft eff
division_12 = Division(A=addition_13, B=addition_14)

# ---- group: effective material properties
matprops = MaterialPropertiesKaramba3D(
    FamilyOfMaterial="Spruce / Spruce",
    Name="Spruce / Spruce",
    ElementIdentifier="Spruce / Spruce",
    YoungsModulusKNCm2Dir1=expr("x*0.1", division_9),
    YoungsModulusKNCm2Dir2=expr("x*0.1", division_10),
    InPlaneShearModulus_kN_cm2="42",
    InPlaneLateralContractionCoefficient=Slider(0.012, range=0..0.1, expression="0.012"),
    TransverseShearModulusKNCm2Dir1="5",
    TransverseShearModulusKNCm2Dir2="5",
    SpecificWeight_kN_m3=division_11,
    CoefficientOfThermalExpansion1CDir1=1.2e-05,
    CoefficientOfThermalExpansion1CDir2=1.2e-05,
    TensileStrengthKNCm2Dir1=division_12,
    TensileStrengthKNCm2Dir2=division_12,
    CompressiveStrengthKNCm2Dir1=-23.5,
    CompressiveStrengthKNCm2Dir2=-23.5,
    ShearStrengthKNCm2Dir12=13.6,
    TsaiWuIntCoeff=0,
    StrengthHypothesis="MISES",
    mode="Orthotropic")  # -> flatten(Material)

# ---- group: effective material properties / Gamma eff
division_13 = Division(A=addition_15, B=addition_10)

# ---- group: effective material properties
matprops_2 = MaterialPropertiesKaramba3D(
    FamilyOfMaterial="Beech / Spruce",
    Name="Beech / Spruce",
    ElementIdentifier="Beech / Spruce",
    YoungsModulusKNCm2Dir1=expr("x*0.1", division_6),
    YoungsModulusKNCm2Dir2=expr("x*0.1", division_7),
    InPlaneShearModulus_kN_cm2="47",
    InPlaneLateralContractionCoefficient=Slider(0.012, range=0..0.1, expression="0.012"),
    TransverseShearModulusKNCm2Dir1="5",
    TransverseShearModulusKNCm2Dir2="5",
    SpecificWeight_kN_m3=division_13,
    CoefficientOfThermalExpansion1CDir1=1.2e-05,
    CoefficientOfThermalExpansion1CDir2=1.2e-05,
    TensileStrengthKNCm2Dir1=division_8,
    TensileStrengthKNCm2Dir2=division_8,
    CompressiveStrengthKNCm2Dir1=-23.5,
    CompressiveStrengthKNCm2Dir2=-23.5,
    ShearStrengthKNCm2Dir12=13.6,
    TsaiWuIntCoeff=0,
    StrengthHypothesis="MISES",
    mode="Orthotropic")  # -> flatten(Material)

# ----
number_slider_12 = Slider(1, range=0..10)
multiplication_19 = Multiplication(A=Slider(1.5, range=0..10), B="1.35")
multiplication_20 = Multiplication(A="-9.8", B="1.35")
Z = UnitZ(Factor=multiplication_19)
Z_2 = UnitZ(Factor=multiplication_20)
rev = Reverse(Vector=Z)
bool_4 = Boolean(compute_3d_boards)
not = GateNot(A=bool_4)
cull = CullPattern(List=matprops, CullPattern=not)
loads = LoadsKaramba3D(Vector=Z_2, LCase="0", mode="Gravity")
X = UnitX(Factor=Slider(10000, range=0..10000))

data_3 = Data(group)
pt_13 = Point(simplify(area.Centroid))
pdecon = Deconstruct(Point=pt_13)  # -> XComponent, YComponent, ZComponent
bnd = Bounds(Numbers=flatten(pdecon.XComponent))
lng_2 = ListLength(List=data_3)
dedomain = DeconstructDomain(Domain=bnd)  # -> Start, End
num_16 = Number(graft(pdecon.XComponent))
bnd_2 = Bounds(Numbers=flatten(pdecon.YComponent))
remap = RemapNumbers(Value=pdecon.YComponent, Source=bnd_2, Target=Domain(0, 1))  # -> graft(Mapped), Clipped

# ---- group: create domains
c_script = CSharpScript(count=lng_2, start=dedomain.Start, end=dedomain.End)  # -> out, A; inputs count: Int32, start: Double, end: Double
# ---------- c_script: C# ----------
    double totalLength = end - start;
    double domLength = totalLength / (double) count;

    List<Interval> intervals = new List<Interval>();
    double currentStart = start;
    for(int i = 0; i < count; i++)
    {
      intervals.Add(new Interval(currentStart, currentStart + domLength));
      currentStart += domLength;
    }
    A = intervals;
# ---------- end c_script ----------

# ----
inc = Includes(Value=num_16, Domain=simplify(c_script.A))  # -> Includes, Deviation
cull_2 = CullPattern(List=data_3, CullPattern=inc.Includes)
item_2 = ListItem(List=cull_2, Index=0, Wrap=True)
ungroup = Ungroup(Group=item_2)  # -> simplify(Objects)
curvature = Curvature(Curve=reparameterize(ungroup), Parameter=remap.Mapped)  # -> P, K, C
curvepoint = PointOnCurve(curvature.C, parameter=0.5)
area_2 = Area(Geometry=curvature.C)  # -> Area, Centroid
cull_3 = CullPattern(List=c_script.A, CullPattern=inc.Includes)
dist = Distance(PointA=area_2.Centroid, PointB=curvepoint)
item_3 = ListItem(List=cull_3, Index=0, Wrap=True)
item_4 = ListItem(List=dist, Index=0, Wrap=True)  # -> Item, Item1
remap_2 = RemapNumbers(Value=num_16, Source=item_3, Target=Domain(0, 1))  # -> Mapped, Clipped
twn2nums = TweenTwoNumbers(NumberA=item_4.Item, NumberB=item_4.Item1, Factor=remap_2.Mapped)
trim = TrimTree(Tree=twn2nums, Depth=1)

bnd_3 = Bounds(Numbers=flatten(trim))

lng_3 = ListLength(List=trim)
dup_7 = DuplicateData(Data="1", Number=lng_3, Order=True)  # -> simplify(Data)

lng_4 = ListLength(List=trim)
data_4 = Data(data)
dup_8 = DuplicateData(Data=data_4, Number=lng_4, Order=True)  # -> simplify(Data)

panel_3 = Panel(bnd_3)
update_panel = UpdatePanel(Panel=panel, Radius=trim, RadiusWeight=dup_7, Material=dup_8, MaterialWeight=dup_7)
dup_panel = DuplicatePanel(Panel=update_panel, Count=Slider(3, range=0..10))

# ---- group: the brains
design_env = DesignEnvironment(Panels=dup_panel, Stockpile=merge_9)  # -> Panels, Stockpiles
deconstruct_panel_2 = DeconstructPanel(Panel=design_env.Panels)
dec_board_2 = DeconstructBoard(Board=deconstruct_panel_2)  # -> Name, Material, Polyline, Radius, MoistureChange, Error, BlendedRadius, Width
bnd_4 = Bounds(Numbers=flatten(dec_board_2.Radius))
bnd_5 = Bounds(Numbers=flatten(dec_board_2.Error))
dedomain_2 = DeconstructDomain(Domain=bnd_4)  # -> Start, End
error = Panel(bnd_5)
multiplication_21 = Multiplication(A=dedomain_2.End, B=Slider(1.25, range=0..10))
convolution = CurvatureConvolution(
    Panel=design_env.Panels,
    TengentialBlending=Slider(3, range=0.0001..3),
    LongitudinalBlending=Slider(0.3, range=0.0001..2),
    MaxRadiusInfluence=multiplication_21)  # -> simplify(Panel)
crosecset = UniqueCrossSections(Panel=convolution)
dec_board_3 = DeconstructBoard(Board=crosecset)  # -> Name, Material, Polyline, Radius, MoistureChange, Error, BlendedRadius, Width

# ----
deconstruct_panel_3 = DeconstructPanel(Panel=convolution)
dec_board_4 = DeconstructBoard(Board=deconstruct_panel_3)  # -> Name, Material, Polyline, Radius, MoistureChange, Error, BlendedRadius, Width
txt_3 = Text(flatten(dec_board_2.Material))

crv_5 = Curve(dec_board_3.Polyline)
area_3 = Area(Geometry=crv_5)  # -> Area, Centroid
avr = Average(Input=area_3.Centroid)
bbox = BoundingBox(Content=flatten(avr), Plane=PlaneXY(0, 0, 0), UnionBox=True)  # -> Box, Box_2
debox = DeconstructBox(Box=bbox.Box)  # -> Plane, X, Y, Z
dedomain_3 = DeconstructDomain(Domain=debox.X)  # -> Start, End
subtraction_8 = Subtraction(A=dedomain_3.End, B=dedomain_3.Start)

trim_2 = TrimTree(Tree=crv_5, Depth=1)

bbox_2 = BoundingBox(Content=trim_2, Plane=PlaneXY(0, 0, 0), UnionBox=True)  # -> Box, Box_2
debox_2 = DeconstructBox(Box=bbox_2.Box)  # -> Plane, X, Y, Z
dedomain_4 = DeconstructDomain(Domain=debox_2.X)  # -> Start, End
subtraction_9 = Subtraction(A=dedomain_4.End, B=dedomain_4.Start)
area_4 = Area(Geometry=bbox_2.Box)  # -> Area, Centroid
division_14 = Division(A=subtraction_9, B=subtraction_8)
scale = Scale(Geometry=avr, Center=area_4.Centroid, Factor=division_14)  # -> Geometry, Transform
yz = YZPlane(Origin=scale.Geometry)

num_17 = Number(dec_board_3.Width)
pln = Plane(yz)
num_18 = Number(dec_board_3.BlendedRadius)
c_script_2 = CSharpScript(iRadii=num_18, iBoardWidth=num_17, iPlanes=pln)  # -> out, simplify(A); inputs iRadii: tree of Double, iBoardWidth: tree of Double, iPlanes: tree of Plane
# ---------- c_script_2: C# ----------
    DataTree<Point3d> pointTree = new DataTree<Point3d>();

    for (int j = 0; j < iRadii.BranchCount; j++)
    {

      //initialize variables
      Plane bp = iPlanes.Branch(j)[0];
      Point3d startPoint = new Point3d(bp.Origin);
      Point3d centerPoint = startPoint;
      Vector3d rotationAxis = new Vector3d(bp.ZAxis);
      Vector3d centerPointVect = new Vector3d(bp.YAxis);
      centerPointVect.Rotate(Math.PI / 2, rotationAxis);

      for (int i = 0; i < iRadii.Branch(j).Count; i++){
        GH_Path pth = iRadii.Paths[j].AppendElement(i);
        Point3d point1 = startPoint;
        Point3d point2 = startPoint;

        pointTree.Add(point1, pth);

        //calculate rotation angle
        Double arcLength = iBoardWidth.Branch(j)[i];
        Double radius = iRadii.Branch(j)[i];
        Double rotation = (arcLength / radius);

        //calculate rotation center point
        centerPointVect.Unitize();
        centerPointVect *= radius;
        centerPoint += centerPointVect;


        //execute half rotation
        Transform tx = Transform.Rotation(rotation / 2, rotationAxis, centerPoint);


        point2.Transform(tx);
        pointTree.Add(point2, pth);

        //execute full rotation
        tx = Transform.Rotation(rotation, rotationAxis, centerPoint);
        startPoint.Transform(tx);
        pointTree.Add(startPoint, pth);

        //updata rotation parameters
        centerPoint = startPoint;
        centerPointVect.Transform(tx);
      }
    }
    A = pointTree;
# ---------- end c_script_2 ----------

trim_3 = TrimTree(Tree=c_script_2.A, Depth=1)
cullpt = CullDuplicates(Points=trim_3, Tolerance=0.1, CullMode=3)  # -> Points, Indices, Valence
pt_14 = Point(cullpt.Points)

# ---- group: animate
pt_15 = Point(simplify(pt_14))
pln_2 = Plane(graft(pln))
num_19 = Number(Slider(1, range=0..1))
c_script_3 = CSharpScript(iPoints=simplify(pt_15), iPlanes=pln_2, iShapeFactor=num_19)  # -> out, A; inputs iPoints: tree of Point3d, iPlanes: tree of Plane, iShapeFactor: Double
# ---------- c_script_3: C# ----------
    DataTree<Point3d> output = new DataTree<Point3d>();
    
    double shapeFactor = 1.0 - iShapeFactor;

    //step through curves
    for (int i = 0; i < iPoints.BranchCount; i++)
    {
      Plane currentPlane = iPlanes.Branch(iPoints.Path(i)[0])[0];

      //get vectors from plane
      Vector3d zVect = currentPlane.YAxis;

      Vector3d rotVect = currentPlane.ZAxis;

      //create new startpoint inside list
      Point3d startPoint = iPoints.Branch(i)[0];

      //step through points. Create and rotate vectors
      for (int j = 0; j < iPoints.Branch(i).Count; j++)
      {
        if (j == 0) output.Add(startPoint, iPoints.Path(i));
        else{
          //create current segment vector
          Vector3d segmentVect = new Vector3d(iPoints.Branch(i)[j] - iPoints.Branch(i)[j - 1]);

          //measure angle with vertical vector
          double angle = Vector3d.VectorAngle(zVect, segmentVect, currentPlane);

          //rotate
          segmentVect.Rotate(-angle * shapeFactor, rotVect);

          startPoint += segmentVect;
          output.Add(startPoint, iPoints.Path(i));
        }
      }
    }

    A = output;
# ---------- end c_script_3 ----------
pt_16 = Point(c_script_3.A)
intcrv = Interpolate(Vertices=pt_16, Degree=3, Periodic=False, KnotStyle=1)  # -> Curve, Length, Domain
crv_6 = Curve(intcrv.Curve)

# ----
crv_7 = Curve(crv_6)
pt_17 = Point(simplify(graft(scale.Geometry)))
end = EndPoints(Curve=crv_7)  # -> Start, End
vec2pt = Vector2Pt(PointA=end.Start, PointB=end.End, Unitize=False)  # -> Vector, Length
yz_2 = YZPlane(Origin=end.Start)
Y_3 = UnitY(Factor=panel_orientation)
angle = Angle(VectorA=vec2pt.Vector, VectorB=Y_3, Plane=yz_2)  # -> Angle, Reflex
rotate = Rotate(Geometry=crv_7, Angle=angle.Angle, Plane=yz_2)  # -> Geometry, Transform
curvepoint_2 = PointOnCurve(rotate.Geometry, parameter=0.5)
vec2pt_2 = Vector2Pt(PointA=curvepoint_2, PointB=pt_17, Unitize=False)  # -> Vector, Length
move = Move(Geometry=rotate.Geometry, Motion=vec2pt_2.Vector)  # -> Geometry, Transform
trim_4 = TrimTree(Tree=move.Geometry, Depth=1)
crv_8 = Curve(reverse(trim_4))
loft = Loft(Curves=crv_8, Options={Adjust=False, Closed=False, LoftEnds=0, LoftSimp=0, LoftType=2, Rebuild=10, Refit=0.01})

cull_4 = CullPattern(List=loft, CullPattern=bool)

number_slider_13 = Slider(8, range=0..100)
srf = Surface(cull_4)
num_20 = Number(number_slider_9)
quads = QuadPanels(Surface=srf, UDivisions=number_slider_13, VDivisions=num_20)
srf_2 = Surface(reparameterize(simplify(quads)))

smesh = SimpleMesh(Brep=srf_2)

area_5 = MeshArea(Mesh=smesh)  # -> Area, Centroid
meshcp = MeshClosestPoint(Point=area_5.Centroid, Mesh=smesh)  # -> Point, Index, Parameter
meval = MeshEval(Mesh=smesh, Parameter=meshcp.Parameter)  # -> Point, Normal, Colour
pl = PlaneNormal(Origin=meval.Point, ZAxis=meval.Normal)
X_2 = UnitX(Factor=1)
deplane = DeconstructPlane(Plane=pl)  # -> Origin, XAxis, YAxis, ZAxis
angle_2 = Angle(VectorA=deplane.XAxis, VectorB=X_2, Plane=pl)  # -> Angle, Reflex
rotate_2 = Rotate(Geometry=pl, Angle=angle_2.Angle, Plane=pl)  # -> graft(Geometry), Transform

medges = MeshEdges(Mesh=smesh)  # -> simplify(NakedEdges), InteriorEdges, NonManifoldEdges
curvepoint_3 = PointOnCurve(medges.NakedEdges, parameter=0.5)
plcoord = PlaneCoordinates(Point=curvepoint_3, System=rotate_2.Geometry)  # -> XCoordinate, YCoordinate, ZCoordinate
sort = SortList(Keys=plcoord.XCoordinate, ValuesA=medges.NakedEdges)  # -> Keys, ValuesA
sort_2 = SortList(Keys=plcoord.YCoordinate, ValuesA=medges.NakedEdges)  # -> Keys, ValuesA
item_5 = ListItem(List=reverse(sort.ValuesA), Index=0, Wrap=True)
item_6 = ListItem(List=reverse(sort_2.ValuesA), Index=0, Wrap=True)
item_7 = ListItem(List=sort.ValuesA, Index=0, Wrap=True)
item_8 = ListItem(List=sort_2.ValuesA, Index=0, Wrap=True)

merge_10 = Merge(Data1=item_7, Data2=item_5)
trim_5 = TrimTree(Tree=merge_10, Depth=1)
rdlines = RemoveDuplicateLinesKaramba3D(Line=trim_5, LimitDistance=0.005)  # -> OutLine, Info, Indexes
join_3 = JoinCurves(Curves=rdlines.OutLine, Preserve=False)
explode = Explode(Curve=join_3, Recursive=True)  # -> Segments, simplify(Vertices)
pline = PolyLine(Vertices=explode.Vertices, Closed=False)  # -> simplify(graft(Polyline))
trim_6 = TrimTree(Tree=pline, Depth=1)
curvepoint_4 = PointOnCurve(trim_6, parameter=0.5)
pdecon_2 = Deconstruct(Point=curvepoint_4)  # -> XComponent, YComponent, ZComponent
sort_3 = SortList(Keys=pdecon_2.XComponent, ValuesA=trim_6)  # -> Keys, ValuesA
crv_9 = Curve(sort_3.ValuesA)

merge_11 = Merge(Data1=item_8, Data2=item_6)
trim_7 = TrimTree(Tree=merge_11, Depth=1)
rdlines_2 = RemoveDuplicateLinesKaramba3D(Line=trim_7, LimitDistance=0.005)  # -> OutLine, Info, Indexes
join_4 = JoinCurves(Curves=rdlines_2.OutLine, Preserve=False)
explode_2 = Explode(Curve=join_4, Recursive=True)  # -> Segments, Vertices
pline_2 = PolyLine(Vertices=explode_2.Vertices, Closed=False)  # -> simplify(Polyline)
trim_8 = TrimTree(Tree=pline_2, Depth=1)
curvepoint_5 = PointOnCurve(trim_8, parameter=0.5)
pdecon_3 = Deconstruct(Point=curvepoint_5)  # -> XComponent, YComponent, ZComponent
sort_4 = SortList(Keys=pdecon_3.YComponent, ValuesA=trim_8)  # -> Keys, ValuesA
crv_10 = Curve(sort_4.ValuesA)

crv_11 = Curve(crv_9)
item_9 = ListItem(List=crv_11, Index=0, Wrap=True)
curvepoint_6 = PointOnCurve(crv_11, parameter=0.5)
curvepoint_7 = PointOnCurve(item_9, parameter=0.5)
vec2pt_3 = Vector2Pt(PointA=curvepoint_7, PointB=curvepoint_6, Unitize=False)  # -> Vector, Length
move_2 = Move(Geometry=item_9, Motion=vec2pt_3.Vector)  # -> Geometry, Transform

crv_12 = Curve(crv_9)
flip = FlipCurve(Curve=crv_12, Guide=move_2.Geometry)  # -> Curve, Flag

explode_3 = Explode(Curve=flip.Curve, Recursive=True)  # -> simplify(Segments), Vertices
explode_4 = Explode(Curve=move_2.Geometry, Recursive=True)  # -> simplify(Segments), Vertices
lng_5 = ListLength(List=explode_3.Segments)
lng_6 = ListLength(List=explode_3.Segments)
lng_7 = ListLength(List=explode_4.Segments)
lng_8 = ListLength(List=explode_4.Segments)
subtraction_10 = Subtraction(A=lng_5, B=2)
subtraction_11 = Subtraction(A=lng_6, B=1)
subtraction_12 = Subtraction(A=lng_7, B=2)
subtraction_13 = Subtraction(A=lng_8, B=1)
dom_4 = ConstructDomain(DomainStart=0, DomainEnd=subtraction_10)
dom_5 = ConstructDomain(DomainStart=1, DomainEnd=subtraction_11)
dom_6 = ConstructDomain(DomainStart=0, DomainEnd=subtraction_12)
dom_7 = ConstructDomain(DomainStart=1, DomainEnd=subtraction_13)
subset_2 = SubList(List=explode_3.Segments, Domain=dom_4, Wrap=True)  # -> List, Index
subset_3 = SubList(List=explode_3.Segments, Domain=dom_5, Wrap=True)  # -> List, Index
subset_4 = SubList(List=explode_4.Segments, Domain=dom_6, Wrap=True)  # -> List, Index
subset_5 = SubList(List=explode_4.Segments, Domain=dom_7, Wrap=True)  # -> List, Index
angle_3 = Angle(VectorA=subset_4.List, VectorB=subset_5.List)  # -> simplify(Angle), Reflex
angle_4 = Angle(VectorA=subset_2.List, VectorB=subset_3.List)  # -> simplify(Angle), Reflex
num_21 = Number(angle_3.Angle)
num_22 = Number(angle_4.Angle)

explode_5 = Explode(Curve=flip.Curve, Recursive=True)  # -> simplify(Segments), Vertices
explode_6 = Explode(Curve=move_2.Geometry, Recursive=True)  # -> simplify(Segments), Vertices
path_mapper = PathMapper(explode_5.Segments, source=["{A}(i)", "{A;B}(i)"], target=["{i}(A)", "{A;i}(B)"])
path_mapper_2 = PathMapper(explode_6.Segments, source=["{A}(i)", "{A;B}(i)"], target=["{i}(A)", "{A;i}(B)"])
crv_13 = Curve(path_mapper_2)
crv_14 = Curve(path_mapper)
lng_9 = ListLength(List=crv_14)  # -> expr("x-2", Length)
lng_10 = ListLength(List=crv_13)  # -> expr("x-2", Length)
lng_11 = ListLength(List=crv_14)  # -> expr("x-1", Length)
lng_12 = ListLength(List=crv_13)  # -> expr("x-1", Length)
dom_8 = ConstructDomain(DomainStart=0, DomainEnd=lng_9)
dom_9 = ConstructDomain(DomainStart=0, DomainEnd=lng_10)
dom_10 = ConstructDomain(DomainStart=1, DomainEnd=lng_11)
dom_11 = ConstructDomain(DomainStart=1, DomainEnd=lng_12)
subset_6 = SubList(List=crv_14, Domain=dom_8, Wrap=True)  # -> graft(List), Index
subset_7 = SubList(List=crv_13, Domain=dom_9, Wrap=True)  # -> graft(List), Index
subset_8 = SubList(List=crv_14, Domain=dom_10, Wrap=True)  # -> graft(List), Index
subset_9 = SubList(List=crv_13, Domain=dom_11, Wrap=True)  # -> graft(List), Index
loft_2 = Loft(
    Curves=[subset_6.List, subset_8.List],
    Options={Adjust=False, Closed=False, LoftEnds=0, LoftSimp=0, LoftType=0, Rebuild=10, Refit=0.01})  # -> simplify(Loft)
loft_3 = Loft(
    Curves=[subset_7.List, subset_9.List],
    Options={Adjust=False, Closed=False, LoftEnds=0, LoftSimp=0, LoftType=0, Rebuild=10, Refit=0.01})  # -> simplify(Loft)
smesh_2 = SimpleMesh(Brep=loft_2)
smesh_3 = SimpleMesh(Brep=loft_3)
path_mapper_3 = PathMapper(smesh_3, source=["{A;B;C}", "{A;B}"], target=["{A}", "{0}"])
path_mapper_4 = PathMapper(smesh_2, source=["{A;B;C}", "{A;B}"], target=["{A}", "{0}"])
mjoin = MeshJoin(Meshes=path_mapper_3)
mjoin_2 = MeshJoin(Meshes=path_mapper_4)
weld = WeldMesh(Mesh=mjoin, Angle=3.141592654)
weld_2 = WeldMesh(Mesh=mjoin_2, Angle=3.141592654)

explode_7 = Explode(Curve=move_2.Geometry, Recursive=True)  # -> Segments, Vertices
num_23 = Number(num_22)
num_24 = Number(num_21)
mesh = Mesh(weld)
path_mapper_5 = PathMapper(explode_7.Vertices, source=["{A;B}(i)", "{A}(i)"], target=["{A;i}(B)", "{i}(A)"])
division_15 = Division(A=num_23, B=num_24)
avr_2 = Average(Input=division_15)
number_slider_14 = Slider(10, range=0..100000)
pline_3 = PolyLine(Vertices=path_mapper_5, Closed=False)  # -> simplify(Polyline)
trim_9 = TrimTree(Tree=avr_2, Depth=1)
path_mapper_6 = PathMapper(pline_3, source=["{A;B}", "{A}"], target=["{A}", "{0}"])
crv_15 = Curve(move_2.Geometry)
show = Show(G=mesh)
rod = Rod(
    Polyline=path_mapper_6,
    LengthFactor=1,
    AngleFactor=1,
    AxialStrength=number_slider_14,
    BendStrength=Slider(10000, range=0..10000))
rod_2 = Rod(
    Polyline=crv_15,
    LengthFactor=1,
    AngleFactor=trim_9,
    AxialStrength=number_slider_14,
    BendStrength=Slider(10000, range=0..10000))
path_mapper_7 = PathMapper(rod, source=["{A;B}", "{A}"], target=["{A}", "{0}"])
path_mapper_8 = PathMapper(rod_2, source=["{A;B}", "{A}"], target=["{A}", "{0}"])
merge_12 = Merge(Data1=path_mapper_7, Data2=path_mapper_8, Data3=show)

zombiesolver = ZombieSolver(GoalObjects=merge_12, Threshold=1e-10, Tolerance=0.0001, MaxIterations=Slider(10000, range=0..100000))  # -> I, V, O
mesh_2 = Mesh(zombiesolver.O)
clean = CleanTree(RemoveNulls=True, RemoveInvalid=True, RemoveEmpty=False, Tree=mesh_2)

mesh_3 = Mesh(simplify(graft(clean)))

mesh_4 = Mesh(mesh_3)
num_25 = Number(expr("x+1", number_slider_13))
medges_2 = MeshEdges(Mesh=mesh_4)  # -> NakedEdges, InteriorEdges, NonManifoldEdges
demesh = DeconstructMesh(Mesh=mesh_4)  # -> Vertices, Faces, Colours, Normals
join_5 = JoinCurves(Curves=medges_2.NakedEdges, Preserve=False)
patch = Patch(Curves=join_5, Points=demesh.Vertices, Spans=num_25, Flexibility=Slider(1, range=0..1), Trim=True)
srf_3 = Surface(simplify(patch))

merge_13 = Merge(Data1=simplify(graft(clean)), Data2=weld_2)
wbedges = WeaverbirdsMeshEdges(MeshOrPolylines=graft(merge_13))
c_script_4 = CSharpScript(tree=wbedges)  # -> out, A, B; inputs tree: tree
# ---------- c_script_4: C# ----------
    DataTree<object> even = new DataTree<object>();
    DataTree<object> odd = new DataTree<object>();
    
    for(int i = 0; i < tree.BranchCount; i++)
    {
      if(tree.Paths[i][1] == 0)even.AddRange(tree.Branch(i), tree.Paths[i]);
      else odd.AddRange(tree.Branch(i), tree.Paths[i]);
    }
    A = even;
    B = odd;
# ---------- end c_script_4 ----------
len = Length(Curve=c_script_4.B)
len_2 = Length(Curve=c_script_4.A)
group_2 = Group(Objects=c_script_4.A)  # -> flatten(Group)
lng_13 = ListLength(List=group_2)
subtraction_14 = Subtraction(A=len, B=len_2)
series_4 = Series(Start=0, Step=Slider(1856, range=0..10000), Count=lng_13)
smaller = SmallerThan(FirstNumber=subtraction_14, SecondNumber=0)  # -> SmallerThan, OrEqualTo
Y_4 = UnitY(Factor=series_4)
dispatch = Dispatch(List=subtraction_14, DispatchPattern=smaller.SmallerThan)  # -> ListA, ListB
move_3 = Move(Geometry=group_2, Motion=Y_4)  # -> Geometry, Transform
bnd_6 = Bounds(Numbers=dispatch.ListA)
bnd_7 = Bounds(Numbers=dispatch.ListB)
dedomain_5 = DeconstructDomain(Domain=bnd_6)  # -> Start, End
dedomain_6 = DeconstructDomain(Domain=bnd_7)  # -> Start, End
gradient = Gradient(
    LowerLimit=dedomain_5.Start,
    UpperLimit=dedomain_5.End,
    Parameter=dispatch.ListA,
    stops=[0: RGB(234, 38, 0), 0.499: RGB(234, 126, 0), 1: RGB(254, 244, 84), 1: RGB(75, 107, 169), 1: RGB(173, 203, 249)])
gradient_2 = Gradient(
    LowerLimit=dedomain_6.Start,
    UpperLimit=dedomain_6.End,
    Parameter=dispatch.ListB,
    stops=[0: RGB(254, 244, 84), 0.501: RGB(173, 203, 249), 1: RGB(75, 107, 169)])

crv_16 = Curve(c_script_4.A)
end_2 = EndPoints(Curve=crv_16)  # -> Start, End
pdecon_4 = Deconstruct(Point=end_2.Start)  # -> XComponent, YComponent, ZComponent
pdecon_5 = Deconstruct(Point=end_2.End)  # -> XComponent, YComponent, ZComponent
subtraction_15 = Subtraction(A=pdecon_4.XComponent, B=pdecon_5.XComponent)
abs_5 = Absolute(Value=subtraction_15)
smaller_2 = SmallerThan(FirstNumber=abs_5, SecondNumber=Slider(100, range=0..100))  # -> SmallerThan, OrEqualTo
cull_5 = CullPattern(List=crv_16, CullPattern=smaller_2.SmallerThan)
join_6 = JoinCurves(Curves=cull_5, Preserve=False)
curvepoint_8 = PointOnCurve(join_6, parameter=0.5)
pdecon_6 = Deconstruct(Point=curvepoint_8)  # -> XComponent, YComponent, ZComponent
sort_5 = SortList(Keys=pdecon_6.XComponent, ValuesA=join_6)  # -> Keys, ValuesA
explode_8 = Explode(Curve=sort_5.ValuesA, Recursive=True)  # -> Segments, simplify(Vertices)
intcrv_2 = Interpolate(Vertices=explode_8.Vertices, Degree=3, Periodic=False, KnotStyle=1)  # -> Curve, Length, Domain
path_mapper_9 = PathMapper(intcrv_2.Curve, source=["{A;B}", "{A}"], target=["{A}", "{0}"])
loft_4 = Loft(Curves=path_mapper_9, Options={Adjust=False, Closed=False, LoftEnds=0, LoftSimp=0, LoftType=0, Rebuild=10, Refit=0.01})

move_4 = Move(Geometry=move_3.Geometry, Motion=Y)  # -> Geometry, Transform

ungroup_2 = Ungroup(Group=move_4.Geometry)
dispatch_2 = Dispatch(List=ungroup_2, DispatchPattern=smaller.SmallerThan)  # -> ListA, ListB
previewlw = CustomPreviewLineweights(Geometry=dispatch_2.ListA, Shader=gradient, Thickness=3, Absolute=False)
previewlw_2 = CustomPreviewLineweights(Geometry=dispatch_2.ListB, Shader=gradient_2, Thickness=3, Absolute=False)

# ---- group: control gate
srf_4 = Surface(loft_4)
srf_5 = Surface(loft)
bool_5 = Boolean(compute_double_curvature)
not_2 = GateNot(A=bool_5)
cull_6 = CullPattern(List=srf_5, CullPattern=not_2)
merge_14 = Merge(Data1=srf_4, Data2=cull_6)

# ----
cull_7 = CullPattern(List=merge_14, CullPattern=bool_2)

crv_17 = Curve(dec_board_4.Polyline)
srf_6 = Surface(reparameterize(graft(cull_7)))
explode_9 = Explode(Curve=crv_17, Recursive=True)  # -> Segments, Vertices
len_3 = Length(Curve=explode_9.Segments)
path_mapper_10 = PathMapper(crv_17, source=["{A;B}", "{A}"], target=["{A}", "{0}"])
division_16 = Division(A=len_3, B=Slider(50, range=0..100))
runion = RegionUnion(Curves=path_mapper_10)
divide = DivideCurve(Curve=explode_9.Segments, Count=division_16, Kinks=False)  # -> Points, Tangents, Parameters
path_mapper_11 = PathMapper(divide.Points, source=["{A;B;C;D}", "{A;B;C}"], target=["{A}", "{0}"])
srf_7 = Surface(reparameterize(simplify(runion)))
srf_cp = SurfaceClosestPoint(Point=path_mapper_11, Surface=srf_7)  # -> Point, UVPoint, Distance
evalsrf = EvaluateSurface(Surface=reparameterize(srf_6), Point=srf_cp.UVPoint)  # -> Point, Normal, UDirection, VDirection, Frame
c_script_5 = CSharpScript(trimmedTree=evalsrf.Point, originalTree=divide.Points)  # -> out, A; inputs trimmedTree: tree, originalTree: tree
# ---------- c_script_5: C# ----------
    if(originalTree.DataCount != trimmedTree.DataCount) Component.AddRuntimeMessage(GH_RuntimeMessageLevel.Error, "Number of items in both trees must be equal");

    DataTree<object> outputs = new DataTree<object>();
    List<GH_Path> paths = GetPaths(originalTree);
    //step through trimmed tree objects and add them to output tree with the correct

    int counter = 0;
    for(int i = 0; i < trimmedTree.BranchCount; i++)
    {
      for(int j = 0; j < trimmedTree.Branch(i).Count; j++)
      {
        outputs.Add(trimmedTree.Branch(i)[j], paths[counter]);
        counter++;
      }
    }
    A = outputs;
# ---------- c_script_5: C# additional code ----------
  public List<GH_Path> GetPaths(DataTree<object> originalTree)
  {
    List<GH_Path> output = new List<GH_Path>();
    for(int i = 0; i < originalTree.BranchCount; i++)
    {
      for(int j = 0; j < originalTree.Branch(i).Count; j++)
      {
        output.Add(originalTree.Paths[i]);
      }
    }
    return output;
  }
# ---------- end c_script_5 ----------
intcrv_3 = Interpolate(Vertices=c_script_5.A, Degree=3, Periodic=False, KnotStyle=1)  # -> Curve, Length, Domain
trim_10 = TrimTree(Tree=intcrv_3.Curve, Depth=1)
join_7 = JoinCurves(Curves=trim_10, Preserve=False)  # -> simplify(Curves)
path_mapper_12 = PathMapper(join_7, source=["{A;B;C}", "{A;B}"], target=["{A}", "{0}"])
lng_14 = ListLength(List=path_mapper_12)
dup_9 = DuplicateData(Data=srf_6, Number=lng_14, Order=True)
c_script_6 = CSharpScript(surface=simplify(graft(dup_9)), curves=simplify(graft(path_mapper_12)))  # -> out, A; inputs surface: tree of Brep, curves: tree of Curve
# ---------- c_script_6: C# ----------
    DataTree<Brep> splitBreps = new DataTree<Brep>();
    for(int i = 0; i < curves.BranchCount; i++)
    {
      Brep[] results = surface.Branch(i)[0].Split(curves.Branch(i), 0.1);
      foreach(Brep brep in results)
      {
        splitBreps.Add(brep, curves.Paths[i]);
      }
    }
    A = splitBreps;
# ---------- end c_script_6 ----------
area_6 = Area(Geometry=c_script_6.A)  # -> Area, Centroid
sort_6 = SortList(Keys=area_6.Area, ValuesA=c_script_6.A)  # -> Keys, reverse(ValuesA)
item_10 = ListItem(List=sort_6.ValuesA, Index=Slider(1, range=0..1), Wrap=True)
trim_11 = TrimTree(Tree=item_10, Depth=1)
c_script_7 = CSharpScript(trimmedTree=trim_11, originalTree=join_7)  # -> out, A; inputs trimmedTree: tree, originalTree: tree; same code as c_script_5
trim_12 = TrimTree(Tree=c_script_7.A, Depth=1)

srf_8 = Surface(reparameterize(flatten(merge_14)))

srf_9 = Surface(srf_8)
edges = BrepEdges(Brep=srf_9)  # -> Naked, Interior, NonManifold
len_4 = Length(Curve=edges.Naked)
sort_7 = SortList(Keys=len_4, ValuesA=edges.Naked)  # -> Keys, reverse(ValuesA)
item_11 = ListItem(List=sort_7.ValuesA, Index=0, Wrap=True)  # -> Item, Item1
flip_2 = FlipCurve(Curve=item_11.Item1)  # -> Curve, Flag
merge_15 = Merge(Data1=item_11.Item, Data2=flip_2.Curve)
divide_2 = DivideCurve(Curve=merge_15, Count=Slider(100, range=0..100), Kinks=False)  # -> Points, Tangents, Parameters
path_mapper_13 = PathMapper(divide_2.Points, source="{A;B;C}(i)", target="{A;B;i}(C)")
item_12 = ListItem(List=path_mapper_13, Index=0, Wrap=True)  # -> Item, Item1
dist_2 = Distance(PointA=item_12.Item, PointB=item_12.Item1)
trim_13 = TrimTree(Tree=dist_2, Depth=1)
bnd_8 = Bounds(Numbers=trim_13)
dedomain_7 = DeconstructDomain(Domain=bnd_8)  # -> simplify(Start), End
srf_10 = Surface(trim_12)
multiplication_22 = Multiplication(A=dedomain_7.Start, B=Slider(0.9, range=0..1))  # -> flatten(Result)
group_3 = Group(Objects=srf_10)
c_script_8 = CSharpScript(x=multiplication_22)  # -> out, A; inputs x: list of Double
# ---------- c_script_8: C# ----------
    List<double> output = new List<double>();
    
    double currentVal = 0;
    for(int i = 0; i < x.Count; i++)
    {
      output.Add(currentVal);
      currentVal += x[i];
    }
    A = output;
# ---------- end c_script_8 ----------
trim_14 = TrimTree(Tree=group_3, Depth=1)
Y_5 = UnitY(Factor=c_script_8.A)
group_4 = Group(Objects=trim_14)  # -> flatten(Group)
move_5 = Move(Geometry=srf_9, Motion=Y_5)  # -> Geometry, Transform

move_6 = Move(Geometry=group_4, Motion=Y_5)  # -> Geometry, Transform
ungroup_3 = Ungroup(Group=move_6.Geometry)  # -> simplify(graft(Objects))
ungroup_4 = Ungroup(Group=ungroup_3)  # -> simplify(flatten(Objects))

relaxation = Panel(bnd_6)

mesh_5 = Mesh(mesh_3)
c_script_9 = CSharpScript(mesh=mesh_5, surface=srf_3)  # -> out, Curvature; inputs mesh: Mesh, surface: Surface
# ---------- c_script_9: C# ----------
        //get surface gaussian curvature at each mesh point
        List<double> gaussianCurvatures = new List<double>();
        double maxGaussian = 0;
        double minGaussian = double.MaxValue;

        double U;
        double V;

        for (int i = 0; i < mesh.Vertices.Count; i++)
        {
            Point3d currentMeshPoint = mesh.Vertices.Point3dAt(i);
            surface.ClosestPoint(currentMeshPoint, out U, out V);
            SurfaceCurvature surfaceCurvature = surface.CurvatureAt(U, V);
            double gaussian = surfaceCurvature.Gaussian;
            gaussianCurvatures.Add(gaussian);

            //get the range of curvatures
            if (gaussian > maxGaussian) maxGaussian = gaussian;
            if( gaussian < minGaussian) minGaussian = gaussian;
        }


        //get the range of curvatures


        //remap the curvatures to color values on the mesh points
        for (int i = 0; i < mesh.Vertices.Count; i++)
        {
            double hue = (gaussianCurvatures[i] - minGaussian) / (0 - minGaussian) * (0.5 - maxGaussian) + maxGaussian;
        }
        Curvature = gaussianCurvatures;
# ---------- end c_script_9 ----------
mesh_6 = Mesh(flatten(mesh_5))
num_26 = Number(c_script_9.Curvature)
bnd_9 = Bounds(Numbers=num_26)
dedomain_8 = DeconstructDomain(Domain=bnd_9)  # -> Start, End
gradient_3 = Gradient(
    LowerLimit=dedomain_8.Start,
    UpperLimit=dedomain_8.End,
    Parameter=num_26,
    stops=[0: RGB(0, 128, 0), 0.5: RGB(255, 255, 0), 1: RGB(255, 0, 0)])

gaussian_curvature = Panel(bnd_9)

move_7 = Move(Geometry=mesh_6, Motion=Y_5)  # -> simplify(graft(Geometry)), Transform

mesh_7 = Mesh(move_7.Geometry)

move_8 = Move(Geometry=mesh_7, Motion=Y_2)  # -> Geometry, Transform

c_script_10 = CSharpScript(mesh=move_8.Geometry, colors=simplify(gradient_3))  # -> out, A; inputs mesh: Mesh, colors: list of Color
# ---------- c_script_10: C# ----------
    for(int i = 0; i < mesh.Vertices.Count; i++)
    {
      mesh.VertexColors.SetColor(i, colors[i]);
    }
    A = mesh;
# ---------- end c_script_10 ----------

srf_11 = Surface(move_5.Geometry)
shift_2 = ShiftList(List=srf_11, Shift=1, Wrap=True)
shift_3 = ShiftList(List=srf_11, Shift=-1, Wrap=True)
bbx = BrepBrep(BrepA=srf_11, BrepB=shift_3)  # -> Curves, Points
bbx_2 = BrepBrep(BrepA=srf_11, BrepB=shift_2)  # -> Curves, Points
number_slider_15 = Slider(30, range=0..100)
srf_12 = Surface(simplify(graft(srf_11)))
merge_16 = Merge(Data1=bbx_2.Curves, Data2=bbx.Curves)  # -> simplify(Result)
ext = ExtendCurve(Curve=merge_16, Type=0, Start=number_slider_15, End=number_slider_15)
srfsplit = SurfaceSplit(Surface=srf_12, Curves=ext)  # -> simplify(Fragments)
area_7 = Area(Geometry=srfsplit)  # -> Area, Centroid

ungroup_5 = Ungroup(Group=move_6.Geometry)
group_5 = Group(Objects=merge_16)
ungroup_6 = Ungroup(Group=ungroup_5)  # -> simplify(Objects)
srf_13 = Surface(ungroup_6)
trim_15 = TrimTree(Tree=srf_13, Depth=1)
lng_15 = ListLength(List=trim_15)
lng_16 = ListLength(List=srf_13)
dup_10 = DuplicateData(Data=group_5, Number=lng_15, Order=True)  # -> simplify(Data)
trim_16 = TrimTree(Tree=lng_16, Depth=1)
partition = PartitionList(List=dup_10, Size=trim_16)
srf_14 = Surface(graft(srf_13))
ungroup_7 = Ungroup(Group=partition)
scx = SurfaceCurve(Surface=srf_14, Curve=ungroup_7)  # -> simplify(Curves), simplify(Points), UVPoints, Normals, Parameters, Tangents
trim_17 = TrimTree(Tree=scx.Points, Depth=1)
trim_18 = TrimTree(Tree=scx.Curves, Depth=1)
null = NullItem(Item=trim_18)  # -> NullFlags, InvalidFlags, Description
null_2 = NullItem(Item=trim_17)  # -> NullFlags, InvalidFlags, Description
not_3 = GateNot(A=null.NullFlags)
not_4 = GateNot(A=null_2.NullFlags)
toggle = BooleanToggle(True)
cset = CreateSet(List=not_3)  # -> Set, Map
cset_2 = CreateSet(List=not_4)  # -> Set, Map
mindex = MemberIndex(Set=cset.Set, Member=toggle)  # -> simplify(Index), Count
mindex_2 = MemberIndex(Set=cset_2.Set, Member=toggle)  # -> simplify(Index), Count
larger = LargerThan(FirstNumber=mindex.Count, SecondNumber=0)  # -> LargerThan, OrEqualTo
larger_2 = LargerThan(FirstNumber=mindex_2.Count, SecondNumber=0)  # -> LargerThan, OrEqualTo
or = GateOr(A=larger.LargerThan, B=larger_2.LargerThan)
cull_8 = CullPattern(List=ungroup_7, CullPattern=or)
srfsplit_2 = SurfaceSplit(Surface=srf_14, Curves=cull_8)

area_8 = Area(Geometry=srf_12)  # -> Area, Centroid
dist_3 = Distance(PointA=area_8.Centroid, PointB=area_7.Centroid)
sort_8 = SortList(Keys=dist_3, ValuesA=srfsplit)  # -> Keys, ValuesA

item_13 = ListItem(List=sort_8.ValuesA, Index=0, Wrap=True)  # -> flatten(Item)

srf_15 = Surface(item_13)
preview = CustomPreview(Geometry=srf_15, Material=ColourSwatch(SwatchColor=RGB(196, 196, 196)))

srf_16 = Surface(srfsplit_2)
area_9 = Area(Geometry=srf_16)  # -> Area, simplify(Centroid)
path_mapper_14 = PathMapper(area_9.Centroid, source=["{A;B;C}", "{A;B}"], target=["{A}", "{0}"])
srf_cp_2 = SurfaceClosestPoint(Point=path_mapper_14, Surface=simplify(graft(item_13)))  # -> Point, UVPoint, Distance
smaller_3 = SmallerThan(FirstNumber=srf_cp_2.Distance, SecondNumber=Slider(25, range=0..100))  # -> SmallerThan, OrEqualTo
c_script_11 = CSharpScript(trimmedTree=smaller_3.SmallerThan, originalTree=area_9.Centroid)  # -> out, A; inputs trimmedTree: tree, originalTree: tree; same code as c_script_5
cull_9 = CullPattern(List=srf_16, CullPattern=c_script_11.A)  # -> simplify(List)

txt_4 = Text(graft(dec_board_4.Material))
srf_17 = Surface(cull_9)
path_mapper_15 = PathMapper(srf_17, source=["{A;B;C}", "{A;B}"], target=["{A}", "{0}"])
lng_17 = ListLength(List=srf_17)
addition_17 = Addition(A=Y_2, B=X)
dup_11 = DuplicateData(Data=txt_4, Number=lng_17, Order=True)  # -> simplify(Data)
move_9 = Move(Geometry=path_mapper_15, Motion=addition_17)  # -> Geometry, Transform
len_5 = TextLength(Text=dup_11)
c_script_12 = CSharpScript(trimmedTree=move_9.Geometry, originalTree=srf_17)  # -> out, A; inputs trimmedTree: tree, originalTree: tree; same code as c_script_5
bnd_10 = Bounds(Numbers=flatten(len_5))
dedomain_9 = DeconstructDomain(Domain=bnd_10)  # -> Start, End
gradient_4 = Gradient(
    LowerLimit=dedomain_9.Start,
    UpperLimit=dedomain_9.End,
    Parameter=len_5,
    stops=[0: RGB(186, 186, 186), 1: RGB(122, 122, 122)])
clean_2 = CleanTree(RemoveNulls=True, RemoveInvalid=True, RemoveEmpty=True, Tree=gradient_4)
preview_2 = CustomPreview(Geometry=c_script_12.A, Material=clean_2)

cull_10 = CullPattern(List=item_13, CullPattern=bool_3)
brep = Brep(item_13)
scale_2 = Scale(Geometry=cull_10, Center=Point(0, 0, 0), Factor=number_slider_11)  # -> Geometry, Transform
debrep = DeconstructBrep(Brep=brep)  # -> Faces, Edges, Vertices
curvepoint_9 = PointOnCurve(debrep.Edges, parameter=0.5)
pdecon_7 = Deconstruct(Point=curvepoint_9)  # -> XComponent, YComponent, ZComponent
debrep_2 = DeconstructBrep(Brep=scale_2.Geometry)  # -> Faces, Edges, Vertices
smaller_4 = SmallerThan(FirstNumber=pdecon_7.XComponent, SecondNumber=Slider(1525, range=0..10000))  # -> SmallerThan, OrEqualTo
mesh_breps = MeshBrepsKaramba3D(
    Brep=debrep_2.Faces,
    MeshResolution=Slider(0.1, range=0..100),
    EdgeRefinementFactor=0.67,
    PointReduction=False,
    SmoothingStepSize=0,
    SmoothingIterations=5)  # -> Mesh, Info
cull_11 = CullPattern(List=debrep.Edges, CullPattern=smaller_4.SmallerThan)  # -> simplify(flatten(List))
mjoin_3 = MeshJoin(Meshes=flatten(mesh_breps.Mesh))
scale_3 = Scale(Geometry=cull_11, Center=Point(0, 0, 0), Factor=number_slider_11)  # -> Geometry, Transform
unim = UnifyMesh(Mesh=mjoin_3)  # -> Result, Count
weld_3 = WeldMesh(Mesh=unim.Result, Angle=3.141592654)
scale_4 = Scale(Geometry=weld_3, Center=Point(0, 0, 0), Factor=Slider(1000, range=0..1000))  # -> Geometry, Transform
facen = FaceNormals(Mesh=scale_4.Geometry)  # -> graft(Centers), Normals

demesh_2 = DeconstructMesh(Mesh=weld_3)  # -> flatten(Vertices), Faces, Colours, Normals
crv_cp = CurveClosestPoint(Point=demesh_2.Vertices, Curve=graft(scale_3.Geometry))  # -> Point, Parameter, Distance
equalst = EqualityWithinTolerance(FirstNumber=crv_cp.Distance, SecondNumber=0, Tolerance=0.1)  # -> Equality, Inequality
cull_12 = CullPattern(List=demesh_2.Vertices, CullPattern=equalst.Equality)
pt_18 = Point(cull_12)

srf_cp_3 = SurfaceClosestPoint(Point=facen.Centers, Surface=ungroup_4)  # -> Point, UVPoint, Distance
listdexs = ListIndices(List=srf_cp_3.Distance)
sort_9 = SortList(Keys=srf_cp_3.Distance, ValuesA=listdexs)  # -> Keys, ValuesA
item_14 = ListItem(List=sort_9.ValuesA, Index=0, Wrap=True)  # -> flatten(Item)
item_15 = ListItem(List=txt_3, Index=item_14, Wrap=True)
cullpt_2 = CullDuplicates(Points=flatten(pt_18), Tolerance=0.01, CullMode=3)  # -> simplify(flatten(Points)), Indices, Valence
len_6 = TextLength(Text=item_15)
avr_3 = Average(Input=len_6)
larger_3 = LargerThan(FirstNumber=len_6, SecondNumber=avr_3)  # -> simplify(graft(LargerThan)), OrEqualTo
not_5 = GateNot(A=larger_3.LargerThan)
cull_13 = CullPattern(List=matprops_2, CullPattern=not_5)
cull_14 = CullPattern(List=matprops, CullPattern=larger_3.LargerThan)
merge_17 = Merge(Data1=cull_13, Data2=cull_14)  # -> flatten(Result)

# ---- group: Karamba simulation
mesh_8 = Mesh(weld_3)
supp = SupportKaramba3D(PosInd=cullpt_2.Points, menu=[buttons(on, on, on, on, on, on)])
cross_section = CrossSectionKaramba3D(FamilyNameOfCrossSection="DefaultCroSec", Materials=cull, Heights_cm=Slider(2.4, range=0..10), mode="Shell - Var")
loads_2 = LoadsKaramba3D(Vector=rev, Mesh=weld_3, LCase="0", mode="MeshLoad -Const.", menu=[buttons(off, on, off), buttons(on, on)])
meshtoshell = MeshToShellKaramba3D(Mesh=mesh_8, CrossSection=cross_section, LimitDistance_m=0.005)  # -> Element, Points, Info
assemble = AssembleModelKaramba3D(
    Elem=meshtoshell.Element,
    Support=supp,
    Load=flatten([loads_2, loads]),
    CrossSection=cross_section,
    LimitDistance_m=0.005)  # -> Model, Info, Mass_kg, CenterOfGravity, LoadCaseNames

# ----
analyze = AnalyzeKaramba3D(Model=assemble.Model)  # -> CalculatedModel, MaximumDisplacement_cm, ResultingForceOfGravity_kN, ElasticEnergyChange_kNm
num_27 = Number(flatten(analyze.MaximumDisplacement_cm))

# ---- group: Karamba simulation (continued)
modelview = ModelViewKaramba3D(Model=analyze.CalculatedModel, ResultFactors=1, ResultCase=-1)  # -> Model, DeformedMesh, DeformedAxes, DeformedModel
shellview = ShellViewKaramba3D(Model=modelview.Model, IndexOfLayer=0)  # -> Model, MeshesOfRenderedShells, LegendColors, LegendTags
mesh_9 = Mesh(shellview.MeshesOfRenderedShells)

# ----
panel_4 = Panel(num_27)
scale_5 = Scale(Geometry=mesh_9, Center=Point(0, 0, 0), Factor=Slider(1000, range=0..1000))  # -> Geometry, Transform
mesh_10 = Mesh(scale_5.Geometry)
move_10 = Move(Geometry=mesh_10, Motion=X)  # -> Geometry, Transform
