# Grasshopper definition Object Oriented Bilayers.gh (Grasshopper 1.0.7)
# plug-ins: sof_gh_sofistik-2022, HygroDesign, MeshEdit Components, Karamba3D, Kangaroo2 Components, Weaverbird, Pufferfish, Human, LunchBox, Opossum2_0_Proto_A, Heteroptera

io = IO(
    SofistikDocumentProperties_VersionMajor="2022",
    SofistikDocumentProperties_VersionMinor="0",
    SofistikDocumentProperties_VersionName="2022")
update = Button()
python = GhPythonScript(update=update)  # inputs update: Boolean
# ---------- python: Python ----------
# Seghier Mohamed Abdelaziz - 2021 - seghierdesign@gmail.com

import Grasshopper as gh

ghDoc = ghenv.Component.OnPingDocument()
objects = ghDoc.Objects

object = []

for obj in objects: 

    if obj.NickName.Length == 0:
        if str(obj.RemovedFromDocument.DeclaringType) == "Grasshopper.Kernel.GH_Component":
            object.append(obj)
                
if update == True:
    gh.Kernel.GH_Document.NewSolution(ghDoc,False)
    for o in object:
        gh.Kernel.GH_Document.RemoveObject(ghDoc ,o,False)
# ---------- end python ----------

number_slider = Slider(3000, range=0..3000)
number_slider_2 = Slider(11, range=0..30)
number_slider_3 = Slider(150, range=0..200)
xy = XYPlane(Origin=Point(0, 0, 0))
panel = BilayerPanel(
    BasePlane=xy,
    BoardWidth=number_slider_3,
    BoardLength=number_slider,
    WidthCount=number_slider_2,
    LengthCount=Slider(3, range=0..10))

panel_orientation = Panel("-1")

species = WoodSpecies()
item = ListItem(List=species, Index=0, Wrap=True)  # -> Item, Item1

multiplication = Multiplication(A=number_slider_3, B=number_slider_2)

# ---- group: spruce
data = Data(item.Item1)

# ---- group: beech
data_2 = Data(item.Item)

# ----
board_count = Slider(100, range=0..100)

deconstruct_panel = DeconstructPanel(Panel=panel)
dec_board = DeconstructBoard(Board=deconstruct_panel)  # -> Name, Material, Polyline, Radius, MoistureChange, Error, BlendedRadius, Width
area = Area(Geometry=dec_board.Polyline)  # -> Area, Centroid

bbox = BoundingBox(Content=flatten(dec_board.Polyline), Plane=PlaneXY(0, 0, 0), UnionBox=True)  # -> Box, Box_2
debox = DeconstructBox(Box=bbox.Box)  # -> Plane, X, Y, Z
dedomain = DeconstructDomain(Domain=debox.X)  # -> Start, End
dedomain_2 = DeconstructDomain(Domain=debox.Y)  # -> Start, End
subtraction = Subtraction(A=dedomain.End, B=dedomain.Start)
subtraction_2 = Subtraction(A=dedomain_2.End, B=dedomain_2.Start)
panel_2 = Panel(subtraction)
panel_3 = Panel(subtraction_2)

# ---- group: calculate weights
pt = Point(area.Centroid)
avr = Average(Input=flatten(pt))
pdecon = Deconstruct(Point=pt)  # -> XComponent, YComponent, ZComponent
pdecon_2 = Deconstruct(Point=avr)  # -> XComponent, YComponent, ZComponent
subtraction_3 = Subtraction(A=pdecon.XComponent, B=pdecon_2.XComponent)
abs = Absolute(Value=subtraction_3)
bnd = Bounds(Numbers=flatten(abs))
dom = ConstructDomain(DomainStart=Slider(1, range=0..1000), DomainEnd=Slider(1, range=0..10))
remap = RemapNumbers(Value=abs, Source=bnd, Target=dom)  # -> Mapped, Clipped

# ---- group: multi-arc control
pt_2 = Point(area.Centroid)
pdecon_3 = Deconstruct(Point=pt_2)  # -> XComponent, YComponent, ZComponent
bnd_2 = Bounds(Numbers=flatten(pdecon_3.XComponent))
number_of_controls = Slider(10, range=0..10)
genes = GenePool(
    Decimals=2,
    Maximum=1,
    Minimum=0,
    Value=[0.0007, 0.003554, 0.987914, 0.999347, 0.034011, 0.011303, 0.9684, 0.434234, 0.999084, 0.970658])
dedomain_3 = DeconstructDomain(Domain=bnd_2)  # -> Start, End
dom_2 = ConstructDomain(DomainStart=0, DomainEnd=1)
pt_3 = ConstructPoint(XCoordinate=dedomain_3.Start, YCoordinate=0, ZCoordinate=0)
pt_4 = ConstructPoint(XCoordinate=dedomain_3.End, YCoordinate=0, ZCoordinate=0)
gnc = PoolController(GenePool=genes, Count=number_of_controls, Range=dom_2, Randomness=0.1)
ln = Line(StartPoint=pt_3, EndPoint=pt_4)
divide = DivideCurve(Curve=ln, Count=expr("x-1", number_of_controls), Kinks=False)  # -> Points, Tangents, Parameters
Y = UnitY(Factor=genes)
move = Move(Geometry=divide.Points, Motion=Y)  # -> Geometry, Transform
yz = YZPlane(Origin=pt_2)
intcrv = Interpolate(Vertices=move.Geometry, Degree=3, Periodic=False, KnotStyle=1)  # -> Curve, Length, Domain
pcx = CurvePlane(Curve=intcrv.Curve, Plane=yz)  # -> Points, ParamsC, ParamsP
pdecon_4 = Deconstruct(Point=pcx.Points)  # -> XComponent, YComponent, ZComponent
trim = TrimTree(Tree=pdecon_4.YComponent, Depth=1)  # -> simplify(Tree)

# ---- group: Material goals / beech
data_3 = Data(data_2)

# ---- group: Material goals / spruce
data_4 = Data(data)

# ---- group: Material goals
pt_5 = Point(area.Centroid)
genes_2 = GenePool(Decimals=2, Maximum=8250, Minimum=750, Value=[2461.2225, 5041.4925])
lng = ListLength(List=flatten(pt_5))
lng_2 = ListLength(List=pt_5)  # -> flatten(Length)
bbox_2 = BoundingBox(Content=flatten(pt_5), Plane=PlaneXY(0, 0, 0), UnionBox=True)  # -> Box, Box_2
number_slider_4 = Slider(2, range=0..10)
debox_2 = DeconstructBox(Box=bbox_2.Box)  # -> Plane, X, Y, Z
dup = DuplicateData(Data=data_3, Number=lng, Order=True)
dup_2 = DuplicateData(Data=data_4, Number=lng, Order=True)
partition = PartitionList(List=dup, Size=lng_2)  # -> simplify(Chunks)
partition_2 = PartitionList(List=dup_2, Size=lng_2)  # -> simplify(Chunks)
dedomain_4 = DeconstructDomain(Domain=debox_2.Y)  # -> Start, End
gnc_2 = PoolController(GenePool=genes_2, Count=number_slider_4, Range=debox_2.X, Randomness=0.1)
rev = ReverseList(List=genes_2)
merge = Merge(Data1=flatten(genes_2), Data2=flatten(rev))
pt_6 = ConstructPoint(XCoordinate=0, YCoordinate=dedomain_4.Start, ZCoordinate=0)
pt_7 = ConstructPoint(XCoordinate=0, YCoordinate=dedomain_4.End, ZCoordinate=0)
ln_2 = Line(StartPoint=pt_6, EndPoint=pt_7)
divide_2 = DivideCurve(Curve=ln_2, Count=expr("(x*2)-1", number_slider_4), Kinks=False)  # -> Points, Tangents, Parameters
pt_8 = Point(pt_5)
X = UnitX(Factor=merge)
move_2 = Move(Geometry=divide_2.Points, Motion=X)  # -> Geometry, Transform
xz = XZPlane(Origin=graft(pt_8))
pline = PolyLine(Vertices=move_2.Geometry, Closed=False)
pcx_2 = CurvePlane(Curve=pline, Plane=xz)  # -> simplify(Points), ParamsC, ParamsP
trim_2 = TrimTree(Tree=pcx_2.Points, Depth=1)
pdecon_5 = Deconstruct(Point=pt_8)  # -> XComponent, YComponent, ZComponent
pdecon_6 = Deconstruct(Point=trim_2)  # -> XComponent, YComponent, ZComponent
smaller = SmallerThan(FirstNumber=pdecon_5.XComponent, SecondNumber=pdecon_6.XComponent)  # -> SmallerThan, OrEqualTo
not = GateNot(A=smaller.SmallerThan)
cull = CullPattern(List=partition, CullPattern=smaller.SmallerThan)
cull_2 = CullPattern(List=partition_2, CullPattern=not)
merge_2 = Merge(Data1=cull, Data2=cull_2)  # -> simplify(Result)

# ---- group: variable curvature tangential and longitudinal
pt_9 = Point(area.Centroid)
pdecon_7 = Deconstruct(Point=pt_9)  # -> XComponent, YComponent, ZComponent
bnd_3 = Bounds(Numbers=flatten(pdecon_7.XComponent))
number_of_controls_2 = Slider(5, range=0..10)
genes_3 = GenePool(Decimals=2, Maximum=1, Minimum=0, Value=[3e-06, 0.081281, 0.082181, 0.933349, 0.32256])
dedomain_5 = DeconstructDomain(Domain=bnd_3)  # -> Start, End
genes_4 = GenePool(Decimals=2, Maximum=1, Minimum=0, Value=[0.282594, 0.026963, 0.318152, 1.1e-05, 0.419694])
pt_10 = ConstructPoint(XCoordinate=dedomain_5.Start, YCoordinate=0, ZCoordinate=0)
pt_11 = ConstructPoint(XCoordinate=dedomain_5.End, YCoordinate=0, ZCoordinate=0)
dom_3 = ConstructDomain(DomainStart=0, DomainEnd=1)
ln_3 = Line(StartPoint=pt_10, EndPoint=pt_11)
gnc_3 = PoolController(GenePool=[genes_4, genes_3], Count=number_of_controls_2, Range=dom_3, Randomness=0.1)
divide_3 = DivideCurve(Curve=ln_3, Count=expr("x-1", number_of_controls_2), Kinks=False)  # -> Points, Tangents, Parameters
yz_2 = YZPlane(Origin=pt_9)
Y_2 = UnitY(Factor=genes_3)
Y_3 = UnitY(Factor=genes_4)
move_3 = Move(Geometry=divide_3.Points, Motion=Y_2)  # -> Geometry, Transform
move_4 = Move(Geometry=divide_3.Points, Motion=Y_3)  # -> Geometry, Transform
intcrv_2 = Interpolate(Vertices=move_3.Geometry, Degree=3, Periodic=False, KnotStyle=1)  # -> Curve, Length, Domain
intcrv_3 = Interpolate(Vertices=move_4.Geometry, Degree=3, Periodic=False, KnotStyle=1)  # -> Curve, Length, Domain
pcx_3 = CurvePlane(Curve=intcrv_2.Curve, Plane=yz_2)  # -> Points, ParamsC, ParamsP
pcx_4 = CurvePlane(Curve=intcrv_3.Curve, Plane=yz_2)  # -> Points, ParamsC, ParamsP
pdecon_8 = Deconstruct(Point=pcx_3.Points)  # -> XComponent, YComponent, ZComponent
pdecon_9 = Deconstruct(Point=pcx_4.Points)  # -> XComponent, YComponent, ZComponent
trim_3 = TrimTree(Tree=pdecon_8.YComponent, Depth=1)  # -> simplify(Tree)
trim_4 = TrimTree(Tree=pdecon_9.YComponent, Depth=1)  # -> simplify(Tree)
dom_4 = ConstructDomain(DomainStart=Slider(550, range=0..1000), DomainEnd=Slider(2200, range=0..10000))
remap_2 = RemapNumbers(Value=trim_3, Source=dom_3, Target=dom_4)  # -> Mapped, Clipped
num = Number(pdecon_7.YComponent)
remap_3 = RemapNumbers(Value=trim_4, Source=dom_3, Target=dom_4)  # -> Mapped, Clipped
bnd_4 = Bounds(Numbers=flatten(num))
remap_4 = RemapNumbers(Value=num, Source=bnd_4, Target=Domain(0, 1))  # -> Mapped, Clipped
subtraction_4 = Subtraction(A=remap_4.Mapped, B=Slider(0.5, range=0..1))
abs_2 = Absolute(Value=subtraction_4)
bnd_5 = Bounds(Numbers=flatten(abs_2))
remap_5 = RemapNumbers(Value=abs_2, Source=bnd_5, Target=Domain(0, 1))  # -> Mapped, Clipped
twn2nums = TweenTwoNumbers(NumberA=remap_2.Mapped, NumberB=remap_3.Mapped, Factor=remap_5.Mapped)

# ---- group: name
num_2 = Number(board_count)
series = Series(Start=0, Step=1, Count=num_2)
dup_3 = DuplicateData(Data="S", Number=num_2, Order=True)  # -> graft(Data)
txt = Text(graft(series))
merge_3 = Merge(Data1=dup_3, Data2=txt)  # -> simplify(Result)
join = TextJoin(Text=merge_3)  # -> flatten(Result)

# ---- group: RT
dom_5 = ConstructDomain(DomainStart=Slider(11, range=0..100), DomainEnd=Slider(75, range=0..100))
random = Random(Range=dom_5, Number=board_count, Seed=Slider(225, range=0..1000))

dom_6 = ConstructDomain(DomainStart=Slider(15, range=0..100), DomainEnd=Slider(75, range=0..100))
random_2 = Random(Range=dom_6, Number=board_count, Seed=Slider(225, range=0..1000))

# ---- group: name
num_3 = Number(board_count)
series_2 = Series(Start=0, Step=1, Count=num_3)
dup_4 = DuplicateData(Data="B", Number=num_3, Order=True)  # -> graft(Data)
txt_2 = Text(graft(series_2))
merge_4 = Merge(Data1=dup_4, Data2=txt_2)  # -> simplify(Result)
join_2 = TextJoin(Text=merge_4)  # -> flatten(Result)

# ---- group: length
num_4 = Number(number_slider)
num_5 = Number(board_count)
dup_5 = DuplicateData(Data=num_4, Number=num_5, Order=True)

num_6 = Number(number_slider_3)
num_7 = Number(board_count)
dup_6 = DuplicateData(Data=num_6, Number=num_7, Order=True)

num_8 = Number(number_slider_3)
num_9 = Number(board_count)
dup_7 = DuplicateData(Data=num_8, Number=num_9, Order=True)

num_10 = Number(number_slider)
num_11 = Number(board_count)
dup_8 = DuplicateData(Data=num_10, Number=num_11, Order=True)

# ---- group: simple attractor curvature optimization
pt_12 = Point(area.Centroid)
pdecon_10 = Deconstruct(Point=pt_12)  # -> XComponent, YComponent, ZComponent
bnd_6 = Bounds(Numbers=flatten(pdecon_10.XComponent))
dedomain_6 = DeconstructDomain(Domain=bnd_6)  # -> Start, End
twn2nums_2 = TweenTwoNumbers(NumberA=dedomain_6.Start, NumberB=dedomain_6.End, Factor=Slider(0, range=0..1))
pdecon_11 = Deconstruct(Point=pt_12)  # -> XComponent, YComponent, ZComponent
subtraction_5 = Subtraction(A=twn2nums_2, B=pdecon_11.XComponent)
abs_3 = Absolute(Value=subtraction_5)

# ---- group: moisture changes
panel_4 = Panel("""5
10
15
20""")
num_12 = Number(panel_4)

# ----
series_3 = Series(Start=Slider(1, range=0..1), Step=1, Count=Slider(25, range=0..100))
stockpile = Stockpile(Material=data_2, Name=join_2, Length=dup_5, Width=dup_6, RTAngle=random, MoistureChanges=num_12)
stockpile_2 = Stockpile(Material=data, Name=join, Length=dup_8, Width=dup_7, RTAngle=random_2, MoistureChanges=num_12)

# ---- group: desired radius
dom_7 = ConstructDomain(DomainStart=Slider(500, range=0..1000), DomainEnd=Slider(2200, range=0..10000))
remap_6 = RemapNumbers(Value=trim, Source=dom_2, Target=dom_7)  # -> Mapped, Clipped

# ----
merge_5 = Merge(Data1=stockpile, Data2=stockpile_2)
update_panel = UpdatePanel(Panel=panel, Radius=twn2nums, RadiusWeight=remap.Mapped, Material=merge_2, MaterialWeight=remap.Mapped)

# ---- group: the brains
design_env = DesignEnvironment(Panels=update_panel, Stockpile=merge_5)  # -> Panels, Stockpiles
deconstruct_panel_2 = DeconstructPanel(Panel=design_env.Panels)
dec_board_2 = DeconstructBoard(Board=deconstruct_panel_2)  # -> Name, Material, Polyline, Radius, MoistureChange, Error, BlendedRadius, Width
bnd_7 = Bounds(Numbers=flatten(dec_board_2.Radius))
bnd_8 = Bounds(Numbers=flatten(dec_board_2.Error))
dedomain_7 = DeconstructDomain(Domain=bnd_7)  # -> Start, End
error = Panel(bnd_8)
multiplication_2 = Multiplication(A=dedomain_7.End, B=Slider(1.25, range=0..10))
convolution = CurvatureConvolution(
    Panel=design_env.Panels,
    TengentialBlending=Slider(3, range=0.0001..3),
    LongitudinalBlending=Slider(0.3, range=0.0001..2),
    MaxRadiusInfluence=multiplication_2)
crosecset = UniqueCrossSections(Panel=convolution)
dec_board_3 = DeconstructBoard(Board=crosecset)  # -> Name, Material, Polyline, Radius, MoistureChange, Error, BlendedRadius, Width

# ----
crv = Curve(dec_board_3.Polyline)
area_2 = Area(Geometry=crv)  # -> Area, Centroid
avr_2 = Average(Input=area_2.Centroid)
bbox_3 = BoundingBox(Content=flatten(crv), Plane=PlaneXY(0, 0, 0), UnionBox=True)  # -> Box, Box_2
bbox_4 = BoundingBox(Content=flatten(avr_2), Plane=PlaneXY(0, 0, 0), UnionBox=True)  # -> Box, Box_2
debox_3 = DeconstructBox(Box=bbox_3.Box)  # -> Plane, X, Y, Z
debox_4 = DeconstructBox(Box=bbox_4.Box)  # -> Plane, X, Y, Z
dedomain_8 = DeconstructDomain(Domain=debox_3.X)  # -> Start, End
dedomain_9 = DeconstructDomain(Domain=debox_4.X)  # -> Start, End
subtraction_6 = Subtraction(A=dedomain_8.End, B=dedomain_8.Start)
subtraction_7 = Subtraction(A=dedomain_9.End, B=dedomain_9.Start)
area_3 = Area(Geometry=bbox_3.Box)  # -> Area, Centroid
division = Division(A=subtraction_6, B=subtraction_7)
scale = Scale(Geometry=avr_2, Center=area_3.Centroid, Factor=division)  # -> Geometry, Transform
yz_3 = YZPlane(Origin=scale.Geometry)

num_13 = Number(dec_board_3.Width)
pln = Plane(yz_3)
num_14 = Number(dec_board_3.BlendedRadius)
c_script = CSharpScript(iRadii=num_14, iBoardWidth=num_13, iPlanes=pln)  # -> out, simplify(A); inputs iRadii: tree of Double, iBoardWidth: tree of Double, iPlanes: tree of Plane
# ---------- c_script: C# ----------
    DataTree<Point3d> pointTree = new DataTree<Point3d>();

    for (int j = 0; j < iRadii.BranchCount; j++)
    {

      //initialize variables
      Plane bp = iPlanes.Branch(j)[0];
      Point3d startPoint = new Point3d(bp.Origin);
      Point3d centerPoint = startPoint;
      Vector3d rotationAxis = new Vector3d(bp.ZAxis);
      Vector3d centerPointVect = new Vector3d(bp.YAxis);
      centerPointVect.Rotate(Math.PI / 2, rotationAxis);

      for (int i = 0; i < iRadii.Branch(j).Count; i++){
        GH_Path pth = new GH_Path(j, i);
        Point3d point1 = startPoint;
        Point3d point2 = startPoint;

        pointTree.Add(point1, pth);

        //calculate rotation angle
        Double arcLength = iBoardWidth.Branch(j)[i];
        Double radius = iRadii.Branch(j)[i];
        Double rotation = (arcLength / radius);

        //calculate rotation center point
        centerPointVect.Unitize();
        centerPointVect *= radius;
        centerPoint += centerPointVect;


        //execute half rotation
        Transform tx = Transform.Rotation(rotation / 2, rotationAxis, centerPoint);


        point2.Transform(tx);
        pointTree.Add(point2, pth);

        //execute full rotation
        tx = Transform.Rotation(rotation, rotationAxis, centerPoint);
        startPoint.Transform(tx);
        pointTree.Add(startPoint, pth);

        //updata rotation parameters
        centerPoint = startPoint;
        centerPointVect.Transform(tx);
      }
    }
    A = pointTree;
# ---------- end c_script ----------

trim_5 = TrimTree(Tree=c_script.A, Depth=1)
cullpt = CullDuplicates(Points=trim_5, Tolerance=0.1, CullMode=3)  # -> Points, Indices, Valence
pt_13 = Point(cullpt.Points)

# ---- group: animate
pt_14 = Point(simplify(pt_13))
pln_2 = Plane(graft(pln))
num_15 = Number(Slider(1, range=0..1))
c_script_2 = CSharpScript(iPoints=simplify(pt_14), iPlanes=pln_2, iShapeFactor=num_15)  # -> out, A; inputs iPoints: tree of Point3d, iPlanes: tree of Plane, iShapeFactor: Double
# ---------- c_script_2: C# ----------
    DataTree<Point3d> output = new DataTree<Point3d>();
    
    double shapeFactor = 1.0 - iShapeFactor;

    //step through curves
    for (int i = 0; i < iPoints.BranchCount; i++)
    {
      Plane currentPlane = iPlanes.Branch(iPoints.Path(i)[0])[0];

      //get vectors from plane
      Vector3d zVect = currentPlane.YAxis;

      Vector3d rotVect = currentPlane.ZAxis;

      //create new startpoint inside list
      Point3d startPoint = iPoints.Branch(i)[0];

      //step through points. Create and rotate vectors
      for (int j = 0; j < iPoints.Branch(i).Count; j++)
      {
        if (j == 0) output.Add(startPoint, iPoints.Path(i));
        else{
          //create current segment vector
          Vector3d segmentVect = new Vector3d(iPoints.Branch(i)[j] - iPoints.Branch(i)[j - 1]);

          //measure angle with vertical vector
          double angle = Vector3d.VectorAngle(zVect, segmentVect, currentPlane);

          //rotate
          segmentVect.Rotate(-angle * shapeFactor, rotVect);

          startPoint += segmentVect;
          output.Add(startPoint, iPoints.Path(i));
        }
      }
    }

    A = output;
# ---------- end c_script_2 ----------
pt_15 = Point(c_script_2.A)
intcrv_4 = Interpolate(Vertices=pt_15, Degree=3, Periodic=False, KnotStyle=1)  # -> Curve, Length, Domain
crv_2 = Curve(intcrv_4.Curve)

# ----
crv_3 = Curve(crv_2)
pt_16 = Point(simplify(graft(scale.Geometry)))
end = EndPoints(Curve=crv_3)  # -> Start, End
vec2pt = Vector2Pt(PointA=end.Start, PointB=end.End, Unitize=False)  # -> Vector, Length
yz_4 = YZPlane(Origin=end.Start)
Y_4 = UnitY(Factor=panel_orientation)
angle = Angle(VectorA=vec2pt.Vector, VectorB=Y_4, Plane=yz_4)  # -> Angle, Reflex
rotate = Rotate(Geometry=crv_3, Angle=angle.Angle, Plane=yz_4)  # -> Geometry, Transform
curvepoint = PointOnCurve(rotate.Geometry, parameter=0.5)
vec2pt_2 = Vector2Pt(PointA=curvepoint, PointB=pt_16, Unitize=False)  # -> Vector, Length
move_5 = Move(Geometry=rotate.Geometry, Motion=vec2pt_2.Vector)  # -> flatten(Geometry), Transform
crv_4 = Curve(reverse(move_5.Geometry))
loft = Loft(Curves=crv_4, Options={Adjust=False, Closed=False, LoftEnds=0, LoftSimp=0, LoftType=0, Rebuild=10, Refit=0.01})

number_slider_5 = Slider(15, range=0..100)
num_16 = Number(number_slider_2)
srf = Surface(loft)
quads = QuadPanels(Surface=graft(srf), UDivisions=number_slider_5, VDivisions=num_16)
srf_2 = Surface(reparameterize(quads))

smesh = SimpleMesh(Brep=srf_2)

area_4 = MeshArea(Mesh=smesh)  # -> Area, Centroid
meshcp = MeshClosestPoint(Point=area_4.Centroid, Mesh=smesh)  # -> Point, Index, Parameter
meval = MeshEval(Mesh=smesh, Parameter=meshcp.Parameter)  # -> Point, Normal, Colour
pl = PlaneNormal(Origin=meval.Point, ZAxis=meval.Normal)
X_2 = UnitX(Factor=1)
deplane = DeconstructPlane(Plane=pl)  # -> Origin, XAxis, YAxis, ZAxis
angle_2 = Angle(VectorA=deplane.XAxis, VectorB=X_2, Plane=pl)  # -> Angle, Reflex
rotate_2 = Rotate(Geometry=pl, Angle=angle_2.Angle, Plane=pl)  # -> graft(Geometry), Transform

medges = MeshEdges(Mesh=smesh)  # -> simplify(NakedEdges), InteriorEdges, NonManifoldEdges
curvepoint_2 = PointOnCurve(medges.NakedEdges, parameter=0.5)
plcoord = PlaneCoordinates(Point=curvepoint_2, System=rotate_2.Geometry)  # -> XCoordinate, YCoordinate, ZCoordinate
sort = SortList(Keys=plcoord.XCoordinate, ValuesA=medges.NakedEdges)  # -> Keys, ValuesA
sort_2 = SortList(Keys=plcoord.YCoordinate, ValuesA=medges.NakedEdges)  # -> Keys, ValuesA
item_2 = ListItem(List=reverse(sort.ValuesA), Index=0, Wrap=True)
item_3 = ListItem(List=reverse(sort_2.ValuesA), Index=0, Wrap=True)
item_4 = ListItem(List=sort.ValuesA, Index=0, Wrap=True)
item_5 = ListItem(List=sort_2.ValuesA, Index=0, Wrap=True)

merge_6 = Merge(Data1=item_4, Data2=item_2)  # -> flatten(Result)
rdlines = RemoveDuplicateLinesKaramba3D(Line=merge_6, LimitDistance=0.005)  # -> OutLine, Info, Indexes
join_3 = JoinCurves(Curves=rdlines.OutLine, Preserve=False)
explode = Explode(Curve=join_3, Recursive=True)  # -> Segments, Vertices
pline_2 = PolyLine(Vertices=explode.Vertices, Closed=False)  # -> simplify(flatten(Polyline))
curvepoint_3 = PointOnCurve(pline_2, parameter=0.5)
pdecon_12 = Deconstruct(Point=curvepoint_3)  # -> XComponent, YComponent, ZComponent
sort_3 = SortList(Keys=pdecon_12.XComponent, ValuesA=pline_2)  # -> Keys, ValuesA
crv_5 = Curve(sort_3.ValuesA)

merge_7 = Merge(Data1=item_5, Data2=item_3)  # -> flatten(Result)
rdlines_2 = RemoveDuplicateLinesKaramba3D(Line=merge_7, LimitDistance=0.005)  # -> OutLine, Info, Indexes
join_4 = JoinCurves(Curves=rdlines_2.OutLine, Preserve=False)
explode_2 = Explode(Curve=join_4, Recursive=True)  # -> Segments, Vertices
pline_3 = PolyLine(Vertices=explode_2.Vertices, Closed=False)  # -> simplify(flatten(Polyline))
curvepoint_4 = PointOnCurve(pline_3, parameter=0.5)
pdecon_13 = Deconstruct(Point=curvepoint_4)  # -> XComponent, YComponent, ZComponent
sort_4 = SortList(Keys=pdecon_13.YComponent, ValuesA=pline_3)  # -> Keys, ValuesA
crv_6 = Curve(sort_4.ValuesA)

crv_7 = Curve(crv_5)
item_6 = ListItem(List=crv_7, Index=0, Wrap=True)
curvepoint_5 = PointOnCurve(crv_7, parameter=0.5)
curvepoint_6 = PointOnCurve(item_6, parameter=0.5)
vec2pt_3 = Vector2Pt(PointA=curvepoint_6, PointB=curvepoint_5, Unitize=False)  # -> Vector, Length
move_6 = Move(Geometry=item_6, Motion=vec2pt_3.Vector)  # -> Geometry, Transform

crv_8 = Curve(crv_5)
flip = FlipCurve(Curve=crv_8, Guide=move_6.Geometry)  # -> Curve, Flag

explode_3 = Explode(Curve=flip.Curve, Recursive=True)  # -> simplify(Segments), Vertices
explode_4 = Explode(Curve=move_6.Geometry, Recursive=True)  # -> simplify(Segments), Vertices
lng_3 = ListLength(List=explode_3.Segments)
lng_4 = ListLength(List=explode_3.Segments)
lng_5 = ListLength(List=explode_4.Segments)
lng_6 = ListLength(List=explode_4.Segments)
subtraction_8 = Subtraction(A=lng_3, B=2)
subtraction_9 = Subtraction(A=lng_4, B=1)
subtraction_10 = Subtraction(A=lng_5, B=2)
subtraction_11 = Subtraction(A=lng_6, B=1)
dom_8 = ConstructDomain(DomainStart=0, DomainEnd=subtraction_8)
dom_9 = ConstructDomain(DomainStart=1, DomainEnd=subtraction_9)
dom_10 = ConstructDomain(DomainStart=0, DomainEnd=subtraction_10)
dom_11 = ConstructDomain(DomainStart=1, DomainEnd=subtraction_11)
subset = SubList(List=explode_3.Segments, Domain=dom_8, Wrap=True)  # -> List, Index
subset_2 = SubList(List=explode_3.Segments, Domain=dom_9, Wrap=True)  # -> List, Index
subset_3 = SubList(List=explode_4.Segments, Domain=dom_10, Wrap=True)  # -> List, Index
subset_4 = SubList(List=explode_4.Segments, Domain=dom_11, Wrap=True)  # -> List, Index
angle_3 = Angle(VectorA=subset_3.List, VectorB=subset_4.List)  # -> simplify(Angle), Reflex
angle_4 = Angle(VectorA=subset.List, VectorB=subset_2.List)  # -> simplify(Angle), Reflex
num_17 = Number(angle_3.Angle)
num_18 = Number(angle_4.Angle)

explode_5 = Explode(Curve=flip.Curve, Recursive=True)  # -> simplify(Segments), Vertices
explode_6 = Explode(Curve=move_6.Geometry, Recursive=True)  # -> simplify(Segments), Vertices
flip_2 = FlipMatrix(Data=explode_5.Segments)
flip_3 = FlipMatrix(Data=explode_6.Segments)
crv_9 = Curve(flip_3)
crv_10 = Curve(flip_2)
lng_7 = ListLength(List=crv_10)  # -> expr("x-2", Length)
lng_8 = ListLength(List=crv_9)  # -> expr("x-2", Length)
lng_9 = ListLength(List=crv_10)  # -> expr("x-1", Length)
lng_10 = ListLength(List=crv_9)  # -> expr("x-1", Length)
dom_12 = ConstructDomain(DomainStart=0, DomainEnd=lng_7)
dom_13 = ConstructDomain(DomainStart=0, DomainEnd=lng_8)
dom_14 = ConstructDomain(DomainStart=1, DomainEnd=lng_9)
dom_15 = ConstructDomain(DomainStart=1, DomainEnd=lng_10)
subset_5 = SubList(List=crv_10, Domain=dom_12, Wrap=True)  # -> graft(List), Index
subset_6 = SubList(List=crv_9, Domain=dom_13, Wrap=True)  # -> graft(List), Index
subset_7 = SubList(List=crv_10, Domain=dom_14, Wrap=True)  # -> graft(List), Index
subset_8 = SubList(List=crv_9, Domain=dom_15, Wrap=True)  # -> graft(List), Index
loft_2 = Loft(
    Curves=[subset_5.List, subset_7.List],
    Options={Adjust=False, Closed=False, LoftEnds=0, LoftSimp=0, LoftType=0, Rebuild=10, Refit=0.01})  # -> simplify(Loft)
loft_3 = Loft(
    Curves=[subset_6.List, subset_8.List],
    Options={Adjust=False, Closed=False, LoftEnds=0, LoftSimp=0, LoftType=0, Rebuild=10, Refit=0.01})  # -> simplify(Loft)
smesh_2 = SimpleMesh(Brep=loft_2)
smesh_3 = SimpleMesh(Brep=loft_3)
mjoin = MeshJoin(Meshes=flatten(smesh_3))
mjoin_2 = MeshJoin(Meshes=flatten(smesh_2))
weld = WeldMesh(Mesh=mjoin, Angle=3.141592654)
weld_2 = WeldMesh(Mesh=mjoin_2, Angle=3.141592654)

explode_7 = Explode(Curve=move_6.Geometry, Recursive=True)  # -> Segments, Vertices
num_19 = Number(num_18)
num_20 = Number(num_17)
mesh = Mesh(weld)
number_slider_6 = Slider(10, range=0..100000)
flip_4 = FlipMatrix(Data=explode_7.Vertices)
division_2 = Division(A=num_19, B=num_20)
avr_3 = Average(Input=division_2)  # -> flatten(ArithmeticMean)
pline_4 = PolyLine(Vertices=flip_4, Closed=False)  # -> simplify(flatten(Polyline))
crv_11 = Curve(move_6.Geometry)
rod = Rod(
    Polyline=pline_4,
    LengthFactor=1,
    AngleFactor=1,
    AxialStrength=number_slider_6,
    BendStrength=Slider(10000, range=0..10000))  # -> flatten(R)
rod_2 = Rod(
    Polyline=crv_11,
    LengthFactor=1,
    AngleFactor=avr_3,
    AxialStrength=number_slider_6,
    BendStrength=Slider(10000, range=0..10000))  # -> flatten(R)
show = Show(G=mesh)
merge_8 = Merge(Data1=rod, Data2=rod_2, Data3=show)

deconstruct_panel_3 = DeconstructPanel(Panel=convolution)
dec_board_4 = DeconstructBoard(Board=deconstruct_panel_3)  # -> Name, Material, Polyline, Radius, MoistureChange, Error, BlendedRadius, Width
number_slider_7 = Slider(0.001, range=0..0.001)

# ---- group: active layer
e0 = Slider(13000, range=0..100000)
e90 = Slider(860, range=0..100000)
ft0 = Slider(80, range=0..100)
gamma = Slider(6.91, range=0..10)
num_21 = Number(Slider(20, range=0..100))

# ---- group: passive layer
num_22 = Number(Slider(4, range=0..10))
e90_2 = Slider(13000, range=0..100000)
ft0_2 = Slider(0, range=0..100)
e0_2 = Slider(860, range=0..100000)
gamma_2 = Slider(4.58, range=0..10)

# ---- group: active layer / total thickness
addition = Addition(A=num_21, B=num_22)

# ---- group: active layer / distance from bottom
expression = Expression(x=addition, y=num_21, Expression="x - y/2")

# ---- group: passive layer / distance from bottom
expression_2 = Expression(x=expression, y=addition, Expression="x - y/2")

# ---- group: active layer / CG from bottom
division_3 = Division(A=addition, B=2)

# ---- group: passive layer / dist from CG
subtraction_12 = Subtraction(A=expression_2, B=division_3)
abs_4 = Absolute(Value=subtraction_12)

# ---- group: active layer / dist from CG
subtraction_13 = Subtraction(A=expression, B=division_3)
abs_5 = Absolute(Value=subtraction_13)

# ---- group: active layer / l
expression_3 = Expression(x=num_21, Expression="1000*x^3/12")

# ---- group: passive layer / l
expression_4 = Expression(x=num_22, Expression="1000*x^3/12")

# ---- group: passive layer / Ax2
expression_5 = Expression(x=num_22, y=abs_4, Expression="1000*x*y^2")

# ---- group: active layer / Ax2
expression_6 = Expression(x=num_21, y=abs_5, Expression="1000*x*y^2")

# ---- group: active layer / total l
addition_2 = Addition(A=expression_3, B=expression_6)

# ---- group: passive layer / total l
addition_3 = Addition(A=expression_4, B=expression_5)

# ---- group: active layer / El0
multiplication_3 = Multiplication(A=e0, B=addition_2)

# ---- group: active layer / T x ft0
multiplication_4 = Multiplication(A=num_21, B=ft0)

# ---- group: active layer / T x Gam
multiplication_5 = Multiplication(A=gamma, B=num_21)

# ---- group: passive layer / El0
multiplication_6 = Multiplication(A=e0_2, B=addition_3)

# ---- group: passive layer / El90
multiplication_7 = Multiplication(A=e90_2, B=addition_3)

# ---- group: passive layer / T x ft0
multiplication_8 = Multiplication(A=num_22, B=ft0_2)

# ---- group: active layer / El90
multiplication_9 = Multiplication(A=e90, B=addition_2)

# ---- group: effective material properties / El0 eff (Nmm2)
addition_4 = Addition(A=multiplication_3, B=multiplication_6)

# ---- group: effective material properties / El90 eff (Nmm2)
addition_5 = Addition(A=multiplication_9, B=multiplication_7)

# ---- group: effective material properties / Sum T x Ft0
addition_6 = Addition(A=multiplication_4, B=multiplication_8)

# ---- group: effective material properties / total thickness
addition_7 = Addition(A=num_21, B=num_22)

# ---- group: effective material properties / Sum Tx Gam
addition_8 = Addition(A=multiplication_5)

# ---- group: effective material properties / lx / ly
expression_7 = Expression(x=addition_7, Expression="1000*x^3/12")

# ---- group: effective material properties / E0eff
division_4 = Division(A=addition_4, B=expression_7)

# ---- group: effective material properties / E90eff
division_5 = Division(A=addition_5, B=expression_7)

# ---- group: effective material properties / Gamma eff
division_6 = Division(A=addition_8, B=addition_7)

# ---- group: effective material properties / ft eff
division_7 = Division(A=addition_6, B=addition_7)

# ---- group: effective material properties
matprops = MaterialPropertiesKaramba3D(
    FamilyOfMaterial="CLT",
    Name="CLT",
    ElementIdentifier="CLT",
    YoungsModulusKNCm2Dir1=expr("x*0.1", division_4),
    YoungsModulusKNCm2Dir2=expr("x*0.1", division_5),
    InPlaneShearModulus_kN_cm2="42",
    InPlaneLateralContractionCoefficient=Slider(0.012, range=0..0.1, expression="0.012"),
    TransverseShearModulusKNCm2Dir1="5",
    TransverseShearModulusKNCm2Dir2="5",
    SpecificWeight_kN_m3=division_6,
    CoefficientOfThermalExpansion1CDir1=1.2e-05,
    CoefficientOfThermalExpansion1CDir2=1.2e-05,
    TensileStrengthKNCm2Dir1=division_7,
    TensileStrengthKNCm2Dir2=division_7,
    CompressiveStrengthKNCm2Dir1=-23.5,
    CompressiveStrengthKNCm2Dir2=-23.5,
    ShearStrengthKNCm2Dir12=13.6,
    TsaiWuIntCoeff=0,
    StrengthHypothesis="MISES",
    mode="Orthotropic")  # -> flatten(Material)
num_23 = Number(flatten(addition_7))

# ----
multiplication_10 = Multiplication(A=Slider(1.5, range=0..10), B="1.35")
multiplication_11 = Multiplication(A="-9.8", B="1.35")
Z = UnitZ(Factor=multiplication_10)
Z_2 = UnitZ(Factor=multiplication_11)
rev_2 = Reverse(Vector=Z)
loads = LoadsKaramba3D(Vector=Z_2, LCase="0", mode="Gravity")
movopossum_3_0_0 = Opossum(
    OpossumData_NumberOfObjectives=1,
    OpossumData_OptimizationType=0,
    OpossumData_ResultSerializationStatus=1,
    OpossumData_ObjectiveValue=[43.66975104, 37.826752, 41.51264526, 49.19149569, 43.92164726, 43.77334731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],
    OpossumData_ParameterList=["0.263034,0.790628,0.573286,0.571689,0.038556,0.660884,0.953496,0.400448,0.795884,0.511214,1215.802500,8046.075000", "0.000384,0.792691,0.647659,0.988636,0.257739,0.997357,0.529531,0.676607,0.405270,0.014210,7484.542500,8022.952500", "0.486004,0.757362,0.086958,0.642461,0.471421,0.472794,0.743452,0.807368,0.766477,0.007683,4405.350000,5920.717500", "0.389579,0.790065,0.134683,0.769124,0.230845,0.402781,0.992834,0.944660,0.858254,0.998879,7188.285000,3793.140000", "0.667670,0.559652,0.986856,0.530116,0.040843,0.450559,0.513068,0.993502,0.734746,0.762668,4925.460000,5209.657500", "0.788191,0.793578,0.816338,0.968773,0.249346,0.984574,0.978628,0.823845,0.901909,0.421354,7550.647500,7243.432500"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],
    OpossumData_objective=num_30,
    OpossumData_variable=[genes_3, genes_4, genes_2])

zombiesolver = ZombieSolver(GoalObjects=merge_8, Threshold=1e-10, Tolerance=0.0001, MaxIterations=Slider(10000, range=0..100000))  # -> I, V, O
mesh_2 = Mesh(zombiesolver.O)
clean = CleanTree(RemoveNulls=True, RemoveInvalid=True, RemoveEmpty=False, Tree=mesh_2)

mesh_3 = Mesh(clean)

mesh_4 = Mesh(mesh_3)
num_24 = Number(expr("x+1", number_slider_5))
medges_2 = MeshEdges(Mesh=mesh_4)  # -> NakedEdges, InteriorEdges, NonManifoldEdges
demesh = DeconstructMesh(Mesh=mesh_4)  # -> Vertices, Faces, Colours, Normals
join_5 = JoinCurves(Curves=medges_2.NakedEdges, Preserve=False)
patch = Patch(Curves=join_5, Points=demesh.Vertices, Spans=num_24, Flexibility=Slider(1, range=0..1), Trim=True)
srf_3 = Surface(patch)

merge_9 = Merge(Data1=flatten(clean), Data2=flatten(weld_2))
wbedges = WeaverbirdsMeshEdges(MeshOrPolylines=graft(merge_9))
bang = ExplodeTree(Data=wbedges)  # -> Branch0, Branch1
len = Length(Curve=bang.Branch1)
len_2 = Length(Curve=bang.Branch0)
subtraction_14 = Subtraction(A=len, B=len_2)
smaller_2 = SmallerThan(FirstNumber=subtraction_14, SecondNumber=0)  # -> SmallerThan, OrEqualTo
dispatch = Dispatch(List=subtraction_14, DispatchPattern=smaller_2.SmallerThan)  # -> ListA, ListB
number_slider_8 = Slider(2653, range=0..5000)
bnd_9 = Bounds(Numbers=dispatch.ListA)
bnd_10 = Bounds(Numbers=dispatch.ListB)
dedomain_10 = DeconstructDomain(Domain=bnd_9)  # -> Start, End
dedomain_11 = DeconstructDomain(Domain=bnd_10)  # -> Start, End
Y_5 = UnitY(Factor=number_slider_8)
move_7 = Move(Geometry=bang.Branch0, Motion=Y_5)  # -> Geometry, Transform
gradient = Gradient(
    LowerLimit=dedomain_10.Start,
    UpperLimit=dedomain_10.End,
    Parameter=dispatch.ListA,
    stops=[0: RGB(234, 38, 0), 0.499: RGB(234, 126, 0), 1: RGB(254, 244, 84), 1: RGB(75, 107, 169), 1: RGB(173, 203, 249)])
dispatch_2 = Dispatch(List=move_7.Geometry, DispatchPattern=smaller_2.SmallerThan)  # -> ListA, ListB
gradient_2 = Gradient(
    LowerLimit=dedomain_11.Start,
    UpperLimit=dedomain_11.End,
    Parameter=dispatch.ListB,
    stops=[0: RGB(254, 244, 84), 0.501: RGB(173, 203, 249), 1: RGB(75, 107, 169)])
previewlw = CustomPreviewLineweights(Geometry=dispatch_2.ListA, Shader=gradient, Thickness=3, Absolute=False)
previewlw_2 = CustomPreviewLineweights(Geometry=dispatch_2.ListB, Shader=gradient_2, Thickness=3, Absolute=False)

crv_12 = Curve(bang.Branch0)
end_2 = EndPoints(Curve=crv_12)  # -> Start, End
pdecon_14 = Deconstruct(Point=end_2.Start)  # -> XComponent, YComponent, ZComponent
pdecon_15 = Deconstruct(Point=end_2.End)  # -> XComponent, YComponent, ZComponent
subtraction_15 = Subtraction(A=pdecon_14.XComponent, B=pdecon_15.XComponent)
abs_6 = Absolute(Value=subtraction_15)
smaller_3 = SmallerThan(FirstNumber=abs_6, SecondNumber=Slider(100, range=0..100))  # -> SmallerThan, OrEqualTo
cull_3 = CullPattern(List=crv_12, CullPattern=smaller_3.SmallerThan)
join_6 = JoinCurves(Curves=cull_3, Preserve=False)
curvepoint_7 = PointOnCurve(join_6, parameter=0.5)
pdecon_16 = Deconstruct(Point=curvepoint_7)  # -> XComponent, YComponent, ZComponent
sort_5 = SortList(Keys=pdecon_16.XComponent, ValuesA=join_6)  # -> Keys, ValuesA
explode_8 = Explode(Curve=sort_5.ValuesA, Recursive=True)  # -> Segments, Vertices
intcrv_5 = Interpolate(Vertices=explode_8.Vertices, Degree=3, Periodic=False, KnotStyle=1)  # -> flatten(Curve), Length, Domain
loft_4 = Loft(Curves=intcrv_5.Curve, Options={Adjust=False, Closed=False, LoftEnds=0, LoftSimp=0, LoftType=0, Rebuild=10, Refit=0.01})

mesh_5 = Mesh(mesh_3)
c_script_3 = CSharpScript(mesh=mesh_5, surface=srf_3)  # -> out, Curvature; inputs mesh: Mesh, surface: Surface
# ---------- c_script_3: C# ----------
        //get surface gaussian curvature at each mesh point
        List<double> gaussianCurvatures = new List<double>();
        double maxGaussian = 0;
        double minGaussian = double.MaxValue;

        double U;
        double V;

        for (int i = 0; i < mesh.Vertices.Count; i++)
        {
            Point3d currentMeshPoint = mesh.Vertices.Point3dAt(i);
            surface.ClosestPoint(currentMeshPoint, out U, out V);
            SurfaceCurvature surfaceCurvature = surface.CurvatureAt(U, V);
            double gaussian = surfaceCurvature.Gaussian;
            gaussianCurvatures.Add(gaussian);

            //get the range of curvatures
            if (gaussian > maxGaussian) maxGaussian = gaussian;
            if( gaussian < minGaussian) minGaussian = gaussian;
        }


        //get the range of curvatures


        //remap the curvatures to color values on the mesh points
        for (int i = 0; i < mesh.Vertices.Count; i++)
        {
            double hue = (gaussianCurvatures[i] - minGaussian) / (0 - minGaussian) * (0.5 - maxGaussian) + maxGaussian;
        }
        Curvature = gaussianCurvatures;
# ---------- end c_script_3 ----------
num_25 = Number(c_script_3.Curvature)
bnd_11 = Bounds(Numbers=num_25)
dedomain_12 = DeconstructDomain(Domain=bnd_11)  # -> Start, End
gradient_3 = Gradient(
    LowerLimit=dedomain_12.Start,
    UpperLimit=dedomain_12.End,
    Parameter=num_25,
    stops=[0: RGB(0, 128, 0), 0.5: RGB(255, 255, 0), 1: RGB(255, 0, 0)])
mesh_6 = Mesh(mesh_5)
c_script_4 = CSharpScript(mesh=mesh_6, colors=gradient_3)  # -> out, A; inputs mesh: Mesh, colors: list of Color
# ---------- c_script_4: C# ----------
    for(int i = 0; i < mesh.Vertices.Count; i++)
    {
      mesh.VertexColors.SetColor(i, colors[i]);
    }
    A = mesh;
# ---------- end c_script_4 ----------

gaussian_curvature = Panel(bnd_11)
relaxation = Panel(bnd_9)

curvepoint_8 = PointOnCurve(intcrv_5.Curve, parameter=0.5)
pdecon_17 = Deconstruct(Point=curvepoint_8)  # -> XComponent, YComponent, ZComponent
bnd_12 = Bounds(Numbers=pdecon_17.ZComponent)

crv_13 = Curve(dec_board_4.Polyline)
srf_4 = Surface(reparameterize(loft_4))
explode_9 = Explode(Curve=crv_13, Recursive=True)  # -> Segments, Vertices
neg = Negative(Value=number_slider_8)
len_3 = Length(Curve=explode_9.Segments)
Y_6 = UnitY(Factor=neg)
runion = RegionUnion(Curves=flatten(crv_13))
division_8 = Division(A=len_3, B=Slider(50, range=0..100))
move_8 = Move(Geometry=srf_4, Motion=Y_6)  # -> Geometry, Transform
srf_5 = Surface(reparameterize(runion))
divide_4 = DivideCurve(Curve=explode_9.Segments, Count=division_8, Kinks=False)  # -> Points, Tangents, Parameters
srf_cp = SurfaceClosestPoint(Point=divide_4.Points, Surface=srf_5)  # -> Point, UVPoint, Distance
evalsrf = EvaluateSurface(Surface=reparameterize(move_8.Geometry), Point=srf_cp.UVPoint)  # -> Point, Normal, UDirection, VDirection, Frame
intcrv_6 = Interpolate(Vertices=evalsrf.Point, Degree=3, Periodic=False, KnotStyle=1)  # -> Curve, Length, Domain
trim_6 = TrimTree(Tree=intcrv_6.Curve, Depth=1)
join_7 = JoinCurves(Curves=trim_6, Preserve=False)  # -> simplify(Curves)
trim_7 = TrimTree(Tree=join_7, Depth=1)  # -> graft(Tree)
c_script_5 = CSharpScript(surface=move_8.Geometry, curves=trim_7)  # -> out, A; inputs surface: Brep, curves: tree of Curve
# ---------- c_script_5: C# ----------
    DataTree<Brep> splitBreps = new DataTree<Brep>();
    for(int i = 0; i < curves.BranchCount; i++)
    {
      Brep[] results = surface.Split(curves.Branch(i), 0.01);
      foreach(Brep brep in results)
      {
        splitBreps.Add(brep, curves.Paths[i]);
      }
    }
    A = splitBreps;
# ---------- end c_script_5 ----------
area_5 = Area(Geometry=c_script_5.A)  # -> Area, Centroid
sort_6 = SortList(Keys=area_5.Area, ValuesA=c_script_5.A)  # -> Keys, ValuesA
item_7 = ListItem(List=sort_6.ValuesA, Index=0, Wrap=True)
trim_8 = TrimTree(Tree=item_7, Depth=1)
srf_6 = Surface(trim_8)

dedomain_13 = DeconstructDomain(Domain=bnd_12)  # -> Start, End
num_26 = Number(dedomain_13.End)
panel_5 = Panel(num_26)

# ---- group: split and mirror
srf_7 = Surface(reparameterize(loft_4))
bbox_5 = BoundingBox(Content=srf_7, Plane=PlaneXY(0, 0, 0))  # -> Box, Box_2
area_6 = Area(Geometry=bbox_5.Box)  # -> Area, Centroid
xz_2 = XZPlane(Origin=area_6.Centroid)
sec = BrepPlane(Brep=srf_7, Plane=xz_2)  # -> Curves, Points
srfsplit = SurfaceSplit(Surface=srf_7, Curves=sec.Curves)
item_8 = ListItem(List=srfsplit, Index=0, Wrap=True)
mirror = Mirror(Geometry=item_8, Plane=xz_2)  # -> Geometry, Transform
join_8 = BrepJoin(Breps=[mirror.Geometry, item_8])  # -> Breps, Closed
brep = Brep(join_8.Breps)

# ----
brep_2 = Brep(brep)
bbox_6 = BoundingBox(Content=brep_2, Plane=PlaneXY(0, 0, 0))  # -> Box, Box_2
debrep = DeconstructBrep(Brep=brep_2)  # -> Faces, Edges, Vertices
debox_5 = DeconstructBox(Box=bbox_6.Box)  # -> Plane, X, Y, Z
dedomain_14 = DeconstructDomain(Domain=debox_5.Z)  # -> Start, End
pdecon_18 = Deconstruct(Point=debrep.Vertices)  # -> XComponent, YComponent, ZComponent
subtraction_16 = Subtraction(A=dedomain_14.Start, B=pdecon_18.ZComponent)
abs_7 = Absolute(Value=subtraction_16)
sort_7 = SortList(Keys=abs_7, ValuesA=debrep.Vertices)  # -> Keys, ValuesA
item_9 = ListItem(List=sort_7.ValuesA, Index=0, Wrap=True)
xz_3 = XZPlane(Origin=item_9)
rotate_3 = Rotate(Geometry=brep_2, Angle=degrees(Slider(5, range=0..100)), Plane=xz_3)  # -> Geometry, Transform

txt_3 = Text(dec_board_4.Material)
srf_8 = Surface(srf_6)
len_4 = TextLength(Text=txt_3)
bnd_13 = Bounds(Numbers=len_4)
dedomain_15 = DeconstructDomain(Domain=bnd_13)  # -> Start, End
gradient_4 = Gradient(
    LowerLimit=dedomain_15.Start,
    UpperLimit=dedomain_15.End,
    Parameter=len_4,
    stops=[0: RGB(186, 186, 186), 1: RGB(122, 122, 122)])
panel_6 = Panel(txt_3)
preview = CustomPreview(Geometry=srf_8, Material=gradient_4)

edges = BrepEdges(Brep=brep)  # -> Naked, Interior, NonManifold
len_5 = Length(Curve=edges.Naked)
sort_8 = SortList(Keys=len_5, ValuesA=edges.Naked)  # -> reverse(Keys), reverse(ValuesA)
item_10 = ListItem(List=sort_8.ValuesA, Index=0, Wrap=True)  # -> Item, Item1
merge_10 = Merge(Data1=item_10.Item, Data2=item_10.Item1)
eval = EvaluateCurve(Curve=reparameterize(merge_10), Parameter=Slider(0.9, range=0..1))  # -> Point, Tangent, Angle
pdecon_19 = Deconstruct(Point=eval.Point)  # -> XComponent, YComponent, ZComponent
item_11 = ListItem(List=pdecon_19.YComponent, Index=0, Wrap=True)  # -> Item, Item1
sort_9 = SortList(Keys=pdecon_19.YComponent, ValuesA=eval.Point)  # -> Keys, ValuesA
subtraction_17 = Subtraction(A=item_11.Item1, B=item_11.Item)
xz_4 = XZPlane(Origin=sort_9.ValuesA)
num_27 = Number(subtraction_17)

debrep_2 = DeconstructBrep(Brep=brep)  # -> Faces, Edges, Vertices
area_7 = Area(Geometry=debrep_2.Faces)  # -> Area, Centroid
pdecon_20 = Deconstruct(Point=area_7.Centroid)  # -> XComponent, YComponent, ZComponent
sort_10 = SortList(Keys=pdecon_20.YComponent, ValuesA=debrep_2.Faces)  # -> Keys, ValuesA

srf_9 = Surface(reparameterize(sort_10.ValuesA))
pln_3 = Plane(xz_4)
sec_2 = BrepPlane(Brep=srf_9, Plane=pln_3)  # -> simplify(flatten(Curves)), Points
srfsplit_2 = SurfaceSplit(Surface=srf_9, Curves=sec_2.Curves)  # -> simplify(Fragments)
area_8 = Area(Geometry=srfsplit_2)  # -> Area, Centroid
sort_11 = SortList(Keys=area_8.Area, ValuesA=srfsplit_2)  # -> Keys, reverse(ValuesA)
item_12 = ListItem(List=sort_11.ValuesA, Index=0, Wrap=True)
join_9 = BrepJoin(Breps=flatten(item_12))  # -> Breps, Closed

num_28 = Number(num_27)
brep_3 = Brep(join_9.Breps)
Y_7 = UnitY(Factor=num_28)
arrlinear = LinearArray(Geometry=brep_3, Direction=Y_7, Count=Slider(3, range=0..10))  # -> Geometry, Transform

brep_4 = Brep(arrlinear.Geometry)
scale_2 = Scale(Geometry=arrlinear.Geometry, Center=Point(0, 0, 0), Factor=number_slider_7)  # -> Geometry, Transform
debrep_3 = DeconstructBrep(Brep=brep_4)  # -> Faces, Edges, Vertices
curvepoint_9 = PointOnCurve(debrep_3.Edges, parameter=0.5)
pdecon_21 = Deconstruct(Point=curvepoint_9)  # -> XComponent, YComponent, ZComponent
smaller_4 = SmallerThan(FirstNumber=pdecon_21.XComponent, SecondNumber=Slider(1525, range=0..10000))  # -> SmallerThan, OrEqualTo
cull_4 = CullPattern(List=debrep_3.Edges, CullPattern=smaller_4.SmallerThan)  # -> simplify(flatten(List))
scale_3 = Scale(Geometry=cull_4, Center=Point(0, 0, 0), Factor=number_slider_7)  # -> Geometry, Transform
debrep_4 = DeconstructBrep(Brep=scale_2.Geometry)  # -> Faces, Edges, Vertices
mesh_breps = MeshBrepsKaramba3D(
    Brep=debrep_4.Faces,
    MeshResolution=Slider(0.1, range=0..100),
    EdgeRefinementFactor=0.67,
    PointReduction=False,
    SmoothingStepSize=0,
    SmoothingIterations=5)  # -> Mesh, Info
mjoin_3 = MeshJoin(Meshes=flatten(mesh_breps.Mesh))
unim = UnifyMesh(Mesh=mjoin_3)  # -> Result, Count
weld_3 = WeldMesh(Mesh=unim.Result, Angle=3.141592654)

demesh_2 = DeconstructMesh(Mesh=weld_3)  # -> flatten(Vertices), Faces, Colours, Normals
crv_cp = CurveClosestPoint(Point=demesh_2.Vertices, Curve=graft(scale_3.Geometry))  # -> Point, Parameter, Distance
equalst = EqualityWithinTolerance(FirstNumber=crv_cp.Distance, SecondNumber=0, Tolerance=0.1)  # -> Equality, Inequality
cull_5 = CullPattern(List=demesh_2.Vertices, CullPattern=equalst.Equality)
pt_17 = Point(cull_5)

cullpt_2 = CullDuplicates(Points=flatten(pt_17), Tolerance=0.01, CullMode=3)  # -> simplify(flatten(Points)), Indices, Valence

mesh_7 = Mesh(clean)
mesh_8 = Mesh(weld_2)
merge_11 = Merge(Data1=mesh_7, Data2=mesh_8)
wbfacepolys = WeaverbirdsFacePolylines(Mesh=merge_11)  # -> simplify(Polygons)
explode_10 = Explode(Curve=wbfacepolys, Recursive=True)  # -> Segments, Vertices
cullpt_3 = CullDuplicates(Points=explode_10.Vertices, Tolerance=0.1, CullMode=3)  # -> simplify(Points), Indices, Valence
avr_4 = Average(Input=cullpt_3.Points)
trim_9 = TrimTree(Tree=avr_4, Depth=1)
bang_2 = ExplodeTree(Data=trim_9)  # -> Branch0, Branch1
dist = Distance(PointA=bang_2.Branch0, PointB=bang_2.Branch1)

bang_3 = ExplodeTree(Data=wbfacepolys)  # -> Branch0, Branch1

pline2msh = PolylineToMesh(Polyline=bang_3.Branch0, Quadrangulate=True)  # -> flatten(Mesh)

bnd_14 = Bounds(Numbers=dist)
dedomain_16 = DeconstructDomain(Domain=bnd_14)  # -> Start, End
gradient_5 = Gradient(
    LowerLimit=dedomain_16.Start,
    UpperLimit=dedomain_16.End,
    Parameter=dist,
    stops=[0: RGB(75, 107, 169), 0.254: RGB(173, 203, 249), 0.5: RGB(254, 244, 84), 0.754: RGB(234, 126, 0), 1: RGB(234, 38, 0)])
mesh_9 = Mesh(pline2msh)
preview_2 = CustomPreview(Geometry=mesh_9, Material=gradient_5)

bbox_7 = BoundingBox(Content=mesh_9, Plane=PlaneXY(0, 0, 0), UnionBox=True)  # -> Box, Box_2
debrep_5 = DeconstructBrep(Brep=bbox_7.Box)  # -> Faces, Edges, Vertices
number_slider_9 = Slider(1000, range=0..1000)
item_13 = ListItem(List=debrep_5.Edges, Index=0, Wrap=True)  # -> Item, Item1
ext = ExtendCurve(Curve=item_13.Item1, Type=0, Start=number_slider_9, End=number_slider_9)

# ---- group: Karamba simulation
num_29 = Number(num_23)
mesh_10 = Mesh(weld_3)
supp = SupportKaramba3D(PosInd=cullpt_2.Points, menu=[buttons(on, on, on, on, on, on)])
cross_section = CrossSectionKaramba3D(FamilyNameOfCrossSection="DefaultCroSec", Height_cm=expr("x/10", num_29), mode="Shell - Const")
loads_2 = LoadsKaramba3D(Vector=rev_2, Mesh=weld_3, LCase="0", mode="MeshLoad -Const.", menu=[buttons(off, on, off), buttons(on, on)])
meshtoshell = MeshToShellKaramba3D(Mesh=mesh_10, CrossSection=cross_section, LimitDistance_m=0.005)  # -> Element, Points, Info
assemble = AssembleModelKaramba3D(
    Elem=meshtoshell.Element,
    Support=supp,
    Load=flatten([loads_2, loads]),
    CrossSection=cross_section,
    Material=matprops,
    LimitDistance_m=0.005)  # -> Model, Info, Mass_kg, CenterOfGravity, LoadCaseNames

# ----
analyze = AnalyzeKaramba3D(Model=assemble.Model)  # -> CalculatedModel, MaximumDisplacement_cm, ResultingForceOfGravity_kN, ElasticEnergyChange_kNm
num_30 = Number(flatten(analyze.MaximumDisplacement_cm))

# ---- group: Karamba simulation (continued)
modelview = ModelViewKaramba3D(Model=analyze.CalculatedModel, ResultFactors=1, ResultCase=-1)  # -> Model, DeformedMesh, DeformedAxes, DeformedModel
shellview = ShellViewKaramba3D(Model=modelview.Model, IndexOfLayer=0)  # -> Model, MeshesOfRenderedShells, LegendColors, LegendTags
mesh_11 = Mesh(shellview.MeshesOfRenderedShells)

# ----
panel_7 = Panel(num_30)
scale_4 = Scale(Geometry=mesh_11, Center=Point(0, 0, 0), Factor=Slider(1000, range=0..1000))  # -> Geometry, Transform
mesh_12 = Mesh(scale_4.Geometry)
