# Grasshopper definition BilayerDesign Final Prediction.gh (Grasshopper 1.0.7)
# plug-ins: HygroDesign, Pufferfish, Bookworm, treesloth01, Sofistik, Telepathy

update = Button()
python = GhPythonScript(update=update)  # inputs update: Boolean
# ---------- python: Python ----------
# Seghier Mohamed Abdelaziz - 2021 - seghierdesign@gmail.com

import Grasshopper as gh

ghDoc = ghenv.Component.OnPingDocument()
objects = ghDoc.Objects

object = []

for obj in objects: 

    if obj.NickName.Length == 0:
        if str(obj.RemovedFromDocument.DeclaringType) == "Grasshopper.Kernel.GH_Component":
            object.append(obj)
                
if update == True:
    gh.Kernel.GH_Document.NewSolution(ghDoc,False)
    for o in object:
        gh.Kernel.GH_Document.RemoveObject(ghDoc ,o,False)
# ---------- end python ----------

# ---- group: Template
od_outdated = ColourSwatch(SwatchColor=RGBA(97, 97, 97, 150))
u_updated = ColourSwatch(SwatchColor=RGBA(208, 115, 230, 112))
toggle = BooleanToggle(True)
o_outputs = ColourSwatch(SwatchColor=RGBA(160, 218, 242, 203))
s_settings = ColourSwatch(SwatchColor=RGBA(224, 145, 81, 154))
g_general = ColourSwatch(SwatchColor=RGBA(245, 243, 237, 156))
y_yellow = ColourSwatch(SwatchColor=RGBA(247, 244, 64, 188))
i_inputs = ColourSwatch(SwatchColor=RGBA(125, 217, 98, 150))
c_core = ColourSwatch(SwatchColor=RGBA(235, 227, 206, 203))
r_red = ColourSwatch(SwatchColor=RGBA(242, 63, 63, 203))

# ----
file = CSharpScript()  # -> File
# ---------- file: C# usings ----------
using System.IO;
# ---------- file: C# ----------
    GH_Document doc = owner.OnPingDocument();
    string filePath = doc.FilePath;
    string pathOnly = Path.GetDirectoryName(filePath);


    File = pathOnly;
# ---------- end file ----------
filepath = RemoteSender(file)

# ---- group: Template
change_background_color = Button()
toggle_2 = BooleanToggle(True)
button = Button()
button_2 = Button()
button_3 = Button()
changebackground = GhPythonScript(
    change=change_background_color,
    newBackgroundColor=ColourSwatch(SwatchColor=RGB(255, 255, 255)),
    wireColor=RGB(110, 110, 110),
    selectedWireColor=RGB(47, 255, 0))  # inputs newBackgroundColor: Color, wireColor: Color, selectedWireColor: Color
# ---------- changebackground: Python ----------
import Grasshopper as gh
import rhinoscriptsyntax as rs

newShadeColor = rs.CreateColor(0,0,0,20)
newEdgeColor = rs.CreateColor(0,0,0,40)

if(change):
     gh.GUI.Canvas.GH_Skin.canvas_back = newBackgroundColor
     gh.GUI.Canvas.GH_Skin.canvas_shade = newShadeColor
     gh.GUI.Canvas.GH_Skin.canvas_edge = newEdgeColor
     gh.GUI.Canvas.GH_Skin.wire_default = wireColor
     gh.GUI.Canvas.GH_Skin.wire_selected_a = selectedWireColor
     gh.GUI.Canvas.GH_Skin.wire_selected_b = selectedWireColor
# ---------- end changebackground ----------

# ---- group: beech
panel = Panel("beech")
number_slider = Slider(0.0001, range=0..0.0001)
number_slider_2 = Slider(0.002, range=0..1)
number_slider_3 = Slider(0.0041, range=0..1)
number_slider_4 = Slider(14000, range=0..20000)
number_slider_5 = Slider(2280, range=0..20000)
number_slider_6 = Slider(1160, range=0..20000)
number_slider_7 = Slider(720, range=0..1000)

# ----
number_slider_8 = Slider(140, range=0..1000)
number_slider_9 = Slider(15, range=0..100)

# ---- group: Template
# Do not modify this
# component without setting
# enable to false first!
toggle_3 = BooleanToggle(True)
colorgroups = CSharpScript(
    Colors=[i_inputs, s_settings, g_general, c_core, o_outputs, r_red, y_yellow, u_updated, od_outdated],
    Enable=toggle,
    Rename=toggle_2,
    RunOnce=button,
    Debug=toggle_3)  # -> out; inputs Colors: list of Color, Enable: Boolean, Rename: Boolean, RunOnce: Boolean, Debug: Boolean
# ---------- colorgroups: C# usings ----------
using System.Linq;
using System.Text;
using System.Reflection;
# ---------- colorgroups: C# ----------
    msg.Clear();


    this.Component.Message = "id: " + id.ToString();

    _debug = Debug; //Set to true to have all events printed in rhino log
    _rename = Rename;

    if (Enable)
    {
      msg.AppendFormat("Set up events on ID {0}\n", id);
      SetupDict(); // Create a dictionary of the input swatches
      SetEventHandlers(); // This would do the job.


    }
    else
    {
      RemoveEventHandlers();
    }
    if (RunOnce)
    {
      foreach(Grasshopper.Kernel.Special.GH_Group grp in Grasshopper.Instances.ActiveCanvas.Document.Objects.OfType<Grasshopper.Kernel.Special.GH_Group>())
      {
        ColorGroup(grp, null); // You decide if it should run once on all existing groups

      }
    }

    Print(msg.ToString());


    // Component setup
    Component.Description = "Set up event handlers to color groups based on prefixes such as 'in_' and 'out_'.\n"
      + "Please insert only swatcheds directly into the Colors input\n\n"
      + "MIT License. Copyright Mathias Sønderskov Schaltz 2022";
    Component.Params.Input[0].Description = "Please insert only swatcheds directly into the Colors input.\nRemember to rename them";
    Component.Params.Input[1].Description = "Toggle to run...";
    Component.Params.Input[2].Description = "Set to true if you want to automatically rename the groups and remove prefix. Default is false.";
    Component.Params.Input[3].Description = "Set to true to run it once and color all existing groups.";
    Component.Params.Input[Component.Params.Input.Count - 1].Description = "Set debug to true to get all the events printed in the rhino log";
# ---------- colorgroups: C# additional code ----------
  public static Random rnd = new Random();
  public int id = rnd.Next(0, 1000);
  StringBuilder msg = new StringBuilder();
  Dictionary<string, System.Drawing.Color> colorDict = new Dictionary<string, System.Drawing.Color>();

  bool _debug = false;
  bool _rename = false;

  public bool IdExists(int id)
  {
    IList<IGH_DocumentObject> objs = Grasshopper.Instances.ActiveCanvas.Document.Objects;
    return objs
      .OfType<IGH_Component>()
      .Where(ob => ob.NickName == this.Component.NickName)
      .Where(ob => ob.GetType().ToString() == "ScriptComponents.Component_CSNET_Script")
      .Where(ob => ob.Message == "id: " + id.ToString()).Any();

  }


  public void SetupDict()
  {
    colorDict.Clear();
    // Get all inputs to "Colors"
    IList<IGH_Param> colorSources = this.Component.Params.Input[0].Sources;
    if (colorSources.Count == 0)
    {
      throw new Exception("You forgot to setup the colors. Please input swatch components and rename them");
    }
    foreach(IGH_Param source in colorSources)
    {
      //if (source.Type.ToString() == "Grasshopper.Kernel.Types.GH_Colour")
      if (source is Grasshopper.Kernel.Special.GH_ColourSwatch)
      {
        string nickName = source.NickName.Split('_')[0].Trim() + "_";
        if(!colorDict.ContainsKey(nickName))
        {
          Grasshopper.Kernel.Special.GH_ColourSwatch swatch = (Grasshopper.Kernel.Special.GH_ColourSwatch) source;
          colorDict.Add(nickName, swatch.SwatchColour);
        }
        else
        {
          throw new Exception("Multiple swatches using the same name detected. Please rename");
        }
      }
      else
      {
        throw new Exception("Whacko! Why did you input a non-swatch into the Colors? " + source.Type.ToString());
      }

    }

    msg.AppendFormat("Set up the dictionaries with {0} colors\n", colorDict.Count);
    foreach(var pairs in colorDict)
    {
      msg.AppendFormat("{0} -> {1}\n", ("\"" + pairs.Key + "\"").PadRight(5 + colorDict.Keys.Select(k => k.Length).Max()), pairs.Value);
    }
  }

  public void SetEventHandlers()
  {

    // Always remove events first to avoid duplicates
    GrasshopperDocument.ObjectsAdded -= OnObjectsAdded;
    GrasshopperDocument.ObjectsDeleted -= OnObjectsRemoved;
    GrasshopperDocument.ObjectsDeleted -= OnDeleteThisComponent;

    // Attach events
    GrasshopperDocument.ObjectsAdded += OnObjectsAdded;
    GrasshopperDocument.ObjectsDeleted += OnObjectsRemoved;
    GrasshopperDocument.ObjectsDeleted += OnDeleteThisComponent;


    foreach(Grasshopper.Kernel.Special.GH_Group grp in GrasshopperDocument.Objects.OfType<Grasshopper.Kernel.Special.GH_Group>())
    {
      grp.ObjectChanged -= ColorGroup;
      grp.ObjectChanged += ColorGroup;

      //ColorGroup(grp, null); // Make sure to run it once
    }
    msg.AppendFormat("Added the eventhandlers on {0} existing groups and on future created groups\n", GrasshopperDocument.Objects.OfType<Grasshopper.Kernel.Special.GH_Group>().Count());
  }

  public void OnObjectsAdded(object sender, GH_DocObjectEventArgs e)
  {
    bool any = false;
    foreach (Grasshopper.Kernel.Special.GH_Group grp in e.Objects.OfType<Grasshopper.Kernel.Special.GH_Group>())
    {
      grp.ObjectChanged -= ColorGroup;
      grp.ObjectChanged += ColorGroup;
      any = true;
    }

    DebugWrite(any ? "Group Objects Added: Attaching Events to ObjectChanged" : "Objects Added - but no groups");
  }

  //Same but reversed
  public void OnObjectsRemoved(object sender, GH_DocObjectEventArgs e)
  {
    bool any = false;
    foreach (Grasshopper.Kernel.Special.GH_Group grp in e.Objects.OfType<Grasshopper.Kernel.Special.GH_Group>())
    {
      grp.ObjectChanged -= ColorGroup;
      any = true;
    }

    DebugWrite(any ? "Group Objects Removed, removing event" : "Objects Removed - although not a group");

  }



  public void RemoveEventHandlers()
  {
    GrasshopperDocument.ObjectsAdded -= OnObjectsAdded;
    GrasshopperDocument.ObjectsDeleted -= OnObjectsRemoved;


    foreach(Grasshopper.Kernel.Special.GH_Group grp in GrasshopperDocument.Objects.OfType<Grasshopper.Kernel.Special.GH_Group>())
    {
      grp.ObjectChanged -= ColorGroup;

    }
    msg.AppendFormat("Removed event handlers on document and on {0} groups\n", GrasshopperDocument.Objects.OfType<Grasshopper.Kernel.Special.GH_Group>().Count());

  }

  public void ColorGroup(object sender, EventArgs e)
  {
    if (!IdExists(id))
    {
      DebugWrite("Component not relevant. Disabling old id + " + id.ToString());
      RemoveEventHandlers();
      return;
    }

    Grasshopper.Kernel.Special.GH_Group grp = sender as Grasshopper.Kernel.Special.GH_Group;
    if (grp == null) return; //not type GH_Group
    //if (!grp.NickName.EndsWith("_")) return;

    string[] nameParts = grp.NickName.Split('_');
    if (nameParts.Length <= 1)
      return;
    string prefix = grp.NickName.Split('_')[0].Trim() + '_';

    string prefixes = String.Join(", ", colorDict.Keys.Select(k => "\"" + k + "\""));

    msg.Append("prefix " + prefix + "\n");
    if (colorDict.ContainsKey(prefix))
    {
      //if (grp.NickName.EndsWith("_"))
      grp.Colour = colorDict[prefix];
      if (_rename)
      {
        grp.NickName = grp.NickName.Replace(prefix, "");
      }

      DebugWrite("Colored " + grp.NickName);

    }
    else
    {
      DebugWrite("Group changed but not relevant: prefix " + prefix + " is not among " + prefixes);
    }

  }
  public void DebugWrite(string msg)
  {
    if (_debug)
    {
      Rhino.RhinoApp.WriteLine(String.Format("[ColGrps {0}]: {1}", id, msg));
    }
  }

  public void OnDeleteThisComponent(object sender, GH_DocObjectEventArgs e)
  {

    if (e.Objects.OfType<Grasshopper.Kernel.GH_Component>().Where(o => o.NickName == this.Component.NickName).Any())
    {
      DebugWrite("Removed template component. Removing all the eventhandlers");
      RemoveEventHandlers();
    }

  }
# ---------- end colorgroups ----------

fixwires = CSharpScript(FixOnce=button_2, Enable=toggle, Debug=Toggle(True))  # -> out; inputs FixOnce: Boolean, Enable: Boolean, Debug: Boolean
# ---------- fixwires: C# usings ----------
using System.Text;
using System.Linq;
using Grasshopper.Kernel.Special;
# ---------- fixwires: C# ----------
    _debug = Debug;
    _enable = Enable;
    msg.Clear();
    this.Component.Message = "id: " + id.ToString();


    SetDictionary();

    if (Enable)
    {
      SetEventHandlers();
    }
    else
    {
      RemoveEventHandlers();
    }


    if (FixOnce)
    {
      FixAll();
    }

    Print(msg.ToString());
    
    // Component setup
    Component.Description = "Set up event handlers to change all wire types across groups to faint"
      + "\n\n"
      + "MIT License. Copyright Mathias Sønderskov Schaltz 2022";
    Component.Params.Input[0].Description = "Run me once on the document";
    Component.Params.Input[1].Description = "Toggle to enable event listener";
    Component.Params.Input[Component.Params.Input.Count - 1].Description = "Set debug to true to get all the events printed in the rhino log";
# ---------- fixwires: C# additional code ----------
  public static Random rnd = new Random();
  public int id = rnd.Next(0, 1000);
  StringBuilder msg = new StringBuilder();
  bool _debug = false;
  bool _enable = false;

  public Dictionary<IGH_ActiveObject, HashSet<GH_Group>> groupsPerObject = new Dictionary<IGH_ActiveObject, HashSet<GH_Group>>();


  public void OnSolutionExpired(object sender, GH_DocUndoEventArgs e)
  {
    if(_enable)
      FixAll();
  }

  public void FixAll()
  {
    //DebugWrite("Fixing all?");
    foreach(IGH_ActiveObject key in groupsPerObject.Keys.Where(k => groupsPerObject[k].Count() > 0))
    {

      FixInputs(key);
    }
  }



  public bool HasGroup(IGH_ActiveObject obj)
  {
    return groupsPerObject[obj].Count > 0;
  }


  public void FixInputs(IGH_ActiveObject obj)
  {

    if (!IdExists(id))
    {
      DebugWrite("Component not relevant. Disabling old id " + id.ToString());
      RemoveEventHandlers();
      return;
    }

    //List<List<IGH_ActiveObject>> parents = new List<List<IGH_ActiveObject>>();
    IGH_Param par = obj as IGH_Param;
    if (par != null && par.Sources != null)
    {


      IEnumerable<IGH_ActiveObject> p = par.Sources.Select(s => s.Attributes.GetTopLevel.DocObject as IGH_ActiveObject);
      //parents.Add(p);
      if(HasGroup(obj) && p.All(o => !HasGroupsInCommon(o, obj)) && par.WireDisplay != GH_ParamWireDisplay.faint)
      {
        DebugWrite("Fixing " + par.Attributes.GetTopLevel.DocObject.NickName);
        par.WireDisplay = GH_ParamWireDisplay.faint;
      }

    }

    IGH_Component comp = obj as IGH_Component;
    if (comp != null)
    {
      foreach(IGH_Param inp in comp.Params.Input)
      {

        IEnumerable<IGH_ActiveObject> p = inp.Sources.Select(i => i.Attributes.GetTopLevel.DocObject as IGH_ActiveObject);

        if(HasGroup(obj) && p.All(o => !HasGroupsInCommon(o, obj)) && inp.WireDisplay != GH_ParamWireDisplay.faint)
        {
          DebugWrite("Fixing " + inp.Attributes.GetTopLevel.DocObject.NickName);
          inp.WireDisplay = GH_ParamWireDisplay.faint;
        }
      }

    }



  }





  public void SetDictionary()
  {
    IList<IGH_DocumentObject> objects = Grasshopper.Instances.ActiveCanvas.Document.Objects.ToList();
    //Print(String.Join(", ", objects.Select(o => o.NickName)));

    groupsPerObject = objects
      .Where(o => o.GetType() != typeof(GH_Group))
      .OfType<IGH_ActiveObject>()
      .ToDictionary(o => o, o => new HashSet<GH_Group>());

    foreach(GH_Group grp in objects.OfType<GH_Group>())
    {

      foreach(IGH_ActiveObject obj in grp.ObjectsRecursive().OfType<IGH_ActiveObject>())
      {
        groupsPerObject[obj].Add(grp);

      }
    }



  }

  public bool HasGroupsInCommon(IGH_ActiveObject obj1, IGH_ActiveObject obj2)
  {
    HashSet<GH_Group> set1 = groupsPerObject[obj1];
    HashSet<GH_Group> set2 = groupsPerObject[obj2];

    set1.IntersectWith(set2);

    return set1.Any();
  }

  public void SetEventHandlers()
  {

    GrasshopperDocument.UndoStateChanged -= OnSolutionExpired;
    GrasshopperDocument.UndoStateChanged += OnSolutionExpired;
    GrasshopperDocument.ObjectsDeleted -= OnDeleteThisComponent;
    GrasshopperDocument.ObjectsDeleted += OnDeleteThisComponent;
    msg.AppendFormat("Added the eventhandlers to UndoStateChanged\n", GrasshopperDocument.Objects.OfType<Grasshopper.Kernel.Special.GH_Group>().Count());
  }

  public void RemoveEventHandlers()
  {
    GrasshopperDocument.UndoStateChanged -= OnSolutionExpired;
    GrasshopperDocument.ObjectsDeleted -= OnDeleteThisComponent;

    msg.AppendFormat("Removed wire event handlers on document\n", GrasshopperDocument.Objects.OfType<Grasshopper.Kernel.Special.GH_Group>().Count());

  }

  public void OnDeleteThisComponent(object sender, GH_DocObjectEventArgs e)
  {

    if (e.Objects.OfType<Grasshopper.Kernel.GH_Component>().Where(o => o.NickName == this.Component.NickName).Any())
    {
      DebugWrite("Removed template component. Removing all the eventhandlers");
      RemoveEventHandlers();
    }

  }

  public bool IdExists(int id)
  {
    IList<IGH_DocumentObject> objs = Grasshopper.Instances.ActiveCanvas.Document.Objects;
    return objs
      .OfType<IGH_Component>()
      .Where(ob => ob.NickName == this.Component.NickName)
      .Where(ob => ob.GetType().ToString() == "ScriptComponents.Component_CSNET_Script")
      .Where(ob => ob.Message == "id: " + id.ToString()).Any();

  }

  public void DebugWrite(string msg)
  {
    if (_debug)
    {
      Rhino.RhinoApp.WriteLine(String.Format("[FixWire {0}]: {1}", id, msg));
    }
  }
# ---------- end fixwires ----------

fixparams = CSharpScript(FixOnce=button_3, Enable=toggle, Debug=Toggle(True))  # -> out; inputs FixOnce: Boolean, Enable: Boolean, Debug: Boolean
# ---------- fixparams: C# ----------
    _debug = Debug;
    _enable = Enable;
    msg.Clear();
    this.Component.Message = "id: " + id.ToString();




    if (Enable)
    {
      SetEventHandlers();
    }
    else
    {
      RemoveEventHandlers();
    }


    if (FixOnce)
    {
      FixAll();
    }

    Print(msg.ToString());

    // Component setup
    Component.Description = "Set up event handlers to change params to show nickname and not icon"
      + "\n\n"
      + "MIT License. Copyright Mathias Sønderskov Schaltz 2022";
    Component.Params.Input[0].Description = "Run me once on the document";
    Component.Params.Input[1].Description = "Toggle to enable event listener";
    Component.Params.Input[Component.Params.Input.Count - 1].Description = "Set debug to true to get all the events printed in the rhino log";
# ---------- fixparams: C# additional code ----------
  public static Random rnd = new Random();
  public int id = rnd.Next(0, 1000);
  StringBuilder msg = new StringBuilder();
  bool _debug = false;
  bool _enable = false;

  public Dictionary<IGH_ActiveObject, HashSet<GH_Group>> groupsPerObject = new Dictionary<IGH_ActiveObject, HashSet<GH_Group>>();


  public void OnObjectsAdded(object sender, GH_DocObjectEventArgs e)
  {
    if (!IdExists(id))
    {
      DebugWrite("[FixParam] Component not relevant. Disabling old id " + id.ToString());
      RemoveEventHandlers();
      return;
    }


    if(_enable)
    {
      foreach(IGH_Param par in e.Objects.OfType<IGH_Param>())
      {
        FixInputs(par);
      }
    }


  }

  public void FixAll()
  {
    //DebugWrite("Fixing all?");
    foreach(IGH_Param par in GrasshopperDocument.Objects.OfType<IGH_Param>())
    {

      FixInputs(par);
    }
  }




  public void FixInputs(IGH_ActiveObject obj)
  {



    IGH_Param par = obj as IGH_Param;
    if (par != null)
    {

      par.IconDisplayMode = GH_IconDisplayMode.name;


    }

  }


  public void SetEventHandlers()
  {

    GrasshopperDocument.ObjectsAdded -= OnObjectsAdded;
    GrasshopperDocument.ObjectsAdded += OnObjectsAdded;
    GrasshopperDocument.ObjectsDeleted -= OnDeleteThisComponent;
    GrasshopperDocument.ObjectsDeleted += OnDeleteThisComponent;
    msg.AppendFormat("Added the eventhandlers to OnObjectsAdded\n", GrasshopperDocument.Objects.OfType<Grasshopper.Kernel.Special.GH_Group>().Count());
  }

  public void RemoveEventHandlers()
  {
    GrasshopperDocument.ObjectsAdded -= OnObjectsAdded;
    GrasshopperDocument.ObjectsDeleted -= OnDeleteThisComponent;

    msg.AppendFormat("Removed wire event handlers on document\n", GrasshopperDocument.Objects.OfType<Grasshopper.Kernel.Special.GH_Group>().Count());

  }

  public void OnDeleteThisComponent(object sender, GH_DocObjectEventArgs e)
  {

    if (e.Objects.OfType<Grasshopper.Kernel.GH_Component>().Where(o => o.NickName == this.Component.NickName).Any())
    {
      DebugWrite("Removed template component. Removing all the eventhandlers");
      RemoveEventHandlers();
    }

  }

  public bool IdExists(int id)
  {
    IList<IGH_DocumentObject> objs = Grasshopper.Instances.ActiveCanvas.Document.Objects;
    return objs
      .OfType<IGH_Component>()
      .Where(ob => ob.NickName == this.Component.NickName)
      .Where(ob => ob.GetType().ToString() == "ScriptComponents.Component_CSNET_Script")
      .Where(ob => ob.Message == "id: " + id.ToString()).Any();

  }

  public void DebugWrite(string msg)
  {
    if (_debug)
    {
      Rhino.RhinoApp.WriteLine(String.Format("[FixParams {0}]: {1}", id, msg));
    }
  }
# ---------- end fixparams ----------

# ---- group: spruce
panel_2 = Panel("spruce")
number_slider_10 = Slider(0.0001, range=0..0.0001)
number_slider_11 = Slider(0.0019, range=0..1)
number_slider_12 = Slider(0.0036, range=0..1)
number_slider_13 = Slider(10000, range=0..20000)
number_slider_14 = Slider(450, range=0..20000)
number_slider_15 = Slider(800, range=0..20000)
number_slider_16 = Slider(400, range=0..1000)

# ----
division = Division(A=Slider(991, range=0..1000), B="6")
division_2 = Division(A=Slider(5000, range=0..10000), B=division)
num = Number(number_slider_8)
round = Round(Number=division_2)  # -> Nearest, Floor, Ceiling
num_2 = Number(round.Floor)
multiplication = Multiplication(A=division, B=num_2)
multiplication_2 = Multiplication(A=number_slider_8, B=number_slider_9)
species = WoodSpecies(
    name=panel,
    density=number_slider_7,
    LExp=number_slider,
    RExp=number_slider_2,
    TExp=number_slider_3,
    LEmod=number_slider_4,
    REmod=number_slider_5,
    TEmod=number_slider_6)
species_2 = WoodSpecies(
    name=panel_2,
    density=number_slider_16,
    LExp=number_slider_10,
    RExp=number_slider_11,
    TExp=number_slider_12,
    LEmod=number_slider_13,
    REmod=number_slider_15,
    TEmod=number_slider_14)
panel_3 = Panel(HMaxelLength=division, HMaxelWidth=num, LengthCount=num_2, WidthCount=number_slider_9)
rectangle = Rectangle(Plane=PlaneXY(0, 0, 0), XSize=multiplication, YSize=multiplication_2, Radius=0)  # -> Rectangle, Length
panel_4 = Panel(division)
dec_pan = DeconstructPanel(Panel=panel_3)  # -> Bilayers, graft(HMaxels), LengthRange, WidthRange

number_slider_17 = Slider(1000, range=0..1000)
rectangle_2 = Rectangle(Plane=PlaneXY(0, 0, 0), XSize=number_slider_17, YSize=number_slider_17, Radius=0)  # -> Rectangle, Length
drec = DeconstuctRectangle(Rectangle=rectangle_2.Rectangle)  # -> BasePlane, XInterval, YInterval
dedomain = DeconstructDomain(Domain=drec.YInterval)  # -> Start, End
subtraction = Subtraction(A=dedomain.End, B=dedomain.Start)
division_3 = Division(A=subtraction, B=2)
dom = ConstructDomain(DomainStart=0, DomainEnd=1)
addition = Addition(A=dedomain.Start, B=division_3)
number_slider_18 = Slider(0.412, range=0..1)
dom_2 = ConstructDomain(DomainStart=addition, DomainEnd=dedomain.End)
dom_3 = ConstructDomain(DomainStart=addition, DomainEnd=dedomain.Start)
remap = RemapNumbers(Value=number_slider_18, Source=dom, Target=dom_3)  # -> Mapped, Clipped
remap_2 = RemapNumbers(Value=Slider(1, range=0..1), Source=dom, Target=drec.XInterval)  # -> Mapped, Clipped
remap_3 = RemapNumbers(Value=number_slider_18, Source=dom, Target=dom_2)  # -> Mapped, Clipped
remap_4 = RemapNumbers(Value=Slider(1, range=0..1), Source=dom, Target=drec.XInterval)  # -> Mapped, Clipped
pt = ConstructPoint(XCoordinate=0, YCoordinate=remap_2.Mapped, ZCoordinate=0)
pt_2 = ConstructPoint(XCoordinate=remap.Mapped, YCoordinate=remap_4.Mapped, ZCoordinate=0)
pt_3 = ConstructPoint(XCoordinate=remap_3.Mapped, YCoordinate=remap_4.Mapped, ZCoordinate=0)
pt_4 = ConstructPoint(XCoordinate=number_slider_17, YCoordinate=remap_2.Mapped, ZCoordinate=0)
merge = Merge(Data1=pt, Data2=pt_2, Data3=pt_3, Data4=pt_4)
nurbs = NurbsCurve(Vertices=merge, Degree=2, Periodic=False)  # -> Curve, Length, Domain

number_slider_19 = Slider(1000, range=0..1000)
rectangle_3 = Rectangle(Plane=PlaneXY(0, 0, 0), XSize=number_slider_19, YSize=number_slider_19, Radius=0)  # -> Rectangle, Length
drec_2 = DeconstuctRectangle(Rectangle=rectangle_3.Rectangle)  # -> BasePlane, XInterval, YInterval
dedomain_2 = DeconstructDomain(Domain=drec_2.YInterval)  # -> Start, End
subtraction_2 = Subtraction(A=dedomain_2.End, B=dedomain_2.Start)
division_4 = Division(A=subtraction_2, B=2)
dom_4 = ConstructDomain(DomainStart=0, DomainEnd=1)
addition_2 = Addition(A=dedomain_2.Start, B=division_4)
number_slider_20 = Slider(0.743, range=0..1)
dom_5 = ConstructDomain(DomainStart=addition_2, DomainEnd=dedomain_2.End)
dom_6 = ConstructDomain(DomainStart=addition_2, DomainEnd=dedomain_2.Start)
remap_5 = RemapNumbers(Value=number_slider_20, Source=dom_4, Target=dom_6)  # -> Mapped, Clipped
remap_6 = RemapNumbers(Value=Slider(0.35, range=0..1), Source=dom_4, Target=drec_2.XInterval)  # -> Mapped, Clipped
remap_7 = RemapNumbers(Value=number_slider_20, Source=dom_4, Target=dom_5)  # -> Mapped, Clipped
remap_8 = RemapNumbers(Value=Slider(0, range=0..1), Source=dom_4, Target=drec_2.XInterval)  # -> Mapped, Clipped
pt_5 = ConstructPoint(XCoordinate=0, YCoordinate=remap_6.Mapped, ZCoordinate=0)
pt_6 = ConstructPoint(XCoordinate=remap_5.Mapped, YCoordinate=remap_8.Mapped, ZCoordinate=0)
pt_7 = ConstructPoint(XCoordinate=remap_7.Mapped, YCoordinate=remap_8.Mapped, ZCoordinate=0)
pt_8 = ConstructPoint(XCoordinate=number_slider_19, YCoordinate=remap_6.Mapped, ZCoordinate=0)
merge_2 = Merge(Data1=pt_5, Data2=pt_6, Data3=pt_7, Data4=pt_8)
nurbs_2 = NurbsCurve(Vertices=merge_2, Degree=2, Periodic=False)  # -> Curve, Length, Domain

number_slider_21 = Slider(1000, range=0..1000)
rectangle_4 = Rectangle(Plane=PlaneXY(0, 0, 0), XSize=number_slider_21, YSize=number_slider_21, Radius=0)  # -> Rectangle, Length
drec_3 = DeconstuctRectangle(Rectangle=rectangle_4.Rectangle)  # -> BasePlane, XInterval, YInterval
dedomain_3 = DeconstructDomain(Domain=drec_3.YInterval)  # -> Start, End
subtraction_3 = Subtraction(A=dedomain_3.End, B=dedomain_3.Start)
division_5 = Division(A=subtraction_3, B=2)
dom_7 = ConstructDomain(DomainStart=0, DomainEnd=1)
addition_3 = Addition(A=dedomain_3.Start, B=division_5)
number_slider_22 = Slider(0.852, range=0..1)
dom_8 = ConstructDomain(DomainStart=addition_3, DomainEnd=dedomain_3.End)
dom_9 = ConstructDomain(DomainStart=addition_3, DomainEnd=dedomain_3.Start)
remap_9 = RemapNumbers(Value=number_slider_22, Source=dom_7, Target=dom_9)  # -> Mapped, Clipped
remap_10 = RemapNumbers(Value=Slider(0, range=0..1), Source=dom_7, Target=drec_3.XInterval)  # -> Mapped, Clipped
remap_11 = RemapNumbers(Value=number_slider_22, Source=dom_7, Target=dom_8)  # -> Mapped, Clipped
remap_12 = RemapNumbers(Value=Slider(0, range=0..1), Source=dom_7, Target=drec_3.XInterval)  # -> Mapped, Clipped
pt_9 = ConstructPoint(XCoordinate=0, YCoordinate=remap_10.Mapped, ZCoordinate=0)
pt_10 = ConstructPoint(XCoordinate=remap_9.Mapped, YCoordinate=remap_12.Mapped, ZCoordinate=0)
pt_11 = ConstructPoint(XCoordinate=remap_11.Mapped, YCoordinate=remap_12.Mapped, ZCoordinate=0)
pt_12 = ConstructPoint(XCoordinate=number_slider_21, YCoordinate=remap_10.Mapped, ZCoordinate=0)
merge_3 = Merge(Data1=pt_9, Data2=pt_10, Data3=pt_11, Data4=pt_12)
nurbs_3 = NurbsCurve(Vertices=merge_3, Degree=2, Periodic=False)  # -> Curve, Length, Domain

number_slider_23 = Slider(1000, range=0..1000)
rectangle_5 = Rectangle(Plane=PlaneXY(0, 0, 0), XSize=number_slider_23, YSize=number_slider_23, Radius=0)  # -> Rectangle, Length
drec_4 = DeconstuctRectangle(Rectangle=rectangle_5.Rectangle)  # -> BasePlane, XInterval, YInterval
dedomain_4 = DeconstructDomain(Domain=drec_4.YInterval)  # -> Start, End
subtraction_4 = Subtraction(A=dedomain_4.End, B=dedomain_4.Start)
division_6 = Division(A=subtraction_4, B=2)
number_slider_24 = Slider(0.466, range=0..1)
dom_10 = ConstructDomain(DomainStart=0, DomainEnd=1)
addition_4 = Addition(A=dedomain_4.Start, B=division_6)
dom_11 = ConstructDomain(DomainStart=addition_4, DomainEnd=dedomain_4.End)
dom_12 = ConstructDomain(DomainStart=addition_4, DomainEnd=dedomain_4.Start)
remap_13 = RemapNumbers(Value=number_slider_24, Source=dom_10, Target=dom_12)  # -> Mapped, Clipped
remap_14 = RemapNumbers(Value=Slider(0.1, range=0..1), Source=dom_10, Target=drec_4.XInterval)  # -> Mapped, Clipped
remap_15 = RemapNumbers(Value=number_slider_24, Source=dom_10, Target=dom_11)  # -> Mapped, Clipped
remap_16 = RemapNumbers(Value=Slider(0, range=0..1), Source=dom_10, Target=drec_4.XInterval)  # -> Mapped, Clipped
pt_13 = ConstructPoint(XCoordinate=0, YCoordinate=remap_14.Mapped, ZCoordinate=0)
pt_14 = ConstructPoint(XCoordinate=remap_13.Mapped, YCoordinate=remap_16.Mapped, ZCoordinate=0)
pt_15 = ConstructPoint(XCoordinate=remap_15.Mapped, YCoordinate=remap_16.Mapped, ZCoordinate=0)
pt_16 = ConstructPoint(XCoordinate=number_slider_23, YCoordinate=remap_14.Mapped, ZCoordinate=0)
merge_4 = Merge(Data1=pt_13, Data2=pt_14, Data3=pt_15, Data4=pt_16)
nurbs_4 = NurbsCurve(Vertices=merge_4, Degree=2, Periodic=False)  # -> Curve, Length, Domain

number_slider_25 = Slider(1000, range=0..1000)
rectangle_6 = Rectangle(Plane=PlaneXY(0, 0, 0), XSize=number_slider_25, YSize=number_slider_25, Radius=0)  # -> Rectangle, Length
drec_5 = DeconstuctRectangle(Rectangle=rectangle_6.Rectangle)  # -> BasePlane, XInterval, YInterval
dedomain_5 = DeconstructDomain(Domain=drec_5.YInterval)  # -> Start, End
subtraction_5 = Subtraction(A=dedomain_5.End, B=dedomain_5.Start)
division_7 = Division(A=subtraction_5, B=2)
dom_13 = ConstructDomain(DomainStart=0, DomainEnd=1)
addition_5 = Addition(A=dedomain_5.Start, B=division_7)
number_slider_26 = Slider(0.37, range=0..1)
dom_14 = ConstructDomain(DomainStart=addition_5, DomainEnd=dedomain_5.End)
dom_15 = ConstructDomain(DomainStart=addition_5, DomainEnd=dedomain_5.Start)
remap_17 = RemapNumbers(Value=number_slider_26, Source=dom_13, Target=dom_15)  # -> Mapped, Clipped
remap_18 = RemapNumbers(Value=Slider(0.6, range=0..1), Source=dom_13, Target=drec_5.XInterval)  # -> Mapped, Clipped
remap_19 = RemapNumbers(Value=number_slider_26, Source=dom_13, Target=dom_14)  # -> Mapped, Clipped
remap_20 = RemapNumbers(Value=Slider(0.4, range=0..1), Source=dom_13, Target=drec_5.XInterval)  # -> Mapped, Clipped
pt_17 = ConstructPoint(XCoordinate=0, YCoordinate=remap_18.Mapped, ZCoordinate=0)
pt_18 = ConstructPoint(XCoordinate=remap_17.Mapped, YCoordinate=remap_20.Mapped, ZCoordinate=0)
pt_19 = ConstructPoint(XCoordinate=remap_19.Mapped, YCoordinate=remap_20.Mapped, ZCoordinate=0)
pt_20 = ConstructPoint(XCoordinate=number_slider_25, YCoordinate=remap_18.Mapped, ZCoordinate=0)
merge_5 = Merge(Data1=pt_17, Data2=pt_18, Data3=pt_19, Data4=pt_20)
nurbs_5 = NurbsCurve(Vertices=merge_5, Degree=2, Periodic=False)  # -> Curve, Length, Domain

number_slider_27 = Slider(1000, range=0..1000)
rectangle_7 = Rectangle(Plane=PlaneXY(0, 0, 0), XSize=number_slider_27, YSize=number_slider_27, Radius=0)  # -> Rectangle, Length
drec_6 = DeconstuctRectangle(Rectangle=rectangle_7.Rectangle)  # -> BasePlane, XInterval, YInterval
dedomain_6 = DeconstructDomain(Domain=drec_6.YInterval)  # -> Start, End
subtraction_6 = Subtraction(A=dedomain_6.End, B=dedomain_6.Start)
division_8 = Division(A=subtraction_6, B=2)
dom_16 = ConstructDomain(DomainStart=0, DomainEnd=1)
addition_6 = Addition(A=dedomain_6.Start, B=division_8)
number_slider_28 = Slider(0.852, range=0..1)
dom_17 = ConstructDomain(DomainStart=addition_6, DomainEnd=dedomain_6.End)
dom_18 = ConstructDomain(DomainStart=addition_6, DomainEnd=dedomain_6.Start)
remap_21 = RemapNumbers(Value=number_slider_28, Source=dom_16, Target=dom_18)  # -> Mapped, Clipped
remap_22 = RemapNumbers(Value=Slider(1, range=0..1), Source=dom_16, Target=drec_6.XInterval)  # -> Mapped, Clipped
remap_23 = RemapNumbers(Value=number_slider_28, Source=dom_16, Target=dom_17)  # -> Mapped, Clipped
remap_24 = RemapNumbers(Value=Slider(1, range=0..1), Source=dom_16, Target=drec_6.XInterval)  # -> Mapped, Clipped
pt_21 = ConstructPoint(XCoordinate=0, YCoordinate=remap_22.Mapped, ZCoordinate=0)
pt_22 = ConstructPoint(XCoordinate=remap_21.Mapped, YCoordinate=remap_24.Mapped, ZCoordinate=0)
pt_23 = ConstructPoint(XCoordinate=remap_23.Mapped, YCoordinate=remap_24.Mapped, ZCoordinate=0)
pt_24 = ConstructPoint(XCoordinate=number_slider_27, YCoordinate=remap_22.Mapped, ZCoordinate=0)
merge_6 = Merge(Data1=pt_21, Data2=pt_22, Data3=pt_23, Data4=pt_24)
nurbs_6 = NurbsCurve(Vertices=merge_6, Degree=2, Periodic=False)  # -> Curve, Length, Domain

merge_7 = Merge(Data1=nurbs.Curve, Data2=nurbs_3.Curve)
lng = ListLength(List=merge_7)
merge_8 = Merge(Data1=nurbs_2.Curve, Data2=nurbs_4.Curve, Data3=nurbs_5.Curve, Data4=nurbs_6.Curve)
subtraction_7 = Subtraction(A=lng, B=1)
lng_2 = ListLength(List=merge_8)
division_9 = Division(A=Slider(4466, range=0..10000), B=subtraction_7)
subtraction_8 = Subtraction(A=lng_2, B=1)
series = Series(Start=0, Step=division_9, Count=lng)
division_10 = Division(A=Slider(4466, range=0..10000), B=subtraction_8)
X = UnitX(Factor=series)
series_2 = Series(Start=0, Step=division_10, Count=lng_2)
neg = Negative(Value=Slider(3000, range=0..3000))
move = Move(Geometry=merge_7, Motion=X)  # -> Geometry, Transform
X_2 = UnitX(Factor=series_2)

crv = Curve(merge_7)
lng_3 = ListLength(List=crv)  # -> expr("x-2", Length)
dom_19 = ConstructDomain(DomainStart=0, DomainEnd=lng_3)
subset = SubList(List=crv, Domain=dom_19, Wrap=True)  # -> graft(List), Index
shift = ShiftList(List=crv, Shift=1, Wrap=False)  # -> graft(List)
merge_9 = Merge(Data1=subset.List, Data2=shift)  # -> simplify(Result)
group = Group(Objects=merge_9)  # -> flatten(Group)

Y = UnitY(Factor=neg)
neg_2 = Negative(Value=Slider(1496, range=0..3000))
move_2 = Move(Geometry=move.Geometry, Motion=Y)  # -> Geometry, Transform
move_3 = Move(Geometry=merge_8, Motion=X_2)  # -> Geometry, Transform

crv_2 = Curve(merge_8)
lng_4 = ListLength(List=crv_2)  # -> expr("x-2", Length)
dom_20 = ConstructDomain(DomainStart=0, DomainEnd=lng_4)
subset_2 = SubList(List=crv_2, Domain=dom_20, Wrap=True)  # -> graft(List), Index
shift_2 = ShiftList(List=crv_2, Shift=1, Wrap=False)  # -> graft(List)
merge_10 = Merge(Data1=subset_2.List, Data2=shift_2)  # -> simplify(Result)
group_2 = Group(Objects=merge_10)  # -> flatten(Group)

data = Data(dec_pan.HMaxels)
dec_hmaxel = DeconstructHMaxel(HMaxel=data)  # -> PassiveLayers, ActiveBoards, Height, RowRange, ColumnRange, DesiredRadius, BlendedRadius, ShapedHMaxel
rectangle_8 = Rectangle(Plane=PlaneXY(0, 0, 0), XSize=dec_hmaxel.RowRange, YSize=dec_hmaxel.ColumnRange, Radius=0)  # -> Rectangle, Length
area = Area(Geometry=rectangle_8.Rectangle)  # -> Area, Centroid

Y_2 = UnitY(Factor=neg_2)
move_4 = Move(Geometry=move_3.Geometry, Motion=Y_2)  # -> Geometry, Transform

num_3 = Number(dec_pan.WidthRange)
num_4 = Number(dec_pan.LengthRange)
dedomain_7 = DeconstructDomain(Domain=num_3)  # -> Start, End
subtraction_9 = Subtraction(A=dedomain_7.End, B=dedomain_7.Start)
division_11 = Division(A=subtraction_9, B=2)
number_slider_29 = Slider(0.174, range=0..1)
addition_7 = Addition(A=dedomain_7.Start, B=division_11)
dom_21 = ConstructDomain(DomainStart=0, DomainEnd=1)
dom_22 = ConstructDomain(DomainStart=addition_7, DomainEnd=dedomain_7.End)
dom_23 = ConstructDomain(DomainStart=addition_7, DomainEnd=dedomain_7.Start)
remap_25 = RemapNumbers(Value=Slider(0.36, range=0.25..1), Source=dom_21, Target=num_4)  # -> Mapped, Clipped
remap_26 = RemapNumbers(Value=Slider(0.051, range=0..0.75), Source=dom_21, Target=num_4)  # -> Mapped, Clipped
remap_27 = RemapNumbers(Value=number_slider_29, Source=dom_21, Target=dom_23)  # -> Mapped, Clipped
remap_28 = RemapNumbers(Value=number_slider_29, Source=dom_21, Target=dom_22)  # -> Mapped, Clipped
pt_25 = ConstructPoint(XCoordinate=remap_25.Mapped, YCoordinate=dedomain_7.Start, ZCoordinate=0)
pt_26 = ConstructPoint(XCoordinate=remap_26.Mapped, YCoordinate=remap_27.Mapped, ZCoordinate=0)
pt_27 = ConstructPoint(XCoordinate=remap_26.Mapped, YCoordinate=remap_28.Mapped, ZCoordinate=0)
pt_28 = ConstructPoint(XCoordinate=remap_25.Mapped, YCoordinate=dedomain_7.End, ZCoordinate=0)
merge_11 = Merge(Data1=pt_25, Data2=pt_26, Data3=pt_27, Data4=pt_28)
nurbs_7 = NurbsCurve(Vertices=merge_11, Degree=2, Periodic=False)  # -> Curve, Length, Domain

# ---- group: generate distribution
pt_29 = Point(simplify(area.Centroid))
data_2 = Data(group)
pdecon = Deconstruct(Point=pt_29)  # -> XComponent, YComponent, ZComponent
bnd = Bounds(Numbers=flatten(pdecon.XComponent))
bnd_2 = Bounds(Numbers=flatten(pdecon.YComponent))
lng_5 = ListLength(List=data_2)
dedomain_8 = DeconstructDomain(Domain=bnd)  # -> Start, End
remap_29 = RemapNumbers(Value=pdecon.YComponent, Source=bnd_2, Target=Domain(0, 1))  # -> graft(Mapped), Clipped
c_script = CSharpScript(count=lng_5, start=dedomain_8.Start, end=dedomain_8.End)  # -> out, A; inputs count: Int32, start: Double, end: Double
# ---------- c_script: C# ----------
    double totalLength = end - start;
    double domLength = totalLength / (double) count;

    List<Interval> intervals = new List<Interval>();
    double currentStart = start;
    for(int i = 0; i < count; i++)
    {
      intervals.Add(new Interval(currentStart, currentStart + domLength));
      currentStart += domLength;
    }
    A = intervals;
# ---------- end c_script ----------
num_5 = Number(graft(pdecon.XComponent))
inc = Includes(Value=num_5, Domain=simplify(c_script.A))  # -> Includes, Deviation
cull = CullPattern(List=data_2, CullPattern=inc.Includes)
item = ListItem(List=cull, Index=0, Wrap=True)
cull_2 = CullPattern(List=c_script.A, CullPattern=inc.Includes)
ungroup = Ungroup(Group=item)  # -> simplify(Objects)
item_2 = ListItem(List=cull_2, Index=0, Wrap=True)
remap_30 = RemapNumbers(Value=num_5, Source=item_2, Target=Domain(0, 1))  # -> Mapped, Clipped
eval = EvaluateCurve(Curve=reparameterize(ungroup), Parameter=remap_29.Mapped)  # -> Point, Tangent, Angle
pdecon_2 = Deconstruct(Point=eval.Point)  # -> XComponent, YComponent, ZComponent
item_3 = ListItem(List=pdecon_2.YComponent, Index=0, Wrap=True)  # -> Item, Item1
twn2nums = TweenTwoNumbers(NumberA=item_3.Item, NumberB=item_3.Item1, Factor=remap_30.Mapped)
num_6 = Number(twn2nums)

pt_30 = Point(simplify(area.Centroid))
data_3 = Data(group_2)
pdecon_3 = Deconstruct(Point=pt_30)  # -> XComponent, YComponent, ZComponent
bnd_3 = Bounds(Numbers=flatten(pdecon_3.XComponent))
bnd_4 = Bounds(Numbers=flatten(pdecon_3.YComponent))
lng_6 = ListLength(List=data_3)
dedomain_9 = DeconstructDomain(Domain=bnd_3)  # -> Start, End
remap_31 = RemapNumbers(Value=pdecon_3.YComponent, Source=bnd_4, Target=Domain(0, 1))  # -> graft(Mapped), Clipped
c_script_2 = CSharpScript(count=lng_6, start=dedomain_9.Start, end=dedomain_9.End)  # -> out, A; inputs count: Int32, start: Double, end: Double; same code as c_script
num_7 = Number(graft(pdecon_3.XComponent))
inc_2 = Includes(Value=num_7, Domain=simplify(c_script_2.A))  # -> Includes, Deviation
cull_3 = CullPattern(List=data_3, CullPattern=inc_2.Includes)
item_4 = ListItem(List=cull_3, Index=0, Wrap=True)
cull_4 = CullPattern(List=c_script_2.A, CullPattern=inc_2.Includes)
ungroup_2 = Ungroup(Group=item_4)  # -> simplify(Objects)
item_5 = ListItem(List=cull_4, Index=0, Wrap=True)
remap_32 = RemapNumbers(Value=num_7, Source=item_5, Target=Domain(0, 1))  # -> Mapped, Clipped
eval_2 = EvaluateCurve(Curve=reparameterize(ungroup_2), Parameter=remap_31.Mapped)  # -> Point, Tangent, Angle
pdecon_4 = Deconstruct(Point=eval_2.Point)  # -> XComponent, YComponent, ZComponent
item_6 = ListItem(List=pdecon_4.YComponent, Index=0, Wrap=True)  # -> Item, Item1
twn2nums_2 = TweenTwoNumbers(NumberA=item_6.Item, NumberB=item_6.Item1, Factor=remap_32.Mapped)
num_8 = Number(twn2nums_2)

# ---- group: material / beech
data_4 = Data(species)

# ---- group: material / spruce
data_5 = Data(species_2)

# ---- group: material / Species
crv_3 = Curve(nurbs_7.Curve)

# ---- group: material
pt_31 = Point(graft(area.Centroid))
xz = XZPlane(Origin=pt_31)
pcx = CurvePlane(Curve=crv_3, Plane=xz)  # -> simplify(Points), ParamsC, ParamsP
pdecon_5 = Deconstruct(Point=pcx.Points)  # -> XComponent, YComponent, ZComponent
pdecon_6 = Deconstruct(Point=pt_31)  # -> XComponent, YComponent, ZComponent
smaller = SmallerThan(FirstNumber=pdecon_5.XComponent, SecondNumber=pdecon_6.XComponent)  # -> SmallerThan, OrEqualTo
not = GateNot(A=smaller.SmallerThan)
cull_5 = CullPattern(List=data_4, CullPattern=not)
cull_6 = CullPattern(List=data_5, CullPattern=smaller.SmallerThan)
merge_12 = Merge(Data1=cull_5, Data2=cull_6)  # -> simplify(Result)
dup = DuplicateData(Data=merge_12, Number="2", Order=True)  # -> simplify(Data)

# ----
num_9 = Number(num_6)
rec = Rectangle(rectangle_2.Rectangle)
drec_7 = DeconstuctRectangle(Rectangle=rec)  # -> BasePlane, XInterval, YInterval
dom_24 = ConstructDomain(DomainStart=Slider(24, range=0..100), DomainEnd=Slider(75, range=0..100))
remap_33 = RemapNumbers(Value=num_9, Source=drec_7.YInterval, Target=dom_24)  # -> Mapped, Clipped
trim = TrimTree(Tree=remap_33.Mapped, Depth=1)

panel_5 = Panel("https://docs.google.com/spreadsheets/d/1Z8We5sh-bn7ZBMgxJj_1jFgPpPcUv_A9OEZdiu0wZ1I/edit#gid=0")
panel_6 = Panel("https://docs.google.com/spreadsheets/d/1Z8We5sh-bn7ZBMgxJj_1jFgPpPcUv_A9OEZdiu0wZ1I/edit#gid=0")
panel_7 = Panel("https://docs.google.com/spreadsheets/d/1Z8We5sh-bn7ZBMgxJj_1jFgPpPcUv_A9OEZdiu0wZ1I/edit#gid=0")
panel_8 = Panel("https://docs.google.com/spreadsheets/d/1Z8We5sh-bn7ZBMgxJj_1jFgPpPcUv_A9OEZdiu0wZ1I/edit#gid=0")

num_10 = Number(num_8)
rec_2 = Rectangle(rectangle_2.Rectangle)
drec_8 = DeconstuctRectangle(Rectangle=rec_2)  # -> BasePlane, XInterval, YInterval
dom_25 = ConstructDomain(DomainStart=0, DomainEnd=1)
remap_34 = RemapNumbers(Value=num_10, Source=drec_8.YInterval, Target=dom_25)  # -> Mapped, Clipped
trim_2 = TrimTree(Tree=remap_34.Mapped, Depth=1)

readcell = ReadCell(
    SpreadsheetURL=panel_5,
    SheetName="Sheet1",
    CellRange="A2:E16",
    DuplicateMerged=False,
    SameLength=False,
    Read=Toggle(True))
readcell_2 = ReadCell(
    SpreadsheetURL=panel_6,
    SheetName="Sheet1",
    CellRange="G2:I16",
    DuplicateMerged=False,
    SameLength=False,
    Read=Toggle(True))
readcell_3 = ReadCell(
    SpreadsheetURL=panel_7,
    SheetName="Sheet1",
    CellRange="P2:R16",
    DuplicateMerged=False,
    SameLength=False,
    Read=Toggle(True))
readcell_4 = ReadCell(
    SpreadsheetURL=panel_8,
    SheetName="Sheet1",
    CellRange="J2:O16",
    DuplicateMerged=False,
    SameLength=False,
    Read=Toggle(True))
decell = DeconstructCell(Cell=readcell)  # -> FormattedValue, UserEnteredValue, CellFormat
decell_2 = DeconstructCell(Cell=readcell_2)  # -> graft(FormattedValue), UserEnteredValue, CellFormat
data_6 = Data(panel_3)
decell_3 = DeconstructCell(Cell=readcell_3)  # -> flatten(FormattedValue), UserEnteredValue, CellFormat
decell_4 = DeconstructCell(Cell=readcell_4)  # -> flatten(FormattedValue), UserEnteredValue, CellFormat
data_7 = Data(species_2)
data_8 = Data(dec_pan.HMaxels)
panel_9 = Panel("""SL79
SR38
SR22
SL79
SR50
SR12
SR50
SR12
SL60
SR12
SR40
SL79
SR22
SR38
SL8""")

data_9 = Data(data_6)
panel_10 = Panel("""0
1""")
data_10 = Data(data_7)
bilayer = ConstructBilayer(
    Panel=data_9,
    BoardLength=Slider(5, range=0..10),
    RowOffsets=panel_10,
    PassiveSpecies=data_10,
    ActiveThickness=Slider(20, range=0..100),
    PassiveThickness=Slider(4, range=0..10))

data_11 = Data(data_6)
panel_11 = Panel("""1
0""")
data_12 = Data(data_7)
bilayer_2 = ConstructBilayer(
    Panel=data_11,
    BoardLength=Slider(5, range=0..10),
    RowOffsets=panel_11,
    PassiveSpecies=data_12,
    ActiveThickness=Slider(20, range=0..100),
    PassiveThickness=Slider(4, range=0..10))

entwine = Entwine(Branch00=decell_4.FormattedValue, Branch01=decell_3.FormattedValue, FlattenInputs=True)  # -> simplify(Result)
txt = Text(panel_9)
subtraction_10 = Subtraction(A=entwine, B="12")
up_hmaxel = UpdateHMaxel(HMaxel=simplify(data_8), Height=simplify(trim), RadiusFactor=simplify(trim_2), Species=simplify(dup))  # -> flatten(HMaxel)
merge_13 = Merge(Data1=bilayer, Data2=bilayer_2)
data_13 = Data(panel_3)
up_pan = UpdatePanel(Panel=data_13, Bilayers=merge_13, HMaxels=up_hmaxel)
data_14 = Data(up_pan)
c_script_3 = CSharpScript(Reference="C:\Users\Alex Reiner\AppData\Roaming\Grasshopper\Libraries\HygroDesign.Core.dll")  # -> out, A
# ---------- c_script_3: C# usings ----------
using BilayerDesign;
# ---------- c_script_3: C# ----------
    TimoshenkoPrediction timo = new TimoshenkoPrediction();
    A = timo;
# ---------- c_script_3: C# additional code ----------
  public class TimoshenkoPrediction : PredictionEngine
  {

    public TimoshenkoPrediction()
    {
    }

    public override double Predict(StockBoard board, Bilayer bilayer, double moistureChange)
    {
      double h1 = bilayer.PassiveLayer.Thickness;
      double h2 = bilayer.ActiveLayer.Thickness;
      double h = h1 + h2;
      double m = h1 / h2;
      double e1 = bilayer.PassiveLayer.Species.Attributes["LEmod"];
      double e2 = GrainAngleInterpolation(board.RTAngle, board.Species.Attributes["REmod"], board.Species.Attributes["TEmod"]);
      double n = e1 / e2;
      double a1 = bilayer.PassiveLayer.Species.Attributes["LExp"];
      double a2 = GrainAngleInterpolation(board.RTAngle, board.Species.Attributes["RExp"], board.Species.Attributes["TExp"]);
      double deltaAlpha = a2 - a1;
      double kValue = 6 * Math.Pow(1.0 + m, 2) / (3 * Math.Pow(1 + m, 2) + (1 + m * n) * Math.Pow(m, 2) + (1 / (m * n)));
      double curvature = kValue * ((moistureChange * deltaAlpha) / h);
      return 1 / (curvature /* * TimError*/ );
    }

    public static double GrainAngleInterpolation(double rtAngle, double eR, double eT)
    {
      double angleConv = RhinoMath.ToRadians(rtAngle);
      double angleT = Math.Cos(angleConv);
      double angleR = Math.Sin(angleConv);
      double eActive = eT * Math.Pow(angleT, 2) + eR * Math.Pow(angleR, 2);
      return eActive;
    }
  }
# ---------- end c_script_3 ----------
number_slider_30 = Slider(6, range=0..10)
num_11 = Number(num_2)
division_12 = Division(A=num_11, B=number_slider_30)

rec_3 = Rectangle(rectangle.Rectangle)
drec_9 = DeconstuctRectangle(Rectangle=rec_3)  # -> BasePlane, XInterval, YInterval
dedomain_10 = DeconstructDomain(Domain=drec_9.YInterval)  # -> Start, End
subtraction_11 = Subtraction(A=dedomain_10.Start, B=dedomain_10.End)
division_13 = Division(A=subtraction_11, B="2")
Y_3 = UnitY(Factor=division_13)
move_5 = Move(Geometry=rec_3, Motion=Y_3)  # -> Geometry, Transform
boundary = BoundarySurfaces(Edges=move_5.Geometry)

srf = Surface(boundary)
crv_4 = Curve(Tree({0}: [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], {1}: [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]))
explode = Explode(Curve=crv_4, Recursive=True)  # -> Segments, Vertices
divide = DivideCurve(Curve=explode.Segments, Count=Slider(100, range=0..100), Kinks=False)  # -> Points, Tangents, Parameters
srf_cp = SurfaceClosestPoint(Point=divide.Points, Surface=srf)  # -> Point, UVPoint, Distance
pt_32 = Point(srf_cp.UVPoint)

number_slider_31 = Slider(6, range=0..10)
num_12 = Number(num_2)
division_14 = Division(A=num_12, B=number_slider_31)
Z = UnitZ(Factor=Slider(62, range=0..100))
Y_4 = UnitY(Factor=Slider(2775, range=0..10000))
division_15 = Division(A=Slider(5.6, range=0..10), B="2")
material_buildups = Panel("""100
200
300
101
201
301""")
support = RemoteSender(<missing>)
support_2 = RemoteReceiver(support)
node_sofistik = NodeSofistik(<missing>)
support_sofistik = SupportSofistik(flatten(<missing>))
# SOFIMESH
load_sofistik = LoadSofistik(<missing>)

# ---- group: spruce left
panel_12 = Panel("https://docs.google.com/spreadsheets/d/1Q0xuMOoM9MJtYBJnVYEzEPmUDS6WbwrvgMLvJoCEvrc/edit#gid=0")
readcell_5 = ReadCell(
    SpreadsheetURL=panel_12,
    SheetName="Sheet1",
    CellRange="A3:B82",
    DuplicateMerged=False,
    SameLength=False,
    Read=Toggle(True))
decell_5 = DeconstructCell(Cell=readcell_5)  # -> FormattedValue, UserEnteredValue, CellFormat

# ---- group: spruce left / remove null branches
c_script_4 = CSharpScript(obj=decell_5.FormattedValue)  # -> out, A; inputs obj: tree
# ---------- c_script_4: C# ----------
    DataTree<object> output = new DataTree<object>();
    
    int currentID = 0;
    for(int i = 0; i < obj.BranchCount; i++)
    {
      if(obj.Branch(i)[1] as string != "null")
      {
        output.AddRange(obj.Branch(i), new GH_Path(currentID));
        currentID++;
      }
    }
    A = output;
# ---------- end c_script_4 ----------

# ---- group: spruce left (continued)
item_7 = ListItem(List=c_script_4.A, Index=0, Wrap=True)  # -> flatten(Item), Item1

# ---- group: name
data_15 = Data(item_7.Item)
lng_7 = ListLength(List=data_15)
dup_2 = DuplicateData(Data="SL", Number=lng_7, Order=True)  # -> graft(Data)
txt_2 = Text(graft(data_15))
merge_14 = Merge(Data1=simplify(dup_2), Data2=simplify(txt_2))
join = TextJoin(Text=merge_14)

# ---- group: rt
num_13 = Number(item_7.Item1)

# ---- group: spruce right
panel_13 = Panel("https://docs.google.com/spreadsheets/d/1Q0xuMOoM9MJtYBJnVYEzEPmUDS6WbwrvgMLvJoCEvrc/edit#gid=0")
readcell_6 = ReadCell(
    SpreadsheetURL=panel_13,
    SheetName="Sheet1",
    CellRange="D3:E70",
    DuplicateMerged=False,
    SameLength=False,
    Read=Toggle(True))
decell_6 = DeconstructCell(Cell=readcell_6)  # -> FormattedValue, UserEnteredValue, CellFormat

# ---- group: spruce right / remove null branches
c_script_5 = CSharpScript(obj=decell_6.FormattedValue)  # -> out, A; inputs obj: tree; same code as c_script_4

# ---- group: spruce right (continued)
item_8 = ListItem(List=c_script_5.A, Index=0, Wrap=True)  # -> flatten(Item), Item1

# ---- group: name
data_16 = Data(item_8.Item)
lng_8 = ListLength(List=data_16)
dup_3 = DuplicateData(Data="SR", Number=lng_8, Order=True)  # -> graft(Data)
txt_3 = Text(graft(data_16))
merge_15 = Merge(Data1=simplify(dup_3), Data2=simplify(txt_3))
join_2 = TextJoin(Text=merge_15)

# ---- group: rt
num_14 = Number(item_8.Item1)

# ----
merge_16 = Merge(Data1=join, Data2=num_13)
merge_17 = Merge(Data1=join_2, Data2=num_14)
entwine_2 = Entwine(Branch0X=merge_16, Branch1X=merge_17, FlattenInputs=False)
renumber = RenumberPaths(Data=entwine_2)
item_9 = ListItem(List=renumber, Index=0, Wrap=True)  # -> flatten(Item), flatten(Item1)

# ---- group: beech left
panel_14 = Panel("https://docs.google.com/spreadsheets/d/1Q0xuMOoM9MJtYBJnVYEzEPmUDS6WbwrvgMLvJoCEvrc/edit#gid=0")
readcell_7 = ReadCell(
    SpreadsheetURL=panel_14,
    SheetName="Sheet1",
    CellRange="G3:H36",
    DuplicateMerged=False,
    SameLength=False,
    Read=Toggle(True))
decell_7 = DeconstructCell(Cell=readcell_7)  # -> FormattedValue, UserEnteredValue, CellFormat

# ---- group: beech left / remove null branches
c_script_6 = CSharpScript(obj=decell_7.FormattedValue)  # -> out, A; inputs obj: tree; same code as c_script_4

# ---- group: beech left (continued)
item_10 = ListItem(List=c_script_6.A, Index=0, Wrap=True)  # -> flatten(Item), Item1

# ---- group: name
data_17 = Data(item_10.Item)
lng_9 = ListLength(List=data_17)
dup_4 = DuplicateData(Data="BL", Number=lng_9, Order=True)  # -> graft(Data)
txt_4 = Text(graft(data_17))
merge_18 = Merge(Data1=simplify(dup_4), Data2=simplify(txt_4))
join_3 = TextJoin(Text=merge_18)

# ---- group: rt
num_15 = Number(item_10.Item1)

# ---- group: beech right
panel_15 = Panel("https://docs.google.com/spreadsheets/d/1Q0xuMOoM9MJtYBJnVYEzEPmUDS6WbwrvgMLvJoCEvrc/edit#gid=0")
readcell_8 = ReadCell(
    SpreadsheetURL=panel_15,
    SheetName="Sheet1",
    CellRange="J3:K38",
    DuplicateMerged=False,
    SameLength=False,
    Read=Toggle(True))
decell_8 = DeconstructCell(Cell=readcell_8)  # -> FormattedValue, UserEnteredValue, CellFormat

# ---- group: beech right / remove null branches
c_script_7 = CSharpScript(obj=decell_8.FormattedValue)  # -> out, A; inputs obj: tree; same code as c_script_4

# ---- group: beech right (continued)
item_11 = ListItem(List=c_script_7.A, Index=0, Wrap=True)  # -> flatten(Item), Item1

# ---- group: name
data_18 = Data(item_11.Item)
lng_10 = ListLength(List=data_18)
dup_5 = DuplicateData(Data="BR", Number=lng_10, Order=True)  # -> graft(Data)
txt_5 = Text(graft(data_18))
merge_19 = Merge(Data1=simplify(dup_5), Data2=simplify(txt_5))
join_4 = TextJoin(Text=merge_19)

# ---- group: rt
num_16 = Number(item_11.Item1)

# ----
merge_20 = Merge(Data1=join_3, Data2=num_15)
merge_21 = Merge(Data1=join_4, Data2=num_16)
entwine_3 = Entwine(Branch0X=merge_20, Branch1X=merge_21, FlattenInputs=False)
renumber_2 = RenumberPaths(Data=entwine_3)
item_12 = ListItem(List=renumber_2, Index=0, Wrap=True)  # -> flatten(Item), flatten(Item1)

txt_6 = Text(item_12.Item)
txt_7 = Text(item_12.Item)
jitter = Jitter(List=txt_6, Jitter=Slider(1, range=0..1), Seed="19989887")  # -> Values, Indices
jitter_2 = Jitter(List=txt_7, Jitter=Slider(1, range=0..1), Seed="19989887")  # -> Values, Indices
c_script_8 = CSharpScript(beechIDs=jitter.Values, IDs=decell.FormattedValue)  # -> out, A; inputs beechIDs: list of String, IDs: tree of String
# ---------- c_script_8: C# ----------
    int count = 0;
    for(int i = 0; i < IDs.BranchCount; i++)
    {
      for(int j = 0; j < IDs.Branch(i).Count; j++)
      {
        if(IDs.Branch(i)[j] == "B")
        {
          IDs.Branch(i)[j] = beechIDs[count];
          count++;
        }
      }
    }
    A = IDs;
# ---------- end c_script_8 ----------
c_script_9 = CSharpScript(beechIDs=jitter_2.Values, IDs=decell_2.FormattedValue)  # -> out, A; inputs beechIDs: list of String, IDs: tree of String; same code as c_script_8

lng_11 = ListLength(List=item_9.Item)
lng_12 = ListLength(List=item_12.Item)
dup_6 = DuplicateData(Data=Slider(1000, range=0..1000), Number=lng_12, Order=True)
dup_7 = DuplicateData(Data=Slider(150, range=0..1000), Number=lng_12, Order=True)
dup_8 = DuplicateData(Data=Slider(27, range=0..100), Number=lng_11, Order=True)
dup_9 = DuplicateData(Data=species, Number=lng_12, Order=True)
dup_10 = DuplicateData(Data=Slider(27, range=0..100), Number=lng_12, Order=True)
dup_11 = DuplicateData(Data=species_2, Number=lng_11, Order=True)
dup_12 = DuplicateData(Data=Slider(2400, range=0..2500), Number=lng_11, Order=True)
dup_13 = DuplicateData(Data=Slider(150, range=0..1000), Number=lng_11, Order=True)
merge_22 = Merge(Data1=item_9.Item1, Data2=item_12.Item1)
merge_23 = Merge(Data1=dup_8, Data2=dup_10)
merge_24 = Merge(Data1=dup_12, Data2=dup_6)
merge_25 = Merge(Data1=dup_13, Data2=dup_7)
merge_26 = Merge(Data1=item_9.Item, Data2=item_12.Item)
merge_27 = Merge(Data1=dup_11, Data2=dup_9)

merge_28 = Merge(Data1=c_script_8.A, Data2=graft(txt))
entwine_4 = Entwine(Branch00=merge_28, Branch01=c_script_9.A, FlattenInputs=True)
stock_boards = StockBoards(Name=merge_26, Species=merge_27, Thickness=merge_23, Length=merge_24, Width=merge_25, RTAngle=merge_22, MoistureChange=0)

# ---- group: stockboards
data_19 = Data(stock_boards)

# ----
c_script_10 = CSharpScript(
    stockBoards=data_19,
    IDs=entwine_4,
    Reference="C:\Users\Alex Reiner\AppData\Roaming\Grasshopper\Libraries\HygroDesign.Core.dll")  # -> out, A; inputs stockBoards: list, IDs: tree of String
# ---------- c_script_10: C# ----------
    DataTree<StockBoard> output = new DataTree<StockBoard>();
    for(int i = 0; i < IDs.BranchCount; i++)
    {
      for(int j = 0; j < IDs.Branch(i).Count; j++)
      {
        for(int v = 0; v < stockBoards.Count; v++)
        {
          StockBoard sb = stockBoards[v] as StockBoard;
          if(sb.Name == IDs.Branch(i)[j])
          {
            output.Add(sb, new GH_Path(i));
          }
        }
      }
    }
    A = output;
# ---------- end c_script_10 ----------
c_script_11 = CSharpScript(
    Panel=data_14,
    Stock=c_script_10.A,
    MC=subtraction_10,
    Prediction=c_script_3.A,
    Reference="C:\Users\Alex Reiner\AppData\Roaming\Grasshopper\Libraries\HygroDesign.Core.dll")  # -> out, A; inputs Stock: tree, MC: tree of Double
# ---------- c_script_11: C# ----------
    var panel = Panel as Panel;
    var prediction = Prediction as PredictionEngine;
    for(int i = 0; i < panel.Bilayers.Count;i++)
    {
      for(int j = 0; j < panel.Bilayers[i].ActiveLayer.Boards.Count;j++)
      {
        panel.Bilayers[i].ActiveLayer.Boards[j].StockBoard = Stock.Branch(i)[j] as StockBoard;
        panel.Bilayers[i].ActiveLayer.Boards[j].Radius = prediction.Predict(panel.Bilayers[i].ActiveLayer.Boards[j].StockBoard, panel.Bilayers[i], MC.Branch(i)[j]);
      }
    }
    A = panel;
# ---------- end c_script_11 ----------
dec_pan_2 = DeconstructPanel(Panel=c_script_11.A)  # -> Bilayers, HMaxels, LengthRange, WidthRange
dec_bilayer = DeconstructBilayer(Bilayer=dec_pan_2.Bilayers)  # -> ActiveLayer, PassiveLayer
dec_active_layer = DeconstructActiveLayer(ActiveLayer=dec_bilayer.ActiveLayer)  # -> ActiveLayerBoards, Thickness
dec_active_board = DeconstructActiveBoard(ActiveBoard=dec_active_layer.ActiveLayerBoards)  # -> HMaxels, StockBoard, Thickness, RowRange, ColumnRange, DesiredRadius, Radius, BlendedRadius, MoistureChange, ShapedBoard
bnd_5 = Bounds(Numbers=flatten(dec_active_board.Radius))
panel_16 = Panel(bnd_5)

# ---- group: convolution
c_script_12 = CSharpScript(
    tan=Slider(3, range=0.01..3),
    lon=Slider(0.24, range=0.01..3),
    rad=Slider(10000, range=0..10000),
    stiff=Slider(0.75, range=0.01..3),
    Reference="C:\USERS\ALEX REINER\APPDATA\ROAMING\GRASSHOPPER\LIBRARIES\HygroDesign.Core.dll")  # -> out, A; inputs tan: Double, lon: Double, rad: Double, stiff: Double, thick: Double
# ---------- c_script_12: C# ----------
    HMaxelConvolution convEngine = new HMaxelConvolution(tan, lon, rad, stiff, thick);
    A = convEngine;
# ---------- c_script_12: C# additional code ----------
  public class HMaxelConvolution : ConvolutionEngine
  {
    public double Tangential { get; set; }
    public double Longitudinal { get; set; }
    public double RadiusMax { get; set; }
    public double StiffnessInfluence { get; set; }
    public double ThicknessInfluence { get; set; }
    public HMaxelConvolution(double tangential, double longitudinal, double radiusMax, double stiffnessInfluence, double thicknessInfluence)
    {
      Tangential = tangential;
      Longitudinal = longitudinal;
      RadiusMax = radiusMax;
      StiffnessInfluence = stiffnessInfluence;
      ThicknessInfluence = thicknessInfluence;
    }

    public override Panel Convolution(Panel panel)
    {
      double MaxRad = double.MinValue;
      double MinRad = double.MaxValue;

      double MaxRStiff = double.MinValue;
      double MinRStiff = double.MaxValue;
      double MaxLStiff = double.MinValue;
      double MinLStiff = double.MaxValue;

      for (int i = 0; i < panel.HMaxels.GetLength(0); i++)
      {
        for (int j = 0; j < panel.HMaxels.GetLength(1); j++)
        {
          double averageRStiffness = 0;
          double averageLStiffness = 0;
          double weightedRadius = 0;
          double totalRWeights = 0;

          HMaxel hmaxel = panel.HMaxels[i, j];
          List<Tuple<double, double>> tuples = new List<Tuple<double, double>>();
          for (int v = 0; v < hmaxel.ActiveBoards.Count; v++)
          {
            averageRStiffness += (double) hmaxel.ActiveBoards[v].StockBoard.Species.Attributes["REmod"];
            averageLStiffness += (double) hmaxel.ActiveBoards[v].StockBoard.Species.Attributes["LEmod"];

            weightedRadius += (hmaxel.ActiveBoards[v].Radius * (double) hmaxel.ActiveBoards[v].StockBoard.Species.Attributes["REmod"]);
            totalRWeights += (double) hmaxel.ActiveBoards[v].StockBoard.Species.Attributes["REmod"];

          }
          averageRStiffness /= hmaxel.ActiveBoards.Count;
          averageLStiffness /= hmaxel.ActiveBoards.Count;
          weightedRadius /= totalRWeights;
          panel.HMaxels[i, j].Attributes.Add("REmod", averageRStiffness);
          panel.HMaxels[i, j].Attributes.Add("LEmod", averageLStiffness);
          panel.HMaxels[i, j].Attributes.Add("weighted radius", weightedRadius);
          panel.HMaxels[i, j].BlendedRaidus = weightedRadius;

          /*
          if (weightedRadius > MaxRad) MaxRad = weightedRadius;
          if (weightedRadius < MinRad) MinRad = weightedRadius;
          if (averageLStiffness > MaxLStiff) MaxLStiff = averageLStiffness;
          if (averageLStiffness < MinLStiff) MinLStiff = averageLStiffness;
          if (averageRStiffness > MaxRStiff) MaxRStiff = averageRStiffness;
          if (averageRStiffness < MinRStiff) MinRStiff = averageRStiffness;
     */
        }
      }

      /*
      //set factors
      for (int i = 0; i < panel.HMaxels.GetLength(0); i++)
      {
        for (int j = 0; j < panel.HMaxels.GetLength(1); j++)
        {
          panel.HMaxels[i, j].Attributes.Add("REmodFactor", Remap((double) panel.HMaxels[i, j].Attributes["REmod"], MinRStiff, MaxRStiff, 1 - StiffnessInfluence, 1));
          panel.HMaxels[i, j].Attributes.Add("LEmodFactor", Remap((double) panel.HMaxels[i, j].Attributes["LEmod"], MinLStiff, MaxLStiff, 1 - StiffnessInfluence, 1));
          panel.HMaxels[i, j].Attributes.Add("RadiusFactor", Remap((double) panel.HMaxels[i, j].Attributes["weighted radius"], MinRad, RadiusMax, 1, 0));

        }
      }

      //horizontal convolution
      for (int i = 0; i < panel.HMaxels.GetLength(0); i++)
      {
        for (int j = 0; j < panel.HMaxels.GetLength(1); j++)
        {
          double totalWeights = 0;
          double blendedRadius = 0;
          for (int x = 0; x < panel.HMaxels.GetLength(0); x++)
          {
            for (int y = 0; y < panel.HMaxels.GetLength(1); y++)
            {

              double xdist = Math.Abs(panel.HMaxels[i, j].X - panel.HMaxels[x, y].X);
              double ydist = Math.Abs(panel.HMaxels[i, j].Y - panel.HMaxels[x, y].Y);
              double LFactor = (double) panel.HMaxels[x, y].Attributes["LEmodFactor"] / Math.Pow(xdist + 1, Longitudinal);
              double RFactor = (double) panel.HMaxels[x, y].Attributes["REmodFactor"] / Math.Pow(ydist + 1, Tangential);
              blendedRadius += (double) panel.HMaxels[x, y].Attributes["weighted radius"] * (double) panel.HMaxels[i, j].Attributes["RadiusFactor"] * LFactor * RFactor;
              totalWeights += (double) panel.HMaxels[x, y].Attributes["RadiusFactor"] * LFactor * RFactor;

            }
          }

          panel.HMaxels[i, j].BlendedRaidus = blendedRadius / totalWeights;

        }
      }
  */


      return panel;
    }
    public static double Remap(double val, double from1, double to1, double from2, double to2)
    {
      return (val - from1) / (to1 - from1) * (to2 - from2) + from2;
    }
  }
# ---------- end c_script_12 ----------
data_20 = Data(c_script_11.A)
rad_blend = RadiusBlending(Panels=data_20, ConvolutionEngine=c_script_12.A)
dec_pan_3 = DeconstructPanel(Panel=rad_blend)  # -> Bilayers, HMaxels, LengthRange, WidthRange
dec_hmaxel_2 = DeconstructHMaxel(HMaxel=dec_pan_3.HMaxels)  # -> PassiveLayers, ActiveBoards, Height, RowRange, ColumnRange, DesiredRadius, BlendedRadius, ShapedHMaxel

# ----
panel_17 = Panel(dec_hmaxel_2.BlendedRadius)

num_17 = Number(expr("x/2", num_11))
dedomain_11 = DeconstructDomain(Domain=dec_hmaxel_2.RowRange)  # -> Start, End
bnd_6 = Bounds(Numbers=dedomain_11.Start)
bnd_7 = Bounds(Numbers=dedomain_11.End)
dedomain_12 = DeconstructDomain(Domain=bnd_6)  # -> Start, End
dedomain_13 = DeconstructDomain(Domain=bnd_7)  # -> Start, End
x_minus_one = XMinusOne(NumberX=division_12)
subtraction_12 = Subtraction(A=dedomain_13.End, B=dedomain_12.Start)
division_16 = Division(A=subtraction_12, B=x_minus_one)
series_3 = Series(Start=dedomain_12.Start, Step=division_16, Count=division_12)
pt_33 = ConstructPoint(XCoordinate=series_3, YCoordinate=0, ZCoordinate=0)
yz = YZPlane(Origin=pt_33)  # -> simplify(graft(Plane))

partition = PartitionList(List=dec_hmaxel_2.BlendedRadius, Size=num_11)  # -> simplify(Chunks)
flip = FlipMatrix(Data=partition)
num_18 = Number(flip)
c_script_13 = CSharpScript(x=num_18, y=number_slider_30)  # -> out, A; inputs x: tree, y: Int32
# ---------- c_script_13: C# ----------
    DataTree<object> output = new DataTree<object>();

    for(int i = 0; i < x.BranchCount; i++)
    {
      if(i % y == 0)output.AddRange(x.Branch(i), new GH_Path(i));
    }
    A = output;
# ---------- end c_script_13 ----------
renumber_3 = RenumberPaths(Data=c_script_13.A)

num_19 = Number(num)
pln = Plane(yz)
num_20 = Number(renumber_3)
c_script_14 = CSharpScript()  # -> out, A; inputs x: tree
# ---------- c_script_14: C# ----------
    DataTree<object> output = new DataTree<object>();
    int firstIndex = 0;
    int branchCount = 0;
    for(int i = 0; i < x.BranchCount; i++)
    {
      GH_Path path = new GH_Path(firstIndex, branchCount);
      if(x.Paths[i][0] == firstIndex)
      {
        output.AddRange(x.Branch(i), path);
      }
      else
      {
        firstIndex++;
        branchCount = -1;
        i--;
      }
      branchCount++;
    }
    A = output;
# ---------- end c_script_14 ----------
c_script_15 = CSharpScript(iRadii=num_20, iBoardWidth=num_19, iPlanes=pln)  # -> out, simplify(A); inputs iRadii: tree of Double, iBoardWidth: Double, iPlanes: tree of Plane
# ---------- c_script_15: C# ----------
    DataTree<Point3d> pointTree = new DataTree<Point3d>();

    for (int j = 0; j < iRadii.BranchCount; j++)
    {

      //initialize variables
      Plane bp = iPlanes.Branch(j)[0];
      Point3d startPoint = new Point3d(bp.Origin);
      Point3d centerPoint = startPoint;
      Vector3d rotationAxis = new Vector3d(bp.ZAxis);
      Vector3d centerPointVect = new Vector3d(bp.YAxis);
      centerPointVect.Rotate(Math.PI / 2, rotationAxis);

      for (int i = 0; i < iRadii.Branch(j).Count; i++){
        GH_Path pth = iRadii.Paths[j].AppendElement(i);
        Point3d point1 = startPoint;
        Point3d point2 = startPoint;

        pointTree.Add(point1, pth);

        //calculate rotation angle
        Double arcLength = iBoardWidth;
        Double radius = iRadii.Branch(j)[i];
        Double rotation = (arcLength / radius);

        //calculate rotation center point
        centerPointVect.Unitize();
        centerPointVect *= radius;
        centerPoint += centerPointVect;


        //execute half rotation
        Transform tx = Transform.Rotation(rotation / 2, rotationAxis, centerPoint);


        point2.Transform(tx);
        pointTree.Add(point2, pth);

        //execute full rotation
        tx = Transform.Rotation(rotation, rotationAxis, centerPoint);
        startPoint.Transform(tx);
        pointTree.Add(startPoint, pth);

        //updata rotation parameters
        centerPoint = startPoint;
        centerPointVect.Transform(tx);
      }
    }
    A = pointTree;
# ---------- end c_script_15 ----------

trim_3 = TrimTree(Tree=c_script_15.A, Depth=1)
cullpt = CullDuplicates(Points=trim_3, Tolerance=0.1, CullMode=3)  # -> Points, Indices, Valence
pt_34 = Point(cullpt.Points)

# ---- group: animate
pt_35 = Point(simplify(pt_34))
pln_2 = Plane(graft(pln))
num_21 = Number(Slider(1, range=0..1))
c_script_16 = CSharpScript(iPoints=simplify(pt_35), iPlanes=pln_2, iShapeFactor=num_21)  # -> out, A; inputs iPoints: tree of Point3d, iPlanes: tree of Plane, iShapeFactor: Double
# ---------- c_script_16: C# ----------
    DataTree<Point3d> output = new DataTree<Point3d>();
    
    double shapeFactor = 1.0 - iShapeFactor;

    //step through curves
    for (int i = 0; i < iPoints.BranchCount; i++)
    {
      Plane currentPlane = iPlanes.Branch(iPoints.Path(i)[0])[0];

      //get vectors from plane
      Vector3d zVect = currentPlane.YAxis;

      Vector3d rotVect = currentPlane.ZAxis;

      //create new startpoint inside list
      Point3d startPoint = iPoints.Branch(i)[0];

      //step through points. Create and rotate vectors
      for (int j = 0; j < iPoints.Branch(i).Count; j++)
      {
        if (j == 0) output.Add(startPoint, iPoints.Path(i));
        else{
          //create current segment vector
          Vector3d segmentVect = new Vector3d(iPoints.Branch(i)[j] - iPoints.Branch(i)[j - 1]);

          //measure angle with vertical vector
          double angle = Vector3d.VectorAngle(zVect, segmentVect, currentPlane);

          //rotate
          segmentVect.Rotate(-angle * shapeFactor, rotVect);

          startPoint += segmentVect;
          output.Add(startPoint, iPoints.Path(i));
        }
      }
    }

    A = output;
# ---------- end c_script_16 ----------
pt_36 = Point(c_script_16.A)
intcrv = Interpolate(Vertices=pt_36, Degree=3, Periodic=False, KnotStyle=1)  # -> Curve, Length, Domain
crv_5 = Curve(intcrv.Curve)

# ----
crv_6 = Curve(crv_5)
pt_37 = Point(simplify(graft(yz)))
end = EndPoints(Curve=crv_6)  # -> Start, End
vec2pt = Vector2Pt(PointA=end.Start, PointB=end.End, Unitize=False)  # -> Vector, Length
yz_2 = YZPlane(Origin=end.Start)
Y_5 = UnitY(Factor="-1")
angle = Angle(VectorA=vec2pt.Vector, VectorB=Y_5, Plane=yz_2)  # -> Angle, Reflex
rotate = Rotate(Geometry=crv_6, Angle=angle.Angle, Plane=yz_2)  # -> Geometry, Transform
curvepoint = PointOnCurve(rotate.Geometry, parameter=0.5)
vec2pt_2 = Vector2Pt(PointA=curvepoint, PointB=pt_37, Unitize=False)  # -> Vector, Length
move_6 = Move(Geometry=rotate.Geometry, Motion=vec2pt_2.Vector)  # -> Geometry, Transform
path_mapper = PathMapper(move_6.Geometry, source=["{A;B}", "{A}"], target=["{A}", "{0}"])
crv_7 = Curve(path_mapper)
flip_2 = FlipCurve(Curve=crv_7)  # -> Curve, Flag
loft = Loft(Curves=flip_2.Curve, Options={Adjust=False, Closed=False, LoftEnds=0, LoftSimp=0, LoftType=0, Rebuild=10, Refit=0.01})
srf_2 = Surface(loft)

dec_bilayer_2 = DeconstructBilayer(Bilayer=dec_pan_3.Bilayers)  # -> ActiveLayer, PassiveLayer
dec_active_layer_2 = DeconstructActiveLayer(ActiveLayer=dec_bilayer_2.ActiveLayer)  # -> ActiveLayerBoards, Thickness
dec_active_board_2 = DeconstructActiveBoard(ActiveBoard=dec_active_layer_2.ActiveLayerBoards)  # -> HMaxels, StockBoard, Thickness, RowRange, ColumnRange, DesiredRadius, Radius, BlendedRadius, MoistureChange, ShapedBoard
rectangle_9 = Rectangle(Plane=PlaneXY(0, 0, 0), XSize=dec_active_board_2.RowRange, YSize=dec_active_board_2.ColumnRange, Radius=0)  # -> Rectangle, Length
move_7 = Move(Geometry=rectangle_9.Rectangle, Motion=Y_3)  # -> Geometry, Transform
srf_3 = Surface(srf_2)

evalsrf = EvaluateSurface(Surface=srf_3, Point=pt_32)  # -> Point, Normal, UDirection, VDirection, Frame
intcrv_2 = Interpolate(Vertices=evalsrf.Point, Degree=3, Periodic=False, KnotStyle=1)  # -> simplify(Curve), Length, Domain
trim_4 = TrimTree(Tree=intcrv_2.Curve, Depth=1)
join_5 = JoinCurves(Curves=trim_4, Preserve=False)  # -> simplify(Curves)
srfsplit = SurfaceSplit(Surface=srf_3, Curves=join_5)
item_13 = ListItem(List=srfsplit, Index=0, Wrap=True)  # -> Item, Item1
srf_4 = Surface(item_13.Item1)
item_14 = ListItem(List=flatten(srf_4), Index=0, Wrap=True)
pan_srf = PanelSurface(Panel=rad_blend, Surface=item_14)
trim_breps = TrimmingBreps(Panel=pan_srf, Breps=srf_4)

# ---- group: convolution
c_script_17 = CSharpScript(
    tan=Slider(1, range=0.01..3),
    lon=Slider(0.7, range=0.01..3),
    rad=Slider(10000, range=0..10000),
    stiff=Slider(0.75, range=0.01..3),
    Reference="C:\USERS\ALEX REINER\APPDATA\ROAMING\GRASSHOPPER\LIBRARIES\HygroDesign.Core.dll")  # -> out, A; inputs tan: Double, lon: Double, rad: Double, stiff: Double, thick: Double
# ---------- c_script_17: C# ----------
    HMaxelConvolution convEngine = new HMaxelConvolution(tan, lon, rad, stiff, thick);
    A = convEngine;
# ---------- c_script_17: C# additional code ----------
    public class HMaxelConvolution : ConvolutionEngine
  {
    public double Tangential { get; set; }
    public double Longitudinal { get; set; }
    public double RadiusMax { get; set; }
    public double StiffnessInfluence { get; set; }
    public double ThicknessInfluence { get; set; }
    public HMaxelConvolution(double tangential, double longitudinal, double radiusMax, double stiffnessInfluence, double thicknessInfluence)
    {
      Tangential = tangential;
      Longitudinal = longitudinal;
      RadiusMax = radiusMax;
      StiffnessInfluence = stiffnessInfluence;
      ThicknessInfluence = thicknessInfluence;
    }

    public override Panel Convolution(Panel panel)
    {
      double MaxRad = double.MinValue;
      double MinRad = double.MaxValue;

      double MaxRStiff = double.MinValue;
      double MinRStiff = double.MaxValue;
      double MaxLStiff = double.MinValue;
      double MinLStiff = double.MaxValue;

      for (int i = 0; i < panel.HMaxels.GetLength(0); i++)
      {
        for (int j = 0; j < panel.HMaxels.GetLength(1); j++)
        {
          double averageRStiffness = 0;
          double averageLStiffness = 0;
          double weightedRadius = 0;
          double totalRWeights = 0;

          HMaxel hmaxel = panel.HMaxels[i, j];
          List<Tuple<double, double>> tuples = new List<Tuple<double, double>>();
          for (int v = 0; v < hmaxel.ActiveBoards.Count; v++)
          {
            averageRStiffness += (double) hmaxel.ActiveBoards[v].StockBoard.Species.Attributes["REmod"];
            averageLStiffness += (double) hmaxel.ActiveBoards[v].StockBoard.Species.Attributes["LEmod"];

            weightedRadius += (hmaxel.ActiveBoards[v].Radius * (double) hmaxel.ActiveBoards[v].StockBoard.Species.Attributes["REmod"]);
            totalRWeights += (double) hmaxel.ActiveBoards[v].StockBoard.Species.Attributes["REmod"];

          }
          averageRStiffness /= hmaxel.ActiveBoards.Count;
          averageLStiffness /= hmaxel.ActiveBoards.Count;
          weightedRadius /= totalRWeights;
          panel.HMaxels[i, j].Attributes.Add("REmod", averageRStiffness);
          panel.HMaxels[i, j].Attributes.Add("LEmod", averageLStiffness);
          panel.HMaxels[i, j].Attributes.Add("weighted radius", weightedRadius);

          if (weightedRadius > MaxRad) MaxRad = weightedRadius;
          if (weightedRadius < MinRad) MinRad = weightedRadius;
          if (averageLStiffness > MaxLStiff) MaxLStiff = averageLStiffness;
          if (averageLStiffness < MinLStiff) MinLStiff = averageLStiffness;
          if (averageRStiffness > MaxRStiff) MaxRStiff = averageRStiffness;
          if (averageRStiffness < MinRStiff) MinRStiff = averageRStiffness;
        }
      }
      //set factors
      for (int i = 0; i < panel.HMaxels.GetLength(0); i++)
      {
        for (int j = 0; j < panel.HMaxels.GetLength(1); j++)
        {
          panel.HMaxels[i, j].Attributes.Add("REmodFactor", Remap((double) panel.HMaxels[i, j].Attributes["REmod"], MinRStiff, MaxRStiff, 1 - StiffnessInfluence, 1));
          panel.HMaxels[i, j].Attributes.Add("LEmodFactor", Remap((double) panel.HMaxels[i, j].Attributes["LEmod"], MinLStiff, MaxLStiff, 1 - StiffnessInfluence, 1));
          panel.HMaxels[i, j].Attributes.Add("RadiusFactor", Remap((double) panel.HMaxels[i, j].Attributes["weighted radius"], MinRad, RadiusMax, 1, 0));

        }
      }

      //horizontal convolution
      for (int i = 0; i < panel.HMaxels.GetLength(0); i++)
      {
        for (int j = 0; j < panel.HMaxels.GetLength(1); j++)
        {
          double totalWeights = 0;
          double blendedRadius = 0;
          for (int x = 0; x < panel.HMaxels.GetLength(0); x++)
          {
            for (int y = 0; y < panel.HMaxels.GetLength(1); y++)
            {



              double xdist = Math.Abs(panel.HMaxels[i, j].X - panel.HMaxels[x, y].X);
              double ydist = Math.Abs(panel.HMaxels[i, j].Y - panel.HMaxels[x, y].Y);
              double LFactor = (double) panel.HMaxels[x, y].Attributes["LEmodFactor"] / Math.Pow(xdist + 1, Longitudinal);
              double RFactor = (double) panel.HMaxels[x, y].Attributes["REmodFactor"] / Math.Pow(ydist + 1, Tangential);
              if(panel.HMaxels[i, j].ShapedHMaxel == null)continue;
              else
              {
                blendedRadius += (double) panel.HMaxels[x, y].Attributes["weighted radius"] * (double) panel.HMaxels[i, j].Attributes["RadiusFactor"] * LFactor * RFactor;
                totalWeights += (double) panel.HMaxels[x, y].Attributes["RadiusFactor"] * LFactor * RFactor;

              }



            }
          }


          if(totalWeights == 0) panel.HMaxels[i, j].BlendedRaidus = (double)panel.HMaxels[i, j].Attributes["weighted radius"];
          else panel.HMaxels[i, j].BlendedRaidus = blendedRadius / totalWeights;


        }
      }
      return panel;
    }
    public static double Remap(double val, double from1, double to1, double from2, double to2)
    {
      return (val - from1) / (to1 - from1) * (to2 - from2) + from2;
    }
  }
# ---------- end c_script_17 ----------
data_21 = Data(trim_breps)
rad_blend_2 = RadiusBlending(Panels=data_21, ConvolutionEngine=c_script_17.A)

# ----
dec_pan_4 = DeconstructPanel(Panel=rad_blend_2)  # -> Bilayers, HMaxels, LengthRange, WidthRange
dec_hmaxel_3 = DeconstructHMaxel(HMaxel=dec_pan_4.HMaxels)  # -> PassiveLayers, ActiveBoards, Height, RowRange, ColumnRange, DesiredRadius, BlendedRadius, ShapedHMaxel

num_22 = Number(expr("x/2", num_12))
dedomain_14 = DeconstructDomain(Domain=dec_hmaxel_3.RowRange)  # -> Start, End
bnd_8 = Bounds(Numbers=dedomain_14.Start)
bnd_9 = Bounds(Numbers=dedomain_14.End)
dedomain_15 = DeconstructDomain(Domain=bnd_8)  # -> Start, End
dedomain_16 = DeconstructDomain(Domain=bnd_9)  # -> Start, End
x_minus_one_2 = XMinusOne(NumberX=division_14)
subtraction_13 = Subtraction(A=dedomain_16.End, B=dedomain_15.Start)
division_17 = Division(A=subtraction_13, B=x_minus_one_2)
series_4 = Series(Start=dedomain_15.Start, Step=division_17, Count=division_14)
pt_38 = ConstructPoint(XCoordinate=series_4, YCoordinate=0, ZCoordinate=0)
yz_3 = YZPlane(Origin=pt_38)  # -> simplify(graft(Plane))

partition_2 = PartitionList(List=dec_hmaxel_3.BlendedRadius, Size=num_12)  # -> simplify(Chunks)
flip_3 = FlipMatrix(Data=partition_2)
num_23 = Number(flip_3)
c_script_18 = CSharpScript(x=num_23, y=number_slider_31)  # -> out, A; inputs x: tree, y: Int32; same code as c_script_13
renumber_4 = RenumberPaths(Data=c_script_18.A)

num_24 = Number(num)
pln_3 = Plane(yz_3)
num_25 = Number(renumber_4)
c_script_19 = CSharpScript()  # -> out, A; inputs x: tree; same code as c_script_14
c_script_20 = CSharpScript(iRadii=num_25, iBoardWidth=num_24, iPlanes=pln_3)  # -> out, simplify(A); inputs iRadii: tree of Double, iBoardWidth: Double, iPlanes: tree of Plane; same code as c_script_15

trim_5 = TrimTree(Tree=c_script_20.A, Depth=1)
cullpt_2 = CullDuplicates(Points=trim_5, Tolerance=0.1, CullMode=3)  # -> Points, Indices, Valence
pt_39 = Point(cullpt_2.Points)

# ---- group: animate
pt_40 = Point(simplify(pt_39))
pln_4 = Plane(graft(pln_3))
num_26 = Number(Slider(1, range=0..1))
c_script_21 = CSharpScript(iPoints=simplify(pt_40), iPlanes=pln_4, iShapeFactor=num_26)  # -> out, A; inputs iPoints: tree of Point3d, iPlanes: tree of Plane, iShapeFactor: Double; same code as c_script_16
pt_41 = Point(c_script_21.A)
intcrv_3 = Interpolate(Vertices=pt_41, Degree=3, Periodic=False, KnotStyle=1)  # -> Curve, Length, Domain
crv_8 = Curve(intcrv_3.Curve)

# ----
crv_9 = Curve(crv_8)
pt_42 = Point(simplify(graft(yz_3)))
end_2 = EndPoints(Curve=crv_9)  # -> Start, End
vec2pt_3 = Vector2Pt(PointA=end_2.Start, PointB=end_2.End, Unitize=False)  # -> Vector, Length
yz_4 = YZPlane(Origin=end_2.Start)
Y_6 = UnitY(Factor="-1")
angle_2 = Angle(VectorA=vec2pt_3.Vector, VectorB=Y_6, Plane=yz_4)  # -> Angle, Reflex
rotate_2 = Rotate(Geometry=crv_9, Angle=angle_2.Angle, Plane=yz_4)  # -> Geometry, Transform
curvepoint_2 = PointOnCurve(rotate_2.Geometry, parameter=0.5)
vec2pt_4 = Vector2Pt(PointA=curvepoint_2, PointB=pt_42, Unitize=False)  # -> Vector, Length
move_8 = Move(Geometry=rotate_2.Geometry, Motion=vec2pt_4.Vector)  # -> Geometry, Transform
path_mapper_2 = PathMapper(move_8.Geometry, source=["{A;B}", "{A}"], target=["{A}", "{0}"])
crv_10 = Curve(path_mapper_2)
flip_4 = FlipCurve(Curve=crv_10)  # -> Curve, Flag
loft_2 = Loft(Curves=flip_4.Curve, Options={Adjust=False, Closed=False, LoftEnds=0, LoftSimp=0, LoftType=0, Rebuild=10, Refit=0.01})
srf_5 = Surface(loft_2)

pt_43 = Point(srf_cp.UVPoint)
srf_6 = Surface(srf_5)
evalsrf_2 = EvaluateSurface(Surface=srf_6, Point=pt_43)  # -> Point, Normal, UDirection, VDirection, Frame
intcrv_4 = Interpolate(Vertices=evalsrf_2.Point, Degree=3, Periodic=False, KnotStyle=1)  # -> simplify(Curve), Length, Domain
trim_6 = TrimTree(Tree=intcrv_4.Curve, Depth=1)
join_6 = JoinCurves(Curves=trim_6, Preserve=False)  # -> simplify(Curves)
srfsplit_2 = SurfaceSplit(Surface=srf_6, Curves=join_6)
item_15 = ListItem(List=srfsplit_2, Index=0, Wrap=True)  # -> Item, Item1
srf_7 = Surface(item_15.Item1)
item_16 = ListItem(List=flatten(srf_7), Index=0, Wrap=True)
pan_srf_2 = PanelSurface(Panel=rad_blend, Surface=item_16)
trim_breps_2 = TrimmingBreps(Panel=pan_srf_2, Breps=srf_7)

dec_pan_5 = DeconstructPanel(Panel=trim_breps_2)  # -> Bilayers, HMaxels, LengthRange, WidthRange
dec_bilayer_3 = DeconstructBilayer(Bilayer=dec_pan_5.Bilayers)  # -> ActiveLayer, PassiveLayer
dec_active_layer_3 = DeconstructActiveLayer(ActiveLayer=dec_bilayer_3.ActiveLayer)  # -> simplify(ActiveLayerBoards), Thickness
dec_active_board_3 = DeconstructActiveBoard(ActiveBoard=dec_active_layer_3.ActiveLayerBoards)  # -> HMaxels, StockBoard, Thickness, RowRange, ColumnRange, DesiredRadius, Radius, BlendedRadius, MoistureChange, ShapedBoard

trim_7 = TrimTree(Tree=dec_active_board_3.ShapedBoard, Depth=1)
null = NullItem(Item=trim_7)  # -> NullFlags, InvalidFlags, Description
not_2 = GateNot(A=null.NullFlags)

dec_stock_board = DeconstructStockBoard(StockBoard=dec_active_board_3.StockBoard)  # -> Name, Species, RTAngle, Length, Width, ActiveBoards
dec_secies = DeconstructSpecies(Species=dec_stock_board.Species)
trim_8 = TrimTree(Tree=simplify(dec_secies), Depth=1)

lamination_width = Slider(991, range=0..1500)
domain = Domain(dec_active_board_3.RowRange)
trim_9 = TrimTree(Tree=domain, Depth=1)
num_27 = Number(division)
c_script_22 = CSharpScript(
    boards=dec_active_layer_3.ActiveLayerBoards,
    ranges=trim_9,
    length=lamination_width,
    overlap=num_27,
    Reference="C:\USERS\ALEX REINER\APPDATA\ROAMING\GRASSHOPPER\LIBRARIES\HygroDesign.Core.dll")  # -> out, A; inputs boards: tree, ranges: tree, length: Double, overlap: Double
# ---------- c_script_22: C# ----------
    DataTree<ActiveBoard> laminationGroups = new DataTree<ActiveBoard>();


    for(int i = 0; i < ranges.BranchCount; i++)
    {
      for(int j = 0; j < ranges.Branch(i).Count; j++)
      {
        for(int x = 1; x < 10; x++)
        {
          double test = (x * length) - ((x - 1) * overlap);

          if(Math.Floor(ranges.Branch(i)[j][1]) > test)continue;
          GH_Path path = ranges.Paths[i].AppendElement(x);
          laminationGroups.Add(boards.Branch(i)[j] as ActiveBoard, path);
          break;
        }
      }
    }
    A = laminationGroups;
# ---------- end c_script_22 ----------
dec_active_board_4 = DeconstructActiveBoard(ActiveBoard=c_script_22.A)  # -> HMaxels, StockBoard, Thickness, RowRange, ColumnRange, DesiredRadius, Radius, BlendedRadius, MoistureChange, ShapedBoard
dec_stock_board_2 = DeconstructStockBoard(StockBoard=dec_active_board_4.StockBoard)  # -> Name, Species, RTAngle, Length, Width, ActiveBoards

trim_10 = TrimTree(Tree=dec_active_board_3.BlendedRadius, Depth=1)

cull_7 = CullPattern(List=trim_10, CullPattern=not_2)
num_28 = Number(cull_7)
bnd_10 = Bounds(Numbers=flatten(num_28))
dedomain_17 = DeconstructDomain(Domain=bnd_10)  # -> Start, End
gradient = Gradient(
    LowerLimit=dedomain_17.Start,
    UpperLimit=dedomain_17.End,
    Parameter=num_28,
    stops=[0: RGB(234, 38, 0), 0.25: RGB(234, 126, 0), 0.5: RGB(254, 244, 84), 0.75: RGB(173, 203, 249), 1: RGB(75, 107, 169)])

python_2 = GhPythonScript(x=c_script_22.A)  # -> out, a
# ---------- python_2: Python ----------
a = x.Length
# ---------- end python_2 ----------

cull_8 = CullPattern(List=simplify(trim_8), CullPattern=simplify(not_2))
chars = Characters(Text=cull_8)  # -> Result, Unicode
lng_13 = ListLength(List=chars.Result)
equals = Equality(FirstNumber=lng_13, SecondNumber="5")  # -> Equality, Inequality
cset = CreateSet(List=flatten(lng_13))  # -> Set, Map
cull_9 = CullPattern(List=ColourSwatch(SwatchColor=RGB(250, 116, 82)), CullPattern=equals.Equality)
cull_10 = CullPattern(List=ColourSwatch(SwatchColor=RGB(250, 165, 90)), CullPattern=equals.Inequality)
merge_29 = Merge(Data1=cull_9, Data2=cull_10)  # -> simplify(Result)

panel_18 = Panel(python_2.a)

rectangle_10 = Rectangle(Plane=PlaneXY(0, 0, 0), XSize=dec_active_board_4.RowRange, YSize=dec_active_board_4.ColumnRange, Radius=0)  # -> Rectangle, Length
trim_11 = TrimTree(Tree=rectangle_10.Rectangle, Depth=1)
group_3 = Group(Objects=trim_11)  # -> flatten(Group)
bbox = BoundingBox(Content=trim_11, Plane=PlaneXY(0, 0, 0), UnionBox=True)  # -> flatten(Box), Box_2
debox = DeconstructBox(Box=bbox.Box)  # -> Plane, X, Y, Z
number_slider_32 = Slider(1071, range=0..10000)
dedomain_18 = DeconstructDomain(Domain=debox.X)  # -> Start, End
neg_3 = Negative(Value=dedomain_18.Start)
lng_14 = ListLength(List=group_3)
X_3 = UnitX(Factor=neg_3)
series_5 = Series(Start=number_slider_32, Step=number_slider_32, Count=lng_14)  # -> simplify(Series)
move_9 = Move(Geometry=group_3, Motion=X_3)  # -> Geometry, Transform
X_4 = UnitX(Factor=series_5)
move_10 = Move(Geometry=move_9.Geometry, Motion=X_4)  # -> Geometry, Transform
Y_7 = UnitY(Factor=Slider(1000, range=0..1000))
move_11 = Move(Geometry=move_10.Geometry, Motion=Y_7)  # -> Geometry, Transform
ungroup_3 = Ungroup(Group=move_11.Geometry)
boundary_2 = BoundarySurfaces(Edges=ungroup_3)

round_2 = Round(Number=cull_7)  # -> Nearest, Floor, Ceiling

dec_secies_2 = DeconstructSpecies(Species=dec_stock_board_2.Species)
trim_12 = TrimTree(Tree=simplify(dec_secies_2), Depth=1)
chars_2 = Characters(Text=trim_12)  # -> Result, Unicode
lng_15 = ListLength(List=chars_2.Result)
equals_2 = Equality(FirstNumber=lng_15, SecondNumber="5")  # -> Equality, Inequality
cull_11 = CullPattern(List=ColourSwatch(SwatchColor=RGB(250, 116, 82)), CullPattern=equals_2.Equality)
cull_12 = CullPattern(List=ColourSwatch(SwatchColor=RGB(250, 165, 90)), CullPattern=equals_2.Inequality)
merge_30 = Merge(Data1=cull_11, Data2=cull_12)  # -> simplify(Result)
trim_13 = TrimTree(Tree=merge_30, Depth=1)

# ---- group: COG
python_3 = GhPythonScript(x=trim_breps_2)  # -> out, a
# ---------- python_3: Python ----------
x.CalculateCenterOfGravity()
a = x.Centroid
# ---------- end python_3 ----------

# ----
trim_14 = TrimTree(Tree=simplify(dec_stock_board_2.Name), Depth=1)
area_2 = Area(Geometry=boundary_2)  # -> Area, Centroid
tag = TextTag3D(
    Location=area_2.Centroid,
    Text=trim_14,
    Size=Slider(54, range=0..100),
    Colour=ColourSwatch(SwatchColor=RGB(0, 0, 0)),
    Justification=5)
preview = CustomPreview(Geometry=boundary_2, Material=trim_13)

bang = ExplodeTree(Data=boundary_2)

dec_pan_6 = DeconstructPanel(Panel=trim_breps_2)  # -> Bilayers, HMaxels, LengthRange, WidthRange
dec_pan_7 = DeconstructPanel(Panel=trim_breps_2)  # -> Bilayers, HMaxels, LengthRange, WidthRange
dec_bilayer_4 = DeconstructBilayer(Bilayer=dec_pan_6.Bilayers)  # -> ActiveLayer, PassiveLayer
dec_hmaxel_4 = DeconstructHMaxel(HMaxel=dec_pan_7.HMaxels)  # -> PassiveLayers, simplify(ActiveBoards), Height, RowRange, ColumnRange, DesiredRadius, BlendedRadius, ShapedHMaxel
item_17 = ListItem(List=dec_bilayer_4.ActiveLayer, Index=0, Wrap=True)  # -> Item, Item1
dec_active_layer_4 = DeconstructActiveLayer(ActiveLayer=dec_bilayer_4.ActiveLayer)  # -> simplify(ActiveLayerBoards), Thickness
dec_active_board_5 = DeconstructActiveBoard(ActiveBoard=dec_active_layer_4.ActiveLayerBoards)  # -> HMaxels, StockBoard, Thickness, RowRange, ColumnRange, DesiredRadius, Radius, BlendedRadius, MoistureChange, simplify(ShapedBoard)

move_12 = Move(Geometry=bang, Motion=Y_4)  # -> Geometry, Transform
bbox_2 = BoundingBox(Content=move_12.Geometry, Plane=PlaneXY(0, 0, 0))  # -> Box, Box_2
area_3 = Area(Geometry=move_12.Geometry)  # -> Area, Centroid
debox_2 = DeconstructBox(Box=bbox_2.Box)  # -> Plane, X, Y, Z
dec_active_board_6 = DeconstructActiveBoard(ActiveBoard=dec_hmaxel_4.ActiveBoards)  # -> HMaxels, StockBoard, flatten(Thickness), RowRange, ColumnRange, DesiredRadius, Radius, BlendedRadius, MoistureChange, ShapedBoard
dedomain_19 = DeconstructDomain(Domain=debox_2.X)  # -> Start, End
subtraction_14 = Subtraction(A=dedomain_19.End, B=dedomain_19.Start)
dec_stock_board_3 = DeconstructStockBoard(StockBoard=dec_active_board_6.StockBoard)  # -> Name, Species, RTAngle, Length, Width, ActiveBoards
panel_19 = Panel(subtraction_14)
brep = Brep(simplify(dec_hmaxel_4.ShapedHMaxel))
null_2 = NullItem(Item=brep)  # -> NullFlags, InvalidFlags, Description
dec_secies_3 = DeconstructSpecies(Species=dec_stock_board_3.Species)  # -> simplify(Name)
trim_15 = TrimTree(Tree=dec_secies_3, Depth=1)
chars_3 = Characters(Text=trim_15)  # -> Result, Unicode
not_3 = GateNot(A=null_2.NullFlags)
lng_16 = ListLength(List=chars_3.Result)
trim_16 = TrimTree(Tree=lng_16, Depth=1)
lng_17 = ListLength(List=trim_15)
sort = SortList(Keys=trim_16)  # -> Keys, ValuesA
item_18 = ListItem(List=sort.Keys, Index=0, Wrap=True)  # -> flatten(Item)
cull_13 = CullPattern(List=flatten(lng_17), CullPattern=not_3)
cull_14 = CullPattern(List=item_18, CullPattern=not_3)
cull_15 = CullPattern(List=brep, CullPattern=not_3)
c_script_23 = CSharpScript(layers=cull_13, materials=cull_14)  # -> out, A, B, C; inputs layers: list of Int32, materials: list of Int32
# ---------- c_script_23: C# ----------
    
    List<int> keys = new List<int>();
    List<int> numberize = new List<int>();
    List<double> thickness = new List<double>();

    for(int i = 0; i < layers.Count ;i++)
    {
      int lCount = layers[i];
      int mat = materials[i];

      numberize.Add(i + 1);

      if(lCount == 1 && mat == 5)
      {
        keys.Add(0);
        thickness.Add(2.8);
      }
      if(lCount == 1 && mat == 6)
      {
        keys.Add(3);
        thickness.Add(2.8);
      }
      if(lCount == 2 && mat == 5)
      {
        keys.Add(1);
        thickness.Add(5.2);
      }
      if(lCount == 2 && mat == 6)
      {
        keys.Add(4);
        thickness.Add(5.2);
      }

    }

    A = keys;
    B = numberize;
    C = thickness;
# ---------- end c_script_23 ----------
item_19 = ListItem(List=material_buildups, Index=c_script_23.A, Wrap=True)

# ---- group: material ids
num_29 = Number(item_19)

# ----
mat = RemoteSender(num_29)
num_30 = Number(c_script_23.B)
group_nr = RemoteSender(num_30)
num_31 = Number(c_script_23.C)
thicknesses = RemoteSender(num_31)
thicknesses_2 = RemoteReceiver(thicknesses)
mat_2 = RemoteReceiver(mat)

number_slider_33 = Slider(24, range=0..100)
cull_16 = CullPattern(List=trim_7, CullPattern=not_2)
bang_2 = ExplodeTree(Data=cull_16)  # -> Branch0, Branch1
offsrf = OffsetSurface(Surface=bang_2.Branch1, Distance=expr("-x", number_slider_33), BothSides=0, CreateSolid=True)
offsrf_2 = OffsetSurface(Surface=bang_2.Branch0, Distance=number_slider_33, BothSides=0, CreateSolid=True)

offsrf_3 = OffsetSurface(Surface=bang_2.Branch1, Distance=expr("-x", number_slider_33), BothSides=False, CreateSolid=True)
offsrf_4 = OffsetSurface(Surface=bang_2.Branch0, Distance=number_slider_33, BothSides=False, CreateSolid=True)

entwine_5 = Entwine(Branch00=offsrf_4, Branch01=offsrf_3, FlattenInputs=True)  # -> graft(Result)

area_4 = Area(Geometry=cull_16)  # -> Area, Centroid
move_13 = Move(Geometry=area_4.Centroid, Motion=Z)  # -> Geometry, Transform
tag_2 = TextTag3D(Location=move_13.Geometry, Text=round_2.Nearest, Size=Slider(29, range=0..100), Colour=RGB(0, 0, 0), Justification=5)

# ---- group: PANEL
preview_2 = CustomPreview(Geometry=entwine_5, Material=graft(gradient))
